# Grasshopper definition tool_cluster.gh (Grasshopper 1.0.8)
# plug-ins: Bifocals, Swiftlet

# ----
# Connect MCP Tools to Decall and Update All Clusters
button = Button()
# IF SOMETHING IS NOT
# WORKING PRESS THIS
# BUTTON FIRST
toggle = BooleanToggle(True)
connect_mcp_tools_to_decall = CSharpScript(nickname_From="Central MCP Server", nickname_To="Central DeCall", connect=button)  # -> out; inputs nickname_From: String, nickname_To: String, connect: Boolean
# ---------- connect_mcp_tools_to_decall: C# ----------
using System;
using System.Linq;
using Grasshopper;
using Grasshopper.Kernel;

public class Script_Instance : GH_ScriptInstance
{
    private void RunScript(string nickname_From, string nickname_To, bool connect)
    {
        if (!connect) return;
        Console.Write($"Attempting to connect outputs from '{nickname_From}' to '{nickname_To}'...");

        var ghDoc = Instances.ActiveCanvas?.Document;
        if (ghDoc == null) return;

        var compFrom = ghDoc.Objects
            .OfType<IGH_Component>()
            .FirstOrDefault(o => o.NickName == nickname_From);

        var compTo = ghDoc.Objects
            .OfType<IGH_Param>()
            .FirstOrDefault(o => o.NickName == nickname_To);

        if (compFrom != null && compTo != null)
        {
            ghDoc.ScheduleSolution(5, doc => Connect(doc, compFrom, compTo));
        }
    }

    // <Custom additional code> 
    private void Connect(GH_Document doc, IGH_Component compFrom, IGH_Param compTo)
    {
        if (compFrom == null || compTo == null) return;

        foreach (IGH_Param param in compFrom.Params.Output)
        {
            compTo.AddSource(param);
        }
    }
}
# ---------- end connect_mcp_tools_to_decall ----------
update_all_clusters = CSharpScript(update=button, recursive=toggle)  # -> out, A; inputs update: Boolean, recursive: Boolean, passwords: list of String, localPath: String
# ---------- update_all_clusters: C# ----------
using System;
using System.Collections;
using System.Collections.Generic;

using Rhino;
using Rhino.Geometry;

using Grasshopper;
using Grasshopper.Kernel;
using Grasshopper.Kernel.Data;
using Grasshopper.Kernel.Types;
using System.Windows.Forms;
using System.Linq;
/// <summary>
/// This class will be instantiated on demand by the Script component.
/// </summary>
public class Script_Instance : GH_ScriptInstance
{
  /// <summary>Print a String to the [Out] Parameter of the Script component.</summary>
  /// <param name="text">String to print.</param>
  private void Print(string text) { /* Implementation hidden. */ }
  /// <summary>Print a formatted String to the [Out] Parameter of the Script component.</summary>
  /// <param name="format">String format.</param>
  /// <param name="args">Formatting parameters.</param>
  private void Print(string format, params object[] args) { /* Implementation hidden. */ }
  /// <summary>Print useful information about an object instance to the [Out] Parameter of the Script component. </summary>
  /// <param name="obj">Object instance to parse.</param>
  private void Reflect(object obj) { /* Implementation hidden. */ }
  /// <summary>Print the signatures of all the overloads of a specific method to the [Out] Parameter of the Script component. </summary>
  /// <param name="obj">Object instance to parse.</param>
  private void Reflect(object obj, string method_name) { /* Implementation hidden. */ }

  /// <summary>Gets the current Rhino document.</summary>
  private readonly RhinoDoc RhinoDocument;
  /// <summary>Gets the Grasshopper document that owns this script.</summary>
  private readonly GH_Document GrasshopperDocument;
  /// <summary>Gets the Grasshopper script component that owns this script.</summary>
  private readonly IGH_Component Component;
  /// <summary>
  /// Gets the current iteration count. The first call to RunScript() is associated with Iteration==0.
  /// Any subsequent call within the same solution will increment the Iteration count.
  /// </summary>
  private readonly int Iteration;

  /// <summary>
  /// This procedure contains the user code. Input parameters are provided as regular arguments,
  /// Output parameters as ref arguments. You don't have to assign output parameters,
  /// they will have a default value.
  /// </summary>
  private void RunScript(
		bool update,
		bool recursive,
		List<string> passwords,
		string localPath,
		ref object A)
  {

    A = updateLog;
    if (update)
    {
      updateLog = new List<string>();
      _passwords = passwords;
      UpdateClusters(GrasshopperDocument, recursive, localPath);
    }

  }

  // <Custom additional code> 
  List<string> updateLog;
  List<String> _passwords;

  void UpdateClusters (GH_Document ghDoc, bool recursive, string localPath)
  {
    foreach (var obj in ghDoc.Objects)
    {
      var cluster = obj as Grasshopper.Kernel.Special.GH_Cluster;
      if (cluster != null)
      {
        var clusterPath = cluster.FilePath;
        if (!string.IsNullOrEmpty(clusterPath))
        {
          if (cluster.Synchronisation == Grasshopper.Kernel.Special.GH_Synchronisation.OutOfDate)
          {
            cluster.CreateFromFilePath(clusterPath);
            updateLog.Add("Updated: " + clusterPath);
          }
          else if (cluster.Synchronisation == Grasshopper.Kernel.Special.GH_Synchronisation.MissingReference)
          {
            string newPath = ReplacePath(localPath, clusterPath);
            if (!string.IsNullOrEmpty(newPath))
            {
              cluster.CreateFromFilePath(newPath);
              updateLog.Add("Replaced and updated: " + newPath);
            }
            else
            {
              updateLog.Add("Missing reference: " + clusterPath);
            }

          }
        }

        //Update recursively
        if (recursive)
        {
          GH_Document clusterDoc = GetClusterDoc(cluster);
          if (clusterDoc != null)
            UpdateClusters(clusterDoc, recursive, localPath);
        }
      }
    }
  }

  GH_Document GetClusterDoc(Grasshopper.Kernel.Special.GH_Cluster cluster)
  {
    //no pass needed
    var doc = cluster.Document(string.Empty);
    if (doc != null)
      return doc;

    //try passwords
    if (_passwords != null && _passwords.Any())
    {
      foreach (var pass in _passwords)
      {
        doc = cluster.Document(pass);
        if (doc != null)
          return doc;
      }
    }

    return null;
  }

  string ReplacePath(string localPath, string missingPath)
  {
    if (String.IsNullOrEmpty(missingPath) || string.IsNullOrEmpty(localPath))
      return null;
    else
    {
      string lastLocalPart = localPath.Split('\\').Last();
      string[] parts = missingPath.Split('\\');
      if (parts.Contains(lastLocalPart))
      {
        int i = Array.IndexOf(parts, lastLocalPart);
        string clusterPath = String.Join("\\", parts.Skip(i + 1));
        string result = String.Join("\\", localPath, clusterPath);
        return result;
      }
      else
        return null;
    }
  }
  // </Custom additional code> 
}
# ---------- end update_all_clusters ----------
panel = Panel(connect_mcp_tools_to_decall)

# ----
# Team Definition Clusters,
# Each Team should edit to define tools for their project.
team_01_definition_cluster = Team01DefinitionCluster()
team_02_definition_cluster = Team02DefinitionCluster()
team_03_definition_cluster = Team03DefinitionCluster()
team_04_definition_cluster = Team04DefinitionCluster()
team_05_definition_cluster = Team05DefinitionCluster()
team_06_definition_cluster = Team06DefinitionCluster()

entwine = Entwine(
    Branch00=team_01_definition_cluster,
    Branch01=team_02_definition_cluster,
    Branch02=team_03_definition_cluster,
    Branch03=team_04_definition_cluster,
    Branch04=team_05_definition_cluster,
    Branch05=team_06_definition_cluster,
    FlattenInputs=True)

# ----
# Automatic Network Port Assignment
c_script = CSharpScript()  # -> out, availablePort
# ---------- c_script: C# ----------
// Grasshopper Script Instance
// This script finds an available port on the local machine.
#region Usings
using System;
using System.Linq;
using System.Collections;
using System.Collections.Generic;
using System.Drawing;
using System.Net;
using System.Net.Sockets;

using Rhino;
using Rhino.Geometry;

using Grasshopper;
using Grasshopper.Kernel;
using Grasshopper.Kernel.Data;
using Grasshopper.Kernel.Types;
#endregion

public class Script_Instance : GH_ScriptInstance
{
    #region Notes
    /* 
      Members:
        RhinoDoc RhinoDocument
        GH_Document GrasshopperDocument
        IGH_Component Component
        int Iteration

      Methods (Virtual & overridable):
        Print(string text)
        Print(string format, params object[] args)
        Reflect(object obj)
        Reflect(object obj, string method_name)
    */
    #endregion

    private void RunScript(object start, object end, ref object availablePort)
    {
        // Use default values if parameters are not provided
        int startPort = (start != null && int.TryParse(start.ToString(), out int s)) ? s : 3001;
        int endPort = (end != null && int.TryParse(end.ToString(), out int e)) ? e : 3100;

        // Find an available port in the specified range
        try
        {
            availablePort = FindAvailablePortInRange(startPort, endPort);
            Print($"Available port found: {availablePort}");
        }
        catch (Exception ex)
        {
            Print($"Error: {ex.Message}");
            availablePort = null;
        }
    }

    /// <summary>
    /// Checks if a local TCP port is available for binding (i.e., not in use).
    /// Returns True if available, False otherwise.
    /// </summary>
    private bool IsPortAvailableForBind(int port)
    {
        try
        {
            // Create a new TCP socket
            using (Socket socket = new Socket(AddressFamily.InterNetwork, SocketType.Stream, ProtocolType.Tcp))
            {
                // Try to bind to the port on all interfaces (0.0.0.0)
                socket.Bind(new IPEndPoint(IPAddress.Any, port));
                // If successful, the socket is closed by the using statement and return True
                return true;
            }
        }
        catch (SocketException)
        {
            // If binding fails, it means the port is already in use
            return false;
        }
    }

    /// <summary>
    /// Finds an available port by letting the OS assign one.
    /// </summary>
    private int FindAvailablePort()
    {
        Socket socket = new Socket(AddressFamily.InterNetwork, SocketType.Stream, ProtocolType.Tcp);
        socket.Bind(new IPEndPoint(IPAddress.Any, 0)); // Bind to an available port assigned by the OS
        int availablePort = ((IPEndPoint)socket.LocalEndPoint).Port; // Get the assigned port number
        socket.Close(); // Close the socket
        return availablePort;
    }

    /// <summary>
    /// Finds the first available port in a given range.
    /// </summary>
    private int FindAvailablePortInRange(int start = 3001, int end = 3100)
    {
        for (int port = start; port <= end; port++)
        {
            if (IsPortAvailableForBind(port))
                return port;
        }
        throw new Exception($"No available ports found in the range {start}-{end}.");
    }
}
# ---------- end c_script ----------
assigned_port = Panel(c_script.availablePort)

flatten = FlattenTree(Tree=entwine, Path="{0}")

# ----
# MCP Server Node, Right Click to copy 'mcp.json'
central_mcp_server = MCPServer(Port=c_script.availablePort, Tools=flatten, ServerName="Swiftlet")  # -> Compute_volume_of_sphere, Compute_volume_of_cylinder, Compute_area_of_cylinder, Compute_volume_of_square_pyramid, Compute_area_of_triangular_prism, Compute_volume_of_cone, Compute_area_of_cube, Compute_area_of_sphere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
central_decall = Data([central_mcp_server.Compute_volume_of_sphere, central_mcp_server.Compute_volume_of_cylinder, central_mcp_server.Compute_area_of_cylinder, central_mcp_server.Compute_volume_of_square_pyramid, central_mcp_server.Compute_area_of_triangular_prism, central_mcp_server.Compute_volume_of_cone, central_mcp_server.Compute_area_of_cube, central_mcp_server.Compute_area_of_sphere, central_mcp_server.Compute_volume_of_cube, central_mcp_server.Compute_area_of_cone, central_mcp_server.Compute_volume_of_triangular_prism, central_mcp_server.Compute_area_of_square_pyramid, central_mcp_server.Delete_room_01, central_mcp_server.Add_window_01, central_mcp_server.Delete_room_02, central_mcp_server.Add_window_02, central_mcp_server.Delete_room_03, central_mcp_server.Add_window_03, central_mcp_server.Delete_room_05, central_mcp_server.Add_window_04, central_mcp_server.Add_window_05, central_mcp_server.Delete_room_06, central_mcp_server.Add_window_06, central_mcp_server.Delete_room_04])

# ----
# Routing Logic, Please Do Not Touch
get_tool_names = CSharpScript(x=entwine)  # -> out
# ---------- get_tool_names: C# ----------
// Grasshopper Script Instance
#region Usings
using System;
using System.Linq;
using System.Collections;
using System.Collections.Generic;
using System.Drawing;

using Rhino;
using Rhino.Geometry;

using Grasshopper;
using Grasshopper.Kernel;
using Grasshopper.Kernel.Data;
using Grasshopper.Kernel.Types;
#endregion

public class Script_Instance : GH_ScriptInstance
{
    #region Notes
    /* 
      Members:
        RhinoDoc RhinoDocument
        GH_Document GrasshopperDocument
        IGH_Component Component
        int Iteration

      Methods (Virtual & overridable):
        Print(string text)
        Print(string format, params object[] args)
        Reflect(object obj)
        Reflect(object obj, string method_name)
    */
    #endregion

    private void RunScript(object x)
    {
        dynamic dynamicX = x;
        Console.Write(dynamicX.Name);
    }
}
# ---------- end get_tool_names ----------
trim = TrimTree(Tree=get_tool_names, Depth=1)
decall = DeconstructToolCall(Request=central_decall)  # -> Request, Tool, Arguments
clean = CleanTree(RemoveNulls=True, RemoveInvalid=True, RemoveEmpty=False, Tree=decall.Tool)
toggle_2 = BooleanToggle(True)
mindex = MemberIndex(Set=trim, Member=clean)  # -> Index, Count
clean_2 = CleanTree(RemoveNulls=toggle_2, RemoveInvalid=toggle_2, RemoveEmpty=toggle_2, Tree=mindex.Index)
viewer = ParamViewer(clean_2)
clean_3 = CleanTree(RemoveNulls=True, RemoveInvalid=True, RemoveEmpty=False, Tree=central_decall)
dpath = DeconstructPath(Branch=viewer)
item = ListItem(List=dpath, Index="1", Wrap=True)
sift = SiftPattern(List=clean_3, SiftPattern=item)  # -> Output0, Output1, Output2, Output3, Output4, Output5

# ----
# Team Result Clusters,
# Each Team should edit to create the tool logic for their project.
team_01_results_cluster = Team01ResultsCluster(tool_call_request=sift.Output0)  # -> tool_names_3, tool_call_success
team_02_results_cluster = Team02ResultsCluster(tool_call_request=sift.Output1)  # -> tool_names_3, tool_call_success
team_03_results_cluster = Team03ResultsCluster(tool_call_request=sift.Output2)  # -> tool_names_3, tool_call_success
team_04_results_cluster = Team04ResultsCluster(tool_call_request=sift.Output3)  # -> tool_names_3, tool_call_success
team_05_results_cluster = Team05ResultsCluster(tool_call_request=sift.Output4)  # -> tool_names_3, tool_call_success
team_06_results_cluster = Team06ResultsCluster(tool_call_request=sift.Output5)  # -> tool_names_3, tool_call_success

# ----
# Data Logs
or = GateOr(
    A=team_01_results_cluster.tool_call_success,
    C=team_03_results_cluster.tool_call_success,
    D=team_04_results_cluster.tool_call_success,
    E=team_05_results_cluster.tool_call_success,
    F=team_06_results_cluster.tool_call_success)
rec = DataRecorder(clean, DataLimit=-10, RecordData=True)
rec_2 = DataRecorder(flatten(or), DataLimit=-10, RecordData=True)
rec_3 = DataRecorder(flatten(item), DataLimit=-10, RecordData=True)
result_ok = Panel(rec_2)
called_tool_name = Panel(rec)
team_cluster = Panel(rec_3)

entwine_2 = Entwine(
    Branch00=team_01_results_cluster.tool_names_3,
    Branch01=team_02_results_cluster.tool_names_3,
    Branch02=team_03_results_cluster.tool_names_3,
    Branch03=team_04_results_cluster.tool_names_3,
    Branch04=team_05_results_cluster.tool_names_3,
    Branch05=team_06_results_cluster.tool_names_3,
    FlattenInputs=True)

# ----
# Tool Names from the Results Clusters
# Tool Names from the Definition Clusters
# These Two Clusters should be EXACTLY THE SAME
definition_tool_names = Data(trim)
panel_2 = Panel(definition_tool_names)
panel_3 = Panel(entwine_2)

# ----
# Debug Tool Names
# This Panel should always be TRUE
tool_names_from_the_results_clusters = Data(panel_3)
tool_names_from_the_definition_clusters = Data(panel_2)
join = TextJoin(Text=flatten(tool_names_from_the_definition_clusters))
join_2 = TextJoin(Text=flatten(tool_names_from_the_results_clusters))
tstat = TreeStatistics(Tree=tool_names_from_the_definition_clusters)  # -> Paths, Length, Count
tstat_2 = TreeStatistics(Tree=tool_names_from_the_results_clusters)  # -> Paths, Length, Count
dpath_2 = DeconstructPath(Branch=tstat.Paths)
dpath_3 = DeconstructPath(Branch=tstat_2.Paths)
equals = Equality(FirstNumber=tstat.Length, SecondNumber=tstat_2.Length)  # -> Equality, Inequality
equals_2 = Equality(FirstNumber=tstat.Count, SecondNumber=tstat_2.Count)  # -> Equality, Inequality
ma = MassAddition(Input=flatten(equals.Equality))  # -> Result, PartialResults
equals_3 = Equality(FirstNumber=dpath_2, SecondNumber=dpath_3)  # -> Equality, Inequality
lng = ListLength(List=equals.Equality)
ma_2 = MassAddition(Input=flatten(equals_3.Inequality))  # -> Result, PartialResults
equals_4 = Equality(FirstNumber=ma.Result, SecondNumber=lng)  # -> Equality, Inequality
does_quantity_of_tools_match = Panel(equals_2.Equality)
equals_5 = Equality(FirstNumber=ma_2.Result, SecondNumber="0")  # -> Equality, Inequality
does_quantity_of_tools_match_per_team = Panel(equals_4.Equality)
are_all_teams_included = Panel(equals_5.Equality)

tmatch = MatchText(Text=join, Pattern=join_2, Case=True)

do_all_names_match = Panel(tmatch)
and = GateAnd(A=equals_5.Equality, B=equals_4.Equality, C=equals_2.Equality, D=tmatch)  # -> flatten(Result)
do_trees_match = Panel(and)

# ==== cluster Team01DefinitionCluster
# Team 01 Definition Cluster
# SPHERE TEAM
panel = Panel("This tool computes the volume of a sphere by giving it a radius.  The output unit is the input unit cubed.")
panel_2 = Panel("This tool deletes a room by giving it a room name and the layout json")
panel_3 = Panel("This tool computes the area of a sphere by giving it a radius.  The output unit is the input unit squared.")
panel_4 = Panel("This tool deletes a room by giving it a room name and the layout json")
param = DefineToolParameter(Name="room_name", Type="string", Description="the name of the room", Required=Toggle(True))
param_2 = DefineToolParameter(Name="layout_json", Type="string", Description="the layout data structure", Required=Toggle(True))
param_3 = DefineToolParameter(Name="room_name", Type="string", Description="the name of the room", Required=Toggle(True))
param_4 = DefineToolParameter(Name="layout_json", Type="string", Description="the layout data structure", Required=Toggle(True))
param_5 = DefineToolParameter(Name="radius", Type="number", Description="The Radius of a Sphere", Required=Toggle(True))
param_6 = DefineToolParameter(Name="radius", Type="number", Description="The Radius of a Sphere", Required=Toggle(True))
param_7 = DefineToolParameter(Name="width", Type="number", Description="The width of the window", Required=Toggle(True))
merge = Merge(Data1=param, Data2=param_2)
merge_2 = Merge(Data1=param_3, Data2=param_7, Data3=param_4)
tool = DefineTool(Name="compute_volume_of_sphere", Description=panel, Parameters=param_5)
tool_2 = DefineTool(Name="compute_area_of_sphere", Description=panel_3, Parameters=param_6)
tool_3 = DefineTool(Name="delete_room_01", Description=panel_2, Parameters=merge)
tool_4 = DefineTool(Name="add_window_01", Description=panel_4, Parameters=merge_2)
merge_3 = Merge(Data1=tool, Data2=tool_2, Data3=tool_3, Data4=tool_4)
mcp_tool_list = ClusterOutput(merge_3)

# ==== cluster Team02DefinitionCluster
# Team 02 Definition Cluster
# CONE TEAM
panel = Panel("This tool computes the volume of a cone by giving it a radius and height.  The output unit is the input unit cubed.")
panel_2 = Panel("This tool computes the area of a cone by giving it a radius and height.  The output unit is the input unit squared.")
panel_3 = Panel("This tool deletes a room by giving it a room name and the layout json")
panel_4 = Panel("This tool deletes a room by giving it a room name and the layout json")
param = DefineToolParameter(Name="room_name", Type="string", Description="the name of the room", Required=Toggle(True))
param_2 = DefineToolParameter(Name="height", Type="number", Description="The Height of a Cone", Required=Toggle(True))
param_3 = DefineToolParameter(Name="radius", Type="number", Description="The Radius of a Cone", Required=Toggle(True))
param_4 = DefineToolParameter(Name="layout_json", Type="string", Description="the layout data structure", Required=Toggle(True))
param_5 = DefineToolParameter(Name="room_name", Type="string", Description="the name of the room", Required=Toggle(True))
param_6 = DefineToolParameter(Name="height", Type="number", Description="The Height of a Cone", Required=Toggle(True))
param_7 = DefineToolParameter(Name="radius", Type="number", Description="The Radius of a Cone", Required=Toggle(True))
param_8 = DefineToolParameter(Name="layout_json", Type="string", Description="the layout data structure", Required=Toggle(True))
param_9 = DefineToolParameter(Name="width", Type="number", Description="The width of the window", Required=Toggle(True))
merge = Merge(Data1=param_3, Data2=param_2)
merge_2 = Merge(Data1=param_7, Data2=param_6)
merge_3 = Merge(Data1=param, Data2=param_4)
merge_4 = Merge(Data1=param_5, Data2=param_9, Data3=param_8)
tool = DefineTool(Name="delete_room_02", Description=panel_3, Parameters=merge_3)
tool_2 = DefineTool(Name="add_window_02", Description=panel_4, Parameters=merge_4)
tool_3 = DefineTool(Name="compute_volume_of_cone", Description=panel, Parameters=merge)
tool_4 = DefineTool(Name="compute_area_of_cone", Description=panel_2, Parameters=merge_2)
merge_5 = Merge(Data1=tool_3, Data2=tool_4, Data3=tool, Data4=tool_2)
R = ClusterOutput(merge_5)

# ==== cluster Team02ResultsCluster

# ----
# Team 02 Result Cluster
# CONE TEAM
# Edit Tool Names to
# Match Definition Cluster
tool_names = Panel("""compute_volume_of_cone
compute_area_of_cone
delete_room_02
add_window_02""")

# ----
# Sorting Logic, Please Do Not Edit
tool_call_request = ClusterInput()
tool_names_2 = Text(tool_names)
decall = DeconstructToolCall(Request=tool_call_request)  # -> Request, Tool, Arguments
mindex = MemberIndex(Set=tool_names, Member=decall.Tool)  # -> Index, Count
sift = SiftPattern(List=decall.Request, SiftPattern=mindex.Index)  # -> Output0, Output1, Output2, Output3

# ---- group: Cluster Output
tool_names_3 = ClusterOutput(tool_names_2)

# ---- group: Get the request sent from VSC Agent
decall_2 = DeconstructToolCall(Request=sift.Output3)  # -> Request, Tool, Arguments

# ----
decall_3 = DeconstructToolCall(Request=sift.Output0)  # -> Request, Tool, Arguments
decall_4 = DeconstructToolCall(Request=sift.Output1)  # -> Request, Tool, Arguments
decall_5 = DeconstructToolCall(Request=sift.Output2)  # -> Request, Tool, Arguments
gjok = GetJSONObjectKey(JObject=decall_3.Arguments, Key="height")
gjok_2 = GetJSONObjectKey(JObject=decall_4.Arguments, Key="height")
gjok_3 = GetJSONObjectKey(JObject=decall_3.Arguments, Key="radius")
gjok_4 = GetJSONObjectKey(JObject=decall_4.Arguments, Key="radius")

# ---- group: Extract the tool call parameters
gjok_5 = GetJSONObjectKey(JObject=decall_2.Arguments, Key="layout_json")
gjok_6 = GetJSONObjectKey(JObject=decall_2.Arguments, Key="room_name")
gjok_7 = GetJSONObjectKey(JObject=decall_2.Arguments, Key="width")
rjv = ReadJSONValue(JValue=gjok_5)  # -> AsString, AsNumber, AsBool

# ----
rjv_2 = ReadJSONValue(JValue=gjok)  # -> AsString, AsNumber, AsBool
rjv_3 = ReadJSONValue(JValue=gjok_2)  # -> AsString, AsNumber, AsBool
rjv_4 = ReadJSONValue(JValue=gjok_3)  # -> AsString, AsNumber, AsBool
rjv_5 = ReadJSONValue(JValue=gjok_4)  # -> AsString, AsNumber, AsBool
gjok_8 = GetJSONObjectKey(JObject=decall_5.Arguments, Key="layout_json")
gjok_9 = GetJSONObjectKey(JObject=decall_5.Arguments, Key="room_name")
cone = Cone(Base=PlaneXY(0, 0, 0), Radius=rjv_4.AsNumber, Length=rjv_2.AsNumber)  # -> Cone, Tip
cone_2 = Cone(Base=PlaneXY(0, 0, 0), Radius=rjv_5.AsNumber, Length=rjv_3.AsNumber)  # -> Cone, Tip
rjv_6 = ReadJSONValue(JValue=gjok_8)  # -> AsString, AsNumber, AsBool
rjv_7 = ReadJSONValue(JValue=gjok_7)  # -> AsString, AsNumber, AsBool
cap = CapHoles(Brep=cone.Cone)
cap_2 = CapHoles(Brep=cone_2.Cone)

# ---- group: Delete a Space by name
py3 = Python3Script(json_str=rjv_6.AsString, room_name=gjok_9)  # -> out, a; inputs room_name: String
# ---------- py3: Python ----------
import json
import copy

# Inputs:
# json_str -> JSON as string
# room_name -> e.g. "Kitchen"

def load_json_from_string(json_string):
    try:
        data = json.loads(json_string)
    except Exception as e:
        raise ValueError(f"Invalid JSON string: {e}")
    return data

# Load JSON
data = load_json_from_string(json_str)

# Work on a copy
filtered = copy.deepcopy(data)

# ------------------------
# 1. Find room IDs to remove
# ------------------------
ids_to_remove = set()

for room in filtered.get("rooms", []):
    if room.get("name") == room_name:
        ids_to_remove.add(room.get("id"))

# ------------------------
# 2. Remove from rooms
# ------------------------
filtered["rooms"] = [
    r for r in filtered.get("rooms", [])
    if r.get("id") not in ids_to_remove
]

# ------------------------
# 3. Remove / clean DOORS
# (remove doors that connect to deleted rooms)
# ------------------------
filtered["doors"] = [
    d for d in filtered.get("doors", [])
    if not any(rid in ids_to_remove for rid in d.get("attributes", {}).get("connectsRooms", []))
]

# ------------------------
# 4. Remove WINDOWS linked to deleted rooms
# ------------------------
filtered["windows"] = [
    w for w in filtered.get("windows", [])
    if w.get("attributes", {}).get("roomId") not in ids_to_remove
]

# ------------------------
# 5. Remove FURNITURE linked to deleted rooms
# ------------------------
filtered["furniture"] = [
    f for f in filtered.get("furniture", [])
    if f.get("attributes", {}).get("roomId") not in ids_to_remove
]

# ------------------------
# 6. (Optional) MEP cleanup
# (only if tied to rooms — currently not in your schema)
# ------------------------
# Keeping all MEP elements for now

# ------------------------
# 7. STRUCTURE
# (typically global, so we keep it)
# ------------------------

# ------------------------
# Output ONLY as string
# ------------------------
a = json.dumps(filtered, indent=2)
# ---------- end py3 ----------

# ---- group: Get a Specific Room
py3_2 = Python3Script(json_str=rjv.AsString, room_name=gjok_6)  # -> out, a; inputs room_name: String
# ---------- py3_2: Python ----------
import json
import Rhino.Geometry as rg

# Inputs:
# json_str -> JSON as string
# room_name -> e.g. "Living Room"

def load_json_from_string(json_string):
    try:
        data = json.loads(json_string)
    except Exception as e:
        raise ValueError(f"Invalid JSON string: {e}")
    return data

def create_polyline(points):
    pts = [rg.Point3d(x, y, 0) for x, y in points]

    # Ensure closed
    if pts[0] != pts[-1]:
        pts.append(pts[0])

    return rg.Polyline(pts).ToPolylineCurve()

# Load JSON
data = load_json_from_string(json_str)

# Find the room
room_curve = None

for room in data.get("rooms", []):
    if room.get("name") == room_name:
        geometry = room.get("geometry")
        if geometry:
            room_curve = create_polyline(geometry)
        break

# Output ONLY the polyline
a = room_curve
# ---------- end py3_2 ----------

# ----
volume = Volume(Geometry=cap)  # -> Volume, Centroid
area = Area(Geometry=cap_2)  # -> Area, Centroid
pjs = ParseJSONString(Text=py3.a)
panel = Panel(volume.Volume)
panel_2 = Panel(area.Area)
division = Division(A=rjv_7.AsNumber, B="2")

# ---- group: Design Logic to Add a Window
room_polyline = Data(py3_2.a)
debrep = DeconstructBrep(Brep=room_polyline)  # -> Faces, Edges, Vertices
item = ListItem(List=debrep.Edges, Index=0, Wrap=True)
midpt = CurveMiddle(Curve=item)
X = UnitX(Factor=division)
move = Move(Geometry=midpt, Motion=expr("-x", X))  # -> Geometry, Transform
move_2 = Move(Geometry=midpt, Motion=X)  # -> Geometry, Transform
merge = Merge(Data1=move_2.Geometry, Data2=move.Geometry)

# ----
cjv = CreateJSONValue(Value=panel)
cjv_2 = CreateJSONValue(Value=panel_2)
respond = MCPToolResponse(Request=decall_5.Request, Content=pjs, IsError=False)
cjo = CreateJSONObject(Keys="volume", Values=cjv)
cjo_2 = CreateJSONObject(Keys="area", Values=cjv_2)
respond_2 = MCPToolResponse(Request=decall_3.Request, Content=cjo, IsError=False)
respond_3 = MCPToolResponse(Request=decall_4.Request, Content=cjo_2, IsError=False)

# ---- group: Creates a Window Object
txt = Text(merge)
window_object = Python3Script(element_id="window-2", name="South Window", geometry=txt)  # -> out, window_obj; inputs element_id: String, geometry: list
# ---------- window_object: Python ----------
import json

def parse_point_string(pt_str):
    """
    Converts '{3.5, 0, 0}' -> [3.5, 0.0]
    """
    # Remove braces and spaces
    cleaned = pt_str.strip().replace("{", "").replace("}", "")
    
    # Split into components
    parts = cleaned.split(",")
    
    if len(parts) < 2:
        raise ValueError(f"Invalid point format: {pt_str}")
    
    x = float(parts[0])
    y = float(parts[1])
    
    return [x, y]

def serialize_geometry(geometry_list):
    """
    Converts list of GH strings into [[x,y], [x,y]]
    """
    return [parse_point_string(pt) for pt in geometry_list]

# ------------------------
# Convert geometry
# ------------------------
serialized_geometry = serialize_geometry(geometry)

# Build window object
window_obj = {
    "id": element_id,
    "name": name,
    "geometry": serialized_geometry
}

# Optional attributes
if attributes:
    window_obj["attributes"] = attributes

# Output ONLY as JSON string
window_obj = json.dumps(window_obj, indent=2)
# ---------- end window_object ----------

# ---- group: Merge it to the original layout json
py3_3 = Python3Script(json_str=rjv.AsString, new_object=window_object.window_obj)  # -> out, updated_layout
# ---------- py3_3: Python ----------
import json
import copy

def load_json_from_string(json_string):
    try:
        return json.loads(json_string)
    except Exception as e:
        raise ValueError(f"Invalid JSON string: {e}")

def detect_object_type(obj):
    """
    Infer target list from object id prefix.
    """
    obj_id = obj.get("id", "").lower()

    if obj_id.startswith("window"):
        return "windows"
    elif obj_id.startswith("door"):
        return "doors"
    elif obj_id.startswith("furn") or obj_id.startswith("furniture"):
        return "furniture"
    elif obj_id.startswith("mep"):
        return "mep"
    elif obj_id.startswith("wall") or obj_id.startswith("structure"):
        return "structure"
    else:
        # default fallback (safe choice)
        return "windows"

# ------------------------
# Load inputs
# ------------------------
layout = load_json_from_string(json_str)
new_object = json.loads(new_object)  # assuming object comes as JSON string

# Work on copy
updated = copy.deepcopy(layout)

# ------------------------
# Detect target category
# ------------------------
target_key = detect_object_type(new_object)

# ------------------------
# Ensure list exists
# ------------------------
if target_key not in updated:
    updated[target_key] = []

# ------------------------
# Insert object
# ------------------------
updated[target_key].append(new_object)

# ------------------------
# Output JSON string
# ------------------------
updated_layout = json.dumps(updated, indent=2)
# ---------- end py3_3 ----------

# ----
pjs_2 = ParseJSONString(Text=py3_3.updated_layout)
merge_2 = Merge(Data1=flatten(py3.a), Data2=flatten(py3_3.updated_layout))
respond_4 = MCPToolResponse(Request=decall_2.Request, Content=pjs_2, IsError=False)
or = GateOr(A=respond_2, B=respond_3, C=respond, D=respond_4)
tool_call_success = ClusterOutput(or)

# ---- group: Extractor Tool do map json to grasshopper data
extractor = Python3Script(json_str=merge_2)  # -> out, outline_curve, room_names, room_curves, door_names, door_curves, window_names, window_curves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
# ---------- extractor: Python ----------
import json
import Rhino.Geometry as rg

def load_json_from_string(json_string):
    try:
        data = json.loads(json_string)
    except Exception as e:
        raise ValueError(f"Invalid JSON string: {e}")
    return data

def create_polyline(points, close=True):
    """Create a Rhino PolylineCurve from 2D points"""
    pts = [rg.Point3d(x, y, 0) for x, y in points]

    if close and pts[0] != pts[-1]:
        pts.append(pts[0])

    return rg.Polyline(pts).ToPolylineCurve()

def create_line(points):
    """Create a Rhino LineCurve from 2 points"""
    if len(points) != 2:
        return None
    p1 = rg.Point3d(points[0][0], points[0][1], 0)
    p2 = rg.Point3d(points[1][0], points[1][1], 0)
    return rg.LineCurve(p1, p2)

# Load JSON
layout = load_json_from_string(json_str)

# ------------------------
# ROOMS (polygons)
# ------------------------
room_names = []
room_curves = []

for room in layout.get("rooms", []):
    name = room.get("name")
    geometry = room.get("geometry")

    if name and geometry:
        curve = create_polyline(geometry, close=True)
        room_names.append(name)
        room_curves.append(curve)

# ------------------------
# DOORS (lines)
# ------------------------
door_names = []
door_curves = []

for door in layout.get("doors", []):
    name = door.get("name")
    geometry = door.get("geometry")

    if name and geometry:
        curve = create_line(geometry)
        if curve:
            door_names.append(name)
            door_curves.append(curve)

# ------------------------
# WINDOWS (lines)
# ------------------------
window_names = []
window_curves = []

for window in layout.get("windows", []):
    name = window.get("name")
    geometry = window.get("geometry")

    if name and geometry:
        curve = create_line(geometry)
        if curve:
            window_names.append(name)
            window_curves.append(curve)

# ------------------------
# FURNITURE (polygons)
# ------------------------
furniture_names = []
furniture_curves = []

for furn in layout.get("furniture", []):
    name = furn.get("name")
    geometry = furn.get("geometry")

    if name and geometry:
        curve = create_polyline(geometry, close=True)
        furniture_names.append(name)
        furniture_curves.append(curve)

# ------------------------
# MEP (polygons)
# ------------------------
mep_names = []
mep_curves = []

for m in layout.get("mep", []):
    name = m.get("name")
    geometry = m.get("geometry")

    if name and geometry:
        curve = create_polyline(geometry, close=True)
        mep_names.append(name)
        mep_curves.append(curve)

# ------------------------
# STRUCTURE (lines)
# ------------------------
structure_names = []
structure_curves = []

for s in layout.get("structure", []):
    name = s.get("name")
    geometry = s.get("geometry")

    if name and geometry:
        curve = create_line(geometry)
        if curve:
            structure_names.append(name)
            structure_curves.append(curve)

# ------------------------
# OUTLINE (optional)
# ------------------------
outline_curve = None
if "outline" in layout:
    outline_curve = create_polyline(layout["outline"], close=True)

# ------------------------
# OUTPUTS
# ------------------------
a = room_names
b = room_curves

c = door_names
d = door_curves

e = window_names
f = window_curves

g = furniture_names
h = furniture_curves

i = mep_names
j = mep_curves

k = structure_names
l = structure_curves

m = outline_curve
# ---------- end extractor ----------

# ---- group: Polylines
srf = Surface(extractor.room_curves)
preview = CustomPreview(Geometry=srf, Material=[ColourSwatch(SwatchColor=RGB(167, 219, 44)), ColourSwatch(SwatchColor=RGB(4, 154, 184))])

# ---- group: Windows
data = Data(extractor.window_curves)
previewlw = CustomPreviewLineweights(Geometry=data, Shader=ColourSwatch(SwatchColor=RGB(56, 56, 56)), Thickness=Slider(5.4, range=0..10), Absolute=False)

# ---- group: Labels
area_2 = Area(Geometry=srf)  # -> Area, Centroid
tag = TextTag(Location=area_2.Centroid, Text=extractor.room_names)

# ==== cluster Team03DefinitionCluster
# Team 03 Definition Cluster
# SQUARE PYRAMID TEAM
panel = Panel("The Length of Any Side of the Base of a Square Pyramid")
panel_2 = Panel("This tool computes the area of a square pyramid by giving it the length of any side of the square base and the height of the point.  The output unit is the input unit squared.")
panel_3 = Panel("This tool computes the volume of a square pyramid by giving it the length of any side of the square base and the height of the point.  The output unit is the input unit cubed.")
panel_4 = Panel("This tool deletes a room by giving it a room name and the layout json")
panel_5 = Panel("This tool deletes a room by giving it a room name and the layout json")
param = DefineToolParameter(Name="height", Type="number", Description="The Height of a Square Pyramid", Required=Toggle(True))
param_2 = DefineToolParameter(
    Name="length",
    Type="number",
    Description="The Length of Any Side of the Base of a Square Pyramid",
    Required=Toggle(True))
param_3 = DefineToolParameter(Name="height", Type="number", Description="The Height of a Square Pyramid", Required=Toggle(True))
param_4 = DefineToolParameter(Name="length", Type="number", Description=panel, Required=Toggle(True))
param_5 = DefineToolParameter(Name="room_name", Type="string", Description="the name of the room", Required=Toggle(True))
merge = Merge(Data1=param_2, Data2=param)
merge_2 = Merge(Data1=param_4, Data2=param_3)
param_6 = DefineToolParameter(Name="layout_json", Type="string", Description="the layout data structure", Required=Toggle(True))
param_7 = DefineToolParameter(Name="room_name", Type="string", Description="the name of the room", Required=Toggle(True))
param_8 = DefineToolParameter(Name="layout_json", Type="string", Description="the layout data structure", Required=Toggle(True))
param_9 = DefineToolParameter(Name="width", Type="number", Description="The width of the window", Required=Toggle(True))
merge_3 = Merge(Data1=param_5, Data2=param_6)
merge_4 = Merge(Data1=param_7, Data2=param_9, Data3=param_8)
tool = DefineTool(Name="compute_area_of_square_pyramid", Description=panel_2, Parameters=merge)
tool_2 = DefineTool(Name="compute_volume_of_square_pyramid", Description=panel_3, Parameters=merge_2)
tool_3 = DefineTool(Name="delete_room_03", Description=panel_4, Parameters=merge_3)
tool_4 = DefineTool(Name="add_window_03", Description=panel_5, Parameters=merge_4)
merge_5 = Merge(Data1=tool_2, Data2=tool, Data3=tool_3, Data4=tool_4)
mcp_tool_list = ClusterOutput(merge_5)

# ==== cluster Team03ResultsCluster

# ----
# Team 03 Result Cluster
# SQUARE PYRAMID TEAM
# Edit Tool Names to
# Match Definition Cluster
tool_names = Panel("""compute_volume_of_square_pyramid
compute_area_of_square_pyramid
delete_room_03
add_window_03""")

# ----
# Sorting Logic, Please Do Not Edit
tool_call_request = ClusterInput()
tool_names_2 = Text(tool_names)
decall = DeconstructToolCall(Request=tool_call_request)  # -> Request, Tool, Arguments
mindex = MemberIndex(Set=tool_names, Member=decall.Tool)  # -> Index, Count
sift = SiftPattern(List=decall.Request, SiftPattern=mindex.Index)  # -> Output0, Output1, Output2, Output3

# ---- group: Cluster Output
tool_names_3 = ClusterOutput(tool_names_2)

# ---- group: Get the request sent from VSC Agent
decall_2 = DeconstructToolCall(Request=sift.Output3)  # -> Request, Tool, Arguments

# ----
decall_3 = DeconstructToolCall(Request=sift.Output1)  # -> Request, Tool, Arguments
decall_4 = DeconstructToolCall(Request=sift.Output0)  # -> Request, Tool, Arguments
decall_5 = DeconstructToolCall(Request=sift.Output2)  # -> Request, Tool, Arguments
gjok = GetJSONObjectKey(JObject=decall_3.Arguments, Key="height")
gjok_2 = GetJSONObjectKey(JObject=decall_3.Arguments, Key="length")
gjok_3 = GetJSONObjectKey(JObject=decall_4.Arguments, Key="height")
gjok_4 = GetJSONObjectKey(JObject=decall_4.Arguments, Key="length")

# ---- group: Extract the tool call parameters
gjok_5 = GetJSONObjectKey(JObject=decall_2.Arguments, Key="layout_json")
gjok_6 = GetJSONObjectKey(JObject=decall_2.Arguments, Key="room_name")
gjok_7 = GetJSONObjectKey(JObject=decall_2.Arguments, Key="width")
rjv = ReadJSONValue(JValue=gjok_5)  # -> AsString, AsNumber, AsBool

# ----
rjv_2 = ReadJSONValue(JValue=gjok)  # -> AsString, AsNumber, AsBool
rjv_3 = ReadJSONValue(JValue=gjok_2)  # -> AsString, AsNumber, AsBool
rjv_4 = ReadJSONValue(JValue=gjok_3)  # -> AsString, AsNumber, AsBool
rjv_5 = ReadJSONValue(JValue=gjok_4)  # -> AsString, AsNumber, AsBool
gjok_8 = GetJSONObjectKey(JObject=decall_5.Arguments, Key="layout_json")
gjok_9 = GetJSONObjectKey(JObject=decall_5.Arguments, Key="room_name")
rectangle = Rectangle(Plane=PlaneXY(0, 0, 0), XSize=rjv_3.AsNumber, YSize=rjv_3.AsNumber, Radius=0)  # -> Rectangle, Length
rectangle_2 = Rectangle(Plane=PlaneXY(0, 0, 0), XSize=rjv_5.AsNumber, YSize=rjv_5.AsNumber, Radius=0)  # -> Rectangle, Length
rjv_6 = ReadJSONValue(JValue=gjok_8)  # -> AsString, AsNumber, AsBool
rjv_7 = ReadJSONValue(JValue=gjok_7)  # -> AsString, AsNumber, AsBool
pcen = PolygonCenter(Polyline=rectangle.Rectangle)  # -> CenterV, CenterE, CenterA
pcen_2 = PolygonCenter(Polyline=rectangle_2.Rectangle)  # -> CenterV, CenterE, CenterA

# ---- group: Delete a Space by name
py3 = Python3Script(json_str=rjv_6.AsString, room_name=gjok_9)  # -> out, a; inputs room_name: String; same code as py3

# ---- group: Get a Specific Room
py3_2 = Python3Script(json_str=rjv.AsString, room_name=gjok_6)  # -> out, a; inputs room_name: String; same code as py3_2

# ----
Z = UnitZ(Factor=rjv_2.AsNumber)
Z_2 = UnitZ(Factor=rjv_4.AsNumber)
avr = Average(Input=pcen.CenterV)
avr_2 = Average(Input=pcen_2.CenterV)
pjs = ParseJSONString(Text=py3.a)
move = Move(Geometry=avr, Motion=Z)  # -> Geometry, Transform
move_2 = Move(Geometry=avr_2, Motion=Z_2)  # -> Geometry, Transform
division = Division(A=rjv_7.AsNumber, B="2")

# ---- group: Design Logic to Add a Window
room_polyline = Data(py3_2.a)
debrep = DeconstructBrep(Brep=room_polyline)  # -> Faces, Edges, Vertices
item = ListItem(List=debrep.Edges, Index=0, Wrap=True)
midpt = CurveMiddle(Curve=item)
X = UnitX(Factor=division)
move_3 = Move(Geometry=midpt, Motion=expr("-x", X))  # -> Geometry, Transform
move_4 = Move(Geometry=midpt, Motion=X)  # -> Geometry, Transform
merge = Merge(Data1=move_4.Geometry, Data2=move_3.Geometry)

# ----
extr = ExtrudePoint(Base=rectangle.Rectangle, Point=move.Geometry)
extr_2 = ExtrudePoint(Base=rectangle_2.Rectangle, Point=move_2.Geometry)
respond = MCPToolResponse(Request=decall_5.Request, Content=pjs, IsError=False)
cap = CapHoles(Brep=extr)
cap_2 = CapHoles(Brep=extr_2)
area = Area(Geometry=cap)  # -> Area, Centroid
volume = Volume(Geometry=cap_2)  # -> Volume, Centroid

# ---- group: Creates a Window Object
txt = Text(merge)
window_object = Python3Script(element_id="window-2", name="South Window", geometry=txt)  # -> out, window_obj; inputs element_id: String, geometry: list; same code as window_object

# ----
panel = Panel(area.Area)
panel_2 = Panel(volume.Volume)

# ---- group: Merge it to the original layout json
py3_3 = Python3Script(json_str=rjv.AsString, new_object=window_object.window_obj)  # -> out, updated_layout; same code as py3_3

# ----
cjv = CreateJSONValue(Value=panel)
cjv_2 = CreateJSONValue(Value=panel_2)
pjs_2 = ParseJSONString(Text=py3_3.updated_layout)
respond_2 = MCPToolResponse(Request=decall_2.Request, Content=pjs_2, IsError=False)
cjo = CreateJSONObject(Keys="area", Values=cjv)
cjo_2 = CreateJSONObject(Keys="volume", Values=cjv_2)
merge_2 = Merge(Data1=flatten(py3.a), Data2=flatten(py3_3.updated_layout))
respond_3 = MCPToolResponse(Request=decall_3.Request, Content=cjo, IsError=False)
respond_4 = MCPToolResponse(Request=decall_4.Request, Content=cjo_2, IsError=False)

# ---- group: Extractor Tool do map json to grasshopper data
extractor = Python3Script(json_str=merge_2)  # -> out, outline_curve, room_names, room_curves, door_names, door_curves, window_names, window_curves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; same code as extractor

# ---- group: Polylines
srf = Surface(extractor.room_curves)
preview = CustomPreview(Geometry=srf, Material=[ColourSwatch(SwatchColor=RGB(167, 219, 44)), ColourSwatch(SwatchColor=RGB(4, 154, 184))])

# ---- group: Windows
data = Data(extractor.window_curves)
previewlw = CustomPreviewLineweights(Geometry=data, Shader=ColourSwatch(SwatchColor=RGB(56, 56, 56)), Thickness=Slider(5.4, range=0..10), Absolute=False)

# ---- group: Labels
area_2 = Area(Geometry=srf)  # -> Area, Centroid
tag = TextTag(Location=area_2.Centroid, Text=extractor.room_names)

# ----
or = GateOr(A=respond_4, B=respond_3, C=respond, D=respond_2)
tool_call_success = ClusterOutput(or)

# ==== cluster Team04DefinitionCluster
panel = Panel("This tool deletes a room by giving it a room name and the layout json")
panel_2 = Panel("This tool deletes a room by giving it a room name and the layout json")
# Team 04 Definition Cluster
# CYLINDER TEAM
panel_3 = Panel("This tool computes the volume of a cylinder by giving it a radius and height.  The output unit is the input unit cubed.")
panel_4 = Panel("This tool computes the area of a cylinder by giving it a radius and height.  The output unit is the input unit squared.")
param = DefineToolParameter(Name="room_name", Type="string", Description="the name of the room", Required=Toggle(True))
param_2 = DefineToolParameter(Name="layout_json", Type="string", Description="the layout data structure", Required=Toggle(True))
param_3 = DefineToolParameter(Name="room_name", Type="string", Description="the name of the room", Required=Toggle(True))
param_4 = DefineToolParameter(Name="layout_json", Type="string", Description="the layout data structure", Required=Toggle(True))
param_5 = DefineToolParameter(Name="width", Type="number", Description="The width of the window", Required=Toggle(True))
merge = Merge(Data1=param, Data2=param_2)
merge_2 = Merge(Data1=param_3, Data2=param_5, Data3=param_4)
param_6 = DefineToolParameter(Name="height", Type="number", Description="The Height of a Cylinder", Required=Toggle(True))
param_7 = DefineToolParameter(Name="radius", Type="number", Description="The Radius of a Cylinder", Required=Toggle(True))
param_8 = DefineToolParameter(Name="height", Type="number", Description="The Height of a Cylinder", Required=Toggle(True))
param_9 = DefineToolParameter(Name="radius", Type="number", Description="The Radius of a Cylinder", Required=Toggle(True))
tool = DefineTool(Name="delete_room_04", Description=panel, Parameters=merge)
merge_3 = Merge(Data1=param_7, Data2=param_6)
merge_4 = Merge(Data1=param_9, Data2=param_8)
tool_2 = DefineTool(Name="add_window_04", Description=panel_2, Parameters=merge_2)
tool_3 = DefineTool(Name="compute_volume_of_cylinder", Description=panel_3, Parameters=merge_3)
tool_4 = DefineTool(Name="compute_area_of_cylinder", Description=panel_4, Parameters=merge_4)
merge_5 = Merge(Data1=tool_3, Data2=tool_4, Data3=tool, Data4=tool_2)
R = ClusterOutput(merge_5)

# ==== cluster Team04ResultsCluster

# ----
# Team 04 Result Cluster
# CYLINDER TEAM
# Edit Tool Names to
# Match Definition Cluster
tool_names = Panel("""compute_volume_of_cylinder
compute_area_of_cylinder
delete_room_04
add_window_04""")

# ----
# Sorting Logic, Please Do Not Edit
tool_call_request = ClusterInput()
tool_names_2 = Text(tool_names)
decall = DeconstructToolCall(Request=tool_call_request)  # -> Request, Tool, Arguments
mindex = MemberIndex(Set=tool_names, Member=decall.Tool)  # -> Index, Count
sift = SiftPattern(List=decall.Request, SiftPattern=mindex.Index)  # -> Output0, Output1, Output2, Output3

# ---- group: Cluster Output
tool_names_3 = ClusterOutput(tool_names_2)

# ---- group: Get the request sent from VSC Agent
decall_2 = DeconstructToolCall(Request=sift.Output3)  # -> Request, Tool, Arguments

# ----
decall_3 = DeconstructToolCall(Request=sift.Output1)  # -> Request, Tool, Arguments
decall_4 = DeconstructToolCall(Request=sift.Output0)  # -> Request, Tool, Arguments
decall_5 = DeconstructToolCall(Request=sift.Output2)  # -> Request, Tool, Arguments
gjok = GetJSONObjectKey(JObject=decall_3.Arguments, Key="height")
gjok_2 = GetJSONObjectKey(JObject=decall_4.Arguments, Key="height")
gjok_3 = GetJSONObjectKey(JObject=decall_3.Arguments, Key="radius")
gjok_4 = GetJSONObjectKey(JObject=decall_4.Arguments, Key="radius")

# ---- group: Extract the tool call parameters
gjok_5 = GetJSONObjectKey(JObject=decall_2.Arguments, Key="layout_json")
gjok_6 = GetJSONObjectKey(JObject=decall_2.Arguments, Key="room_name")
gjok_7 = GetJSONObjectKey(JObject=decall_2.Arguments, Key="width")
rjv = ReadJSONValue(JValue=gjok_5)  # -> AsString, AsNumber, AsBool

# ----
rjv_2 = ReadJSONValue(JValue=gjok)  # -> AsString, AsNumber, AsBool
rjv_3 = ReadJSONValue(JValue=gjok_2)  # -> AsString, AsNumber, AsBool
rjv_4 = ReadJSONValue(JValue=gjok_3)  # -> AsString, AsNumber, AsBool
rjv_5 = ReadJSONValue(JValue=gjok_4)  # -> AsString, AsNumber, AsBool
gjok_8 = GetJSONObjectKey(JObject=decall_5.Arguments, Key="layout_json")
gjok_9 = GetJSONObjectKey(JObject=decall_5.Arguments, Key="room_name")
cyl = Cylinder(Base=PlaneXY(0, 0, 0), Radius=rjv_4.AsNumber, Length=rjv_2.AsNumber)
cyl_2 = Cylinder(Base=PlaneXY(0, 0, 0), Radius=rjv_5.AsNumber, Length=rjv_3.AsNumber)
rjv_6 = ReadJSONValue(JValue=gjok_8)  # -> AsString, AsNumber, AsBool
rjv_7 = ReadJSONValue(JValue=gjok_7)  # -> AsString, AsNumber, AsBool
cap = CapHoles(Brep=cyl)
cap_2 = CapHoles(Brep=cyl_2)

# ---- group: Delete a Space by name
py3 = Python3Script(json_str=rjv_6.AsString, room_name=gjok_9)  # -> out, a; inputs room_name: String; same code as py3

# ---- group: Get a Specific Room
py3_2 = Python3Script(json_str=rjv.AsString, room_name=gjok_6)  # -> out, a; inputs room_name: String; same code as py3_2

# ----
volume = Volume(Geometry=cap_2)  # -> Volume, Centroid
area = Area(Geometry=cap)  # -> Area, Centroid
pjs = ParseJSONString(Text=py3.a)
panel = Panel(area.Area)
panel_2 = Panel(volume.Volume)
division = Division(A=rjv_7.AsNumber, B="2")

# ---- group: Design Logic to Add a Window
room_polyline = Data(py3_2.a)
debrep = DeconstructBrep(Brep=room_polyline)  # -> Faces, Edges, Vertices
item = ListItem(List=debrep.Edges, Index=0, Wrap=True)
midpt = CurveMiddle(Curve=item)
X = UnitX(Factor=division)
move = Move(Geometry=midpt, Motion=expr("-x", X))  # -> Geometry, Transform
move_2 = Move(Geometry=midpt, Motion=X)  # -> Geometry, Transform
merge = Merge(Data1=move_2.Geometry, Data2=move.Geometry)

# ----
cjv = CreateJSONValue(Value=panel)
cjv_2 = CreateJSONValue(Value=panel_2)
respond = MCPToolResponse(Request=decall_5.Request, Content=pjs, IsError=False)
cjo = CreateJSONObject(Keys="area", Values=cjv)
cjo_2 = CreateJSONObject(Keys="volume", Values=cjv_2)
respond_2 = MCPToolResponse(Request=decall_3.Request, Content=cjo, IsError=False)
respond_3 = MCPToolResponse(Request=decall_4.Request, Content=cjo_2, IsError=False)

# ---- group: Creates a Window Object
txt = Text(merge)
window_object = Python3Script(element_id="window-2", name="South Window", geometry=txt)  # -> out, window_obj; inputs element_id: String, geometry: list; same code as window_object

# ---- group: Merge it to the original layout json
py3_3 = Python3Script(json_str=rjv.AsString, new_object=window_object.window_obj)  # -> out, updated_layout; same code as py3_3

# ----
merge_2 = Merge(Data1=flatten(py3.a), Data2=flatten(py3_3.updated_layout))
pjs_2 = ParseJSONString(Text=py3_3.updated_layout)

# ---- group: Extractor Tool do map json to grasshopper data
extractor = Python3Script(json_str=merge_2)  # -> out, outline_curve, room_names, room_curves, door_names, door_curves, window_names, window_curves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; same code as extractor

# ----
respond_4 = MCPToolResponse(Request=decall_2.Request, Content=pjs_2, IsError=False)

# ---- group: Polylines
srf = Surface(extractor.room_curves)
preview = CustomPreview(Geometry=srf, Material=[ColourSwatch(SwatchColor=RGB(167, 219, 44)), ColourSwatch(SwatchColor=RGB(4, 154, 184))])

# ---- group: Windows
data = Data(extractor.window_curves)
previewlw = CustomPreviewLineweights(Geometry=data, Shader=ColourSwatch(SwatchColor=RGB(56, 56, 56)), Thickness=Slider(5.4, range=0..10), Absolute=False)

# ----
or = GateOr(A=respond_3, B=respond_2, C=respond, D=respond_4)

# ---- group: Labels
area_2 = Area(Geometry=srf)  # -> Area, Centroid
tag = TextTag(Location=area_2.Centroid, Text=extractor.room_names)

# ----
tool_call_success = ClusterOutput(or)

# ==== cluster Team05DefinitionCluster
panel = Panel("This tool deletes a room by giving it a room name and the layout json")
panel_2 = Panel("This tool deletes a room by giving it a room name and the layout json")
panel_3 = Panel("This tool computes the area of a curbe by giving it a length of a side.  The output unit is the input unit squared.")
# Team 05 Definition Cluster
# CUBE TEAM
panel_4 = Panel("This tool computes the volume of a cube by giving it a length of a side.  The output unit is the input unit cubed.")
param = DefineToolParameter(Name="room_name", Type="string", Description="the name of the room", Required=Toggle(True))
param_2 = DefineToolParameter(Name="layout_json", Type="string", Description="the layout data structure", Required=Toggle(True))
param_3 = DefineToolParameter(Name="room_name", Type="string", Description="the name of the room", Required=Toggle(True))
param_4 = DefineToolParameter(Name="layout_json", Type="string", Description="the layout data structure", Required=Toggle(True))
param_5 = DefineToolParameter(Name="width", Type="number", Description="The width of the window", Required=Toggle(True))
merge = Merge(Data1=param, Data2=param_2)
merge_2 = Merge(Data1=param_3, Data2=param_5, Data3=param_4)
param_6 = DefineToolParameter(Name="length", Type="number", Description="The Radius of a Cube", Required=Toggle(True))
param_7 = DefineToolParameter(Name="length", Type="number", Description="The Radius of a Cube", Required=Toggle(True))
tool = DefineTool(Name="delete_room_05", Description=panel, Parameters=merge)
merge_3 = Merge(Data1=param_6)
merge_4 = Merge(Data1=param_7)
tool_2 = DefineTool(Name="add_window_05", Description=panel_2, Parameters=merge_2)
tool_3 = DefineTool(Name="compute_area_of_cube", Description=panel_3, Parameters=merge_3)
tool_4 = DefineTool(Name="compute_volume_of_cube", Description=panel_4, Parameters=merge_4)
merge_5 = Merge(Data1=tool_4, Data2=tool_3, Data3=tool, Data4=tool_2)
R = ClusterOutput(merge_5)

# ==== cluster Team05ResultsCluster

# ----
# Team 05 Result Cluster
# CUBE TEAM
# Edit Tool Names to
# Match Definition Cluster
tool_names = Panel("""compute_volume_of_cube
compute_area_of_cube
delete_room_05
add_window_05""")

# ----
# Sorting Logic, Please Do Not Edit
tool_call_request = ClusterInput()
tool_names_2 = Text(tool_names)
decall = DeconstructToolCall(Request=tool_call_request)  # -> Request, Tool, Arguments
mindex = MemberIndex(Set=tool_names, Member=decall.Tool)  # -> Index, Count
sift = SiftPattern(List=decall.Request, SiftPattern=mindex.Index)  # -> Output0, Output1, Output2, Output3

# ---- group: Cluster Output
tool_names_3 = ClusterOutput(tool_names_2)

# ---- group: Get the request sent from VSC Agent
decall_2 = DeconstructToolCall(Request=sift.Output3)  # -> Request, Tool, Arguments

# ----
decall_3 = DeconstructToolCall(Request=sift.Output1)  # -> Request, Tool, Arguments
decall_4 = DeconstructToolCall(Request=sift.Output0)  # -> Request, Tool, Arguments
decall_5 = DeconstructToolCall(Request=sift.Output2)  # -> Request, Tool, Arguments
gjok = GetJSONObjectKey(JObject=decall_3.Arguments, Key="length")
gjok_2 = GetJSONObjectKey(JObject=decall_4.Arguments, Key="length")

# ---- group: Extract the tool call parameters
gjok_3 = GetJSONObjectKey(JObject=decall_2.Arguments, Key="layout_json")
gjok_4 = GetJSONObjectKey(JObject=decall_2.Arguments, Key="room_name")
gjok_5 = GetJSONObjectKey(JObject=decall_2.Arguments, Key="width")
rjv = ReadJSONValue(JValue=gjok_3)  # -> AsString, AsNumber, AsBool

# ----
rjv_2 = ReadJSONValue(JValue=gjok)  # -> AsString, AsNumber, AsBool
rjv_3 = ReadJSONValue(JValue=gjok_2)  # -> AsString, AsNumber, AsBool
gjok_6 = GetJSONObjectKey(JObject=decall_5.Arguments, Key="layout_json")
gjok_7 = GetJSONObjectKey(JObject=decall_5.Arguments, Key="room_name")
rectangle = Rectangle(Plane=PlaneXY(0, 0, 0), XSize=rjv_2.AsNumber, YSize=rjv_2.AsNumber, Radius=0)  # -> Rectangle, Length
rectangle_2 = Rectangle(Plane=PlaneXY(0, 0, 0), XSize=rjv_3.AsNumber, YSize=rjv_3.AsNumber, Radius=0)  # -> Rectangle, Length
rjv_4 = ReadJSONValue(JValue=gjok_6)  # -> AsString, AsNumber, AsBool
rjv_5 = ReadJSONValue(JValue=gjok_5)  # -> AsString, AsNumber, AsBool
boxrec = BoxRectangle(Rectangle=rectangle.Rectangle, Height=rjv_2.AsNumber)
boxrec_2 = BoxRectangle(Rectangle=rectangle_2.Rectangle, Height=rjv_3.AsNumber)

# ---- group: Delete a Space by name
py3 = Python3Script(json_str=rjv_4.AsString, room_name=gjok_7)  # -> out, a; inputs room_name: String; same code as py3

# ---- group: Get a Specific Room
py3_2 = Python3Script(json_str=rjv.AsString, room_name=gjok_4)  # -> out, a; inputs room_name: String; same code as py3_2

# ----
area = Area(Geometry=boxrec)  # -> Area, Centroid
volume = Volume(Geometry=boxrec_2)  # -> Volume, Centroid
pjs = ParseJSONString(Text=py3.a)
panel = Panel(area.Area)
panel_2 = Panel(volume.Volume)
division = Division(A=rjv_5.AsNumber, B="2")

# ---- group: Design Logic to Add a Window
room_polyline = Data(py3_2.a)
debrep = DeconstructBrep(Brep=room_polyline)  # -> Faces, Edges, Vertices
item = ListItem(List=debrep.Edges, Index=0, Wrap=True)
midpt = CurveMiddle(Curve=item)
X = UnitX(Factor=division)
move = Move(Geometry=midpt, Motion=expr("-x", X))  # -> Geometry, Transform
move_2 = Move(Geometry=midpt, Motion=X)  # -> Geometry, Transform
merge = Merge(Data1=move_2.Geometry, Data2=move.Geometry)

# ----
cjv = CreateJSONValue(Value=panel)
cjv_2 = CreateJSONValue(Value=panel_2)
respond = MCPToolResponse(Request=decall_5.Request, Content=pjs, IsError=False)
cjo = CreateJSONObject(Keys="area", Values=cjv)
cjo_2 = CreateJSONObject(Keys="volume", Values=cjv_2)
respond_2 = MCPToolResponse(Request=decall_3.Request, Content=cjo, IsError=False)
respond_3 = MCPToolResponse(Request=decall_4.Request, Content=cjo_2, IsError=False)

# ---- group: Creates a Window Object
txt = Text(merge)
window_object = Python3Script(element_id="window-2", name="South Window", geometry=txt)  # -> out, window_obj; inputs element_id: String, geometry: list; same code as window_object

# ---- group: Merge it to the original layout json
py3_3 = Python3Script(json_str=rjv.AsString, new_object=window_object.window_obj)  # -> out, updated_layout; same code as py3_3

# ----
merge_2 = Merge(Data1=flatten(py3.a), Data2=flatten(py3_3.updated_layout))
pjs_2 = ParseJSONString(Text=py3_3.updated_layout)
respond_4 = MCPToolResponse(Request=decall_2.Request, Content=pjs_2, IsError=False)

# ---- group: Extractor Tool do map json to grasshopper data
extractor = Python3Script(json_str=merge_2)  # -> out, outline_curve, room_names, room_curves, door_names, door_curves, window_names, window_curves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; same code as extractor

# ----
or = GateOr(A=respond_3, B=respond_2, C=respond, D=respond_4)
tool_call_success = ClusterOutput(or)

# ---- group: Polylines
srf = Surface(extractor.room_curves)
preview = CustomPreview(Geometry=srf, Material=[ColourSwatch(SwatchColor=RGB(167, 219, 44)), ColourSwatch(SwatchColor=RGB(4, 154, 184))])

# ---- group: Windows
data = Data(extractor.window_curves)
previewlw = CustomPreviewLineweights(Geometry=data, Shader=ColourSwatch(SwatchColor=RGB(56, 56, 56)), Thickness=Slider(5.4, range=0..10), Absolute=False)

# ---- group: Labels
area_2 = Area(Geometry=srf)  # -> Area, Centroid
tag = TextTag(Location=area_2.Centroid, Text=extractor.room_names)

# ==== cluster Team06DefinitionCluster
# Team 06 Definition Cluster
# TRIANGULAR PYRAMID TEAM
panel = Panel("This tool computes the volume of an equilateral triangular prism by giving it the length of any side.  The output unit is the input unit cubed.")
panel_2 = Panel("This tool computes the area of an equilateral triangular prism by giving it the length of any side.  The output unit is the input unit squared.")
panel_3 = Panel("This tool deletes a room by giving it a room name and the layout json")
panel_4 = Panel("This tool deletes a room by giving it a room name and the layout json")
param = DefineToolParameter(Name="length", Type="number", Description="The Length of Any Side of Triangular Prism", Required=Toggle(True))
param_2 = DefineToolParameter(Name="length", Type="number", Description="The Length of Any Side of Triangular Prism", Required=Toggle(True))
param_3 = DefineToolParameter(Name="room_name", Type="string", Description="the name of the room", Required=Toggle(True))
param_4 = DefineToolParameter(Name="layout_json", Type="string", Description="the layout data structure", Required=Toggle(True))
param_5 = DefineToolParameter(Name="room_name", Type="string", Description="the name of the room", Required=Toggle(True))
param_6 = DefineToolParameter(Name="layout_json", Type="string", Description="the layout data structure", Required=Toggle(True))
param_7 = DefineToolParameter(Name="width", Type="number", Description="The width of the window", Required=Toggle(True))
merge = Merge(Data1=param_3, Data2=param_4)
merge_2 = Merge(Data1=param_5, Data2=param_7, Data3=param_6)
tool = DefineTool(Name="compute_area_of_triangular_prism", Description=panel_2, Parameters=param)
tool_2 = DefineTool(Name="compute_volume_of_triangular_prism", Description=panel, Parameters=param_2)
tool_3 = DefineTool(Name="delete_room_06", Description=panel_3, Parameters=merge)
tool_4 = DefineTool(Name="add_window_06", Description=panel_4, Parameters=merge_2)
merge_3 = Merge(Data1=tool_2, Data2=tool, Data3=tool_3, Data4=tool_4)
mcp_tool_list = ClusterOutput(merge_3)

# ==== cluster Team06ResultsCluster

# ----
# Team 06 Result Cluster
# TRIANGULAR PYRAMID TEAM
# Edit Tool Names to
# Match Definition Cluster
tool_names = Panel("""compute_volume_of_triangular_prism
compute_area_of_triangular_prism
delete_room_06
add_window_06""")

# ----
# Sorting Logic, Please Do Not Edit
tool_call_request = ClusterInput()
tool_names_2 = Text(tool_names)
decall = DeconstructToolCall(Request=tool_call_request)  # -> Request, Tool, Arguments
mindex = MemberIndex(Set=tool_names, Member=decall.Tool)  # -> Index, Count
sift = SiftPattern(List=decall.Request, SiftPattern=mindex.Index)  # -> Output0, Output1, Output2, Output3

# ---- group: Cluster Output
tool_names_3 = ClusterOutput(tool_names_2)

# ---- group: Get the request sent from VSC Agent
decall_2 = DeconstructToolCall(Request=sift.Output3)  # -> Request, Tool, Arguments

# ----
decall_3 = DeconstructToolCall(Request=sift.Output0)  # -> Request, Tool, Arguments
decall_4 = DeconstructToolCall(Request=sift.Output1)  # -> Request, Tool, Arguments
decall_5 = DeconstructToolCall(Request=sift.Output2)  # -> Request, Tool, Arguments
gjok = GetJSONObjectKey(JObject=decall_3.Arguments, Key="length")
gjok_2 = GetJSONObjectKey(JObject=decall_4.Arguments, Key="length")
rjv = ReadJSONValue(JValue=gjok)  # -> AsString, AsNumber, AsBool
rjv_2 = ReadJSONValue(JValue=gjok_2)  # -> AsString, AsNumber, AsBool

# ---- group: Extract the tool call parameters
gjok_3 = GetJSONObjectKey(JObject=decall_2.Arguments, Key="layout_json")
gjok_4 = GetJSONObjectKey(JObject=decall_2.Arguments, Key="room_name")
gjok_5 = GetJSONObjectKey(JObject=decall_2.Arguments, Key="width")
rjv_3 = ReadJSONValue(JValue=gjok_3)  # -> AsString, AsNumber, AsBool

# ----
gjok_6 = GetJSONObjectKey(JObject=decall_5.Arguments, Key="layout_json")
division = Division(A=rjv.AsNumber, B="2")
division_2 = Division(A=rjv_2.AsNumber, B="2")
gjok_7 = GetJSONObjectKey(JObject=decall_5.Arguments, Key="room_name")
sqrt = SquareRoot(Value="3")
sqrt_2 = SquareRoot(Value="3")
rjv_4 = ReadJSONValue(JValue=gjok_6)  # -> AsString, AsNumber, AsBool
rjv_5 = ReadJSONValue(JValue=gjok_5)  # -> AsString, AsNumber, AsBool
multiplication = Multiplication(A=division, B=sqrt)
multiplication_2 = Multiplication(A=division_2, B=sqrt_2)
Y = UnitY(Factor=division)
Y_2 = UnitY(Factor=division_2)

# ---- group: Delete a Space by name
py3 = Python3Script(json_str=rjv_4.AsString, room_name=gjok_7)  # -> out, a; inputs room_name: String; same code as py3

# ---- group: Get a Specific Room
py3_2 = Python3Script(json_str=rjv_3.AsString, room_name=gjok_4)  # -> out, a; inputs room_name: String; same code as py3_2

# ----
X = UnitX(Factor=multiplication)
X_2 = UnitX(Factor=multiplication_2)
rev = Reverse(Vector=Y)
rev_2 = Reverse(Vector=Y_2)
pjs = ParseJSONString(Text=py3.a)
pt = ConstructPoint(XCoordinate=0, YCoordinate=0, ZCoordinate=0)
pt_2 = ConstructPoint(XCoordinate=0, YCoordinate=0, ZCoordinate=0)
merge = Merge(Data1=Y, Data2=rev, Data3=X)
merge_2 = Merge(Data1=Y_2, Data2=rev_2, Data3=X_2)
move = Move(Geometry=pt, Motion=merge)  # -> Geometry, Transform
move_2 = Move(Geometry=pt_2, Motion=merge_2)  # -> Geometry, Transform
division_3 = Division(A=rjv_5.AsNumber, B="2")

# ---- group: Design Logic to Add a Window
room_polyline = Data(py3_2.a)
debrep = DeconstructBrep(Brep=room_polyline)  # -> Faces, Edges, Vertices
item = ListItem(List=debrep.Edges, Index=0, Wrap=True)
midpt = CurveMiddle(Curve=item)
X_3 = UnitX(Factor=division_3)
move_3 = Move(Geometry=midpt, Motion=expr("-x", X_3))  # -> Geometry, Transform
move_4 = Move(Geometry=midpt, Motion=X_3)  # -> Geometry, Transform
merge_3 = Merge(Data1=move_4.Geometry, Data2=move_3.Geometry)

# ----
respond = MCPToolResponse(Request=decall_5.Request, Content=pjs, IsError=False)
item_2 = ListItem(List=move.Geometry, Index="0", Wrap=True)
item_3 = ListItem(List=move.Geometry, Index="1", Wrap=True)
item_4 = ListItem(List=move.Geometry, Index="2", Wrap=True)
item_5 = ListItem(List=move_2.Geometry, Index="0", Wrap=True)
item_6 = ListItem(List=move_2.Geometry, Index="1", Wrap=True)
item_7 = ListItem(List=move_2.Geometry, Index="2", Wrap=True)
srf4pt = _4PointSurface(CornerA=item_2, CornerB=item_3, CornerC=item_4)
srf4pt_2 = _4PointSurface(CornerA=item_5, CornerB=item_6, CornerC=item_7)

# ---- group: Creates a Window Object
txt = Text(merge_3)
window_object = Python3Script(element_id="window-2", name="South Window", geometry=txt)  # -> out, window_obj; inputs element_id: String, geometry: list; same code as window_object

# ----
pcen = PolygonCenter(Polyline=srf4pt)  # -> CenterV, CenterE, CenterA
pcen_2 = PolygonCenter(Polyline=srf4pt_2)  # -> CenterV, CenterE, CenterA

# ---- group: Merge it to the original layout json
py3_3 = Python3Script(json_str=rjv_3.AsString, new_object=window_object.window_obj)  # -> out, updated_layout; same code as py3_3

# ----
avr = Average(Input=pcen.CenterV)
avr_2 = Average(Input=pcen_2.CenterV)
Z = UnitZ(Factor=multiplication)
Z_2 = UnitZ(Factor=multiplication_2)
merge_4 = Merge(Data1=flatten(py3.a), Data2=flatten(py3_3.updated_layout))
pjs_2 = ParseJSONString(Text=py3_3.updated_layout)
move_5 = Move(Geometry=avr, Motion=Z)  # -> Geometry, Transform
move_6 = Move(Geometry=avr_2, Motion=Z_2)  # -> Geometry, Transform
respond_2 = MCPToolResponse(Request=decall_2.Request, Content=pjs_2, IsError=False)
extr = ExtrudePoint(Base=srf4pt, Point=move_5.Geometry)
extr_2 = ExtrudePoint(Base=srf4pt_2, Point=move_6.Geometry)

# ---- group: Extractor Tool do map json to grasshopper data
extractor = Python3Script(json_str=merge_4)  # -> out, outline_curve, room_names, room_curves, door_names, door_curves, window_names, window_curves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; same code as extractor

# ----
cap = CapHoles(Brep=extr)
cap_2 = CapHoles(Brep=extr_2)
area = Area(Geometry=cap_2)  # -> Area, Centroid
volume = Volume(Geometry=cap)  # -> Volume, Centroid
panel = Panel(area.Area)
panel_2 = Panel(volume.Volume)

# ---- group: Polylines
srf = Surface(extractor.room_curves)
preview = CustomPreview(Geometry=srf, Material=[ColourSwatch(SwatchColor=RGB(167, 219, 44)), ColourSwatch(SwatchColor=RGB(4, 154, 184))])

# ---- group: Windows
data = Data(extractor.window_curves)
previewlw = CustomPreviewLineweights(Geometry=data, Shader=ColourSwatch(SwatchColor=RGB(56, 56, 56)), Thickness=Slider(5.4, range=0..10), Absolute=False)

# ----
cjv = CreateJSONValue(Value=panel_2)
cjv_2 = CreateJSONValue(Value=panel)

# ---- group: Labels
area_2 = Area(Geometry=srf)  # -> Area, Centroid
tag = TextTag(Location=area_2.Centroid, Text=extractor.room_names)

# ----
cjo = CreateJSONObject(Keys="volume", Values=cjv)
cjo_2 = CreateJSONObject(Keys="area", Values=cjv_2)
respond_3 = MCPToolResponse(Request=decall_3.Request, Content=cjo, IsError=False)
respond_4 = MCPToolResponse(Request=decall_4.Request, Content=cjo_2, IsError=False)
or = GateOr(A=respond_3, B=respond_4, C=respond, D=respond_2)
tool_call_success = ClusterOutput(or)

# ==== cluster Team01ResultsCluster

# ----
# Team 01 Result Cluster
# SPHERE TEAM
# Edit Tool Names to
# Match Definition Cluster
tool_names = Panel("""compute_volume_of_sphere
compute_area_of_sphere
delete_room_01
add_window_01""")

# ----
# Sorting Logic, Please Do Not Edit
tool_call_request = ClusterInput()
tool_names_2 = Text(tool_names)
decall = DeconstructToolCall(Request=tool_call_request)  # -> Request, Tool, Arguments
mindex = MemberIndex(Set=tool_names, Member=decall.Tool)  # -> Index, Count
sift = SiftPattern(List=decall.Request, SiftPattern=mindex.Index)  # -> Output0, Output1, Output2, Output3

# ---- group: Cluster Output
tool_names_3 = ClusterOutput(tool_names_2)

# ----
panel = Panel(tool_call_request)

# ---- group: Get the request sent from VSC Agent
decall_2 = DeconstructToolCall(Request=sift.Output3)  # -> Request, Tool, Arguments

# ----
decall_3 = DeconstructToolCall(Request=sift.Output2)  # -> Request, Tool, Arguments
decall_4 = DeconstructToolCall(Request=sift.Output1)  # -> Request, Tool, Arguments
decall_5 = DeconstructToolCall(Request=sift.Output0)  # -> Request, Tool, Arguments
gjok = GetJSONObjectKey(JObject=decall_4.Arguments, Key="radius")
gjok_2 = GetJSONObjectKey(JObject=decall_5.Arguments, Key="radius")
rjv = ReadJSONValue(JValue=gjok)  # -> AsString, AsNumber, AsBool
rjv_2 = ReadJSONValue(JValue=gjok_2)  # -> AsString, AsNumber, AsBool

# ---- group: Extract the tool call parameters
gjok_3 = GetJSONObjectKey(JObject=decall_2.Arguments, Key="layout_json")
gjok_4 = GetJSONObjectKey(JObject=decall_2.Arguments, Key="room_name")
gjok_5 = GetJSONObjectKey(JObject=decall_2.Arguments, Key="width")
rjv_3 = ReadJSONValue(JValue=gjok_3)  # -> AsString, AsNumber, AsBool
rjv_4 = ReadJSONValue(JValue=gjok_5)  # -> AsString, AsNumber, AsBool

# ----
sph = Sphere(Base=PlaneXY(0, 0, 0), Radius=rjv.AsNumber)
sph_2 = Sphere(Base=PlaneXY(0, 0, 0), Radius=rjv_2.AsNumber)
gjok_6 = GetJSONObjectKey(JObject=decall_3.Arguments, Key="layout_json")
gjok_7 = GetJSONObjectKey(JObject=decall_3.Arguments, Key="room_name")
area = Area(Geometry=sph)  # -> Area, Centroid
volume = Volume(Geometry=sph_2)  # -> Volume, Centroid
geo = Geometry(sph_2)
geo_2 = Geometry(sph)
rjv_5 = ReadJSONValue(JValue=gjok_6)  # -> AsString, AsNumber, AsBool
panel_2 = Panel(area.Area)
panel_3 = Panel(volume.Volume)

# ---- group: Delete a Space by name
py3 = Python3Script(json_str=rjv_5.AsString, room_name=gjok_7)  # -> out, a; inputs room_name: String; same code as py3

# ---- group: Get a Specific Room
py3_2 = Python3Script(json_str=rjv_3.AsString, room_name=gjok_4)  # -> out, a; inputs room_name: String; same code as py3_2

# ----
cjv = CreateJSONValue(Value=panel_2)
cjv_2 = CreateJSONValue(Value=panel_3)
pjs = ParseJSONString(Text=py3.a)
cjo = CreateJSONObject(Keys="area", Values=cjv)
cjo_2 = CreateJSONObject(Keys="volume", Values=cjv_2)
respond = MCPToolResponse(Request=decall_3.Request, Content=pjs, IsError=False)
respond_2 = MCPToolResponse(Request=decall_4.Request, Content=cjo, IsError=False)
respond_3 = MCPToolResponse(Request=decall_5.Request, Content=cjo_2, IsError=False)

# ---- group: Design Logic to Add a Window
room_polyline = Data(py3_2.a)
panel_4 = Panel("2")
debrep = DeconstructBrep(Brep=room_polyline)  # -> Faces, Edges, Vertices
item = ListItem(List=debrep.Edges, Index=0, Wrap=True)
midpt = CurveMiddle(Curve=item)

# ----
division = Division(A=rjv_4.AsNumber, B=panel_4)

# ---- group: Design Logic to Add a Window (continued)
X = UnitX(Factor=division)
move = Move(Geometry=midpt, Motion=expr("-x", X))  # -> Geometry, Transform
move_2 = Move(Geometry=midpt, Motion=X)  # -> Geometry, Transform
merge = Merge(Data1=move_2.Geometry, Data2=move.Geometry)

# ---- group: Creates a Window Object
txt = Text(merge)
window_object = Python3Script(element_id="window-2", name="South Window", geometry=txt)  # -> out, window_obj; inputs element_id: String, geometry: list; same code as window_object

# ---- group: Merge it to the original layout json
py3_3 = Python3Script(json_str=rjv_3.AsString, new_object=window_object.window_obj)  # -> out, updated_layout; same code as py3_3

# ----
pjs_2 = ParseJSONString(Text=py3_3.updated_layout)
respond_4 = MCPToolResponse(Request=decall_2.Request, Content=pjs_2, IsError=False)
merge_2 = Merge(Data1=flatten(py3.a), Data2=flatten(py3_3.updated_layout))
or = GateOr(A=respond_3, B=respond_2, C=respond, D=respond_4)
tool_call_success = ClusterOutput(or)

# ---- group: Extractor Tool do map json to grasshopper data
extractor = Python3Script(json_str=merge_2)  # -> out, outline_curve, room_names, room_curves, door_names, door_curves, window_names, window_curves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; same code as extractor

# ---- group: Polylines
srf = Surface(extractor.room_curves)
preview = CustomPreview(Geometry=srf, Material=[ColourSwatch(SwatchColor=RGB(167, 219, 44)), ColourSwatch(SwatchColor=RGB(4, 154, 184))])

# ---- group: Windows
data = Data(extractor.window_curves)
previewlw = CustomPreviewLineweights(Geometry=data, Shader=ColourSwatch(SwatchColor=RGB(56, 56, 56)), Thickness=Slider(5.4, range=0..10), Absolute=False)

# ---- group: Labels
area_2 = Area(Geometry=srf)  # -> Area, Centroid
tag = TextTag(Location=area_2.Centroid, Text=extractor.room_names)
