# Grasshopper definition geometry_bake.gh (Grasshopper 1.0.8)
# plug-ins: Swiftlet

manual_tolerance = Panel("0.01")
input_mode = ValueList({"Manual Debug": 0, "MCP Request": 1}, selected="Manual Debug")
manual_site_boundary_id = Panel("T04_SITE_001")
manual_units = Panel("meters")
num = Number(manual_tolerance)

# ----
# t04_site_boundary_reader
panel = Panel("Geometric tolerance used to close and validate the site boundary.")
panel_2 = Panel("Model units for area and distance calculations. Use meters unless specified.")
param = DefineToolParameter(Name="site_boundary_id", Type="string", Description="Rhino custom ID of the baked site boundary curve.", Required=True)
param_2 = DefineToolParameter(Name="units", Type="string", Description=panel_2, Required="False")
panel_3 = Panel("""Reads a site boundary curve by Rhino custom ID or serialized boundary data,
calculates the site area, and returns a closed boundary representation as JSON.""")
panel_4 = Panel("site_boundary_id")
panel_5 = Panel("units")
panel_6 = Panel("tolerance")

param_3 = DefineToolParameter(Name="tolerance", Type="double", Description=panel, Required="False")
panel_7 = Panel(param_3)

# ----
# SCALE OBJECT
panel_8 = Panel("Scaling factor for the selected object")
param_4 = DefineToolParameter(Name="object_name", Type="string", Description="Name of the object to scale", Required=True)
param_5 = DefineToolParameter(Name="scaling_factor", Type="double", Description=panel_8, Required=True)
merge = Merge(Data1=param_4, Data2=param_5)
panel_9 = Panel("Selects an object by name from the Rhino document and scale it around its centroid")
tool = DefineTool(Name="scale-object", Description=panel_9, Parameters=merge)
panel_10 = Panel("scaling_factor")
panel_11 = Panel("object_name")

# ----
# CREATE A BOX
panel_12 = Panel("Sphere origin point Y")
param_6 = DefineToolParameter(Name="origin_x", Type="double", Description="Sphere origin point X", Required=True)
param_7 = DefineToolParameter(Name="origin_y", Type="double", Description=panel_12, Required=True)
param_8 = DefineToolParameter(Name="origin_z", Type="double", Description="Sphere origin point Z", Required=True)
param_9 = DefineToolParameter(Name="len_x", Type="double", Description="Box length in X", Required=True)
param_10 = DefineToolParameter(Name="len_y", Type="double", Description="Box length in Y", Required=True)
param_11 = DefineToolParameter(Name="len_z", Type="double", Description="Box length in Z", Required=True)
merge_2 = Merge(Data1=param_6, Data2=param_7, Data3=param_8, Data4=param_9, Data5=param_10, Data6=param_11)
tool_2 = DefineTool(Name="create-box", Description="Bakes a NURBS box to the Rhino document.", Parameters=merge_2)
panel_13 = Panel("origin_x")
panel_14 = Panel("origin_y")
panel_15 = Panel("origin_z")
panel_16 = Panel("len_y")
panel_17 = Panel("len_z")
panel_18 = Panel("len_x")

# ----
# MESH BREP
panel_19 = Panel("Determines whether the original BREP object should be deleted")
param_12 = DefineToolParameter(Name="object_name", Type="string", Description="Name of the BREP object to mesh", Required=True)
param_13 = DefineToolParameter(Name="delete_original", Type="bool", Description=panel_19, Required=True)
merge_3 = Merge(Data1=param_12, Data2=param_13)
tool_3 = DefineTool(Name="mesh-brep", Description="Select a BREP using its Name and turn it into a mesh", Parameters=merge_3)
panel_20 = Panel("delete_original")
panel_21 = Panel("object_name")

# ----
# MOVE OBJECT
panel_22 = Panel("X component of the translation vector")
param_14 = DefineToolParameter(Name="vector_x", Type="double", Description=panel_22, Required=True)
param_15 = DefineToolParameter(Name="vector_y", Type="double", Description="Y component of the translation vector", Required=True)
param_16 = DefineToolParameter(Name="vector_z", Type="double", Description="Z component of the translation vector", Required=True)
param_17 = DefineToolParameter(Name="object_name", Type="string", Description="Name of the object to move", Required=True)
merge_4 = Merge(Data1=param_17, Data2=param_14, Data3=param_15, Data4=param_16)
panel_23 = Panel("Select an object from the Rhino document using its Name and move it along a translation vector.")
tool_4 = DefineTool(Name="move-object", Description=panel_23, Parameters=merge_4)
panel_24 = Panel("vector_y")
panel_25 = Panel("vector_z")
panel_26 = Panel("vector_x")
panel_27 = Panel("object_name")

# ----
# ROTATE OBJECT
panel_28 = Panel("Name of the object to rotate")
param_18 = DefineToolParameter(Name="rotation_x_degrees", Type="double", Description="Rotation around X axis in degrees", Required=True)
param_19 = DefineToolParameter(Name="object_name", Type="string", Description=panel_28, Required=True)
param_20 = DefineToolParameter(Name="rotation_y_degrees", Type="double", Description="Rotation around Y axis in degrees", Required=True)
param_21 = DefineToolParameter(Name="rotation_z_degrees", Type="double", Description="Rotation around Z axis in degrees", Required=True)
merge_5 = Merge(Data1=param_19, Data2=param_18, Data3=param_20, Data4=param_21)
panel_29 = Panel("Rotate an object around three individual axis with the pivot point at the object centroid (first rotates around X, then Y, then Z).")
tool_5 = DefineTool(Name="rotate-object", Description=panel_29, Parameters=merge_5)
panel_30 = Panel("rotation_y_degrees")
panel_31 = Panel("rotation_z_degrees")
panel_32 = Panel("rotation_x_degrees")
panel_33 = Panel("object_name")

# ----
# NORMAL COLOR MESH
panel_34 = Panel("Name of the object to rotate")
param_22 = DefineToolParameter(Name="object_name", Type="string", Description=panel_34, Required=True)
merge_6 = Merge(Data1=param_22)
tool_6 = DefineTool(Name="normal-color-mesh", Description="Vertex-color a mesh with a normal map", Parameters=merge_6)
panel_35 = Panel("object_name")

merge_7 = Merge(Data1=param, Data2=param_2, Data3=param_3)
tool_7 = DefineTool(Name="t04_site_boundary_reader", Description=panel_3, Parameters=merge_7)

panel_36 = Panel(tool_7)

# ----
# LIST OBJECT NAMES
panel_37 = Panel("List all of the object names in the Rhino document")
tool_8 = DefineTool(Name="list-objects", Description=panel_37)

merge_8 = Merge(Data1=tool_7, Data2=tool_2, Data3=tool, Data4=tool_3, Data5=tool_4, Data6=tool_5, Data7=tool_6, Data8=tool_8)
mcp = MCPServer(Port=3001, Tools=merge_8, ServerName="Swiftlet")  # -> CreateBox, ScaleObject, MeshBrep, MoveObject, RotateObject, NormalColorMesh, ListObjects, T04_site_boundary_reader

decall = DeconstructToolCall(Request=mcp.ListObjects)  # -> Request, Tool, Arguments
py3 = Python3Script(trigger=decall.Tool)  # -> names
# ---------- py3: Python ----------
import Rhino
import scriptcontext as sc
import json

names = []
if trigger is not None:
    sc.doc = Rhino.RhinoDoc.ActiveDoc
    for obj in sc.doc.Objects:
        name = obj.Attributes.Name
        if name:
            names.append(name)
    sc.doc = ghdoc
# ---------- end py3 ----------
cjv = CreateJSONValue(Value=py3)
cja = CreateJSONArray(JTokens=cjv)
respond = MCPToolResponse(Request=decall.Request, Content=cja, IsError=False)

decall_2 = DeconstructToolCall(Request=mcp.T04_site_boundary_reader)  # -> Request, Tool, Arguments
null = NullItem(Item=decall_2.Arguments)  # -> NullFlags, InvalidFlags, Description
gjok = GetJSONObjectKey(JObject=decall_2.Arguments, Key=panel_4)
gjok_2 = GetJSONObjectKey(JObject=decall_2.Arguments, Key=panel_5)
gjok_3 = GetJSONObjectKey(JObject=decall_2.Arguments, Key=panel_6)
not = GateNot(A=null.NullFlags)
rjv = ReadJSONValue(JValue=gjok)  # -> AsString, AsNumber, AsBool
rjv_2 = ReadJSONValue(JValue=gjok_2)  # -> AsString, AsNumber, AsBool
rjv_3 = ReadJSONValue(JValue=gjok_3)  # -> AsString, AsNumber, AsBool

# ---- group: Request Is Not Null
bool = Boolean(not)

# ----
filter = StreamFilter(Gate=input_mode, Stream0=manual_units, Stream1=rjv_2.AsString)
filter_2 = StreamFilter(Gate=input_mode, Stream0=num, Stream1=rjv_3.AsString)
filter_3 = StreamFilter(Gate=input_mode, Stream0=manual_site_boundary_id, Stream1=rjv.AsString)

# ---- group: Bake
py3_2 = Python3Script(site_boundary_id=filter_3, units=filter, tolerance=filter_2)  # -> result, error; inputs site_boundary_id: String, units: String, tolerance: Double
# ---------- py3_2: Python ----------
import Rhino
import scriptcontext as sc
import System
import json

# Inputs expected from Grasshopper:
# site_boundary_id: str
# units: str
# tolerance: float

def safe_str(value, default=""):
    if value is None:
        return default
    return str(value)

def safe_float(value, default=0.01):
    try:
        if value is None:
            return default
        return float(value)
    except Exception:
        return default

custom_id = safe_str(site_boundary_id)
units_value = safe_str(units, "meters")
tol = safe_float(tolerance, 0.01)

result = None
error = True

if not custom_id:
    result = json.dumps({
        "tool": "t04_site_boundary_reader",
        "status": "error",
        "message": "Missing required parameter: site_boundary_id"
    })
else:
    sc.doc = Rhino.RhinoDoc.ActiveDoc

    found_obj = None
    found_id = None

    # Search Rhino objects by custom metadata first, then fallback by object name.
    for rh_obj in sc.doc.Objects:
        if rh_obj is None:
            continue

        attr = rh_obj.Attributes
        user_custom_id = attr.GetUserString("custom_id")

        if user_custom_id == custom_id or attr.Name == custom_id:
            found_obj = rh_obj
            found_id = rh_obj.Id
            break

    if found_obj is None:
        result = json.dumps({
            "tool": "t04_site_boundary_reader",
            "status": "error",
            "message": "No Rhino object found with this custom_id or name.",
            "site_boundary_id": custom_id
        })
    else:
        geo = found_obj.Geometry
        curve = None

        if isinstance(geo, Rhino.Geometry.Curve):
            curve = geo
        else:
            result = json.dumps({
                "tool": "t04_site_boundary_reader",
                "status": "error",
                "message": "Found object is not a curve.",
                "site_boundary_id": custom_id,
                "rhino_object_id": str(found_id),
                "geometry_type": geo.GetType().Name
            })

        if curve:
            is_closed = curve.IsClosed
            area_value = None

            if is_closed:
                amp = Rhino.Geometry.AreaMassProperties.Compute(curve)
                if amp:
                    area_value = amp.Area

            bbox = curve.GetBoundingBox(True)

            result = json.dumps({
                "tool": "t04_site_boundary_reader",
                "status": "success",
                "site_boundary_id": custom_id,
                "rhino_object_id": str(found_id),
                "units": units_value,
                "tolerance": tol,
                "geometry_type": geo.GetType().Name,
                "is_closed": is_closed,
                "site_area": area_value,
                "bbox": {
                    "min": [bbox.Min.X, bbox.Min.Y, bbox.Min.Z],
                    "max": [bbox.Max.X, bbox.Max.Y, bbox.Max.Z]
                },
                "message": "Site boundary processed successfully."
            })

            error = False

    sc.doc.Views.Redraw()
    sc.doc = ghdoc
# ---------- end py3_2 ----------

# ----
pjs = ParseJSONString(Text=py3_2.result)

response = Panel(py3_2.result)
respond_2 = MCPToolResponse(Request=decall_2.Request, Content=pjs, IsError=py3_2.error)

panel_38 = Panel(respond_2)
panel_39 = Panel(pjs)

decall_3 = DeconstructToolCall(Request=mcp.CreateBox)  # -> Request, Tool, Arguments
gjok_4 = GetJSONObjectKey(JObject=decall_3.Arguments, Key=panel_16)
null_2 = NullItem(Item=decall_3.Arguments)  # -> NullFlags, InvalidFlags, Description
gjok_5 = GetJSONObjectKey(JObject=decall_3.Arguments, Key=panel_13)
gjok_6 = GetJSONObjectKey(JObject=decall_3.Arguments, Key=panel_14)
gjok_7 = GetJSONObjectKey(JObject=decall_3.Arguments, Key=panel_15)
gjok_8 = GetJSONObjectKey(JObject=decall_3.Arguments, Key=panel_18)
gjok_9 = GetJSONObjectKey(JObject=decall_3.Arguments, Key=panel_17)
rjv_4 = ReadJSONValue(JValue=gjok_4)  # -> AsString, AsNumber, AsBool
rjv_5 = ReadJSONValue(JValue=gjok_5)  # -> AsString, AsNumber, AsBool
rjv_6 = ReadJSONValue(JValue=gjok_6)  # -> AsString, AsNumber, AsBool
rjv_7 = ReadJSONValue(JValue=gjok_7)  # -> AsString, AsNumber, AsBool
rjv_8 = ReadJSONValue(JValue=gjok_8)  # -> AsString, AsNumber, AsBool
rjv_9 = ReadJSONValue(JValue=gjok_9)  # -> AsString, AsNumber, AsBool
not_2 = GateNot(A=null_2.NullFlags)
py3_3 = Python3Script(trigger=decall_3.Arguments, prefix="box")  # -> random_id; inputs prefix: String
# ---------- py3_3: Python ----------
import random

id = random.randint(1000000, 9999999)
random_id = f"{prefix}-{id}"
# ---------- end py3_3 ----------
sphere_name = Panel(py3_3)

# ---- group: Request Is Not Null
bool_2 = Boolean(not_2)

# ---- group: Length Y
num_2 = Number(rjv_4.AsNumber)

# ---- group: X
num_3 = Number(rjv_5.AsNumber)

# ---- group: Length X
num_4 = Number(rjv_8.AsNumber)

# ---- group: Y
num_5 = Number(rjv_6.AsNumber)

# ---- group: Z
num_6 = Number(rjv_7.AsNumber)

# ---- group: Length Z
num_7 = Number(rjv_9.AsNumber)

# ----
decall_4 = DeconstructToolCall(Request=mcp.ScaleObject)  # -> Request, Tool, Arguments
gjok_10 = GetJSONObjectKey(JObject=decall_4.Arguments, Key=panel_11)
gjok_11 = GetJSONObjectKey(JObject=decall_4.Arguments, Key=panel_10)
null_3 = NullItem(Item=decall_4.Arguments)  # -> NullFlags, InvalidFlags, Description
not_3 = GateNot(A=null_3.NullFlags)
rjv_10 = ReadJSONValue(JValue=gjok_10)  # -> AsString, AsNumber, AsBool
rjv_11 = ReadJSONValue(JValue=gjok_11)  # -> AsString, AsNumber, AsBool

# ---- group: Request Is Not Null
bool_3 = Boolean(not_3)

# ---- group: Name
txt = Text(rjv_10.AsString)

# ---- group: Scaling Factor
num_8 = Number(rjv_11.AsNumber)

# ---- group: Find Object in the Doc by Name
py3_4 = Python3Script(name_input=txt)  # -> guid_out, centroid
# ---------- py3_4: Python ----------
"""
Grasshopper Python Script
Inputs:
  name_input : str                        - the object Name to search for
Outputs:
  guid_out   : list[System.Guid]          - GUIDs of all matching objects
  centroid   : list[Rhino.Geometry.Point3d] - volume centroid of each match
"""

import Rhino

guid_out = []
centroid = []

if name_input:
    for obj in Rhino.RhinoDoc.ActiveDoc.Objects:
        if obj and obj.Attributes.Name == name_input:
            vmp = Rhino.Geometry.VolumeMassProperties.Compute(obj.Geometry)
            if vmp:
                guid_out.append(obj.Id)
                centroid.append(vmp.Centroid)
# ---------- end py3_4 ----------

# ---- group: Object Centroid
pt = Point(py3_4.centroid)

# ---- group: Scaling Factor
num_9 = Number(num_8)

# ---- group: Selected Geometry
id = Guid(py3_4.guid_out)

# ---- group: Scale Object
py3_5 = Python3Script(guid_str=id, factor=num_9, ref_point=pt, run=bool_3)  # -> result, new_geo; inputs guid_str: String, factor: Double, ref_point: Point3d, run: Boolean
# ---------- py3_5: Python ----------
"""
Grasshopper Python Script: Scale Object by GUID
-------------------------------------------------
Inputs:
    guid_str   (str)        - The GUID of the Rhino object to scale (as a string)
    factor     (float)      - The uniform scaling factor (e.g. 2.0 = double size)
    ref_point  (Point3d)    - The reference/center point for scaling
    run        (bool)       - Set to True to execute the scaling

Outputs:
    result     (str)        - Status message
    new_geo    (geometry)   - The scaled geometry for preview
"""

import Rhino
import Rhino.Geometry as rg
import rhinoscriptsyntax as rs
import scriptcontext as sc
import System

# Default outputs
result = "Set 'run' to True to execute."
new_geo = None

if run and guid_str:
    # --- Parse the GUID ---
    try:
        obj_id = System.Guid(guid_str)
    except Exception as e:
        result = "Invalid GUID string: {}".format(e)
        obj_id = None

    if obj_id:
        # --- Switch to the Rhino document to access objects ---
        sc.doc = Rhino.RhinoDoc.ActiveDoc

        # --- Find the object in the document ---
        rhino_obj = sc.doc.Objects.Find(obj_id)

        if rhino_obj is None:
            result = "No object found with GUID: {}".format(guid_str)
        else:
            # --- Build a uniform scale transform around the reference point ---
            xform = rg.Transform.Scale(ref_point, factor)

            # --- Duplicate the geometry so we can preview it ---
            geo_copy = rhino_obj.Geometry.Duplicate()
            geo_copy.Transform(xform)

            # --- Apply the transform to the actual Rhino object ---
            success = sc.doc.Objects.Transform(obj_id, xform, True)

            if success != System.Guid.Empty:
                result = "Scaled '{}' by factor {} around ({}, {}, {})".format(
                    rhino_obj.Name if rhino_obj.Name else obj_id,
                    factor,
                    ref_point.X, ref_point.Y, ref_point.Z
                )
                new_geo = geo_copy
            else:
                result = "Transform failed for GUID: {}".format(guid_str)

        # --- Switch back to the Grasshopper document ---
        sc.doc = ghdoc
# ---------- end py3_5 ----------

# ----
cjv_2 = CreateJSONValue(Value=py3_5.result)
cjo = CreateJSONObject(Keys="result", Values=cjv_2)
sjt = StringifyJSONToken(JToken=cjo)
response_2 = Panel(sjt)
respond_3 = MCPToolResponse(Request=decall_4.Request, Content=cjo, IsError=False)

decall_5 = DeconstructToolCall(Request=mcp.MeshBrep)  # -> Request, Tool, Arguments
gjok_12 = GetJSONObjectKey(JObject=decall_5.Arguments, Key=panel_21)
gjok_13 = GetJSONObjectKey(JObject=decall_5.Arguments, Key=panel_20)
null_4 = NullItem(Item=decall_5.Arguments)  # -> NullFlags, InvalidFlags, Description
not_4 = GateNot(A=null_4.NullFlags)
rjv_12 = ReadJSONValue(JValue=gjok_12)  # -> AsString, AsNumber, AsBool
rjv_13 = ReadJSONValue(JValue=gjok_13)  # -> AsString, AsNumber, AsBool

# ---- group: Request Is Not Null
bool_4 = Boolean(not_4)

# ---- group: Delete original
bool_5 = Boolean(rjv_13.AsBool)

# ---- group: Name
txt_2 = Text(rjv_12.AsString)

# ---- group: Find Object in the Doc by Name
py3_6 = Python3Script(name_input=txt_2)  # -> guid_out, centroid; same code as py3_4

# ---- group: Object to mesh
brep = Brep(py3_6.guid_out)

# ----
decall_6 = DeconstructToolCall(Request=mcp.MoveObject)  # -> Request, Tool, Arguments
gjok_14 = GetJSONObjectKey(JObject=decall_6.Arguments, Key=panel_27)
gjok_15 = GetJSONObjectKey(JObject=decall_6.Arguments, Key=panel_26)
gjok_16 = GetJSONObjectKey(JObject=decall_6.Arguments, Key=panel_24)
gjok_17 = GetJSONObjectKey(JObject=decall_6.Arguments, Key=panel_25)
rjv_14 = ReadJSONValue(JValue=gjok_14)  # -> AsString, AsNumber, AsBool
rjv_15 = ReadJSONValue(JValue=gjok_15)  # -> AsString, AsNumber, AsBool
rjv_16 = ReadJSONValue(JValue=gjok_16)  # -> AsString, AsNumber, AsBool
rjv_17 = ReadJSONValue(JValue=gjok_17)  # -> AsString, AsNumber, AsBool

# ---- group: Name
txt_3 = Text(rjv_14.AsString)

# ---- group: Vector Y
num_10 = Number(rjv_16.AsNumber)

# ---- group: Vector X
num_11 = Number(rjv_15.AsNumber)

# ---- group: Vector Z
num_12 = Number(rjv_17.AsNumber)

# ----
vec = VectorXYZ(XComponent=num_11, YComponent=num_10, ZComponent=num_12)  # -> Vector, Length
py3_7 = Python3Script(name=txt_3, vector=vec.Vector)  # -> status, error; inputs name: String, vector: Vector3d
# ---------- py3_7: Python ----------
import Rhino
import scriptcontext as sc

error = False

if name and vector:
    sc.doc = Rhino.RhinoDoc.ActiveDoc
    
    obj = None
    for rh_obj in sc.doc.Objects:
        if rh_obj.Attributes.Name == name:
            obj = rh_obj
            break
    
    if obj:
        xform = Rhino.Geometry.Transform.Translation(vector)
        success = sc.doc.Objects.Transform(obj.Id, xform, True)
        
        if success:
            sc.doc.Views.Redraw()
            status = "Moved '{}' by ({}, {}, {})".format(name, vector.X, vector.Y, vector.Z)
        else:
            status = "Failed to move object"
            error = True
    else:
        status = "Object not found: " + name
        error = True
    
    sc.doc = ghdoc
else:
    status = "Name or vector not provided"
    error = True
# ---------- end py3_7 ----------
cjv_3 = CreateJSONValue(Value=py3_7.status)
cjo_2 = CreateJSONObject(Keys="status", Values=cjv_3)
sjt_2 = StringifyJSONToken(JToken=cjo_2)
response_3 = Panel(sjt_2)
respond_4 = MCPToolResponse(Request=decall_6.Request, Content=cjo_2, IsError=py3_7.error)

decall_7 = DeconstructToolCall(Request=mcp.RotateObject)  # -> Request, Tool, Arguments
gjok_18 = GetJSONObjectKey(JObject=decall_7.Arguments, Key=panel_33)
gjok_19 = GetJSONObjectKey(JObject=decall_7.Arguments, Key=panel_32)
gjok_20 = GetJSONObjectKey(JObject=decall_7.Arguments, Key=panel_30)
gjok_21 = GetJSONObjectKey(JObject=decall_7.Arguments, Key=panel_31)
rjv_18 = ReadJSONValue(JValue=gjok_18)  # -> AsString, AsNumber, AsBool
rjv_19 = ReadJSONValue(JValue=gjok_19)  # -> AsString, AsNumber, AsBool
rjv_20 = ReadJSONValue(JValue=gjok_20)  # -> AsString, AsNumber, AsBool
rjv_21 = ReadJSONValue(JValue=gjok_21)  # -> AsString, AsNumber, AsBool

# ---- group: Name
txt_4 = Text(rjv_18.AsString)

# ---- group: Rotation X Axis
num_13 = Number(rjv_19.AsNumber)

# ---- group: Rotation Z Axis
num_14 = Number(rjv_21.AsNumber)

# ---- group: Rotation Y Axis
num_15 = Number(rjv_20.AsNumber)

# ----
py3_8 = Python3Script(name=txt_4, x_degrees=num_13, y_degrees=num_15, z_degrees=num_14)  # -> status, error; inputs name: String, x_degrees: Double, y_degrees: Double, z_degrees: Double
# ---------- py3_8: Python ----------
import Rhino
import scriptcontext as sc
import math

error = False

if name and x_degrees is not None and y_degrees is not None and z_degrees is not None:
    sc.doc = Rhino.RhinoDoc.ActiveDoc
    
    obj = None
    for rh_obj in sc.doc.Objects:
        if rh_obj.Attributes.Name == name:
            obj = rh_obj
            break
    
    if obj:
        # Get the volume centroid as rotation center
        geo = obj.Geometry
        
        if hasattr(geo, 'GetBoundingBox'):
            # Try volume centroid for Breps
            if isinstance(geo, Rhino.Geometry.Brep):
                mp = Rhino.Geometry.VolumeMassProperties.Compute(geo)
                if mp:
                    center = mp.Centroid
                else:
                    center = geo.GetBoundingBox(True).Center
            elif isinstance(geo, Rhino.Geometry.Mesh):
                mp = Rhino.Geometry.VolumeMassProperties.Compute(geo)
                if mp:
                    center = mp.Centroid
                else:
                    center = geo.GetBoundingBox(True).Center
            else:
                center = geo.GetBoundingBox(True).Center
        else:
            center = geo.GetBoundingBox(True).Center
        
        # Convert degrees to radians
        rx = math.radians(x_degrees)
        ry = math.radians(y_degrees)
        rz = math.radians(z_degrees)
        
        # Build rotation transforms around centroid
        rot_x = Rhino.Geometry.Transform.Rotation(rx, Rhino.Geometry.Vector3d.XAxis, center)
        rot_y = Rhino.Geometry.Transform.Rotation(ry, Rhino.Geometry.Vector3d.YAxis, center)
        rot_z = Rhino.Geometry.Transform.Rotation(rz, Rhino.Geometry.Vector3d.ZAxis, center)
        
        # Combine: first X, then Y, then Z
        combined = Rhino.Geometry.Transform.Identity
        combined = Rhino.Geometry.Transform.Multiply(combined, rot_x)
        combined = Rhino.Geometry.Transform.Multiply(combined, rot_y)
        combined = Rhino.Geometry.Transform.Multiply(combined, rot_z)
        
        success = sc.doc.Objects.Transform(obj.Id, combined, True)
        
        if success:
            sc.doc.Views.Redraw()
            status = "Rotated '{}' by X:{} Y:{} Z:{} around ({:.2f}, {:.2f}, {:.2f})".format(
                name, x_degrees, y_degrees, z_degrees, center.X, center.Y, center.Z)
        else:
            status = "Failed to rotate object"
            error = True
    else:
        status = "Object not found: " + name
        error = True
    
    sc.doc = ghdoc
else:
    status = "Missing inputs"
    error = True
# ---------- end py3_8 ----------
cjv_4 = CreateJSONValue(Value=py3_8.status)
cjo_3 = CreateJSONObject(Keys="status", Values=cjv_4)
sjt_3 = StringifyJSONToken(JToken=cjo_3)
response_4 = Panel(sjt_3)
respond_5 = MCPToolResponse(Request=decall_7.Request, Content=cjo_3, IsError=py3_8.error)

decall_8 = DeconstructToolCall(Request=mcp.NormalColorMesh)  # -> Request, Tool, Arguments
gjok_22 = GetJSONObjectKey(JObject=decall_8.Arguments, Key=panel_35)
rjv_22 = ReadJSONValue(JValue=gjok_22)  # -> AsString, AsNumber, AsBool

# ---- group: Name
txt_5 = Text(rjv_22.AsString)

# ----
py3_9 = Python3Script(name=txt_5)  # -> status, error; inputs name: String
# ---------- py3_9: Python ----------
import Rhino
import scriptcontext as sc
import System.Drawing

error = False

if name:
    sc.doc = Rhino.RhinoDoc.ActiveDoc
    
    obj = None
    for rh_obj in sc.doc.Objects:
        if rh_obj.Attributes.Name == name:
            obj = rh_obj
            break
    
    if obj:
        geo = obj.Geometry
        
        if isinstance(geo, Rhino.Geometry.Mesh):
            mesh = geo.Duplicate()
            
            # Ensure mesh has normals
            if mesh.Normals.Count == 0:
                mesh.Normals.ComputeNormals()
            
            # Apply normal map coloring
            # Normal map convention: RGB = (N.x * 0.5 + 0.5, N.y * 0.5 + 0.5, N.z * 0.5 + 0.5)
            mesh.VertexColors.Clear()
            for i in range(mesh.Vertices.Count):
                n = mesh.Normals[i]
                r = int((n.X * 0.5 + 0.5) * 255)
                g = int((n.Y * 0.5 + 0.5) * 255)
                b = int((n.Z * 0.5 + 0.5) * 255)
                # Clamp values
                r = max(0, min(255, r))
                g = max(0, min(255, g))
                b = max(0, min(255, b))
                mesh.VertexColors.Add(System.Drawing.Color.FromArgb(r, g, b))
            
            sc.doc.Objects.Replace(obj.Id, mesh)
            sc.doc.Views.Redraw()
            status = "Applied normal map colors to '{}' ({} vertices)".format(name, mesh.Vertices.Count)
        else:
            status = "Object '{}' is not a Mesh, it's a {}".format(name, geo.GetType().Name)
            error = True
    else:
        status = "Object not found: " + name
        error = True
    
    sc.doc = ghdoc
else:
    status = "No name provided"
    error = True
# ---------- end py3_9 ----------
cjv_5 = CreateJSONValue(Value=py3_9.status)
cjo_4 = CreateJSONObject(Keys="status", Values=cjv_5)
sjt_4 = StringifyJSONToken(JToken=cjo_4)
response_5 = Panel(sjt_4)
respond_6 = MCPToolResponse(Request=decall_8.Request, Content=cjo_4, IsError=py3_9.error)

division = Division(A=num_2, B="2")
pt_2 = ConstructPoint(XCoordinate=num_3, YCoordinate=num_5, ZCoordinate=num_6)
division_2 = Division(A=num_4, B="2")
neg = Negative(Value=division)
xy = XYPlane(Origin=pt_2)
neg_2 = Negative(Value=division_2)
dom = ConstructDomain(DomainStart=neg, DomainEnd=division)
dom_2 = ConstructDomain(DomainStart=neg_2, DomainEnd=division_2)
rectangle = Rectangle(Plane=xy, XSize=dom_2, YSize=dom, Radius=0)  # -> Rectangle, Length
Z = UnitZ(Factor=num_7)
extr = Extrude(Base=rectangle.Rectangle, Direction=Z)
cap = CapHoles(Brep=extr)

# ---- group: Bake
py3_10 = Python3Script(geometry=cap, name=sphere_name, bake=bool_2)  # -> result, error; inputs geometry: GeometryBase, name: String, bake: Boolean
# ---------- py3_10: Python ----------
import Rhino
import scriptcontext as sc
import System
import json

if bake:
    error = True
    sc.doc = Rhino.RhinoDoc.ActiveDoc
    
    obj_id = sc.doc.Objects.Add(geometry)
    
    if obj_id != System.Guid.Empty:
        obj = sc.doc.Objects.Find(obj_id)
        if obj:
            attr = obj.Attributes.Duplicate()
            attr.Name = name
            sc.doc.Objects.ModifyAttributes(obj_id, attr, True)
            
            # Debug: check bounding box and geometry type
            bbox = obj.Geometry.GetBoundingBox(True)
            geo_type = obj.Geometry.GetType().Name
            result = json.dumps({
                "name": name,
                "type": geo_type
            })
            error = False
        else:
            result = json.dumps({"err" : "Object not found after add"})
        
        sc.doc.Views.Redraw()
    else:
        result = json.dumps({"err" : "Failed to bake geometry"})
    
    sc.doc = ghdoc
else:
    result = json.dumps({"msg" : "Bake is False, skipping"})
    error = False
# ---------- end py3_10 ----------

# ----
pjs_2 = ParseJSONString(Text=py3_10.result)
response_6 = Panel(py3_10.result)
respond_7 = MCPToolResponse(Request=decall_3.Request, Content=pjs_2, IsError=py3_10.error)

py3_11 = Python3Script(guid=py3_6.guid_out, delete=bool_5)  # -> status; inputs guid: String, delete: Boolean
# ---------- py3_11: Python ----------
import Rhino
import scriptcontext as sc
import System

if delete and guid:
    sc.doc = Rhino.RhinoDoc.ActiveDoc
    
    if isinstance(guid, str):
        obj_guid = System.Guid(guid)
    else:
        obj_guid = guid
    
    obj = sc.doc.Objects.Find(obj_guid)
    
    if obj:
        obj_name = obj.Attributes.Name
        success = sc.doc.Objects.Delete(obj_guid, True)
        if success:
            sc.doc.Views.Redraw()
            status = "Deleted: {} ({})".format(obj_name, str(obj_guid))
        else:
            status = "Failed to delete object"
    else:
        status = "Object not found with GUID: " + str(obj_guid)
    
    sc.doc = ghdoc
else:
    status = "Delete is False or no GUID provided"
# ---------- end py3_11 ----------
py3_12 = Python3Script(trigger=bool_5, prefix="mesh")  # -> random_id; inputs prefix: String; same code as py3_3
qrmesh = QuadRemesh(Geometry=brep, Settings={aqc=True, as=50, dhe=True, gci=0, null=False, pme=2, sa=0, tqc=2000})
sphere_name_2 = Panel(py3_12)

# ---- group: Deletion Status
txt_6 = Text(py3_11)

# ---- group: Bake
py3_13 = Python3Script(geometry=qrmesh, name=sphere_name_2, bake=bool_4)  # -> result, error; inputs geometry: GeometryBase, name: String, bake: Boolean; same code as py3_10

# ----
cjv_6 = CreateJSONValue(Value=txt_6)
pjs_3 = ParseJSONString(Text=py3_13.result)
sjk = SetJSONKey(JObject=pjs_3, Key="deletion_status", JToken=cjv_6)
sjt_5 = StringifyJSONToken(JToken=sjk)
response_7 = Panel(sjt_5)
respond_8 = MCPToolResponse(Request=decall_5.Request, Content=sjk, IsError=py3_13.error)
