# Grasshopper definition team_02_working.gh (Grasshopper 1.0.8)
# Copyright: María Sánchez Domínguez
# plug-ins: Swiftlet

cluster = Cluster()

# ----
# Connect MCP Tools to Decall and Update All Clusters
button = Button()
# IF SOMETHING IS NOT
# WORKING PRESS THIS
# BUTTON FIRST
toggle = BooleanToggle(True)
connect_mcp_tools_to_decall = CSharpScript(nickname_From="Central MCP Server", nickname_To="Central DeCall", connect=button)  # -> out; inputs nickname_From: String, nickname_To: String, connect: Boolean
# ---------- connect_mcp_tools_to_decall: C# ----------
using System;
using System.Linq;
using Grasshopper;
using Grasshopper.Kernel;

public class Script_Instance : GH_ScriptInstance
{
    private void RunScript(string nickname_From, string nickname_To, bool connect)
    {
        if (!connect) return;
        Console.Write($"Attempting to connect outputs from '{nickname_From}' to '{nickname_To}'...");

        var ghDoc = Instances.ActiveCanvas?.Document;
        if (ghDoc == null) return;

        var compFrom = ghDoc.Objects
            .OfType<IGH_Component>()
            .FirstOrDefault(o => o.NickName == nickname_From);

        var compTo = ghDoc.Objects
            .OfType<IGH_Param>()
            .FirstOrDefault(o => o.NickName == nickname_To);

        if (compFrom != null && compTo != null)
        {
            ghDoc.ScheduleSolution(5, doc => Connect(doc, compFrom, compTo));
        }
    }

    // <Custom additional code> 
    private void Connect(GH_Document doc, IGH_Component compFrom, IGH_Param compTo)
    {
        if (compFrom == null || compTo == null) return;

        foreach (IGH_Param param in compFrom.Params.Output)
        {
            compTo.AddSource(param);
        }
    }
}
# ---------- end connect_mcp_tools_to_decall ----------
update_all_clusters = CSharpScript(update=button, recursive=toggle)  # -> out, A; inputs update: Boolean, recursive: Boolean, passwords: list of String, localPath: String
# ---------- update_all_clusters: C# ----------
using System;
using System.Collections;
using System.Collections.Generic;

using Rhino;
using Rhino.Geometry;

using Grasshopper;
using Grasshopper.Kernel;
using Grasshopper.Kernel.Data;
using Grasshopper.Kernel.Types;
using System.Windows.Forms;
using System.Linq;
/// <summary>
/// This class will be instantiated on demand by the Script component.
/// </summary>
public class Script_Instance : GH_ScriptInstance
{
  /// <summary>Print a String to the [Out] Parameter of the Script component.</summary>
  /// <param name="text">String to print.</param>
  private void Print(string text) { /* Implementation hidden. */ }
  /// <summary>Print a formatted String to the [Out] Parameter of the Script component.</summary>
  /// <param name="format">String format.</param>
  /// <param name="args">Formatting parameters.</param>
  private void Print(string format, params object[] args) { /* Implementation hidden. */ }
  /// <summary>Print useful information about an object instance to the [Out] Parameter of the Script component. </summary>
  /// <param name="obj">Object instance to parse.</param>
  private void Reflect(object obj) { /* Implementation hidden. */ }
  /// <summary>Print the signatures of all the overloads of a specific method to the [Out] Parameter of the Script component. </summary>
  /// <param name="obj">Object instance to parse.</param>
  private void Reflect(object obj, string method_name) { /* Implementation hidden. */ }

  /// <summary>Gets the current Rhino document.</summary>
  private readonly RhinoDoc RhinoDocument;
  /// <summary>Gets the Grasshopper document that owns this script.</summary>
  private readonly GH_Document GrasshopperDocument;
  /// <summary>Gets the Grasshopper script component that owns this script.</summary>
  private readonly IGH_Component Component;
  /// <summary>
  /// Gets the current iteration count. The first call to RunScript() is associated with Iteration==0.
  /// Any subsequent call within the same solution will increment the Iteration count.
  /// </summary>
  private readonly int Iteration;

  /// <summary>
  /// This procedure contains the user code. Input parameters are provided as regular arguments,
  /// Output parameters as ref arguments. You don't have to assign output parameters,
  /// they will have a default value.
  /// </summary>
  private void RunScript(
		bool update,
		bool recursive,
		List<string> passwords,
		string localPath,
		ref object A)
  {

    A = updateLog;
    if (update)
    {
      updateLog = new List<string>();
      _passwords = passwords;
      UpdateClusters(GrasshopperDocument, recursive, localPath);
    }

  }

  // <Custom additional code> 
  List<string> updateLog;
  List<String> _passwords;

  void UpdateClusters (GH_Document ghDoc, bool recursive, string localPath)
  {
    foreach (var obj in ghDoc.Objects)
    {
      var cluster = obj as Grasshopper.Kernel.Special.GH_Cluster;
      if (cluster != null)
      {
        var clusterPath = cluster.FilePath;
        if (!string.IsNullOrEmpty(clusterPath))
        {
          if (cluster.Synchronisation == Grasshopper.Kernel.Special.GH_Synchronisation.OutOfDate)
          {
            cluster.CreateFromFilePath(clusterPath);
            updateLog.Add("Updated: " + clusterPath);
          }
          else if (cluster.Synchronisation == Grasshopper.Kernel.Special.GH_Synchronisation.MissingReference)
          {
            string newPath = ReplacePath(localPath, clusterPath);
            if (!string.IsNullOrEmpty(newPath))
            {
              cluster.CreateFromFilePath(newPath);
              updateLog.Add("Replaced and updated: " + newPath);
            }
            else
            {
              updateLog.Add("Missing reference: " + clusterPath);
            }

          }
        }

        //Update recursively
        if (recursive)
        {
          GH_Document clusterDoc = GetClusterDoc(cluster);
          if (clusterDoc != null)
            UpdateClusters(clusterDoc, recursive, localPath);
        }
      }
    }
  }

  GH_Document GetClusterDoc(Grasshopper.Kernel.Special.GH_Cluster cluster)
  {
    //no pass needed
    var doc = cluster.Document(string.Empty);
    if (doc != null)
      return doc;

    //try passwords
    if (_passwords != null && _passwords.Any())
    {
      foreach (var pass in _passwords)
      {
        doc = cluster.Document(pass);
        if (doc != null)
          return doc;
      }
    }

    return null;
  }

  string ReplacePath(string localPath, string missingPath)
  {
    if (String.IsNullOrEmpty(missingPath) || string.IsNullOrEmpty(localPath))
      return null;
    else
    {
      string lastLocalPart = localPath.Split('\\').Last();
      string[] parts = missingPath.Split('\\');
      if (parts.Contains(lastLocalPart))
      {
        int i = Array.IndexOf(parts, lastLocalPart);
        string clusterPath = String.Join("\\", parts.Skip(i + 1));
        string result = String.Join("\\", localPath, clusterPath);
        return result;
      }
      else
        return null;
    }
  }
  // </Custom additional code> 
}
# ---------- end update_all_clusters ----------
panel = Panel(connect_mcp_tools_to_decall)

get_tool_names = CSharpScript(x=cluster)  # -> flatten(out)
# ---------- get_tool_names: C# ----------
// Grasshopper Script Instance
#region Usings
using System;
using System.Linq;
using System.Collections;
using System.Collections.Generic;
using System.Drawing;

using Rhino;
using Rhino.Geometry;

using Grasshopper;
using Grasshopper.Kernel;
using Grasshopper.Kernel.Data;
using Grasshopper.Kernel.Types;
#endregion

public class Script_Instance : GH_ScriptInstance
{
    #region Notes
    /* 
      Members:
        RhinoDoc RhinoDocument
        GH_Document GrasshopperDocument
        IGH_Component Component
        int Iteration

      Methods (Virtual & overridable):
        Print(string text)
        Print(string format, params object[] args)
        Reflect(object obj)
        Reflect(object obj, string method_name)
    */
    #endregion

    private void RunScript(object x)
    {
        dynamic dynamicX = x;
        Console.Write(dynamicX.Name);
    }
}
# ---------- end get_tool_names ----------
port = CSharpScript()  # -> out, availablePort
# ---------- port: C# ----------
// Grasshopper Script Instance
// This script finds an available port on the local machine.
#region Usings
using System;
using System.Linq;
using System.Collections;
using System.Collections.Generic;
using System.Drawing;
using System.Net;
using System.Net.Sockets;

using Rhino;
using Rhino.Geometry;

using Grasshopper;
using Grasshopper.Kernel;
using Grasshopper.Kernel.Data;
using Grasshopper.Kernel.Types;
#endregion

public class Script_Instance : GH_ScriptInstance
{
    #region Notes
    /* 
      Members:
        RhinoDoc RhinoDocument
        GH_Document GrasshopperDocument
        IGH_Component Component
        int Iteration

      Methods (Virtual & overridable):
        Print(string text)
        Print(string format, params object[] args)
        Reflect(object obj)
        Reflect(object obj, string method_name)
    */
    #endregion

    private void RunScript(object start, object end, ref object availablePort)
    {
        // Use default values if parameters are not provided
        int startPort = (start != null && int.TryParse(start.ToString(), out int s)) ? s : 3001;
        int endPort = (end != null && int.TryParse(end.ToString(), out int e)) ? e : 3100;

        // Find an available port in the specified range
        try
        {
            availablePort = FindAvailablePortInRange(startPort, endPort);
            Print($"Available port found: {availablePort}");
        }
        catch (Exception ex)
        {
            Print($"Error: {ex.Message}");
            availablePort = null;
        }
    }

    /// <summary>
    /// Checks if a local TCP port is available for binding (i.e., not in use).
    /// Returns True if available, False otherwise.
    /// </summary>
    private bool IsPortAvailableForBind(int port)
    {
        try
        {
            // Create a new TCP socket
            using (Socket socket = new Socket(AddressFamily.InterNetwork, SocketType.Stream, ProtocolType.Tcp))
            {
                // Try to bind to the port on all interfaces (0.0.0.0)
                socket.Bind(new IPEndPoint(IPAddress.Any, port));
                // If successful, the socket is closed by the using statement and return True
                return true;
            }
        }
        catch (SocketException)
        {
            // If binding fails, it means the port is already in use
            return false;
        }
    }

    /// <summary>
    /// Finds an available port by letting the OS assign one.
    /// </summary>
    private int FindAvailablePort()
    {
        Socket socket = new Socket(AddressFamily.InterNetwork, SocketType.Stream, ProtocolType.Tcp);
        socket.Bind(new IPEndPoint(IPAddress.Any, 0)); // Bind to an available port assigned by the OS
        int availablePort = ((IPEndPoint)socket.LocalEndPoint).Port; // Get the assigned port number
        socket.Close(); // Close the socket
        return availablePort;
    }

    /// <summary>
    /// Finds the first available port in a given range.
    /// </summary>
    private int FindAvailablePortInRange(int start = 3001, int end = 3100)
    {
        for (int port = start; port <= end; port++)
        {
            if (IsPortAvailableForBind(port))
                return port;
        }
        throw new Exception($"No available ports found in the range {start}-{end}.");
    }
}
# ---------- end port ----------
panel_2 = Panel(port.availablePort)
central_mcp_server = MCPServer(Port=port.availablePort, Tools=cluster, ServerName="Swiftlet")  # -> Compute_total_area, Compute_room_area, Remove_furniture_piece, Add_window_01, Compute_comfort_scores, Detect_sensorial_conflicts, Generate_suggestions
central_decall = Data([central_mcp_server.Compute_total_area, central_mcp_server.Compute_room_area, central_mcp_server.Remove_furniture_piece, central_mcp_server.Add_window_01, central_mcp_server.Compute_comfort_scores, central_mcp_server.Detect_sensorial_conflicts, central_mcp_server.Generate_suggestions])
clean = CleanTree(RemoveNulls=True, RemoveInvalid=True, RemoveEmpty=False, Tree=central_decall)
team_02_result_cluster = Team_02_result_cluster(R=clean)  # -> text_2, text_3, R_2

# ---- group: Request Parameters
# Debug: Check request input data
decall = DeconstructToolCall(Request=clean)  # -> Request, Tool, Arguments
rjo = ReadJSONObject(JObject=decall.Arguments)  # -> Keys, JTokens
tmatch = MatchText(Text=rjo.Keys, Pattern="room_name", Case=True)
tmatch_2 = MatchText(Text=rjo.Keys, Pattern="layout_json", Case=True)
dispatch = Dispatch(List=rjo.JTokens, DispatchPattern=tmatch)  # -> ListA, ListB
dispatch_2 = Dispatch(List=rjo.JTokens, DispatchPattern=tmatch_2)  # -> ListA, ListB
panel_3 = Panel(dispatch.ListA)
panel_4 = Panel(dispatch_2.ListA)

# ----
# Tool Names from the Results Clusters
# Tool Names from the Definition Clusters
# These Two Clusters should be EXACTLY THE SAME
panel_5 = Panel(get_tool_names)
panel_6 = Panel(team_02_result_cluster.text_2)

rec = DataRecorder(team_02_result_cluster.R_2, DataLimit=-10, RecordData=True)
rec_2 = DataRecorder(clean, DataLimit=-10, RecordData=True)
panel_7 = Panel(rec)
panel_8 = Panel(rec_2)

# ----
# Debug Tool Names
# This Panel should always be TRUE
tool_names_from_the_results_clusters = Data(panel_6)
tool_names_from_the_definition_clusters = Data(panel_5)
join = TextJoin(Text=flatten(tool_names_from_the_definition_clusters))
join_2 = TextJoin(Text=flatten(tool_names_from_the_results_clusters))
tstat = TreeStatistics(Tree=tool_names_from_the_definition_clusters)  # -> Paths, Length, Count
tstat_2 = TreeStatistics(Tree=tool_names_from_the_results_clusters)  # -> Paths, Length, Count
dpath = DeconstructPath(Branch=tstat.Paths)
dpath_2 = DeconstructPath(Branch=tstat_2.Paths)
equals = Equality(FirstNumber=tstat.Length, SecondNumber=tstat_2.Length)  # -> Equality, Inequality
equals_2 = Equality(FirstNumber=tstat.Count, SecondNumber=tstat_2.Count)  # -> Equality, Inequality
ma = MassAddition(Input=flatten(equals.Equality))  # -> Result, PartialResults
equals_3 = Equality(FirstNumber=dpath, SecondNumber=dpath_2)  # -> Equality, Inequality
lng = ListLength(List=equals.Equality)
ma_2 = MassAddition(Input=flatten(equals_3.Inequality))  # -> Result, PartialResults
equals_4 = Equality(FirstNumber=ma.Result, SecondNumber=lng)  # -> Equality, Inequality
does_quantity_of_tools_match = Panel(equals_2.Equality)
equals_5 = Equality(FirstNumber=ma_2.Result, SecondNumber="0")  # -> Equality, Inequality
does_quantity_of_tools_match_per_team = Panel(equals_4.Equality)
are_all_teams_included = Panel(equals_5.Equality)

tmatch_3 = MatchText(Text=join, Pattern=join_2, Case=True)

do_all_names_match = Panel(tmatch_3)
and = GateAnd(A=equals_5.Equality, B=equals_4.Equality, C=equals_2.Equality, D=tmatch_3)  # -> flatten(Result)
do_trees_match = Panel(and)

# ==== cluster Team_02_result_cluster
# TEAM 02
# COMFORT RESULT CLUSTER
R = ClusterInput()

# ----
# Edit Tool Names to
# Match Definition Cluster
tool_names = Panel("""compute_total_area
compute_room_area
remove_furniture_piece
add_window_01
compute_comfort_scores
detect_sensorial_conflicts
generate_suggestions""")

# ----
# Sorting Logic, Please Do Not Edit
decall = DeconstructToolCall(Request=R)  # -> Request, Tool, Arguments
mindex = MemberIndex(Set=tool_names, Member=decall.Tool)  # -> Index, Count
sift = SiftPattern(List=decall.Request, SiftPattern=mindex.Index)  # -> Output0, Output1, Output2, Output3, Output4, Output5, Output6

text = Text(tool_names)
text_2 = ClusterOutput(text)

# ---- group: compute_comfort_scores
decall_2 = DeconstructToolCall(Request=sift.Output4)  # -> Request, Tool, Arguments
gjok = GetJSONObjectKey(JObject=decall_2.Arguments, Key="layout_json")
gjok_2 = GetJSONObjectKey(JObject=decall_2.Arguments, Key="persona")
gjok_3 = GetJSONObjectKey(JObject=decall_2.Arguments, Key="room_ids")
read_json_value = ReadJSONValue(JValue=gjok)  # -> AsString, AsNumber, AsBool
panel = Panel(gjok)
read_json_value_2 = ReadJSONValue(JValue=gjok_2)  # -> AsString, AsNumber, AsBool
panel_2 = Panel(gjok_2)
read_json_value_3 = ReadJSONValue(JValue=gjok_3)  # -> AsString, AsNumber, AsBool
panel_3 = Panel(gjok_3)
python_3_script = Python3Script(layout_json=read_json_value.AsString, persona=read_json_value_2.AsString, room_ids=read_json_value_3.AsString)  # -> a; inputs layout_json: String, persona: String
# ---------- python_3_script: Python ----------
import json

layout = None
try:
    layout = json.loads(layout_json)
except:
    a = json.dumps({"error": "Invalid layout_json"})

if layout:
    rooms = layout.get("rooms", [])
    persona_str = str(persona).strip() if persona else "Neutral"
    room_ids_str = str(room_ids).strip() if room_ids else "all"
    target_ids = [r.get("id") for r in rooms] if room_ids_str.lower() == "all" else [x.strip() for x in room_ids_str.split(",")]

    BASELINES = {
        "bedroom":     {"thermal":0.75,"visual":0.65,"acoustic":0.70,"spatial":0.65,"olfactory":0.80,"tactile":0.70},
        "living":      {"thermal":0.70,"visual":0.80,"acoustic":0.55,"spatial":0.75,"olfactory":0.70,"tactile":0.65},
        "kitchen":     {"thermal":0.50,"visual":0.70,"acoustic":0.45,"spatial":0.60,"olfactory":0.35,"tactile":0.60},
        "bathroom":    {"thermal":0.60,"visual":0.55,"acoustic":0.70,"spatial":0.45,"olfactory":0.45,"tactile":0.65},
        "circulation": {"thermal":0.65,"visual":0.55,"acoustic":0.65,"spatial":0.50,"olfactory":0.70,"tactile":0.55},
        "dining":      {"thermal":0.65,"visual":0.75,"acoustic":0.55,"spatial":0.65,"olfactory":0.60,"tactile":0.60},
        "utility":     {"thermal":0.55,"visual":0.50,"acoustic":0.60,"spatial":0.50,"olfactory":0.55,"tactile":0.55},
    }

    # Volume norms = area_norm × standard 2.7m ceiling
    VOLUME_NORMS = {
        "bedroom":48.6,"living":81.0,"kitchen":32.4,
        "bathroom":13.5,"circulation":16.2,"dining":40.5,"utility":10.8
    }

    PERSONA_W = {
        "Elderly 65+":      {"thermal":1.2,"visual":1.1,"acoustic":1.3,"spatial":1.0,"olfactory":1.0,"tactile":1.1},
        "Child under 12":   {"thermal":1.0,"visual":1.0,"acoustic":1.1,"spatial":1.2,"olfactory":0.9,"tactile":1.2},
        "Sensory Sensitive":{"thermal":1.3,"visual":1.2,"acoustic":1.4,"spatial":1.1,"olfactory":1.3,"tactile":1.3},
        "Young Active":     {"thermal":0.9,"visual":1.0,"acoustic":0.9,"spatial":1.1,"olfactory":0.9,"tactile":0.9},
        "Neutral":          {"thermal":1.0,"visual":1.0,"acoustic":1.0,"spatial":1.0,"olfactory":1.0,"tactile":1.0},
    }

    # Tactile warmth by material (thermal effusivity-based, from Velt et al. 2012)
    MATERIAL_SCORE = {
        "metal":0.10,"glass":0.20,"concrete":0.25,"stone":0.30,
        "ceramic":0.35,"brick":0.50,"plaster":0.55,"cork":0.70,
        "wood":0.75,"fabric":0.80,"carpet":0.85,"natural":0.75
    }

    ORIENTATION_BONUS = {
        "S":0.05,"SE":0.04,"SW":0.04,
        "E":0.02,"W":0.02,
        "N":-0.03,"NE":-0.02,"NW":-0.02
    }

    weights = PERSONA_W.get(persona_str, PERSONA_W["Neutral"])

    # ── Build door adjacency map ──
    adj = {}
    for d in layout.get("doors", []):
        conn = d.get("attributes", {}).get("connectsRooms", [])
        if len(conn) == 2:
            adj.setdefault(conn[0],[]).append(conn[1])
            adj.setdefault(conn[1],[]).append(conn[0])
    rtype = {r.get("id"): r.get("attributes",{}).get("roomType","living") for r in rooms}

    # ── Build window map: roomId -> list of window attributes ──
    window_map = {}
    for w in layout.get("windows", []):
        wrid = w.get("attributes", {}).get("roomId")
        if wrid:
            window_map.setdefault(wrid, []).append(w.get("attributes", {}))

    # ── Build furniture map: roomId -> list of furniture attribute dicts ──
    SOFT_FURNITURE = {"sofa","bed","armchair","rug","cushion","couch"}
    HARD_FURNITURE = {"table","island","desk","shelf","counter","cabinet","storage","dresser"}
    furniture_by_room = {}
    for f in layout.get("furniture", []):
        frid = f.get("attributes", {}).get("roomId")
        if frid:
            furniture_by_room.setdefault(frid, []).append(f.get("attributes", {}))

    # ── Wall material: global average (walls have no roomId) ──
    wall_mats = [w.get("attributes",{}).get("material","plaster").lower() for w in layout.get("structure",[])]
    wall_mat_scores = [MATERIAL_SCORE.get(m, 0.55) for m in wall_mats if m]
    avg_wall_mat = (sum(wall_mat_scores) / len(wall_mat_scores)) if wall_mat_scores else 0.55

    results = []
    for room in rooms:
        rid = room.get("id")
        if rid not in target_ids:
            continue

        rt          = room.get("attributes",{}).get("roomType","living")
        area        = float(room.get("attributes",{}).get("area", 10))
        height      = float(room.get("attributes",{}).get("height", 2.7))
        orientation = room.get("attributes",{}).get("orientation", "N")
        glaz_ratio  = float(room.get("attributes",{}).get("glazingRatio", 0.10))
        vent_type   = room.get("attributes",{}).get("ventilationType", "natural")

        sc = BASELINES.get(rt, BASELINES["living"]).copy()

        # ── SPATIAL: volume-based ──
        sc["spatial"] = round(min(1.0, (area * height) / VOLUME_NORMS.get(rt, 40.5)), 2)

        # ── ACOUSTIC: adjacency penalty ──
        noisy = sum(1 for x in adj.get(rid,[]) if rtype.get(x) in ["kitchen","living"])
        if noisy:
            sc["acoustic"] = round(max(0.1, sc["acoustic"] - 0.15 * noisy), 2)

        # ── THERMAL: orientation + glazing type ──
        thermal_delta = ORIENTATION_BONUS.get(orientation, 0)
        for win in window_map.get(rid, []):
            gt = win.get("glazingType","double")
            if gt == "single":
                thermal_delta -= 0.08
            elif gt == "triple":
                thermal_delta += 0.05
        sc["thermal"] = round(max(0.0, min(1.0, sc["thermal"] + thermal_delta)), 2)

        # ── VISUAL: glazing ratio ──
        if glaz_ratio < 0.10:
            sc["visual"] = round(max(0.0, sc["visual"] - 0.15), 2)
        elif glaz_ratio >= 0.20:
            sc["visual"] = round(min(1.0, sc["visual"] + 0.08), 2)

        # ── OLFACTORY: ventilation type ──
        vent_delta = {"natural":0.05, "mixed":0.0, "mechanical":-0.05}.get(vent_type, 0)
        sc["olfactory"] = round(max(0.0, min(1.0, sc["olfactory"] + vent_delta)), 2)

        # ── PLANTS: biophilic bonus on visual + olfactory ──
        furn_in_room = furniture_by_room.get(rid, [])
        plant_count = sum(1 for f in furn_in_room if f.get("type","").lower() == "plant")
        if plant_count:
            sc["olfactory"] = round(min(1.0, sc["olfactory"] + 0.08 * plant_count), 2)
            sc["visual"]    = round(min(1.0, sc["visual"]    + 0.05 * plant_count), 2)

        # ── TACTILE: material-based (furniture + wall blend) ──
        mat_scores = []
        for fn in furn_in_room:
            mat   = fn.get("material","").lower()
            ftype = fn.get("type","").lower()
            if mat in MATERIAL_SCORE:
                mat_scores.append(MATERIAL_SCORE[mat])
            elif ftype in SOFT_FURNITURE:
                mat_scores.append(0.75)   # fallback: soft type ≈ wood warmth
            elif ftype in HARD_FURNITURE:
                mat_scores.append(0.45)   # fallback: hard type ≈ cooler
        if mat_scores:
            avg_furn_mat = sum(mat_scores) / len(mat_scores)
            # 50% baseline, 30% furniture material, 20% wall material
            sc["tactile"] = round(min(1.0, sc["tactile"]*0.5 + avg_furn_mat*0.3 + avg_wall_mat*0.2), 2)
        else:
            # No furniture — wall material as minor nudge only
            sc["tactile"] = round(min(1.0, sc["tactile"]*0.8 + avg_wall_mat*0.2), 2)

        # ── PERSONA WEIGHTS ──
        scores = {s: round(min(1.0, v * weights.get(s,1.0)), 2) for s,v in sc.items()}
        overall = round(sum(scores.values()) / 6.0, 2)
        low = [s for s,v in scores.items() if v < 0.5]
        narrative = (
            "Room {} scores {:.2f} for {}. Low comfort in: {}.".format(room.get("name"), overall, persona_str, ", ".join(low))
            if low else
            "Room {} scores {:.2f} for {}. Comfort adequate.".format(room.get("name"), overall, persona_str)
        )
        results.append({
            "roomId":        rid,
            "roomName":      room.get("name"),
            "persona":       persona_str,
            "comfortScores": scores,
            "overallScore":  overall,
            "narrative":     narrative
        })

    a = json.dumps({"layoutId": layout.get("layoutId","?"), "persona": persona_str, "rooms": results})
# ---------- end python_3_script ----------
# Tool 1: compute_comfort_scores
# "The Scorer"
# Takes a layout, a persona, and a list of room IDs. For every room, it looks at the room type and area, checks which rooms are adjacent via doors, and calculates a score between 0 and 1 for each of the 6 senses (thermal, visual, acoustic, spatial, olfactory, tactile). Acoustic scores drop if a room is next to a noisy neighbor (kitchen or living room). Scores are adjusted based on how sensitive the persona is. Returns a full comfort profile per room with an overall score and a plain-language narrative.
create_json_value = CreateJSONValue(Value=python_3_script)
cjo = CreateJSONObject(Keys="result", Values=create_json_value)
respond = MCPToolResponse(Request=decall_2.Request, Content=cjo, IsError=False)

# ---- group: detect_sensorial_conflicts
decall_3 = DeconstructToolCall(Request=sift.Output5)  # -> Request, Tool, Arguments
gjok_4 = GetJSONObjectKey(JObject=decall_3.Arguments, Key="scores_json")
gjok_5 = GetJSONObjectKey(JObject=decall_3.Arguments, Key="persona")
read_json_value_4 = ReadJSONValue(JValue=gjok_4)  # -> AsString, AsNumber, AsBool
panel_4 = Panel(gjok_4)
read_json_value_5 = ReadJSONValue(JValue=gjok_5)  # -> AsString, AsNumber, AsBool
panel_5 = Panel(gjok_5)
python_3_script_2 = Python3Script(scores_json=read_json_value_4.AsString, persona=read_json_value_5.AsString)  # -> a; inputs scores_json: String, persona: String
# ---------- python_3_script_2: Python ----------
import json

scores_data = None
try:
    scores_data = json.loads(scores_json)
except:
    a = json.dumps({"error": "Invalid scores_json — must be the output from compute_comfort_scores"})

if scores_data:
    persona_str = str(persona).strip() if persona else "Neutral"

    THRESHOLDS = {
        "Elderly 65+":      {"thermal":0.60,"visual":0.60,"acoustic":0.65,"spatial":0.50,"olfactory":0.55,"tactile":0.55},
        "Child under 12":   {"thermal":0.50,"visual":0.50,"acoustic":0.55,"spatial":0.60,"olfactory":0.45,"tactile":0.60},
        "Sensory Sensitive":{"thermal":0.65,"visual":0.65,"acoustic":0.70,"spatial":0.55,"olfactory":0.65,"tactile":0.65},
        "Young Active":     {"thermal":0.35,"visual":0.35,"acoustic":0.35,"spatial":0.35,"olfactory":0.35,"tactile":0.35},
        "Neutral":          {"thermal":0.45,"visual":0.45,"acoustic":0.45,"spatial":0.45,"olfactory":0.45,"tactile":0.45},
    }
    thresholds = THRESHOLDS.get(persona_str, THRESHOLDS["Neutral"])

    flagged = []
    for room in scores_data.get("rooms", []):
        scores = room.get("comfortScores", {})
        conflicts = [
            "{} score {:.2f} below threshold {:.2f}".format(s, scores[s], thresholds[s])
            for s in scores if scores[s] < thresholds[s]
        ]
        if conflicts:
            flagged.append({
                "roomId":   room.get("roomId"),
                "roomName": room.get("roomName"),
                "persona":  persona_str,
                "conflicts": conflicts
            })

    a = json.dumps({
        "layoutId":    scores_data.get("layoutId", "?"),
        "persona":     persona_str,
        "totalFlagged": len(flagged),
        "flaggedRooms": flagged
    })
# ---------- end python_3_script_2 ----------
create_json_value_2 = CreateJSONValue(Value=python_3_script_2)
cjo_2 = CreateJSONObject(Keys="result", Values=create_json_value_2)
# Tool 2: detect_sensorial_conflicts
# "The Auditor"
# Takes a layout and a persona. Runs the same scoring logic as Tool 1, then compares each score against that persona's minimum acceptable threshold. If a sense score falls below the threshold, it flags it as a conflict. Returns only the rooms that have at least one problem, listing exactly which senses are failing and by how much. This is the tool that identifies what is wrong.
respond_2 = MCPToolResponse(Request=decall_3.Request, Content=cjo_2, IsError=False)

# ---- group: generate_suggestions
decall_4 = DeconstructToolCall(Request=sift.Output6)  # -> Request, Tool, Arguments
gjok_6 = GetJSONObjectKey(JObject=decall_4.Arguments, Key="persona")
gjok_7 = GetJSONObjectKey(JObject=decall_4.Arguments, Key="conflicts")
read_json_value_6 = ReadJSONValue(JValue=gjok_6)  # -> AsString, AsNumber, AsBool
panel_6 = Panel(gjok_6)
read_json_value_7 = ReadJSONValue(JValue=gjok_7)  # -> AsString, AsNumber, AsBool
panel_7 = Panel(gjok_7)
python_3_script_3 = Python3Script(persona=read_json_value_6.AsString, conflicts=read_json_value_7.AsString)  # -> a; inputs persona: String
# ---------- python_3_script_3: Python ----------
import json

conflicts_data = None
try:
    conflicts_data = json.loads(conflicts)
except:
    a = json.dumps({"error": "Invalid conflicts input"})

if conflicts_data:
    flagged_rooms = conflicts_data.get("flaggedRooms", [])
    persona_str = str(persona).strip() if persona else "Neutral"

    SUGGESTIONS = {
    "thermal":   [
        "Upgrade to double or triple glazing to reduce thermal loss",   # was: "Add thermal mass..."
        "Add thermal mass to stabilize temperature",
        "Add ceiling fan for air circulation"
    ],
    "visual":    [
        "Add larger windows or skylights",
        "Use lighter wall colors",
        "Install task lighting"
    ],
    "acoustic":  [
        "Add rugs and curtains to absorb sound",
        "Install acoustic panels on shared walls",
        "Use solid-core doors"
    ],
    "spatial":   [
        "Remove unnecessary furniture",
        "Use multi-functional furniture",
        "Reorganize layout for better flow"
    ],
    "olfactory": [
        "Upgrade to mixed or mechanical ventilation for active air exchange",   # was: "Improve ventilation..."
        "Add air-purifying plants",
        "Install extraction fan to support natural ventilation"
    ],
    "tactile":   [
        "Add natural material surfaces (wood, cork)",
        "Introduce soft flooring in bare-foot areas",
        "Add textured wall treatments"
    ],
    }
    PRIORITY = {
        "Elderly 65+":      ["acoustic","thermal","visual","spatial","tactile","olfactory"],
        "Child under 12":   ["spatial","tactile","acoustic","visual","thermal","olfactory"],
        "Sensory Sensitive":["acoustic","olfactory","tactile","visual","thermal","spatial"],
        "Young Active":     ["spatial","visual","acoustic","thermal","olfactory","tactile"],
        "Neutral":          ["acoustic","thermal","visual","spatial","olfactory","tactile"],
    }
    priority = PRIORITY.get(persona_str, PRIORITY["Neutral"])

    results = []
    for flagged in flagged_rooms:
        conflict_senses = []
        for c in flagged.get("conflicts", []):
            for s in ["thermal","visual","acoustic","spatial","olfactory","tactile"]:
                if s in c and s not in conflict_senses:
                    conflict_senses.append(s)
        sorted_senses = sorted(conflict_senses, key=lambda s: priority.index(s) if s in priority else 99)
        suggestions = [
            {
                "sense": s,
                "priority": priority.index(s) + 1 if s in priority else 99,
                "suggestion": SUGGESTIONS[s][0],
                "alternatives": SUGGESTIONS[s][1:]
            }
            for s in sorted_senses if s in SUGGESTIONS
        ]
        if suggestions:
            results.append({
                "roomId":   flagged.get("roomId"),
                "roomName": flagged.get("roomName"),
                "persona":  persona_str,
                "suggestions": suggestions
            })

    a = json.dumps({
        "layoutId":            conflicts_data.get("layoutId", "?"),
        "persona":             persona_str,
        "totalRoomsAddressed": len(results),
        "improvements":        results
    })
# ---------- end python_3_script_3 ----------
create_json_value_3 = CreateJSONValue(Value=python_3_script_3)
cjo_3 = CreateJSONObject(Keys="result", Values=create_json_value_3)
# Tool 3: generate_suggestions
# "The Advisor"
# Takes a layout, a persona, and the conflict output from Tool 2. For each flagged room, it reads which senses are in conflict and looks them up in a library of practical improvement suggestions. It then ranks the suggestions according to the persona's priority order — for example, acoustic comfort is the top priority for elderly users, while spatial comfort is top for children. Returns a ranked list of actionable interventions per room. This is the tool that answers what to do about it.
respond_3 = MCPToolResponse(Request=decall_4.Request, Content=cjo_3, IsError=False)

# ---- group: Get the request sent from VSC Agent
decall_5 = DeconstructToolCall(Request=sift.Output3)  # -> Request, Tool, Arguments

# ---- group: Extract the tool call parameters
gjok_8 = GetJSONObjectKey(JObject=decall_5.Arguments, Key="layout_json")
gjok_9 = GetJSONObjectKey(JObject=decall_5.Arguments, Key="room_name")
gjok_10 = GetJSONObjectKey(JObject=decall_5.Arguments, Key="width")
rjv = ReadJSONValue(JValue=gjok_8)  # -> AsString, AsNumber, AsBool

# ---- group: Get a Specific Room
py3 = Python3Script(json_str=rjv.AsString, room_name=gjok_9)  # -> out, a; inputs room_name: String
# ---------- py3: Python ----------
import json
import Rhino.Geometry as rg

# Inputs:
# json_str -> JSON as string
# room_name -> e.g. "Living Room"

def load_json_from_string(json_string):
    try:
        data = json.loads(json_string)
    except Exception as e:
        raise ValueError(f"Invalid JSON string: {e}")
    return data

def create_polyline(points):
    pts = [rg.Point3d(x, y, 0) for x, y in points]

    # Ensure closed
    if pts[0] != pts[-1]:
        pts.append(pts[0])

    return rg.Polyline(pts).ToPolylineCurve()

# Load JSON
data = load_json_from_string(json_str)

# Find the room
room_curve = None

for room in data.get("rooms", []):
    if room.get("name") == room_name:
        geometry = room.get("geometry")
        if geometry:
            room_curve = create_polyline(geometry)
        break

# Output ONLY the polyline
a = room_curve
# ---------- end py3 ----------

# ----
decall_6 = DeconstructToolCall(Request=sift.Output1)  # -> Request, Tool, Arguments
gjok_11 = GetJSONObjectKey(JObject=decall_6.Arguments, Key="layout_json")

read_json_value_8 = ReadJSONValue(JValue=gjok_11)  # -> AsString, AsNumber, AsBool
parse_json_string = ParseJSONString(Text=read_json_value_8.AsString)

gjok_12 = GetJSONObjectKey(JObject=parse_json_string, Key="room_name")
gjok_13 = GetJSONObjectKey(JObject=parse_json_string, Key="rooms")
read_json_array = ReadJSONArray(Array=gjok_13)
gjok_14 = GetJSONObjectKey(JObject=read_json_array, Key="name")
read_json_value_9 = ReadJSONValue(JValue=gjok_12)  # -> AsString, AsNumber, AsBool
read_json_value_10 = ReadJSONValue(JValue=gjok_14)  # -> AsString, AsNumber, AsBool
match_text = MatchText(Text=read_json_value_10.AsString, Pattern=read_json_value_9.AsString, Case="False")
panel_8 = Panel(match_text)
computeroomarea = ComputeRoomArea(jo=read_json_array, cull_pattern=match_text)
number = Number(computeroomarea)
cjv = CreateJSONValue(Value=number)
cjo_4 = CreateJSONObject(Keys="area", Values=cjv)
panel_9 = Panel(cjo_4)
respond_4 = MCPToolResponse(Request=decall_6.Request, Content=cjo_4, IsError=False)

decall_7 = DeconstructToolCall(Request=sift.Output0)  # -> Request, Tool, Arguments
gjok_15 = GetJSONObjectKey(JObject=decall_7.Arguments, Key="layout_json")

read_json_value_11 = ReadJSONValue(JValue=gjok_15)  # -> AsString, AsNumber, AsBool
panel_10 = Panel(gjok_15)
parse_json_string_2 = ParseJSONString(Text=read_json_value_11.AsString)

gjok_16 = GetJSONObjectKey(JObject=parse_json_string_2, Key="rooms")
read_json_array_2 = ReadJSONArray(Array=gjok_16)
gjok_17 = GetJSONObjectKey(JObject=read_json_array_2, Key="geometry")
read_json_array_3 = ReadJSONArray(Array=gjok_17)
read_json_array_4 = ReadJSONArray(Array=read_json_array_3)
read_json_value_12 = ReadJSONValue(JValue=read_json_array_4)  # -> AsString, AsNumber, AsBool
list_item = ListItem(List=read_json_value_12.AsNumber, Index=0, Wrap=True)  # -> Item, Item1
construct_point = ConstructPoint(XCoordinate=list_item.Item, YCoordinate=list_item.Item1, ZCoordinate=0)
shift_paths = ShiftPaths(Data=construct_point, Offset=-1)
polyline = PolyLine(Vertices=shift_paths, Closed=False)
area = Area(Geometry=polyline)  # -> Area, Centroid
mass_addition = MassAddition(Input=flatten(area.Area))  # -> Result, PartialResults
cjv_2 = CreateJSONValue(Value=mass_addition.Result)
cjo_5 = CreateJSONObject(Keys="area", Values=cjv_2)
respond_5 = MCPToolResponse(Request=decall_7.Request, Content=cjo_5, IsError=False)

decall_8 = DeconstructToolCall(Request=sift.Output2)  # -> Request, Tool, Arguments

gjok_18 = GetJSONObjectKey(JObject=decall_8.Arguments, Key="layout_json")
gjok_19 = GetJSONObjectKey(JObject=decall_8.Arguments, Key="furniture_name")
panel_11 = Panel(gjok_19)
rjv_2 = ReadJSONValue(JValue=gjok_19)  # -> AsString, AsNumber, AsBool

rjv_3 = ReadJSONValue(JValue=gjok_18)  # -> AsString, AsNumber, AsBool

panel_12 = Panel(rjv_3.AsString)

# ---- group: Delete Furniture by name
py3_2 = Python3Script(json_str=rjv_3.AsString, furniture_name=rjv_2.AsString)  # -> out, a; inputs furniture_name: String
# ---------- py3_2: Python ----------
import json
import copy

# Inputs:
# json_str -> JSON as string
# furniture_name -> e.g. "Master Bed"

def load_json_from_string(json_string):
    try:
        data = json.loads(json_string)
    except Exception as e:
        raise ValueError(f"Invalid JSON string: {e}")
    return data

# Load JSON
data = load_json_from_string(json_str)

# Work on a copy
filtered = copy.deepcopy(data)

# ------------------------
# 1. Find furniture IDs to remove
# ------------------------
ids_to_remove = set()

for furniture in filtered.get("furniture", []):
    if furniture.get("name") == furniture_name:
        ids_to_remove.add(furniture.get("id"))

# ------------------------
# 2. Remove from furniture
# ------------------------
filtered["furniture"] = [
    f for f in filtered.get("furniture", [])
    if f.get("id") not in ids_to_remove
]

# ------------------------
# Output ONLY as string
# ------------------------
a = json.dumps(filtered, indent=2)
# ---------- end py3_2 ----------

# ----
panel_13 = Panel(py3_2.a)

pjs = ParseJSONString(Text=py3_2.a)
respond_6 = MCPToolResponse(Request=decall_8.Request, Content=pjs, IsError=False)

stringify_json_token = StringifyJSONToken(JToken=pjs)
text_3 = ClusterOutput(stringify_json_token)

rjv_4 = ReadJSONValue(JValue=gjok_10)  # -> AsString, AsNumber, AsBool
division = Division(A=rjv_4.AsNumber, B="2")

# ---- group: Design Logic to Add a Window
room_polyline = Data(py3.a)
debrep = DeconstructBrep(Brep=room_polyline)  # -> Faces, Edges, Vertices
item = ListItem(List=debrep.Edges, Index=0, Wrap=True)
X = UnitX(Factor=division)
midpt = CurveMiddle(Curve=item)
move = Move(Geometry=midpt, Motion=expr("-x", X))  # -> Geometry, Transform
move_2 = Move(Geometry=midpt, Motion=X)  # -> Geometry, Transform
merge = Merge(Data1=move_2.Geometry, Data2=move.Geometry)

# ---- group: Creates a Window Object
txt = Text(merge)
window_object = Python3Script(element_id="window-1", name="South Window", geometry=txt)  # -> out, window_obj; inputs element_id: String, geometry: list
# ---------- window_object: Python ----------
import json

def parse_point_string(pt_str):
    """
    Converts '{3.5, 0, 0}' -> [3.5, 0.0]
    """
    # Remove braces and spaces
    cleaned = pt_str.strip().replace("{", "").replace("}", "")
    
    # Split into components
    parts = cleaned.split(",")
    
    if len(parts) < 2:
        raise ValueError(f"Invalid point format: {pt_str}")
    
    x = float(parts[0])
    y = float(parts[1])
    
    return [x, y]

def serialize_geometry(geometry_list):
    """
    Converts list of GH strings into [[x,y], [x,y]]
    """
    return [parse_point_string(pt) for pt in geometry_list]

# ------------------------
# Convert geometry
# ------------------------
serialized_geometry = serialize_geometry(geometry)

# Build window object
window_obj = {
    "id": element_id,
    "name": name,
    "geometry": serialized_geometry
}

# Optional attributes
if attributes:
    window_obj["attributes"] = attributes

# Output ONLY as JSON string
window_obj = json.dumps(window_obj, indent=2)
# ---------- end window_object ----------

# ---- group: Merge it to the original layout json
py3_3 = Python3Script(json_str=rjv.AsString, new_object=window_object.window_obj)  # -> out, updated_layout
# ---------- py3_3: Python ----------
import json
import copy

def load_json_from_string(json_string):
    try:
        return json.loads(json_string)
    except Exception as e:
        raise ValueError(f"Invalid JSON string: {e}")

def detect_object_type(obj):
    """
    Infer target list from object id prefix.
    """
    obj_id = obj.get("id", "").lower()

    if obj_id.startswith("window"):
        return "windows"
    elif obj_id.startswith("door"):
        return "doors"
    elif obj_id.startswith("furn") or obj_id.startswith("furniture"):
        return "furniture"
    elif obj_id.startswith("mep"):
        return "mep"
    elif obj_id.startswith("wall") or obj_id.startswith("structure"):
        return "structure"
    else:
        # default fallback (safe choice)
        return "windows"

# ------------------------
# Load inputs
# ------------------------
layout = load_json_from_string(json_str)
new_object = json.loads(new_object)  # assuming object comes as JSON string

# Work on copy
updated = copy.deepcopy(layout)

# ------------------------
# Detect target category
# ------------------------
target_key = detect_object_type(new_object)

# ------------------------
# Ensure list exists
# ------------------------
if target_key not in updated:
    updated[target_key] = []

# ------------------------
# Insert object
# ------------------------
updated[target_key].append(new_object)

# ------------------------
# Output JSON string
# ------------------------
updated_layout = json.dumps(updated, indent=2)
# ---------- end py3_3 ----------

# ----
pjs_2 = ParseJSONString(Text=py3_3.updated_layout)
respond_7 = MCPToolResponse(Request=decall_5.Request, Content=pjs_2, IsError=False)

or = GateOr(A=respond_5, B=respond_4, E=respond_6, D=respond_7, F=respond, G=respond_2, H=respond_3)
R_2 = ClusterOutput(or)

# ==== cluster Cluster
panel = Panel("SON string of detected conflicts from detect_sensorial_conflicts")
panel_2 = Panel("comma-separated room IDs to analyze, or 'all' for all rooms")
panel_3 = Panel("Computes multi-sensory comfort scores for each room across thermal, visual, acoustic, spatial, olfactory, and tactile dimensions for a given persona.")
panel_4 = Panel("Detects rooms where comfort falls below persona thresholds and identifies which senses are in conflict and why.")
panel_5 = Panel("Generates ranked actionable improvement suggestions for rooms with sensory conflicts, tailored to the user persona.")
# SUPPORTING TOOLS
panel_6 = Panel("Computes the area of the full given layout.")
panel_7 = Panel("Computes the area of the a room given layout and room name.")
panel_8 = Panel("Given room name, layout and furniture name, removes the element from the layout.")
# MAIN TOOLS
toggle = BooleanToggle(True)
panel_9 = Panel("This tool adds a window by giving it a room name and the layout json")
param = DefineToolParameter(Name="layout_json", Type="string", Description="the layout data structure", Required=Toggle(True))
param_2 = DefineToolParameter(Name="room_ids", Type="string", Description=panel_2, Required=Toggle(True))
param_3 = DefineToolParameter(Name="scores_json", Type="string", Description="the layout data structure", Required=Toggle(True))
param_4 = DefineToolParameter(Name="persona", Type="string", Description="the user persona e.g. Elderly 65+", Required=Toggle(True))
param_5 = DefineToolParameter(Name="persona", Type="string", Description="the user persona e.g. Elderly 65+", Required=Toggle(True))
param_6 = DefineToolParameter(Name="persona", Type="string", Description="the user persona e.g. Elderly 65+", Required=Toggle(True))
param_7 = DefineToolParameter(Name="conflicts", Type="string", Description=panel, Required=Toggle(True))
param_8 = DefineToolParameter(Name="room_name", Type="string", Description="the name of the room", Required=Toggle(False))
param_9 = DefineToolParameter(Name="layout_json", Type="string", Description="the layout data structure", Required=Toggle(True))
param_10 = DefineToolParameter(Name="furniture_name", Type="string", Description="the name of the furniture piece", Required=Toggle(True))
param_11 = DefineToolParameter(Name="room_name", Type="string", Description="the name of the room", Required=Toggle(True))
param_12 = DefineToolParameter(Name="width", Type="number", Description="The width of the window", Required=Toggle(True))
param_13 = DefineToolParameter(Name="layout_json", Type="string", Description="the layout data structure", Required=toggle)
param_14 = DefineToolParameter(Name="layout_json", Type="string", Description="the layout data structure", Required=Toggle(True))
param_15 = DefineToolParameter(Name="layout_json", Type="string", Description="the layout data structure", Required=Toggle(True))
param_16 = DefineToolParameter(Name="room_name", Type="string", Description="the name of the room", Required=Toggle(True))
merge = Merge(Data1=param_6, Data2=param_7)
merge_2 = Merge(Data1=param_8, Data2=param_9, Data3=param_10)
merge_3 = Merge(Data1=param_11, Data2=param_12, Data3=param_13)
merge_4 = Merge(Data1=param_3, Data2=param_5)
merge_5 = Merge(Data1=param_15, Data2=param_16)
merge_6 = Merge(Data1=param, Data2=param_4, Data3=param_2)
tool = DefineTool(Name="compute_total_area", Description=panel_6, Parameters=param_14)
tool_2 = DefineTool(Name="compute_room_area", Description=panel_7, Parameters=merge_5)
tool_3 = DefineTool(Name="remove_furniture_piece", Description=panel_8, Parameters=merge_2)
tool_4 = DefineTool(Name="add_window_01", Description=panel_9, Parameters=merge_3)
tool_5 = DefineTool(Name="compute_comfort_scores", Description=panel_3, Parameters=merge_6)
tool_6 = DefineTool(Name="detect_sensorial_conflicts", Description=panel_4, Parameters=merge_4)
tool_7 = DefineTool(Name="generate_suggestions", Description=panel_5, Parameters=merge)
merge_7 = Merge(Data1=tool, Data2=tool_2, Data3=tool_3, Data4=tool_4, Data5=tool_5, Data6=tool_6, Data7=tool_7)
R = ClusterOutput(merge_7)

# ==== cluster ComputeRoomArea
jo = ClusterInput()
cull_pattern = ClusterInput()
gjok = GetJSONObjectKey(JObject=jo, Key="geometry")
cull_pattern_2 = CullPattern(List=gjok, CullPattern=cull_pattern)
read_json_array = ReadJSONArray(Array=cull_pattern_2)
read_json_array_2 = ReadJSONArray(Array=read_json_array)
read_json_value = ReadJSONValue(JValue=read_json_array_2)  # -> AsString, AsNumber, AsBool
list_item = ListItem(List=read_json_value.AsNumber, Index=0, Wrap=True)  # -> Item, Item1
construct_point = ConstructPoint(XCoordinate=list_item.Item, YCoordinate=list_item.Item1, ZCoordinate=0)
shift_paths = ShiftPaths(Data=construct_point, Offset=-1)
polyline = PolyLine(Vertices=shift_paths, Closed=False)
area = Area(Geometry=polyline)  # -> Area, Centroid
area_2 = ClusterOutput(area.Area)
