# Grasshopper definition team_03_collision_detector_Ramon.gh (Grasshopper 1.0.8)
# plug-ins: Human, Swiftlet

# ----
# CLUSTER 01 -  Team 03 Definition Cluster
panel = Panel("location of a point in a normalized polyline lenght, values form 0.00 to 1.00")
panel_2 = Panel("This tool detects collisions by a moving sphere traveling along a polyline, automatically adjusting its radius based on the current segment while performing real-time collision detection against obstacles. When collisions occur, the sphere turns red and displays a warning message. The system dynamically adapts to polyline changes, recalculating all parameters whenever segments are added or modified.")
param = DefineToolParameter(Name="sphere_radius_list", Type="number", Description="radius of the sphere", Required=Toggle(True))
param_2 = DefineToolParameter(Name="point_in_path", Type="number", Description=panel, Required=Toggle(True))
merge = Merge(Data1=param, Data2=param_2)
tool = DefineTool(Name="collision_detector_sphere", Description=panel_2, Parameters=merge)

decall = DeconstructToolCall()  # -> Request, Tool, Arguments
gjok = GetJSONObjectKey(JObject=decall.Arguments, Key="point_in_path")
gjok_2 = GetJSONObjectKey(JObject=decall.Arguments, Key="sphere_radius_list")
rjv = ReadJSONValue(JValue=gjok)  # -> AsString, AsNumber, AsBool
rjv_2 = ReadJSONValue(JValue=gjok_2)  # -> AsString, AsNumber, AsBool

path_curve_polyline = Curve(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)
explode = Explode(Curve=reparameterize(path_curve_polyline), Recursive=True)  # -> Segments, Vertices
len = Length(Curve=explode.Segments)
ma = MassAddition(Input=len)  # -> Result, PartialResults
division = Division(A=ma.PartialResults, B=ma.Result)
panel_3 = Panel("""2.5
2
1""")

# ----
# CLUSTER 01 -  Team 03 Result Cluster
num = Number(Slider(0, range=0..1))
num_2 = Number(panel_3)

larger = LargerThan(FirstNumber=num, SecondNumber=division)  # -> LargerThan, OrEqualTo
eval = EvaluateCurve(Curve=reparameterize(path_curve_polyline), Parameter=num)  # -> Point, Tangent, Angle
ma_2 = MassAddition(Input=larger.LargerThan)  # -> Result, PartialResults
item = ListItem(List=reverse(num_2), Index=ma_2.Result, Wrap=True)

multiplication = Multiplication(A=item, B="2")

sph = Sphere(Base=eval.Point, Radius=multiplication)
mesh = MeshBrep(
    Brep=sph,
    Settings={GridMaxCount=0, GridMinCount=16, JaggedSeams=False, MaxEdgeLength=0, MinEdgeLength=0.0001, MinTolerance=0, Refine=True, RefineAngle=0, RelativeTolerance=0.65, SimplePlanes=True, Tolerance=0})
brep = Brep([<brep referenced from the Rhino model> x3])
mmx = MeshMesh(MeshA=mesh, MeshB=brep)  # -> flatten(Intersections)
lng = ListLength(List=mmx)
larger_2 = LargerThan(FirstNumber=lng, SecondNumber="1")  # -> LargerThan, OrEqualTo

filter = StreamFilter(Gate=larger_2.OrEqualTo, Stream0="\"accessible\"", Stream1="\"collision detected, please fix\"")

filter_2 = StreamFilter(
    Gate=larger_2.OrEqualTo,
    Stream0=ColourSwatch(SwatchColor=RGB(56, 224, 0)),
    Stream1=ColourSwatch(SwatchColor=RGB(224, 0, 0)))
preview = CustomPreview(Geometry=sph, Material=filter_2)

panel_4 = Panel(filter)

texttoscreen = RenderTextToScreen(Text=panel_4, Location="200,150", Size=Slider(25, range=0..100), Color=RGB(0, 0, 0), m_scWithvp=False)

cjv = CreateJSONValue(Value=panel_4)
cjo = CreateJSONObject(Keys="status", Values=cjv)
respond = MCPToolResponse(Content=cjo, IsError=False)
