# Grasshopper definition team_03_working.gh (Grasshopper 1.0.8)
# plug-ins: Pufferfish, Swiftlet

# ----
# Connect MCP Tools to Decall and Update All Clusters
# IF SOMETHING IS NOT
# WORKING PRESS THIS
# BUTTON FIRST
toggle = BooleanToggle(True)
button = Button()
connect_mcp_tools_to_decall = CSharpScript(nickname_From="Central MCP Server", nickname_To="Central DeCall", connect=button)  # -> out; inputs nickname_From: String, nickname_To: String, connect: Boolean
# ---------- connect_mcp_tools_to_decall: C# ----------
using System;
using System.Linq;
using Grasshopper;
using Grasshopper.Kernel;

public class Script_Instance : GH_ScriptInstance
{
    private void RunScript(string nickname_From, string nickname_To, bool connect)
    {
        if (!connect) return;
        Console.Write($"Attempting to connect outputs from '{nickname_From}' to '{nickname_To}'...");

        var ghDoc = Instances.ActiveCanvas?.Document;
        if (ghDoc == null) return;

        var compFrom = ghDoc.Objects
            .OfType<IGH_Component>()
            .FirstOrDefault(o => o.NickName == nickname_From);

        var compTo = ghDoc.Objects
            .OfType<IGH_Param>()
            .FirstOrDefault(o => o.NickName == nickname_To);

        if (compFrom != null && compTo != null)
        {
            ghDoc.ScheduleSolution(5, doc => Connect(doc, compFrom, compTo));
        }
    }

    // <Custom additional code> 
    private void Connect(GH_Document doc, IGH_Component compFrom, IGH_Param compTo)
    {
        if (compFrom == null || compTo == null) return;

        foreach (IGH_Param param in compFrom.Params.Output)
        {
            compTo.AddSource(param);
        }
    }
}
# ---------- end connect_mcp_tools_to_decall ----------
update_all_clusters = CSharpScript(update=button, recursive=toggle)  # -> out, A; inputs update: Boolean, recursive: Boolean, passwords: list of String, localPath: String
# ---------- update_all_clusters: C# ----------
using System;
using System.Collections;
using System.Collections.Generic;

using Rhino;
using Rhino.Geometry;

using Grasshopper;
using Grasshopper.Kernel;
using Grasshopper.Kernel.Data;
using Grasshopper.Kernel.Types;
using System.Windows.Forms;
using System.Linq;
/// <summary>
/// This class will be instantiated on demand by the Script component.
/// </summary>
public class Script_Instance : GH_ScriptInstance
{
  /// <summary>Print a String to the [Out] Parameter of the Script component.</summary>
  /// <param name="text">String to print.</param>
  private void Print(string text) { /* Implementation hidden. */ }
  /// <summary>Print a formatted String to the [Out] Parameter of the Script component.</summary>
  /// <param name="format">String format.</param>
  /// <param name="args">Formatting parameters.</param>
  private void Print(string format, params object[] args) { /* Implementation hidden. */ }
  /// <summary>Print useful information about an object instance to the [Out] Parameter of the Script component. </summary>
  /// <param name="obj">Object instance to parse.</param>
  private void Reflect(object obj) { /* Implementation hidden. */ }
  /// <summary>Print the signatures of all the overloads of a specific method to the [Out] Parameter of the Script component. </summary>
  /// <param name="obj">Object instance to parse.</param>
  private void Reflect(object obj, string method_name) { /* Implementation hidden. */ }

  /// <summary>Gets the current Rhino document.</summary>
  private readonly RhinoDoc RhinoDocument;
  /// <summary>Gets the Grasshopper document that owns this script.</summary>
  private readonly GH_Document GrasshopperDocument;
  /// <summary>Gets the Grasshopper script component that owns this script.</summary>
  private readonly IGH_Component Component;
  /// <summary>
  /// Gets the current iteration count. The first call to RunScript() is associated with Iteration==0.
  /// Any subsequent call within the same solution will increment the Iteration count.
  /// </summary>
  private readonly int Iteration;

  /// <summary>
  /// This procedure contains the user code. Input parameters are provided as regular arguments,
  /// Output parameters as ref arguments. You don't have to assign output parameters,
  /// they will have a default value.
  /// </summary>
  private void RunScript(
		bool update,
		bool recursive,
		List<string> passwords,
		string localPath,
		ref object A)
  {

    A = updateLog;
    if (update)
    {
      updateLog = new List<string>();
      _passwords = passwords;
      UpdateClusters(GrasshopperDocument, recursive, localPath);
    }

  }

  // <Custom additional code> 
  List<string> updateLog;
  List<String> _passwords;

  void UpdateClusters (GH_Document ghDoc, bool recursive, string localPath)
  {
    foreach (var obj in ghDoc.Objects)
    {
      var cluster = obj as Grasshopper.Kernel.Special.GH_Cluster;
      if (cluster != null)
      {
        var clusterPath = cluster.FilePath;
        if (!string.IsNullOrEmpty(clusterPath))
        {
          if (cluster.Synchronisation == Grasshopper.Kernel.Special.GH_Synchronisation.OutOfDate)
          {
            cluster.CreateFromFilePath(clusterPath);
            updateLog.Add("Updated: " + clusterPath);
          }
          else if (cluster.Synchronisation == Grasshopper.Kernel.Special.GH_Synchronisation.MissingReference)
          {
            string newPath = ReplacePath(localPath, clusterPath);
            if (!string.IsNullOrEmpty(newPath))
            {
              cluster.CreateFromFilePath(newPath);
              updateLog.Add("Replaced and updated: " + newPath);
            }
            else
            {
              updateLog.Add("Missing reference: " + clusterPath);
            }

          }
        }

        //Update recursively
        if (recursive)
        {
          GH_Document clusterDoc = GetClusterDoc(cluster);
          if (clusterDoc != null)
            UpdateClusters(clusterDoc, recursive, localPath);
        }
      }
    }
  }

  GH_Document GetClusterDoc(Grasshopper.Kernel.Special.GH_Cluster cluster)
  {
    //no pass needed
    var doc = cluster.Document(string.Empty);
    if (doc != null)
      return doc;

    //try passwords
    if (_passwords != null && _passwords.Any())
    {
      foreach (var pass in _passwords)
      {
        doc = cluster.Document(pass);
        if (doc != null)
          return doc;
      }
    }

    return null;
  }

  string ReplacePath(string localPath, string missingPath)
  {
    if (String.IsNullOrEmpty(missingPath) || string.IsNullOrEmpty(localPath))
      return null;
    else
    {
      string lastLocalPart = localPath.Split('\\').Last();
      string[] parts = missingPath.Split('\\');
      if (parts.Contains(lastLocalPart))
      {
        int i = Array.IndexOf(parts, lastLocalPart);
        string clusterPath = String.Join("\\", parts.Skip(i + 1));
        string result = String.Join("\\", localPath, clusterPath);
        return result;
      }
      else
        return null;
    }
  }
  // </Custom additional code> 
}
# ---------- end update_all_clusters ----------
panel = Panel(connect_mcp_tools_to_decall)

team_03_definition_cluster = Team03DefinitionCluster()
c_script = CSharpScript()  # -> out, availablePort
# ---------- c_script: C# ----------
// Grasshopper Script Instance
// This script finds an available port on the local machine.
#region Usings
using System;
using System.Linq;
using System.Collections;
using System.Collections.Generic;
using System.Drawing;
using System.Net;
using System.Net.Sockets;

using Rhino;
using Rhino.Geometry;

using Grasshopper;
using Grasshopper.Kernel;
using Grasshopper.Kernel.Data;
using Grasshopper.Kernel.Types;
#endregion

public class Script_Instance : GH_ScriptInstance
{
    #region Notes
    /* 
      Members:
        RhinoDoc RhinoDocument
        GH_Document GrasshopperDocument
        IGH_Component Component
        int Iteration

      Methods (Virtual & overridable):
        Print(string text)
        Print(string format, params object[] args)
        Reflect(object obj)
        Reflect(object obj, string method_name)
    */
    #endregion

    private void RunScript(object start, object end, ref object availablePort)
    {
        // Use default values if parameters are not provided
        int startPort = (start != null && int.TryParse(start.ToString(), out int s)) ? s : 3001;
        int endPort = (end != null && int.TryParse(end.ToString(), out int e)) ? e : 3100;

        // Find an available port in the specified range
        try
        {
            availablePort = FindAvailablePortInRange(startPort, endPort);
            Print($"Available port found: {availablePort}");
        }
        catch (Exception ex)
        {
            Print($"Error: {ex.Message}");
            availablePort = null;
        }
    }

    /// <summary>
    /// Checks if a local TCP port is available for binding (i.e., not in use).
    /// Returns True if available, False otherwise.
    /// </summary>
    private bool IsPortAvailableForBind(int port)
    {
        try
        {
            // Create a new TCP socket
            using (Socket socket = new Socket(AddressFamily.InterNetwork, SocketType.Stream, ProtocolType.Tcp))
            {
                // Try to bind to the port on all interfaces (0.0.0.0)
                socket.Bind(new IPEndPoint(IPAddress.Any, port));
                // If successful, the socket is closed by the using statement and return True
                return true;
            }
        }
        catch (SocketException)
        {
            // If binding fails, it means the port is already in use
            return false;
        }
    }

    /// <summary>
    /// Finds an available port by letting the OS assign one.
    /// </summary>
    private int FindAvailablePort()
    {
        Socket socket = new Socket(AddressFamily.InterNetwork, SocketType.Stream, ProtocolType.Tcp);
        socket.Bind(new IPEndPoint(IPAddress.Any, 0)); // Bind to an available port assigned by the OS
        int availablePort = ((IPEndPoint)socket.LocalEndPoint).Port; // Get the assigned port number
        socket.Close(); // Close the socket
        return availablePort;
    }

    /// <summary>
    /// Finds the first available port in a given range.
    /// </summary>
    private int FindAvailablePortInRange(int start = 3001, int end = 3100)
    {
        for (int port = start; port <= end; port++)
        {
            if (IsPortAvailableForBind(port))
                return port;
        }
        throw new Exception($"No available ports found in the range {start}-{end}.");
    }
}
# ---------- end c_script ----------
panel_2 = Panel(team_03_definition_cluster)

panel_3 = Panel("../layout/layout_residential_complex.json")
panel_4 = Panel("../layout/residential_100")
panel_5 = Panel("../layout/industrial_100")

panel_6 = Panel("../layout/industrial_100/industrial_03.json")
get_tool_names = CSharpScript(x=team_03_definition_cluster)  # -> flatten(out)
# ---------- get_tool_names: C# ----------
// Grasshopper Script Instance
#region Usings
using System;
using System.Linq;
using System.Collections;
using System.Collections.Generic;
using System.Drawing;

using Rhino;
using Rhino.Geometry;

using Grasshopper;
using Grasshopper.Kernel;
using Grasshopper.Kernel.Data;
using Grasshopper.Kernel.Types;
#endregion

public class Script_Instance : GH_ScriptInstance
{
    #region Notes
    /* 
      Members:
        RhinoDoc RhinoDocument
        GH_Document GrasshopperDocument
        IGH_Component Component
        int Iteration

      Methods (Virtual & overridable):
        Print(string text)
        Print(string format, params object[] args)
        Reflect(object obj)
        Reflect(object obj, string method_name)
    */
    #endregion

    private void RunScript(object x)
    {
        dynamic dynamicX = x;
        Console.Write(dynamicX.Name);
    }
}
# ---------- end get_tool_names ----------
central_mcp_server = MCPServer(Port=c_script.availablePort, Tools=team_03_definition_cluster, ServerName="Swiftlet")  # -> Visualize_visibility, Visualize_paths, Place_objects, CollisionDetectorGrid, Set_viewport, Move_object, Set_observer
panel_7 = Panel(c_script.availablePort)
panel_8 = Panel(central_mcp_server.Visualize_visibility)
central_decall = Data([central_mcp_server.Visualize_visibility, central_mcp_server.Visualize_paths, central_mcp_server.Place_objects, central_mcp_server.CollisionDetectorGrid, central_mcp_server.Set_viewport, central_mcp_server.Move_object])

# ---- group: ADD HERE YOUR RELATIVE PATH
# this script automates the extraction from the repo without the need of changing the code depending on the computer where it's located.
py3 = Python3Script(relative_path="../layout/industrial_100/industrial_03.json")  # -> out, json_string, full_path, info; inputs relative_path: String
# ---------- py3: Python ----------
"""
GHPython component: Read layout JSON files using paths relative to the .gh file.

INPUTS:
    relative_path  (str)  - Relative path to a single JSON file.
                            Example: "../layout/layout_residential_complex.json"
    folder_path    (str)  - Relative path to a folder containing JSON files.
                            Example: "../layout"

OUTPUTS:
    json_strings  (list)  - List of JSON strings (one per file loaded).
    file_names    (list)  - List of file names corresponding to each JSON string.
    full_paths    (list)  - List of resolved absolute paths (for debugging).
    info          (str)   - Status message.
"""

import os
import json
import glob as globmod

# ---- Read inputs directly (no eval) ----
rel = None
try:
    if relative_path is not None and str(relative_path).strip() != "":
        rel = str(relative_path).strip()
except NameError:
    pass

folder = None
try:
    if folder_path is not None and str(folder_path).strip() != "":
        folder = str(folder_path).strip()
except NameError:
    pass

# ---- Outputs (match GHPython component output names) ----
json_string = []
full_path = []
info = ""

print("DEBUG rel: {}".format(rel))
print("DEBUG folder: {}".format(folder))

if rel is None and folder is None:
    info = "[ERROR] Connect 'relative_path' (single file) or 'folder_path' (all JSONs in folder)"
else:
    try:
        gh_file = ghenv.Component.OnPingDocument().FilePath
        if gh_file is None or gh_file == "":
            info = "[ERROR] Save the .gh file first."
        else:
            gh_folder = os.path.dirname(gh_file)
            errors = []
            loaded = 0

            # --- Single file ---
            if rel is not None:
                resolved = os.path.normpath(os.path.join(gh_folder, rel))
                if not os.path.isfile(resolved):
                    errors.append("File not found: {}".format(resolved))
                else:
                    with open(resolved, "r") as f:
                        text = f.read()
                    json.loads(text)
                    json_string.append(text)
                    full_path.append(resolved)
                    loaded += 1

            # --- Folder ---
            if folder is not None:
                resolved_folder = os.path.normpath(os.path.join(gh_folder, folder))
                if not os.path.isdir(resolved_folder):
                    errors.append("Folder not found: {}".format(resolved_folder))
                else:
                    pattern = os.path.join(resolved_folder, "*.json")
                    files = sorted(globmod.glob(pattern))
                    if len(files) == 0:
                        errors.append("No .json files in: {}".format(resolved_folder))
                    else:
                        for fp in files:
                            try:
                                with open(fp, "r") as f:
                                    text = f.read()
                                json.loads(text)
                                json_string.append(text)
                                full_path.append(fp)
                                loaded += 1
                            except Exception as e:
                                errors.append("{}: {}".format(os.path.basename(fp), e))

            # --- Build info ---
            parts = []
            if loaded > 0:
                names = [os.path.basename(p) for p in full_path]
                parts.append("[OK] Loaded {} file(s): {}".format(loaded, ", ".join(names)))
            if errors:
                parts.append("[ERRORS] " + " | ".join(errors))
            info = "\n".join(parts)

    except Exception as e:
        info = "[ERROR] {}".format(e)
# ---------- end py3 ----------

# ----
py3_2 = Python3Script(relative_path="../output\industrial_03_2026-05-24_15-20_final.json")  # -> out, json_string, full_path, info; inputs relative_path: String; same code as py3
panel_9 = Panel(central_decall)
clean = CleanTree(RemoveNulls=True, RemoveInvalid=True, RemoveEmpty=False, Tree=central_decall)
panel_10 = Panel(clean)
team_03_result_cluster = Team03ResultCluster(tool_call_request=clean)  # -> tool_names_3, tool_call_success, furniture_names, room_names

# ----
# Tool Names from the Results Clusters
# Tool Names from the Definition Clusters
# These Two Clusters should be EXACTLY THE SAME
panel_11 = Panel(get_tool_names)
panel_12 = Panel(team_03_result_cluster.tool_names_3)

# ---- group: 0 = Before, 1= After
number_slider = Slider(0, range=0..1)

# ----
preview = CustomPreview(Geometry=team_03_result_cluster.room_names, Material=ColourSwatch(SwatchColor=RGB(255, 0, 0)))
rec = DataRecorder(clean, DataLimit=-10, RecordData=True)
rec_2 = DataRecorder(team_03_result_cluster.tool_call_success, DataLimit=-10, RecordData=True)

# ---- group: Request Parameters
decall = DeconstructToolCall(Request=clean)  # -> Request, Tool, Arguments
rjo = ReadJSONObject(JObject=decall.Arguments)  # -> Keys, JTokens
tmatch = MatchText(Text=rjo.Keys, Pattern="room_name", Case=True)
tmatch_2 = MatchText(Text=rjo.Keys, Pattern="layout_json", Case=True)
# Debug: Check request input data
dispatch = Dispatch(List=rjo.JTokens, DispatchPattern=tmatch)  # -> ListA, ListB
dispatch_2 = Dispatch(List=rjo.JTokens, DispatchPattern=tmatch_2)  # -> ListA, ListB
panel_13 = Panel(dispatch.ListA)
panel_14 = Panel(dispatch_2.ListA)

# ----
# Visualize Layout from JSON: Before and After
filter = StreamFilter(Gate=number_slider, Stream0=py3.json_string, Stream1=py3_2.json_string)

response_ok = Panel(rec_2)
called_tool_name = Panel(rec)

# ---- group: Extractor Tool do map json to grasshopper data
extractor = Python3Script(json_str=filter)  # -> out, outline_curve, room_names, room_curves, door_names, door_curves, window_names, window_curves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
# ---------- extractor: Python ----------
import json
import Rhino.Geometry as rg

# ---------------------------------------------------------------------------
# Helpers
# ---------------------------------------------------------------------------
def create_polyline(points, close=True):
    pts = [rg.Point3d(x, y, 0) for x, y in points]
    if close and pts[0] != pts[-1]:
        pts.append(pts[0])
    return rg.Polyline(pts).ToPolylineCurve()

def create_line(points):
    if len(points) != 2:
        return None
    p1 = rg.Point3d(points[0][0], points[0][1], 0)
    p2 = rg.Point3d(points[1][0], points[1][1], 0)
    return rg.LineCurve(p1, p2)

# ---------------------------------------------------------------------------
# Initialize all outputs (so they always exist)
# ---------------------------------------------------------------------------
a = b = c = d = e = f = g = h = i = j = k = l = []
m = None
info = ""

# ---------------------------------------------------------------------------
# Validate input
# ---------------------------------------------------------------------------
try:
    _input = json_str
except NameError:
    _input = None

# If input is a list, take the first item
if isinstance(_input, list):
    _input = _input[0] if len(_input) > 0 else None

if _input is None or str(_input).strip() == "":
    print("[DEBUG] json_str is None or empty. Type: {}".format(type(_input)))
else:
    json_text = str(_input).strip()

    # ---------------------------------------------------------------------------
    # Parse JSON — could be a JSON string or a file path
    # ---------------------------------------------------------------------------
    layout = None

    # Try parsing as JSON directly
    try:
        layout = json.loads(json_text)
    except:
        pass

    # If that failed, maybe it's a file path
    if layout is None:
        import os
        if os.path.isfile(json_text):
            try:
                with open(json_text, "r") as fh:
                    layout = json.load(fh)
            except Exception as ex:
                info = "[ERROR] Could not read file: {}".format(ex)

    if layout is None and info == "":
        print("[DEBUG] Could not parse input. Type: {} | First 200 chars: {}".format(
            type(_input), json_text[:200]))

    if layout is not None:
        print("[DEBUG] Layout parsed OK. Keys: {}".format(list(layout.keys())))
        print("[DEBUG] Rooms: {}".format(len(layout.get("rooms", []))))
        # -- Rooms --
        room_names = []
        room_curves = []
        for room in layout.get("rooms", []):
            name = room.get("name")
            geometry = room.get("geometry")
            if name and geometry:
                room_names.append(name)
                room_curves.append(create_polyline(geometry, close=True))

        # -- Doors --
        door_names = []
        door_curves = []
        for door in layout.get("doors", []):
            name = door.get("name")
            geometry = door.get("geometry")
            if name and geometry:
                curve = create_line(geometry)
                if curve:
                    door_names.append(name)
                    door_curves.append(curve)

        # -- Windows --
        window_names = []
        window_curves = []
        for window in layout.get("windows", []):
            name = window.get("name")
            geometry = window.get("geometry")
            if name and geometry:
                curve = create_line(geometry)
                if curve:
                    window_names.append(name)
                    window_curves.append(curve)

        # -- Furniture --
        furniture_names = []
        furniture_curves = []
        for furn in layout.get("furniture", []):
            name = furn.get("name")
            geometry = furn.get("geometry")
            if name and geometry:
                furniture_names.append(name)
                furniture_curves.append(create_polyline(geometry, close=True))

        # -- MEP --
        mep_names = []
        mep_curves = []
        for mep_item in layout.get("mep", []):
            name = mep_item.get("name")
            geometry = mep_item.get("geometry")
            if name and geometry:
                mep_names.append(name)
                mep_curves.append(create_polyline(geometry, close=True))

        # -- Structure --
        structure_names = []
        structure_curves = []
        for s in layout.get("structure", []):
            name = s.get("name")
            geometry = s.get("geometry")
            if name and geometry:
                curve = create_line(geometry)
                if curve:
                    structure_names.append(name)
                    structure_curves.append(curve)

        # -- Outline --
        outline_curve = None
        if "outline" in layout:
            outline_curve = create_polyline(layout["outline"], close=True)

        # -- Outputs --
        a = room_names
        b = room_curves
        c = door_names
        d = door_curves
        e = window_names
        f = window_curves
        g = furniture_names
        h = furniture_curves
        i = mep_names
        j = mep_curves
        k = structure_names
        l = structure_curves
        m = outline_curve
        info = "[OK] {} rooms, {} doors, {} windows, {} furniture, {} mep, {} structure".format(
            len(room_names), len(door_names), len(window_names),
            len(furniture_names), len(mep_names), len(structure_names)
        )
import json
import Rhino.Geometry as rg

# ---------------------------------------------------------------------------
# Helpers
# ---------------------------------------------------------------------------
def create_polyline(points, close=True):
    pts = [rg.Point3d(x, y, 0) for x, y in points]
    if close and pts[0] != pts[-1]:
        pts.append(pts[0])
    return rg.Polyline(pts).ToPolylineCurve()

def create_line(points):
    if len(points) != 2:
        return None
    p1 = rg.Point3d(points[0][0], points[0][1], 0)
    p2 = rg.Point3d(points[1][0], points[1][1], 0)
    return rg.LineCurve(p1, p2)

# ---------------------------------------------------------------------------
# Initialize all outputs (so they always exist)
# ---------------------------------------------------------------------------
a = b = c = d = e = f = g = h = i = j = k = l = []
m = None
info = ""

# ---------------------------------------------------------------------------
# Validate input
# ---------------------------------------------------------------------------
try:
    _input = json_str
except NameError:
    _input = None

# If input is a list, take the first item
if isinstance(_input, list):
    _input = _input[0] if len(_input) > 0 else None

if _input is None or str(_input).strip() == "":
    print("[DEBUG] json_str is None or empty. Type: {}".format(type(_input)))
else:
    json_text = str(_input).strip()

    # ---------------------------------------------------------------------------
    # Parse JSON — could be a JSON string or a file path
    # ---------------------------------------------------------------------------
    layout = None

    # Try parsing as JSON directly
    try:
        layout = json.loads(json_text)
    except:
        pass

    # If that failed, maybe it's a file path
    if layout is None:
        import os
        if os.path.isfile(json_text):
            try:
                with open(json_text, "r") as fh:
                    layout = json.load(fh)
            except Exception as ex:
                info = "[ERROR] Could not read file: {}".format(ex)

    if layout is None and info == "":
        print("[DEBUG] Could not parse input. Type: {} | First 200 chars: {}".format(
            type(_input), json_text[:200]))

    if layout is not None:
        print("[DEBUG] Layout parsed OK. Keys: {}".format(list(layout.keys())))
        print("[DEBUG] Rooms: {}".format(len(layout.get("rooms", []))))
        # -- Rooms --
        room_names = []
        room_curves = []
        for room in layout.get("rooms", []):
            name = room.get("name")
            geometry = room.get("geometry")
            if name and geometry:
                room_names.append(name)
                room_curves.append(create_polyline(geometry, close=True))

        # -- Doors --
        door_names = []
        door_curves = []
        for door in layout.get("doors", []):
            name = door.get("name")
            geometry = door.get("geometry")
            if name and geometry:
                curve = create_line(geometry)
                if curve:
                    door_names.append(name)
                    door_curves.append(curve)

        # -- Windows --
        window_names = []
        window_curves = []
        for window in layout.get("windows", []):
            name = window.get("name")
            geometry = window.get("geometry")
            if name and geometry:
                curve = create_line(geometry)
                if curve:
                    window_names.append(name)
                    window_curves.append(curve)

        # -- Furniture --
        furniture_names = []
        furniture_curves = []
        for furn in layout.get("furniture", []):
            name = furn.get("name")
            geometry = furn.get("geometry")
            if name and geometry:
                furniture_names.append(name)
                furniture_curves.append(create_polyline(geometry, close=True))

        # -- MEP --
        mep_names = []
        mep_curves = []
        for mep_item in layout.get("mep", []):
            name = mep_item.get("name")
            geometry = mep_item.get("geometry")
            if name and geometry:
                mep_names.append(name)
                mep_curves.append(create_polyline(geometry, close=True))

        # -- Structure --
        structure_names = []
        structure_curves = []
        for s in layout.get("structure", []):
            name = s.get("name")
            geometry = s.get("geometry")
            if name and geometry:
                curve = create_line(geometry)
                if curve:
                    structure_names.append(name)
                    structure_curves.append(curve)

        # -- Outline --
        outline_curve = None
        if "outline" in layout:
            outline_curve = create_polyline(layout["outline"], close=True)

        # -- Outputs --
        a = room_names
        b = room_curves
        c = door_names
        d = door_curves
        e = window_names
        f = window_curves
        g = furniture_names
        h = furniture_curves
        i = mep_names
        j = mep_curves
        k = structure_names
        l = structure_curves
        m = outline_curve
        info = "[OK] {} rooms, {} doors, {} windows, {} furniture, {} mep, {} structure".format(
            len(room_names), len(door_names), len(window_names),
            len(furniture_names), len(mep_names), len(structure_names)
        )
# ---------- end extractor ----------

# ----
Z = UnitZ(Factor="2")
extr = Extrude(Base=extractor.door_curves, Direction=Z)

boundary = BoundarySurfaces(Edges=extractor.furniture_curves)
unsplitextr = UnsplitExtrudeSurface(Profile=boundary, Direction=Z)
cap = CapHoles(Brep=unsplitextr)

Z_2 = UnitZ(Factor="1")
extr_2 = Extrude(Base=extractor.window_curves, Direction=Z_2)
move = Move(Geometry=extr_2, Motion=Z_2)  # -> Geometry, Transform

Z_3 = UnitZ(Factor="3")
extr_3 = Extrude(Base=extractor.structure_curves, Direction=Z_3)
sdiff = SolidDifference(BrepsA=extr_3, BrepsB=[move.Geometry, extr])

# ---- group: Polylines
srf = Surface(extractor.room_curves)

# ---- group: Labels
area = Area(Geometry=srf)  # -> Area, Centroid
group = Group(Geometry=area.Centroid)
tag = TextTag(Location=area.Centroid, Text=extractor.room_names, Colour=ColourSwatch(SwatchColor=RGB(255, 0, 0)))

# ----
mcol = MeshColours(Mesh=extr, Colours=ColourSwatch(SwatchColor=RGB(255, 255, 0)))
group_2 = Group(Geometry=mcol)

mcol_2 = MeshColours(Mesh=sdiff, Colours=ColourSwatch(SwatchColor=RGB(166, 166, 166)))
group_3 = Group(Geometry=mcol_2)

mcol_3 = MeshColours(Mesh=move.Geometry, Colours=ColourSwatch(SwatchColor=RGB(0, 255, 255)))
group_4 = Group(Geometry=mcol_3)

mcol_4 = MeshColours(Mesh=cap, Colours=ColourSwatch(SwatchColor=RGB(100, 166, 93)))
group_5 = Group(Geometry=mcol_4)

merge = Merge(Data2=group_5, Data3=group_2, Data4=group_4, Data5=group_3)

group_6 = Group(Geometry=merge)
py3_3 = Python3Script(floors=srf, points=group, geometry=group_6, columns=Slider(5, range=0..100), spacing=Slider(5, range=0..10))  # -> out, a, b, c; inputs floors: tree of Surface, points: tree, geometry: tree; same code as py3_5
panel_15 = Panel(py3_3.out)
tag_2 = TextTag(Location=py3_3.b, Text=extractor.room_names)
geo = Geometry(py3_3.a)

lng = ListLength(List=py3_3.c)
x_minus_one = XMinusOne(NumberX=lng)
range = Range(Domain=Domain(0, 1), Steps=x_minus_one)
gradient = Gradient(
    LowerLimit=0,
    UpperLimit=1,
    Parameter=range,
    stops=[0: RGB(48, 18, 59), 0.0294: RGB(56, 40, 112), 0.0588: RGB(63, 62, 156), 0.0882: RGB(68, 82, 193), 0.118: RGB(70, 102, 221), 0.147: RGB(71, 122, 241)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])
preview_2 = CustomPreview(Geometry=py3_3.c, Material=gradient)

# ----
# Debug Tool Names
# This Panel should always be TRUE
tool_names_from_the_results_clusters = Data(panel_12)
tool_names_from_the_definition_clusters = Data(panel_11)
join = TextJoin(Text=flatten(tool_names_from_the_definition_clusters))
join_2 = TextJoin(Text=flatten(tool_names_from_the_results_clusters))
tstat = TreeStatistics(Tree=tool_names_from_the_definition_clusters)  # -> Paths, Length, Count
tstat_2 = TreeStatistics(Tree=tool_names_from_the_results_clusters)  # -> Paths, Length, Count
dpath = DeconstructPath(Branch=tstat.Paths)
dpath_2 = DeconstructPath(Branch=tstat_2.Paths)
equals = Equality(FirstNumber=tstat.Length, SecondNumber=tstat_2.Length)  # -> Equality, Inequality
equals_2 = Equality(FirstNumber=tstat.Count, SecondNumber=tstat_2.Count)  # -> Equality, Inequality
ma = MassAddition(Input=flatten(equals.Equality))  # -> Result, PartialResults
equals_3 = Equality(FirstNumber=dpath, SecondNumber=dpath_2)  # -> Equality, Inequality
lng_2 = ListLength(List=equals.Equality)
ma_2 = MassAddition(Input=flatten(equals_3.Inequality))  # -> Result, PartialResults
equals_4 = Equality(FirstNumber=ma.Result, SecondNumber=lng_2)  # -> Equality, Inequality
does_quantity_of_tools_match = Panel(equals_2.Equality)
equals_5 = Equality(FirstNumber=ma_2.Result, SecondNumber="0")  # -> Equality, Inequality
does_quantity_of_tools_match_per_team = Panel(equals_4.Equality)
are_all_teams_included = Panel(equals_5.Equality)

tmatch_3 = MatchText(Text=join, Pattern=join_2, Case=True)

do_all_names_match = Panel(tmatch_3)
and = GateAnd(A=equals_5.Equality, B=equals_4.Equality, C=equals_2.Equality, D=tmatch_3)  # -> flatten(Result)
do_trees_match = Panel(and)

# ==== cluster Team03DefinitionCluster

# ----
# place_objects
panel = Panel("comma-separated list of furniture items e.g. sofa,sofa,coffee_table,tv_unit")
panel_2 = Panel("true to clear existing furniture before placing, false to add alongside existing")
# Team 03 Definition Cluster
# SQUARE PYRAMID TEAM
panel_3 = Panel("room_name")
param = DefineToolParameter(Name=panel_3, Type="string", Description="select the room by name", Required=Toggle(True))
param_2 = DefineToolParameter(Name="layout_json", Type="string", Description="the layout data structure", Required=Toggle(True))
param_3 = DefineToolParameter(Name="objects_list", Type="string", Description=panel, Required=Toggle(True))
param_4 = DefineToolParameter(Name="user_profile", Type="string", Description="select user profile", Required=Toggle(True))
param_5 = DefineToolParameter(Name="clear_room", Type="boolean", Description=panel_2, Required=Toggle(False))
merge = Merge(Data1=param, Data2=param_2, Data3=param_3, Data4=param_4, Data5=param_5)
panel_4 = Panel("""Draws placed furniture as 3D boxes in Rhino. 
Receives placed objects list from Python agent.""")
tool = DefineTool(Name="place_objects", Description=panel_4, Parameters=merge)

# ----
# move_objects
panel_5 = Panel("name of the object to move (must match exactly)")
param_6 = DefineToolParameter(Name="object_name", Type="string", Description=panel_5, Required=Toggle(True))
param_7 = DefineToolParameter(Name="new_x", Type="string", Description="new X coordinate in metres", Required=Toggle(True))
param_8 = DefineToolParameter(Name="new_y", Type="string", Description="new Y coordinate in metres", Required=Toggle(True))
param_9 = DefineToolParameter(Name="layout_json", Type="string", Description="current layout JSON", Required=Toggle(True))
merge_2 = Merge(Data1=param_6, Data2=param_7, Data3=param_8, Data4=param_9)
panel_6 = Panel("moves an existing object to new coordinates and redraws it in the viewport")
tool_2 = DefineTool(Name="move_object", Description=panel_6, Parameters=merge_2)

# ----
# collision-detector-grid
panel_7 = Panel("(wheelchair/elderly/stroller/forklift/crane) and optional overrides: \"min_door_width_m\", \"min_corridor_width_m\", \"turning_radius_m\", \"body_width_m\"")
panel_8 = Panel("Previous layout JSON for before/after comparison. Only new collisions are highlighted.")
param_10 = DefineToolParameter(Name="layout_json", Type="string", Description="the full layout JSON string", Required=Toggle(True))
param_11 = DefineToolParameter(Name="user_profile", Type="string", Description=panel_7, Required=Toggle(True))
param_12 = DefineToolParameter(Name="wall_thickness", Type="number", Description="Wall thickness in meters. Default 0.20", Required=Toggle(True))
param_13 = DefineToolParameter(Name="compare_layout_json", Type="string", Description=panel_8, Required=Toggle(True))
merge_3 = Merge(Data1=param_10, Data2=param_11, Data3=param_12, Data4=param_13)
tool_3 = DefineTool(Name="collision-detector-grid", Description="Grid-based collision and accessibility analysis", Parameters=merge_3)

# ----
# set_observer
panel_9 = Panel("Places a 1.7m observer/person point on the floor and returns its x,y ground")
panel_10 = Panel("\"semicolon-separated x,y pairs for path mode: x1,y1;x2,y2;x3,y3 — optional, bypassed if empty\"")
param_14 = DefineToolParameter(Name="point", Type="string", Description="ground point as \"x,y,h\" in layout metres", Required=Toggle(True))
param_15 = DefineToolParameter(Name="height", Type="string", Description="person height in metres (optional, default 1.7)", Required=Toggle(True))
param_16 = DefineToolParameter(Name="layout_json", Type="string", Description="layout JSON string for room boundary extraction", Required=Toggle(True))
param_17 = DefineToolParameter(Name="path_points ", Type="string", Description=panel_10, Required=Toggle(True))
merge_4 = Merge(Data1=param_14, Data2=param_15, Data3=param_16, Data4=param_17)
tool_4 = DefineTool(Name="set_observer", Description=panel_9, Parameters=merge_4)

# ----
# visualize_paths
panel_11 = Panel("Renders layout geometry in the viewport for before/after comparison")
panel_12 = Panel("display mode: all, rooms, furniture, doors, structure, outline_only")
param_18 = DefineToolParameter(Name="layout_json", Type="string", Description="the full layout JSON string", Required=Toggle(True))
param_19 = DefineToolParameter(Name="mode", Type="string", Description=panel_12, Required=Toggle(True))
merge_5 = Merge(Data1=param_18, Data2=param_19)
tool_5 = DefineTool(Name="set_viewport", Description=panel_11, Parameters=merge_5)

# ----
# visualize_visibility
panel_13 = Panel("Draws visibility results between rooms as colored lines in Rhino")
param_20 = DefineToolParameter(Name="layout_json", Type="string", Description="the full layout JSON string", Required=Toggle(True))
param_21 = DefineToolParameter(
    Name="visibility_json",
    Type="string",
    Description="the visibility analysis results as JSON string",
    Required=Toggle(True))
merge_6 = Merge(Data1=param_20, Data2=param_21)
tool_6 = DefineTool(Name="visualize_visibility", Description=panel_13, Parameters=merge_6)

# ----
# visualize_paths
panel_14 = Panel("Draws path analysis results as lines in Rhino")
param_22 = DefineToolParameter(Name="layout_json", Type="string", Description="the full layout JSON string", Required=Toggle(True))
param_23 = DefineToolParameter(Name="paths_json", Type="string", Description="the path analysis results as JSON string", Required=Toggle(True))
merge_7 = Merge(Data1=param_22, Data2=param_23)
tool_7 = DefineTool(Name="visualize_paths", Description=panel_14, Parameters=merge_7)

merge_8 = Merge(Data1=tool, Data2=tool_2, Data3=tool_6, Data4=tool_7, Data5=tool_3, Data6=tool_5, Data7=tool_4)
mcp_tool_list = ClusterOutput(merge_8)

# ==== cluster Team03ResultCluster
# Team 03 Result Cluster
# SQUARE PYRAMID TEAM
# Edit Tool Names to
# Match Definition Cluster
tool_names = Panel("""place_objects
move_object
visualize_visibility
visualize_paths
collision-detector-grid
set_viewport
set_observer""")

# ----
# Sorting Logic, Please Do Not Edit
tool_call_request = ClusterInput()
tool_names_2 = Text(tool_names)
decall = DeconstructToolCall(Request=tool_call_request)  # -> Request, Tool, Arguments
mindex = MemberIndex(Set=tool_names, Member=decall.Tool)  # -> Index, Count
sift = SiftPattern(List=decall.Request, SiftPattern=mindex.Index)  # -> Output0, Output1, Output2, Output3, Output4, Output5, Output6

# ---- group: Cluster Output
tool_names_3 = ClusterOutput(tool_names_2)

# ----
decall_2 = DeconstructToolCall(Request=sift.Output2)  # -> Request, Tool, Arguments
gjok = GetJSONObjectKey(JObject=decall_2.Arguments, Key="visibility_json")
gjok_2 = GetJSONObjectKey(JObject=decall_2.Arguments, Key="layout_json")
rjv = ReadJSONValue(JValue=gjok)  # -> AsString, AsNumber, AsBool
rjv_2 = ReadJSONValue(JValue=gjok_2)  # -> AsString, AsNumber, AsBool
panel = Panel(rjv.AsString)
panel_2 = Panel(rjv_2.AsString)
py3 = Python3Script(visibility_json=rjv.AsString, layout_json=rjv_2.AsString)  # -> visible_lines, blocked_lines, isovist_seated, isovist_standing, out
# ---------- py3: Python ----------
"""
GHPython: visualize_visibility
Draws centroid-to-centroid sightlines AND isovist filled meshes.

INPUTS:
    visibility_json  (str) Item - JSON with sightlines + isovists
    layout_json      (str) Item - Full layout JSON

OUTPUTS:
    a = visible_lines    (list of LineCurve) - green
    b = blocked_lines    (list of LineCurve) - red
    c = isovist_seated   (list of Mesh)      - light blue filled, z=0.9m
    d = isovist_standing (list of Mesh)      - light yellow filled, z=1.55m
    e = out              (str) - status
"""
import json
import Rhino.Geometry as rg
import System.Drawing

SEATED_Z   = 0.90
STANDING_Z = 1.55

COLOR_SEATED   = System.Drawing.Color.FromArgb(200, 100, 180, 255)
COLOR_STANDING = System.Drawing.Color.FromArgb(200, 255, 220, 80)

visible_lines    = []
blocked_lines    = []
isovist_seated   = []
isovist_standing = []
out = json.dumps({"status": "idle"})


def _poly_to_mesh(verts_2d, z, color):
    if not verts_2d or len(verts_2d) < 3:
        return None
    try:
        mesh = rg.Mesh()
        for v in verts_2d:
            mesh.Vertices.Add(float(v[0]), float(v[1]), float(z))
            mesh.VertexColors.Add(color)
        n = len(verts_2d)
        for i in range(1, n - 1):
            mesh.Faces.AddFace(0, i, i + 1)
        mesh.Normals.ComputeNormals()
        mesh.Compact()
        return mesh if mesh.Faces.Count > 0 else None
    except Exception:
        return None


try:
    vis_in = visibility_json
    lay_in = layout_json
    if isinstance(vis_in, list):
        vis_in = vis_in[0] if vis_in else None
    if isinstance(lay_in, list):
        lay_in = lay_in[0] if lay_in else None

    if vis_in is None or lay_in is None:
        out = json.dumps({"status": "waiting", "message": "Waiting for inputs..."})
    else:
        layout = json.loads(lay_in)
        data   = json.loads(vis_in)

        if isinstance(data, list):
            sightlines = data
            isovists   = []
        else:
            sightlines = data.get("sightlines", [])
            isovists   = data.get("isovists", [])

        centroids = {}
        for furn in layout.get("furniture", []):
            fid  = furn.get("id")
            pts  = furn.get("geometry")
            if fid and pts:
                xs = [p[0] for p in pts]
                ys = [p[1] for p in pts]
                centroids[fid] = rg.Point3d(
                    sum(xs) / len(xs),
                    sum(ys) / len(ys),
                    0,
                )

        for pair in sightlines:
            src = centroids.get(pair.get("source"))
            tgt = centroids.get(pair.get("target"))
            if not src or not tgt:
                continue
            line = rg.LineCurve(src, tgt)
            if pair.get("visible_seated", True):
                visible_lines.append(line)
            else:
                blocked_lines.append(line)

        for iso in isovists:
            verts = iso.get("polygon_seated") or iso.get("polygon_standing")
            if not verts or len(verts) < 3:
                continue
            m_seated = _poly_to_mesh(verts, SEATED_Z,   COLOR_SEATED)
            m_stand  = _poly_to_mesh(verts, STANDING_Z, COLOR_STANDING)
            if m_seated:
                isovist_seated.append(m_seated)
            if m_stand:
                isovist_standing.append(m_stand)

        out = json.dumps({
            "status":     "ok",
            "message":    "Visibility drawn",
            "sightlines": {"visible": len(visible_lines), "blocked": len(blocked_lines)},
            "isovists":   len(isovist_seated),
        })

except Exception as ex:
    out = json.dumps({"status": "error", "message": str(ex)})
# ---------- end py3 ----------
panel_3 = Panel("{\"status\": \"ok\", \"message\": \"Visibility drawn\"}")
parse_json_string = ParseJSONString(Text=py3.out)
mcp_tool_response = MCPToolResponse(Request=decall_2.Request, Content=parse_json_string, IsError=False)
preview = CustomPreview(Geometry=py3.visible_lines, Material=ColourSwatch(SwatchColor=RGB(24, 145, 0)))
preview_2 = CustomPreview(Geometry=py3.blocked_lines, Material=ColourSwatch(SwatchColor=RGB(255, 0, 0)))

decall_3 = DeconstructToolCall(Request=sift.Output3)  # -> Request, Tool, Arguments
gjok_3 = GetJSONObjectKey(JObject=decall_3.Arguments, Key="paths_json")
gjok_4 = GetJSONObjectKey(JObject=decall_3.Arguments, Key="layout_json")
rjv_3 = ReadJSONValue(JValue=gjok_3)  # -> AsString, AsNumber, AsBool
rjv_4 = ReadJSONValue(JValue=gjok_4)  # -> AsString, AsNumber, AsBool
panel_4 = Panel(rjv_4.AsString)
panel_5 = Panel(rjv_3.AsString)
py3_2 = Python3Script(paths_json=rjv_3.AsString, layout_json=rjv_4.AsString)  # -> a, b
# ---------- py3_2: Python ----------
import json
import Rhino.Geometry as rg

if paths_json is None or layout_json is None:
    a = None
    b = None
    out = "Waiting for inputs..."
else:
    vis = paths_json
    lay = layout_json
    if isinstance(vis, list): vis = vis[0]
    if isinstance(lay, list): lay = lay[0]

    layout = json.loads(lay)
    results = json.loads(vis)

    # Build centroid lookup for rooms and furniture
    centroids = {}
    for room in layout.get("rooms", []):
        name = room.get("name")
        pts = room.get("geometry")
        if name and pts:
            xs = [p[0] for p in pts]
            ys = [p[1] for p in pts]
            centroids[name] = rg.Point3d(
                sum(xs)/len(xs), sum(ys)/len(ys), 0)

    for furn in layout.get("furniture", []):
        fid = furn.get("id")
        pts = furn.get("geometry")
        if fid and pts:
            xs = [p[0] for p in pts]
            ys = [p[1] for p in pts]
            centroids[fid] = rg.Point3d(
                sum(xs)/len(xs), sum(ys)/len(ys), 0)

    reachable_lines = []
    unreachable_lines = []

    for pair in results.get("pairs", []):
        src = centroids.get(pair["source"])
        tgt = centroids.get(pair["target"])
        if not src or not tgt:
            continue
        line = rg.LineCurve(src, tgt)
        if pair["status"] == "reachable":
            reachable_lines.append(line)
        else:
            unreachable_lines.append(line)

    a = reachable_lines    # green
    b = unreachable_lines  # red
    out = f"Drawn: {len(reachable_lines)} reachable, {len(unreachable_lines)} unreachable"
# ---------- end py3_2 ----------
preview_3 = CustomPreview(Geometry=py3_2.a, Material=ColourSwatch(SwatchColor=RGB(24, 145, 0)))
preview_4 = CustomPreview(Geometry=py3_2.b, Material=ColourSwatch(SwatchColor=RGB(255, 0, 0)))
parse_json_string_2 = ParseJSONString(Text="{\"status\": \"ok\", \"message\": \"Paths drawn\"}")
mcp_tool_response_2 = MCPToolResponse(Request=decall_3.Request, Content=parse_json_string_2, IsError=False)

panel_6 = Panel(decall_2.Arguments)

deconstruct_tool_call = DeconstructToolCall(Request=sift.Output1)  # -> Request, Tool, Arguments
move_object = Python3Script(json_str=deconstruct_tool_call.Arguments)  # -> a
# ---------- move_object: Python ----------
import json
import scriptcontext as sc
import Rhino
import Rhino.Geometry as rg
import Rhino.Display as rd
import System.Drawing

STICKY_KEY = "team_03_objects_display"

try:
    raw  = json_str.ToString() if hasattr(json_str, 'ToString') else str(json_str)
    args = json.loads(raw)

    object_name = args.get("object_name", "")
    new_x       = float(args.get("new_x", 0.0))
    new_y       = float(args.get("new_y", 0.0))
    layout_raw  = args.get("layout_json", "{}")

    if isinstance(layout_raw, str):
        layout = json.loads(layout_raw)
    else:
        layout = layout_raw

    moved     = False
    moved_obj = None

    for furn in layout.get("furniture", []):
        if furn.get("name", "").lower() == object_name.lower():
            geom = furn.get("geometry", [])
            if len(geom) >= 4:
                xs = [p[0] for p in geom]
                ys = [p[1] for p in geom]
                fw = max(xs) - min(xs)
                fd = max(ys) - min(ys)
            else:
                fw, fd = 1.0, 1.0

            furn["geometry"] = [
                [new_x,      new_y     ],
                [new_x + fw, new_y     ],
                [new_x + fw, new_y + fd],
                [new_x,      new_y + fd],
                [new_x,      new_y     ],
            ]
            moved   = True
            fh      = furn.get("attributes", {}).get("height", 1.0)
            moved_obj = {"name": furn["name"], "position": [new_x, new_y],
                         "size": [fw, fd, fh]}
            break

    if not moved:
        a = json.dumps({"status": "error",
                        "message": "Object '{}' not found in layout".format(object_name)})
    else:
        # Only clear display when we have a valid move
        prev = sc.sticky.get(STICKY_KEY)
        if prev is not None:
            try:
                prev.Dispose()
            except Exception:
                pass
            sc.sticky[STICKY_KEY] = None

        edge_color  = System.Drawing.Color.FromArgb(255, 40, 120, 60)
        moved_color = System.Drawing.Color.FromArgb(255, 255, 160, 0)
        label_color = System.Drawing.Color.White
        disp = rd.CustomDisplay(True)

        for furn in layout.get("furniture", []):
            geom = furn.get("geometry", [])
            if len(geom) < 4:
                continue
            xs = [p[0] for p in geom]
            ys = [p[1] for p in geom]
            x0 = min(xs)
            y0 = min(ys)
            fw = max(xs) - x0
            fd = max(ys) - y0
            fh = furn.get("attributes", {}).get("height", 1.0)

            is_moved = furn.get("name", "").lower() == object_name.lower()
            color    = moved_color if is_moved else edge_color

            pt    = rg.Point3d(x0, y0, 0)
            plane = rg.Plane(pt, rg.Vector3d.ZAxis)
            box   = rg.Box(plane, rg.Interval(0, fw), rg.Interval(0, fd), rg.Interval(0, fh))
            brep  = box.ToBrep()
            if brep:
                for b_edge in brep.Edges:
                    disp.AddCurve(b_edge.EdgeCurve, color, 2 if not is_moved else 3)

            cx = x0 + fw / 2.0
            cy = y0 + fd / 2.0
            lp = rg.Plane(rg.Point3d(cx, cy, fh + 0.05), rg.Vector3d.ZAxis)
            try:
                t3d = rd.Text3d(furn["name"], lp, 0.12)
                t3d.HorizontalAlignment = rd.TextHorizontalAlignment.Center
                disp.AddText(t3d, label_color)
            except Exception:
                pass

        sc.sticky[STICKY_KEY] = disp
        Rhino.RhinoDoc.ActiveDoc.Views.Redraw()

        a = json.dumps({
            "status":      "ok",
            "message":     "Moved '{}' to ({}, {})".format(object_name, new_x, new_y),
            "moved":       moved_obj,
            "layout_json": json.dumps(layout)
        })

except Exception as e:
    a = json.dumps({"error": str(e)})
# ---------- end move_object ----------
parse_json_string_3 = ParseJSONString(Text=move_object)
mcp_tool_response_3 = MCPToolResponse(Request=deconstruct_tool_call.Request, Content=parse_json_string_3, IsError=False)

set_observer = Python3Script()  # -> observer_point, observer_eye, person_curve, info, path_curve, path_points; disabled
# ---------- set_observer: Python ----------
"""
GHPython component: set_observer
MCP tool for placing a draggable "observer" / person point from the web UI.

PURPOSE:
    Receives a single ground point (and a person height) dragged in the
    AGENT_ui 3D viewport and materializes it in Grasshopper/Rhino as:
      - a base point on the floor (z = 0),
      - an eye/head point at the person height,
      - a vertical line representing the 1.7m person,
    so downstream GH logic (visibility, isovist, sightlines, etc.) can use the
    observer location chosen interactively in the browser.

    Coordinates arrive in LAYOUT metres (origin bottom-left), the same basis as
    the layout JSON and the other GH scripts (x, y on the ground, z up).

SWIFTLET SETUP:
    1. In team_03_working.gh, add a new GHPython component.
    2. Rename it to "set_observer" (this becomes the MCP tool name).
    3. Add these INPUT parameters (right-click component > Manage Inputs):
         point   (str)  — "x,y,h" or "x,y" in layout metres
         height  (str)  — person height in metres (optional; default 1.7)
    4. Add these OUTPUT parameters (right-click component > Manage Outputs):
         observer_point  (point) — base point on the floor (z = 0)
         observer_eye    (point) — point at person height (z = h)
         person_curve    (curve) — vertical line base -> eye
         info            (str)   — status JSON (REQUIRED for Swiftlet response)
    5. Paste this entire script into the GHPython editor.
    6. Restart Swiftlet — the tool will auto-discover.
    7. (Optional) Wire a Panel to observer_point / info to inspect the value,
       and person_curve to a Custom Preview to see the person in the viewport.

INPUTS (from Swiftlet MCP call):
    point   (str) — "x,y,h" comma-separated, layout metres.
    height  (str) — fallback height if not encoded in `point`.

OUTPUTS:
    observer_point, observer_eye, person_curve, info
"""

import json
import Rhino.Geometry as rg


# ---------------------------------------------------------------------------
# Initialize ALL outputs to empty — prevents GH "null" errors
# ---------------------------------------------------------------------------

observer_point = None
observer_eye   = None
person_curve   = None
info           = ""

DEFAULT_HEIGHT = 1.7


# ---------------------------------------------------------------------------
# Read inputs (set by Swiftlet MCP call)
# ---------------------------------------------------------------------------

_point_input = None
try:
    _point_input = point
except NameError:
    pass

_height_input = None
try:
    _height_input = height
except NameError:
    pass

# Swiftlet sometimes wraps a single value in a list.
if isinstance(_point_input, list):
    _point_input = _point_input[0] if len(_point_input) > 0 else None
if isinstance(_height_input, list):
    _height_input = _height_input[0] if len(_height_input) > 0 else None


def _to_float(value, fallback):
    try:
        return float(str(value).strip())
    except (ValueError, TypeError, AttributeError):
        return fallback


if _point_input is None or str(_point_input).strip() == "":
    info = json.dumps({"status": "error", "message": "No point received"})
else:
    # -----------------------------------------------------------------------
    # Parse "x,y[,h]" — fall back to the separate `height` input for h.
    # -----------------------------------------------------------------------
    h = _to_float(_height_input, DEFAULT_HEIGHT)

    parts = [p for p in str(_point_input).strip().split(",") if p.strip() != ""]

    if len(parts) < 2:
        info = json.dumps({
            "status": "error",
            "message": "Expected 'x,y' or 'x,y,h', got: {}".format(_point_input),
        })
    else:
        x = _to_float(parts[0], None)
        y = _to_float(parts[1], None)
        if len(parts) >= 3:
            h = _to_float(parts[2], h)

        if x is None or y is None:
            info = json.dumps({
                "status": "error",
                "message": "Could not parse coordinates from: {}".format(_point_input),
            })
        else:
            if h is None or h <= 0:
                h = DEFAULT_HEIGHT

            observer_point = rg.Point3d(x, y, 0.0)
            observer_eye   = rg.Point3d(x, y, h)
            person_curve   = rg.LineCurve(observer_point, observer_eye)

            info = json.dumps({
                "status": "ok",
                "x": round(x, 3),
                "y": round(y, 3),
                "h": round(h, 3),
            })
# ---------- end set_observer ----------
panel_7 = Panel(py3.isovist_standing)
swatch = ColourSwatch(SwatchColor=RGBA(0, 153, 255, 147))
preview_5 = CustomPreview(Material=ColourSwatch(SwatchColor=RGBA(0, 153, 255, 61)))

decall_4 = DeconstructToolCall(Request=sift.Output6)  # -> Request, Tool, Arguments

gjok_5 = GetJSONObjectKey(JObject=decall_4.Arguments, Key="height")

gjok_6 = GetJSONObjectKey(JObject=decall_4.Arguments, Key="layout_json")

gjok_7 = GetJSONObjectKey(JObject=decall_4.Arguments, Key="point")

rjv_5 = ReadJSONValue(JValue=gjok_7)  # -> AsString, AsNumber, AsBool
rjv_6 = ReadJSONValue(JValue=gjok_5)  # -> AsString, AsNumber, AsBool
rjv_7 = ReadJSONValue(JValue=gjok_6)  # -> AsString, AsNumber, AsBool
set_observer_2 = Python3Script(point=rjv_5.AsString, height=rjv_6.AsString)  # -> observer_point, observer_eye, person_curve, info, path_curve, path_points
# ---------- set_observer_2: Python ----------
import json
import Rhino.Geometry as rg

# ---------------------------------------------------------------------------
# Initialize ALL outputs
# ---------------------------------------------------------------------------
observer_point = None
observer_eye   = None
person_curve   = None
path_curve     = None
path_points    = []
info           = ""

DEFAULT_HEIGHT = 1.7

# ---------------------------------------------------------------------------
# Read inputs
# ---------------------------------------------------------------------------
_point_input = None
try:
    _point_input = point
except NameError:
    pass

_height_input = None
try:
    _height_input = height
except NameError:
    pass

_path_input = None
try:
    _path_input = path_points
except NameError:
    pass

if isinstance(_point_input, list):
    _point_input = _point_input[0] if _point_input else None
if isinstance(_height_input, list):
    _height_input = _height_input[0] if _height_input else None
if isinstance(_path_input, list):
    _path_input = _path_input[0] if _path_input else None

def _to_float(value, fallback):
    try:
        return float(str(value).strip())
    except (ValueError, TypeError, AttributeError):
        return fallback

h = _to_float(_height_input, DEFAULT_HEIGHT)
if not h or h <= 0:
    h = DEFAULT_HEIGHT

# ---------------------------------------------------------------------------
# PATH MODE — multiple points as "x1,y1;x2,y2;x3,y3"
# ---------------------------------------------------------------------------
if _path_input and str(_path_input).strip():
    try:
        raw_pts = [p.strip() for p in str(_path_input).split(";")
                   if p.strip()]
        parsed = []
        for pt_str in raw_pts:
            coords = [c.strip() for c in pt_str.split(",")]
            if len(coords) >= 2:
                x = _to_float(coords[0], None)
                y = _to_float(coords[1], None)
                if x is not None and y is not None:
                    parsed.append((x, y))

        if len(parsed) < 2:
            info = json.dumps({
                "status": "error",
                "message": "Need at least 2 points for a path, got: {}".format(len(parsed))
            })
        else:
            rg_pts     = [rg.Point3d(x, y, h) for x, y in parsed]
            path_points = rg_pts
            path_curve  = rg.PolylineCurve(rg_pts)

            # Set observer to first point of path
            observer_point = rg.Point3d(parsed[0][0], parsed[0][1], 0.0)
            observer_eye   = rg.Point3d(parsed[0][0], parsed[0][1], h)
            person_curve   = rg.LineCurve(observer_point, observer_eye)

            info = json.dumps({
                "status": "ok",
                "mode": "path",
                "point_count": len(parsed),
                "points": [{"x": round(x, 3), "y": round(y, 3)} for x, y in parsed],
                "height": round(h, 3)
            })

    except Exception as e:
        info = json.dumps({"status": "error", "message": str(e)})

# ---------------------------------------------------------------------------
# SINGLE POINT MODE — "x,y" or "x,y,h"
# ---------------------------------------------------------------------------
elif _point_input and str(_point_input).strip():
    parts = [p for p in str(_point_input).strip().split(",") if p.strip()]

    if len(parts) < 2:
        info = json.dumps({
            "status": "error",
            "message": "Expected 'x,y' or 'x,y,h', got: {}".format(_point_input)
        })
    else:
        x = _to_float(parts[0], None)
        y = _to_float(parts[1], None)
        if len(parts) >= 3:
            h = _to_float(parts[2], h)

        if x is None or y is None:
            info = json.dumps({
                "status": "error",
                "message": "Could not parse coordinates from: {}".format(_point_input)
            })
        else:
            if h is None or h <= 0:
                h = DEFAULT_HEIGHT

            observer_point = rg.Point3d(x, y, 0.0)
            observer_eye   = rg.Point3d(x, y, h)
            person_curve   = rg.LineCurve(observer_point, observer_eye)

            info = json.dumps({
                "status": "ok",
                "mode": "single",
                "x": round(x, 3),
                "y": round(y, 3),
                "h": round(h, 3)
            })

# ---------------------------------------------------------------------------
# NO INPUT
# ---------------------------------------------------------------------------
else:
    info = json.dumps({"status": "idle", "message": "No input received"})
# ---------- end set_observer_2 ----------
boundary_extractor = Python3Script(layout_json=rjv_7.AsString)  # -> a
# ---------- boundary_extractor: Python ----------
import Rhino.Geometry as rg
import json

a = None

_input = layout_json
if isinstance(_input, list):
    _input = _input[0] if _input else None

if _input:
    try:
        data = json.loads(str(_input))
        rooms = data.get("rooms", [])
        best_room = None
        best_area = 0
        for room in rooms:
            geom = room.get("geometry", [])
            if len(geom) < 3:
                continue
            xs = [p[0] for p in geom]
            ys = [p[1] for p in geom]
            area = (max(xs)-min(xs)) * (max(ys)-min(ys))
            if area > best_area:
                best_area = area
                best_room = room
        if best_room:
            pts = [rg.Point3d(p[0], p[1], 0)
                   for p in best_room["geometry"]]
            if pts[0] != pts[-1]:
                pts.append(pts[0])
            a = rg.PolylineCurve(pts)
    except:
        pass
# ---------- end boundary_extractor ----------
panel_8 = Panel(set_observer_2.info)
preview_6 = CustomPreview(Geometry=set_observer_2.person_curve, Material=ColourSwatch(SwatchColor=RGB(38, 0, 255)))

py3_3 = Python3Script(info=set_observer_2.info)  # -> a
# ---------- py3_3: Python ----------
import json
a = False
try:
    data = json.loads(info)
    a = data.get("mode") == "path"
except:
    pass
# ---------- end py3_3 ----------
py3_4 = Python3Script(mode=py3_3, single_pt=set_observer_2.observer_eye, path_pts=set_observer_2.path_points)  # -> a; same code as py3_3

ivist = IsoVist(Plane=py3_4, Count="150", Radius="100", Obstacles=boundary_extractor)  # -> Points, Distance, Index
pline = PolyLine(Vertices=ivist.Points, Closed=invert(False))

current_room = Python3Script(observer_point=set_observer_2.observer_point, layout_json=rjv_7.AsString)  # -> a
# ---------- current_room: Python ----------
import Rhino.Geometry as rg
import json

a = ""

_input = layout_json
if isinstance(_input, list):
    _input = _input[0] if _input else None

if _input and observer_point:
    try:
        data = json.loads(str(_input))
        pt = rg.Point3d(observer_point.X, observer_point.Y, 0)
        for room in data.get("rooms", []):
            geom = room.get("geometry", [])
            if len(geom) < 3:
                continue
            pts = [rg.Point3d(p[0], p[1], 0) for p in geom]
            if pts[0] != pts[-1]:
                pts.append(pts[0])
            crv = rg.PolylineCurve(pts)
            result = crv.Contains(pt, rg.Plane.WorldXY, 0.01)
            if result == rg.PointContainment.Inside:
                a = room.get("name", "")
                break
    except:
        pass
# ---------- end current_room ----------
visibility_metrics = Python3Script(boundary=ivist.Distance, path=pline, current_room=current_room, layout_json=rjv_7.AsString)  # -> a; inputs boundary: Curve
# ---------- visibility_metrics: Python ----------
import Rhino.Geometry as rg
import json

a = json.dumps({
    "metric_a_isovist_distribution": {},
    "metric_b_room_visibility": {}
}, indent=2)

_input = layout_json
if isinstance(_input, list):
    _input = _input[0] if _input else None

if not _input or not boundary:
    pass
else:
    try:
        data = json.loads(str(_input))

        results_a = {}
        results_b = {}
        step = 0.2
        total_isovist_pts = 0
        room_inside_counts = {}
        room_total_counts = {}

        for room in data["rooms"]:
            name = room["name"]
            pts = room["geometry"]
            xs = [p[0] for p in pts]
            ys = [p[1] for p in pts]
            min_x, max_x = min(xs), max(xs)
            min_y, max_y = min(ys), max(ys)
            total = 0
            inside = 0
            x = min_x
            while x <= max_x:
                y = min_y
                while y <= max_y:
                    pt = rg.Point3d(x, y, 0)
                    result = boundary.Contains(
                        pt, rg.Plane.WorldXY, 0.01)
                    if result == rg.PointContainment.Inside:
                        inside += 1
                        total_isovist_pts += 1
                    total += 1
                    y += step
                x += step
            room_inside_counts[name] = inside
            room_total_counts[name] = total

        for name in room_inside_counts:
            pct = round(
                (room_inside_counts[name] / total_isovist_pts) * 100, 1
            ) if total_isovist_pts > 0 else 0.0
            results_a[name] = pct

        for name in room_inside_counts:
            total = room_total_counts[name]
            inside = room_inside_counts[name]
            if name == current_room:
                results_b[name] = 100.0
            elif total > 0:
                results_b[name] = round((inside / total) * 100, 1)
            else:
                results_b[name] = 0.0

        a = json.dumps({
            "metric_a_isovist_distribution": results_a,
            "metric_b_room_visibility": results_b
        }, indent=2)

    except Exception as e:
        a = json.dumps({"error": str(e)})
# ---------- end visibility_metrics ----------
merge = Merge(Data1=set_observer_2.info, Data2=visibility_metrics)
panel_9 = Panel(visibility_metrics)

parse_json_string_4 = ParseJSONString(Text=merge)
respond = MCPToolResponse(Request=decall_4.Request, Content=parse_json_string_4, IsError=False)

decall_5 = DeconstructToolCall(Request=sift.Output5)  # -> Request, Tool, Arguments

gjok_8 = GetJSONObjectKey(JObject=decall_5.Arguments, Key="mode")

gjok_9 = GetJSONObjectKey(JObject=decall_5.Arguments, Key="layout_json")

rjv_8 = ReadJSONValue(JValue=gjok_9)  # -> AsString, AsNumber, AsBool
rjv_9 = ReadJSONValue(JValue=gjok_8)  # -> AsString, AsNumber, AsBool

set_viewport = Python3Script(layout_json=rjv_8.AsString, mode=rjv_9.AsString)  # -> room_curves, room_names, door_curves, door_names, furniture_curves, furniture_names, window_curves, structure_curves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; disabled
# ---------- set_viewport: Python ----------
"""
GHPython component: set_viewport
MCP tool for viewport visualization toggle.

PURPOSE:
    Lightweight layout renderer — receives a layout JSON and a display mode,
    outputs Rhino geometry for real-time viewport preview. Unlike
    collision-detector-grid, this does NO analysis — it only draws geometry,
    making before/after toggling instant.

SWIFTLET SETUP:
    1. In team_03_working.gh, add a new GHPython component.
    2. Rename it to "set_viewport" (this becomes the MCP tool name).
    3. Add these INPUT parameters (right-click component > Manage Inputs):
         layout_json   (str)  — Full layout JSON string
         mode          (str)  — Display mode: "all", "rooms", "furniture",
                                "doors", "structure", "outline_only"
    4. Add these OUTPUT parameters (right-click component > Manage Outputs):
         room_curves       (list)  — Room boundary polylines
         room_names        (list)  — Room name labels
         door_curves       (list)  — Door line segments
         door_names        (list)  — Door name labels
         furniture_curves  (list)  — Furniture footprint polylines
         furniture_names   (list)  — Furniture name labels
         window_curves     (list)  — Window line segments
         structure_curves  (list)  — Structure (wall) line segments
         mep_curves        (list)  — MEP footprint polylines
         outline_curve     (curve) — Exterior boundary polyline
         info              (str)   — Status message
    5. Paste this entire script into the GHPython editor.
    6. Connect outputs to Preview/Custom Preview components as desired.
    7. Restart Swiftlet — the tool will auto-discover.

MODES:
    "all"          — Draw everything (rooms, doors, windows, furniture,
                     mep, structure, outline). Default.
    "rooms"        — Rooms + doors + outline only (no furniture).
    "furniture"    — Furniture footprints + room boundaries only.
    "doors"        — Doors + room boundaries only.
    "structure"    — Structure + outline only.
    "outline_only" — Just the exterior boundary.

INPUTS (from Swiftlet MCP call):
    layout_json  (str)  — Full layout JSON (all 7 layers)
    mode         (str)  — Display mode (default: "all")

OUTPUTS:
    Rhino geometry objects assigned to component outputs.
    info (str) — status message returned to the Python agent.
"""

import json
import Rhino.Geometry as rg


# ---------------------------------------------------------------------------
# Geometry helpers
# ---------------------------------------------------------------------------

def create_polyline(points, close=True):
    """Convert a list of [x, y] points to a Rhino PolylineCurve."""
    pts = [rg.Point3d(x, y, 0) for x, y in points]
    if close and len(pts) > 1 and pts[0] != pts[-1]:
        pts.append(pts[0])
    if len(pts) < 2:
        return None
    return rg.Polyline(pts).ToPolylineCurve()


def create_line(points):
    """Convert a 2-point list to a Rhino LineCurve."""
    if len(points) != 2:
        return None
    p1 = rg.Point3d(points[0][0], points[0][1], 0)
    p2 = rg.Point3d(points[1][0], points[1][1], 0)
    return rg.LineCurve(p1, p2)


# ---------------------------------------------------------------------------
# Initialize ALL outputs to empty — prevents GH "null" errors
# ---------------------------------------------------------------------------

room_curves = []
room_names = []
door_curves = []
door_names = []
furniture_curves = []
furniture_names = []
window_curves = []
structure_curves = []
mep_curves = []
outline_curve = None
info = ""


# ---------------------------------------------------------------------------
# Read inputs from GH component (set by Swiftlet MCP call)
# ---------------------------------------------------------------------------

_layout_input = None
try:
    _layout_input = layout_json
except NameError:
    pass

_mode = "all"
try:
    if mode is not None and str(mode).strip() != "":
        _mode = str(mode).strip().lower()
except NameError:
    pass

# Handle list inputs (Swiftlet sometimes wraps in a list)
if isinstance(_layout_input, list):
    _layout_input = _layout_input[0] if len(_layout_input) > 0 else None

if _layout_input is None or str(_layout_input).strip() == "":
    info = json.dumps({"status": "error", "message": "No layout_json received"})
else:
    # ---------------------------------------------------------------------------
    # Parse layout JSON
    # ---------------------------------------------------------------------------
    layout = None
    json_text = str(_layout_input).strip()

    try:
        layout = json.loads(json_text)
    except Exception:
        # Maybe it's a file path
        import os
        if os.path.isfile(json_text):
            try:
                with open(json_text, "r") as fh:
                    layout = json.load(fh)
            except Exception as ex:
                info = json.dumps({"status": "error", "message": "Could not read file: {}".format(ex)})

    if layout is None and info == "":
        info = json.dumps({"status": "error", "message": "Could not parse layout_json"})

    if layout is not None:
        # -------------------------------------------------------------------
        # Determine which layers to draw based on mode
        # -------------------------------------------------------------------
        # "none" mode: clear all geometry (used when switching to analysis views)
        if _mode == "none":
            info = json.dumps({"status": "ok", "mode": "none", "message": "cleared"})

        else:
            show_rooms     = _mode in ("all", "rooms", "furniture", "doors")
            show_doors     = _mode in ("all", "rooms", "doors")
            show_windows   = _mode in ("all", "rooms")
            show_furniture = _mode in ("all", "furniture")
            show_mep       = _mode in ("all",)
            show_structure = _mode in ("all", "structure")
            show_outline   = _mode in ("all", "rooms", "outline_only", "structure",
                                        "furniture", "doors")

            counts = {}

            # -- Rooms --
            if show_rooms:
                for room in layout.get("rooms", []):
                    name = room.get("name")
                    geometry = room.get("geometry")
                    if name and geometry:
                        curve = create_polyline(geometry, close=True)
                        if curve:
                            room_names.append(name)
                            room_curves.append(curve)
                counts["rooms"] = len(room_curves)

            # -- Doors --
            if show_doors:
                for door in layout.get("doors", []):
                    name = door.get("name")
                    geometry = door.get("geometry")
                    if name and geometry:
                        curve = create_line(geometry)
                        if curve:
                            door_names.append(name)
                            door_curves.append(curve)
                counts["doors"] = len(door_curves)

            # -- Windows --
            if show_windows:
                for window in layout.get("windows", []):
                    name = window.get("name")
                    geometry = window.get("geometry")
                    if name and geometry:
                        curve = create_line(geometry)
                        if curve:
                            window_curves.append(curve)
                counts["windows"] = len(window_curves)

            # -- Furniture --
            if show_furniture:
                for furn in layout.get("furniture", []):
                    name = furn.get("name")
                    geometry = furn.get("geometry")
                    if name and geometry:
                        curve = create_polyline(geometry, close=True)
                        if curve:
                            furniture_names.append(name)
                            furniture_curves.append(curve)
                counts["furniture"] = len(furniture_curves)

            # -- MEP --
            if show_mep:
                for mep_item in layout.get("mep", []):
                    name = mep_item.get("name")
                    geometry = mep_item.get("geometry")
                    if name and geometry:
                        curve = create_polyline(geometry, close=True)
                        if curve:
                            mep_curves.append(curve)
                counts["mep"] = len(mep_curves)

            # -- Structure --
            if show_structure:
                for s in layout.get("structure", []):
                    name = s.get("name")
                    geometry = s.get("geometry")
                    if name and geometry:
                        curve = create_line(geometry)
                        if curve:
                            structure_curves.append(curve)
                counts["structure"] = len(structure_curves)

            # -- Outline --
            if show_outline and "outline" in layout:
                outline_curve = create_polyline(layout["outline"], close=True)
                if outline_curve:
                    counts["outline"] = 1

            # ---------------------------------------------------------------
            # Build status message (returned to the Python agent via MCP)
            # ---------------------------------------------------------------
            layout_id = layout.get("layoutId", "unknown")
            info = json.dumps({
                "status": "ok",
                "mode": _mode,
                "layoutId": layout_id,
                "counts": counts,
            })
# ---------- end set_viewport ----------

set_viewport_2 = Python3Script(layout_json=rjv_8.AsString, mode=rjv_9.AsString)  # -> room_curves, room_names, door_curves, door_names, furniture_curves, furniture_names, furniture_labels, furniture_heights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
# ---------- set_viewport_2: Python ----------
"""
GHPython component: set_viewport
MCP tool for viewport visualization toggle.

PURPOSE:
    Lightweight layout renderer — receives a layout JSON and a display mode,
    outputs Rhino geometry for real-time viewport preview. Unlike
    collision-detector-grid, this does NO analysis — it only draws geometry,
    making before/after toggling instant.

SWIFTLET SETUP:
    1. In team_03_working.gh, add a new GHPython component.
    2. Rename it to "set_viewport" (this becomes the MCP tool name).
    3. Add these INPUT parameters (right-click component > Manage Inputs):
         layout_json   (str)  — Full layout JSON string
         mode          (str)  — Display mode: "all", "rooms", "furniture",
                                "doors", "structure", "outline_only"
    4. Add these OUTPUT parameters (right-click component > Manage Outputs):
         room_curves       (list)  — Room boundary polylines
         room_names        (list)  — Room name labels
         door_curves       (list)  — Door line segments
         door_names        (list)  — Door name labels
         furniture_curves  (list)  — Furniture footprint polylines
         furniture_names   (list)  — Furniture name labels
         furniture_heights (list)  — Furniture extrusion heights in metres
         window_curves     (list)  — Window line segments
         structure_curves  (list)  — Structure (wall) line segments
         mep_curves        (list)  — MEP footprint polylines
         outline_curve     (curve) — Exterior boundary polyline
         info              (str)   — Status message
    5. Paste this entire script into the GHPython editor.
    6. Connect furniture_heights to the Extrude height input instead of
       the hardcoded Panel value.
    7. Restart Swiftlet — the tool will auto-discover.

MODES:
    "all"          — Draw everything (rooms, doors, windows, furniture,
                     mep, structure, outline). Default.
    "rooms"        — Rooms + doors + outline only (no furniture).
    "furniture"    — Furniture footprints + room boundaries only.
    "doors"        — Doors + room boundaries only.
    "structure"    — Structure + outline only.
    "outline_only" — Just the exterior boundary.

INPUTS (from Swiftlet MCP call):
    layout_json  (str)  — Full layout JSON (all 7 layers)
    mode         (str)  — Display mode (default: "all")

OUTPUTS:
    Rhino geometry objects assigned to component outputs.
    furniture_heights (list) — Per-object extrusion heights from knowledge base.
    info (str) — status message returned to the Python agent.
"""

import json
import Rhino.Geometry as rg


# ---------------------------------------------------------------------------
# Default heights per object type — matches knowledge/industrial/equipment_heights.json
# Used as fallback when attributes.height is not set in the layout JSON.
# ---------------------------------------------------------------------------

DEFAULT_HEIGHTS = {
    "workbench":                0.900,
    "quality_control_station":  0.900,
    "qc_station":               0.900,
    "qc_table":                 0.900,
    "assembly_station":         0.850,
    "packaging_station":        0.850,
    "labeling_station":         0.900,
    "conveyor":                 0.850,
    "conveyor_section":         0.850,
    "parts_bin_rack":           2.100,
    "storage_rack":             2.400,
    "cnc_machine":              1.800,
    "press_brake":              1.600,
    "lathe":                    1.400,
    "welding_station":          0.900,
    "robot_cell":               2.200,
    "electrical_panel":         2.000,
    "compressor":               1.200,
    "forklift_charging_station": 1.500,
    "pallet_station":           0.150,
    "office_desk":              0.750,
    "tool_cabinet":             1.000,
    "sink":                     0.850,
    "toilet":                   0.400,
}

FALLBACK_HEIGHT = 0.900  # standard workbench height


def _get_furniture_height(furn):
    """
    Resolve the correct extrusion height for a furniture item.
    Priority:
      1. attributes.height — set by add_objects.py when the LLM specifies height
      2. DEFAULT_HEIGHTS lookup by object name (normalized)
      3. FALLBACK_HEIGHT (0.9m)
    """
    # Priority 1: height stored in attributes by add_objects.py
    h = furn.get("attributes", {}).get("height")
    if h is not None:
        try:
            return float(h)
        except (ValueError, TypeError):
            pass

    # Priority 2: match by name against default heights dict
    name = furn.get("name", "").lower().strip()
    # Try exact match first
    if name in DEFAULT_HEIGHTS:
        return DEFAULT_HEIGHTS[name]
    # Try partial match — e.g. "Assembly Station 1" → "assembly_station"
    name_normalized = name.replace(" ", "_")
    if name_normalized in DEFAULT_HEIGHTS:
        return DEFAULT_HEIGHTS[name_normalized]
    # Try substring match — e.g. "Conveyor Section 5" contains "conveyor"
    for key, height in DEFAULT_HEIGHTS.items():
        if key.replace("_", " ") in name or key in name_normalized:
            return height

    # Priority 3: fallback
    return FALLBACK_HEIGHT


# ---------------------------------------------------------------------------
# Geometry helpers
# ---------------------------------------------------------------------------

def create_polyline(points, close=True):
    """Convert a list of [x, y] points to a Rhino PolylineCurve."""
    pts = [rg.Point3d(x, y, 0) for x, y in points]
    if close and len(pts) > 1 and pts[0] != pts[-1]:
        pts.append(pts[0])
    if len(pts) < 2:
        return None
    return rg.Polyline(pts).ToPolylineCurve()


def create_line(points):
    """Convert a 2-point list to a Rhino LineCurve."""
    if len(points) != 2:
        return None
    p1 = rg.Point3d(points[0][0], points[0][1], 0)
    p2 = rg.Point3d(points[1][0], points[1][1], 0)
    return rg.LineCurve(p1, p2)


def centroid_point(points, z=0.0):
    """Return a simple centroid point for polygon-like [x, y] coordinates."""
    if not points:
        return None
    xs = [p[0] for p in points if len(p) >= 2]
    ys = [p[1] for p in points if len(p) >= 2]
    if not xs or not ys:
        return None
    return rg.Point3d(sum(xs) / len(xs), sum(ys) / len(ys), z)


def midpoint_label(points, z=0.0):
    """Return the midpoint of a 2-point segment for door/window labels."""
    if len(points) != 2:
        return None
    return rg.Point3d(
        (points[0][0] + points[1][0]) / 2.0,
        (points[0][1] + points[1][1]) / 2.0,
        z,
    )


def create_label(text, point):
    """Create Rhino label geometry that is visible directly in the viewport."""
    if not text or point is None:
        return None
    return rg.TextDot(str(text), point)


# ---------------------------------------------------------------------------
# Initialize ALL outputs to empty — prevents GH "null" errors
# ---------------------------------------------------------------------------

room_curves      = []
room_names       = []
door_curves      = []
door_names       = []
furniture_curves  = []
furniture_names  = []
furniture_heights = []  # NEW — per-object extrusion heights
window_curves    = []
structure_curves = []
mep_curves       = []
outline_curve    = None
info             = ""


# ---------------------------------------------------------------------------
# Read inputs from GH component (set by Swiftlet MCP call)
# ---------------------------------------------------------------------------

_layout_input = None
try:
    _layout_input = layout_json
except NameError:
    pass

_mode = "all"
try:
    if mode is not None and str(mode).strip() != "":
        _mode = str(mode).strip().lower()
except NameError:
    pass

# Handle list inputs (Swiftlet sometimes wraps in a list)
if isinstance(_layout_input, list):
    _layout_input = _layout_input[0] if len(_layout_input) > 0 else None

if _layout_input is None or str(_layout_input).strip() == "":
    info = json.dumps({"status": "error", "message": "No layout_json received"})
else:
    # ---------------------------------------------------------------------------
    # Parse layout JSON
    # ---------------------------------------------------------------------------
    layout    = None
    json_text = str(_layout_input).strip()

    try:
        layout = json.loads(json_text)
    except Exception:
        import os
        if os.path.isfile(json_text):
            try:
                with open(json_text, "r") as fh:
                    layout = json.load(fh)
            except Exception as ex:
                info = json.dumps({"status": "error",
                                   "message": "Could not read file: {}".format(ex)})

    if layout is None and info == "":
        info = json.dumps({"status": "error",
                           "message": "Could not parse layout_json"})

    if layout is not None:
        if _mode == "none":
            info = json.dumps({"status": "ok", "mode": "none", "message": "cleared"})

        else:
            show_rooms      = _mode in ("all", "rooms", "furniture", "doors")
            show_doors      = _mode in ("all", "rooms", "doors")
            show_windows    = _mode in ("all", "rooms")
            show_furniture  = _mode in ("all", "furniture")
            show_mep        = _mode in ("all",)
            show_structure  = _mode in ("all", "structure")
            show_outline    = _mode in ("all", "rooms", "outline_only",
                                        "structure", "furniture", "doors")

            counts = {}

            # -- Rooms --
            if show_rooms:
                for room in layout.get("rooms", []):
                    name     = room.get("name")
                    geometry = room.get("geometry")
                    if name and geometry:
                        curve = create_polyline(geometry, close=True)
                        if curve:
                            label = create_label(name, centroid_point(geometry, z=0.05))
                            if label:
                                room_names.append(label)
                            room_curves.append(curve)
                counts["rooms"] = len(room_curves)

            # -- Doors --
            if show_doors:
                for door in layout.get("doors", []):
                    name     = door.get("name")
                    geometry = door.get("geometry")
                    if name and geometry:
                        curve = create_line(geometry)
                        if curve:
                            label = create_label(name, midpoint_label(geometry, z=0.08))
                            if label:
                                door_names.append(label)
                            door_curves.append(curve)
                counts["doors"] = len(door_curves)

            # -- Windows --
            if show_windows:
                for window in layout.get("windows", []):
                    name     = window.get("name")
                    geometry = window.get("geometry")
                    if name and geometry:
                        curve = create_line(geometry)
                        if curve:
                            window_curves.append(curve)
                counts["windows"] = len(window_curves)

            # -- Furniture --
            if show_furniture:
                for furn in layout.get("furniture", []):
                    name     = furn.get("name")
                    geometry = furn.get("geometry")
                    if name and geometry:
                        curve = create_polyline(geometry, close=True)
                        if curve:
                            # Resolve correct height for this object
                            fh = _get_furniture_height(furn)
                            furniture_curves.append(curve)
                            furniture_heights.append(fh)

                            # Place label above the object at its actual height
                            label = create_label(
                                name,
                                centroid_point(geometry, z=fh + 0.05)
                            )
                            if label:
                                furniture_names.append(label)
                counts["furniture"] = len(furniture_curves)

            # -- MEP --
            if show_mep:
                for mep_item in layout.get("mep", []):
                    name     = mep_item.get("name")
                    geometry = mep_item.get("geometry")
                    if name and geometry:
                        curve = create_polyline(geometry, close=True)
                        if curve:
                            mep_curves.append(curve)
                counts["mep"] = len(mep_curves)

            # -- Structure --
            if show_structure:
                for s in layout.get("structure", []):
                    name     = s.get("name")
                    geometry = s.get("geometry")
                    if name and geometry:
                        curve = create_line(geometry)
                        if curve:
                            structure_curves.append(curve)
                counts["structure"] = len(structure_curves)

            # -- Outline --
            if show_outline and "outline" in layout:
                outline_curve = create_polyline(layout["outline"], close=True)
                if outline_curve:
                    counts["outline"] = 1

            layout_id = layout.get("layoutId", "unknown")
            info = json.dumps({
                "status":   "ok",
                "mode":     _mode,
                "layoutId": layout_id,
                "counts":   counts,
            })
# ---------- end set_viewport_2 ----------
panel_10 = Panel(set_viewport_2.info)

panel_11 = Panel(set_viewport_2.furniture_heights)
panel_12 = Panel(set_viewport_2.furniture_labels)
crv = Curve(set_viewport_2.furniture_curves)
panel_13 = Panel(set_viewport_2.furniture_names)
room_names = ClusterOutput(set_viewport_2.room_names)

Z = UnitZ(Factor="2")
extr = Extrude(Base=set_viewport_2.door_curves, Direction=Z)
preview_7 = CustomPreview(Geometry=extr, Material=ColourSwatch(SwatchColor=RGBA(255, 255, 0, 181)))

parse_json_string_5 = ParseJSONString(Text=panel_10)
Z_2 = UnitZ(Factor=set_viewport_2.furniture_heights)

boundary = BoundarySurfaces(Edges=set_viewport_2.furniture_curves)
unsplitextr = UnsplitExtrudeSurface(Profile=boundary, Direction=Z_2)
cap = CapHoles(Brep=unsplitextr)
preview_8 = CustomPreview(Geometry=cap, Material=ColourSwatch(SwatchColor=RGBA(100, 166, 93, 177)))

Z_3 = UnitZ(Factor="1")
extr_2 = Extrude(Base=set_viewport_2.window_curves, Direction=Z_3)
move = Move(Geometry=extr_2, Motion=Z_3)  # -> Geometry, Transform
preview_9 = CustomPreview(Geometry=move.Geometry, Material=ColourSwatch(SwatchColor=RGBA(0, 255, 255, 174)))

Z_4 = UnitZ(Factor="3")
extr_3 = Extrude(Base=set_viewport_2.structure_curves, Direction=Z_4)
sdiff = SolidDifference(BrepsA=extr_3, BrepsB=[move.Geometry, extr])
preview_10 = CustomPreview(Geometry=sdiff, Material=ColourSwatch(SwatchColor=RGBA(166, 166, 166, 137)))

# ---- group: Polylines
srf = Surface(set_viewport_2.room_curves)

# ----
data = Data(set_viewport_2.furniture_names)

# ---- group: Labels
area = Area(Geometry=srf)  # -> Area, Centroid
tag = TextTag(Location=area.Centroid, Text=set_viewport_2.furniture_names)
group = Group(Geometry=area.Centroid)

# ----
furniture_names = ClusterOutput(set_viewport_2.furniture_names)
respond_2 = MCPToolResponse(Request=decall_5.Request, Content=parse_json_string_5, IsError=False)

group_2 = Group()
py3_5 = Python3Script(floors=srf, points=group, geometry=group_2, columns=Slider(5, range=0..100), spacing=Slider(5, range=0..10))  # -> out, a, b, c; inputs floors: tree of Surface, points: tree, geometry: tree
# ---------- py3_5: Python ----------
"""
GHPython component: Arrange existing geometry in a grid.

INPUTS:
    geometry   (DataTree)  - Geometry in branches (one branch per layout). Tree Access, ghdoc Object.
    points     (DataTree)  - Points in branches (for text tags). Tree Access, ghdoc Object.
    floors     (DataTree)  - Floor surfaces/curves in branches. Tree Access, ghdoc Object.
    columns    (int)       - Number of columns. Default: 3.
    spacing    (float)     - Gap between cells in meters. Default: 5.0.

OUTPUTS:
    a  = moved geometry (flat list)
    b  = moved points (DataTree grouped by layout)
    c  = moved floors (DataTree grouped by layout)
    d  = bounding boxes per cell
    e  = info
"""

import Rhino.Geometry as rg
import Rhino
import System
import clr
clr.AddReference("Grasshopper")
from Grasshopper.Kernel.Types import GH_GeometricGoo
from Grasshopper import DataTree
from Grasshopper.Kernel.Data import GH_Path

# ---------------------------------------------------------------------------
# Read inputs
# ---------------------------------------------------------------------------
try:
    _cols = int(columns) if columns is not None else 3
except:
    _cols = 3
if _cols < 1:
    _cols = 1

try:
    _spacing = float(spacing) if spacing is not None else 5.0
except:
    _spacing = 5.0

# ---------------------------------------------------------------------------
# Helpers
# ---------------------------------------------------------------------------
def _extract_geos(item):
    """Get list of raw Rhino geometries, flattening nested lists/wrappers."""
    results = []
    try:
        if hasattr(item, "__iter__") and not isinstance(item, str):
            for sub in item:
                results.extend(_extract_geos(sub))
            return results
    except:
        pass
    # .NET List[Object]
    try:
        cnt = item.Count if hasattr(item, "Count") else -1
        if cnt >= 0:
            for idx in range(cnt):
                results.extend(_extract_geos(item[idx]))
            return results
    except:
        pass
    if isinstance(item, GH_GeometricGoo):
        geo = item.DuplicateGeometry()
        if geo is not None:
            results.append(geo)
        return results
    if hasattr(item, "Value"):
        val = item.Value
        if val is not None:
            return _extract_geos(val)
    # Guid — reference to Rhino doc object
    if isinstance(item, System.Guid):
        obj = Rhino.RhinoDoc.ActiveDoc.Objects.FindId(item)
        if obj is not None:
            geo = obj.Geometry
            if geo is not None:
                results.append(geo.Duplicate())
        return results
    if hasattr(item, "GetBoundingBox"):
        results.append(item)
    return results

def _extract_points(item):
    """Get list of Point3d from nested lists/wrappers."""
    results = []
    if isinstance(item, rg.Point3d):
        results.append(item)
        return results
    if isinstance(item, rg.Point):
        results.append(item.Location)
        return results
    if hasattr(item, "Value"):
        val = item.Value
        if val is not None:
            return _extract_points(val)
    try:
        cnt = item.Count if hasattr(item, "Count") else len(item)
        for idx in range(cnt):
            results.extend(_extract_points(item[idx]))
        return results
    except:
        pass
    return results

def _read_tree(tree_input):
    """Safely read branches from a tree input."""
    try:
        return list(tree_input.Branches), len(tree_input.Branches)
    except:
        return [], 0

# ---------------------------------------------------------------------------
# Read trees
# ---------------------------------------------------------------------------
geo_branches, count = _read_tree(geometry)

pt_branches, pt_count = _read_tree(points)
has_points = pt_count > 0

fl_branches, fl_count = _read_tree(floors)
has_floors = fl_count > 0

# ---------------------------------------------------------------------------
# Outputs
# ---------------------------------------------------------------------------
a = []                          # moved geometry
b = DataTree[rg.Point3d]()     # moved points grouped by layout
c = DataTree[object]()         # moved floors grouped by layout
d = []                          # bounding boxes
e = ""                          # info

if count == 0:
    e = "[ERROR] No geometry connected. Set input to Tree Access."
else:
    # --- First pass: extract geos and find max cell size ---
    branch_geos = []
    branch_pts = []
    branch_fls = []
    bboxes = []
    max_w = 0.0
    max_h = 0.0

    for bi in range(count):
        # Geometry
        geos = []
        bb = rg.BoundingBox.Empty
        for item in geo_branches[bi]:
            extracted = _extract_geos(item)
            for geo in extracted:
                bb.Union(geo.GetBoundingBox(True))
                geos.append(geo)
        branch_geos.append(geos)
        bboxes.append(bb)
        if bb.IsValid:
            w = bb.Max.X - bb.Min.X
            h = bb.Max.Y - bb.Min.Y
            if w > max_w:
                max_w = w
            if h > max_h:
                max_h = h

        # Points
        pts = []
        if has_points and bi < pt_count:
            for item in pt_branches[bi]:
                pts.extend(_extract_points(item))
        branch_pts.append(pts)

        # Floors
        fls = []
        if has_floors and bi < fl_count:
            for item in fl_branches[bi]:
                fls.extend(_extract_geos(item))
            if bi == 0:
                print("DEBUG floors branch 0: {} items, {} extracted".format(
                    len(fl_branches[bi]), len(fls)))
                if len(fl_branches[bi]) > 0:
                    print("DEBUG first floor item type: {}".format(type(fl_branches[bi][0])))
        branch_fls.append(fls)

    cell_w = max_w + _spacing
    cell_h = max_h + _spacing

    # --- Second pass: move everything to grid ---
    for idx in range(count):
        col = idx % _cols
        row = idx // _cols
        bb = bboxes[idx]

        if not bb.IsValid:
            continue

        move_vec = rg.Vector3d(
            col * cell_w - bb.Min.X,
            -(row * cell_h) - bb.Min.Y,
            0
        )
        xform = rg.Transform.Translation(move_vec)
        path = GH_Path(idx)

        # Move geometry
        for geo in branch_geos[idx]:
            if hasattr(geo, "Duplicate"):
                copy = geo.Duplicate()
                copy.Transform(xform)
                a.append(copy)
            elif hasattr(geo, "Transform"):
                geo.Transform(xform)
                a.append(geo)

        # Move points
        for pt in branch_pts[idx]:
            moved = rg.Point3d(pt.X + move_vec.X, pt.Y + move_vec.Y, pt.Z + move_vec.Z)
            b.Add(moved, path)

        # Move floors
        for fl in branch_fls[idx]:
            if hasattr(fl, "Duplicate"):
                copy = fl.Duplicate()
                copy.Transform(xform)
                c.Add(copy, path)
            elif hasattr(fl, "Transform"):
                fl.Transform(xform)
                c.Add(fl, path)

        # Bounding box rectangle
        tx = col * cell_w
        ty = -(row * cell_h)
        pad = _spacing * 0.25
        bb_pts = [
            rg.Point3d(tx - pad, ty - pad, 0),
            rg.Point3d(tx + max_w + pad, ty - pad, 0),
            rg.Point3d(tx + max_w + pad, ty + max_h + pad, 0),
            rg.Point3d(tx - pad, ty + max_h + pad, 0),
            rg.Point3d(tx - pad, ty - pad, 0),
        ]
        d.append(rg.Polyline(bb_pts).ToPolylineCurve())

    e = "[OK] {} layouts in {}x{} grid (cell: {:.1f} x {:.1f} m) | {} pts | {} floors".format(
        count, _cols, (count + _cols - 1) // _cols, cell_w, cell_h,
        b.DataCount, c.DataCount
    )
    print(e)
# ---------- end py3_5 ----------
panel_14 = Panel(py3_5.out)
tag_2 = TextTag(Location=py3_5.b)
geo = Geometry(py3_5.a)

lng = ListLength(List=py3_5.c)
x_minus_one = XMinusOne(NumberX=lng)
range = Range(Domain=Domain(0, 1), Steps=x_minus_one)
gradient = Gradient(
    LowerLimit=0,
    UpperLimit=1,
    Parameter=range,
    stops=[0: RGB(48, 18, 59), 0.0294: RGB(56, 40, 112), 0.0588: RGB(63, 62, 156), 0.0882: RGB(68, 82, 193), 0.118: RGB(70, 102, 221), 0.147: RGB(71, 122, 241)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])
preview_11 = CustomPreview(Geometry=py3_5.c, Material=gradient)

decall_6 = DeconstructToolCall(Request=sift.Output4)  # -> Request, Tool, Arguments
gjok_10 = GetJSONObjectKey(JObject=decall_6.Arguments, Key="layout_json")
rjv_10 = ReadJSONValue(JValue=gjok_10)  # -> AsString, AsNumber, AsBool

gjok_11 = GetJSONObjectKey(JObject=decall_6.Arguments, Key="compare_layout_json")

gjok_12 = GetJSONObjectKey(JObject=decall_6.Arguments, Key="wall_thickness")

gjok_13 = GetJSONObjectKey(JObject=decall_6.Arguments, Key="user_profile")

rjv_11 = ReadJSONValue(JValue=gjok_13)  # -> AsString, AsNumber, AsBool
rjv_12 = ReadJSONValue(JValue=gjok_12)  # -> AsString, AsNumber, AsBool
rjv_13 = ReadJSONValue(JValue=gjok_11)  # -> AsString, AsNumber, AsBool
py3_6 = Python3Script(
    layout_json=rjv_10.AsString,
    user_profile=rjv_11.AsString,
    wall_thickness=rjv_12.AsNumber,
    cell_size="0.2",
    compare_json=rjv_13.AsString)  # -> out, a, b, c, d, e, f, g; inputs wall_thickness: Double, cell_size: Double
# ---------- py3_6: Python ----------
"""
GHPython Component: Grid-Based Collision Visualizer
Visualization-only version — draws clearance mesh and violation zones.
All decision-making runs in nodes/collision.py on the Python side.

INPUTS:
    layout_json    (str)   Item  - Layout JSON string
    user_profile   (str)   Item  - User profile JSON (user_type, body_width_m, etc.)
    wall_thickness (float) Item  - Wall thickness in meters (default: 0.20)
    cell_size      (float) Item  - Grid resolution in meters (default: 0.10)

OUTPUTS:
    a = pass_fail        (bool)
    b = violations       (list of str)
    c = violation_zones  (list of Curve)
    d = clearance_mesh   (Mesh)
    e = result_json      (str)
"""
import json
import math
import os
from collections import deque
import Rhino.Geometry as rg
import System.Drawing


# =============================================================================
# PROFILE PARSER
# All values injected by the Python agent — no hardcoded defaults.
# =============================================================================

def get_profile(profile_json):
    try:
        profile = json.loads(str(profile_json).strip())
    except Exception:
        profile = {}
    return {
        "user_type":            profile.get("user_type",            "standard_worker"),
        "body_width_m":         float(profile.get("body_width_m",         0.70)),
        "min_corridor_width_m": float(profile.get("min_corridor_width_m", 0.915)),
        "min_door_width_m":     float(profile.get("min_door_width_m",     0.85)),
        "turning_radius_m":     float(profile.get("turning_radius_m",     0.30)),
    }


# =============================================================================
# LAYOUT PARSER
# =============================================================================

def parse_layout(text):
    if text is None:
        return None
    text = str(text).strip()
    if not text:
        return None
    try:
        return json.loads(text)
    except Exception:
        pass
    if os.path.isfile(text):
        try:
            with open(text, "r") as fh:
                return json.load(fh)
        except Exception:
            pass
    return None


# =============================================================================
# WALL GEOMETRY HELPERS
# =============================================================================

def _point_on_segment_t(seg_p1, seg_p2, pt, tolerance=0.02):
    dx = seg_p2[0] - seg_p1[0]
    dy = seg_p2[1] - seg_p1[1]
    seg_len_sq = dx * dx + dy * dy
    if seg_len_sq < 1e-12:
        return None
    t = ((pt[0] - seg_p1[0]) * dx + (pt[1] - seg_p1[1]) * dy) / seg_len_sq
    proj_x = seg_p1[0] + t * dx
    proj_y = seg_p1[1] + t * dy
    dist_sq = (pt[0] - proj_x) ** 2 + (pt[1] - proj_y) ** 2
    if dist_sq > tolerance * tolerance:
        return None
    return t


def _split_wall_at_doors(wp1, wp2, door_segments, half_thickness):
    door_intervals = []
    for dp1, dp2 in door_segments:
        t1 = _point_on_segment_t(wp1, wp2, dp1)
        t2 = _point_on_segment_t(wp1, wp2, dp2)
        if t1 is not None and t2 is not None:
            door_intervals.append((min(t1, t2), max(t1, t2)))
    if not door_intervals:
        return [(wp1, wp2)]
    door_intervals.sort()
    merged = [door_intervals[0]]
    for start, end in door_intervals[1:]:
        if start <= merged[-1][1]:
            merged[-1] = (merged[-1][0], max(merged[-1][1], end))
        else:
            merged.append((start, end))
    dx = wp2[0] - wp1[0]
    dy = wp2[1] - wp1[1]
    parts = []
    prev_t = 0.0
    for t_start, t_end in merged:
        if t_start > prev_t + 0.001:
            p_a = [wp1[0] + prev_t * dx, wp1[1] + prev_t * dy]
            p_b = [wp1[0] + t_start * dx, wp1[1] + t_start * dy]
            parts.append((p_a, p_b))
        prev_t = t_end
    if prev_t < 1.0 - 0.001:
        p_a = [wp1[0] + prev_t * dx, wp1[1] + prev_t * dy]
        parts.append((p_a, list(wp2)))
    return parts


def _buffer_wall_segment(p1, p2, half_thickness):
    dx = p2[0] - p1[0]
    dy = p2[1] - p1[1]
    length = math.sqrt(dx * dx + dy * dy)
    if length < 1e-9:
        return None
    nx = -dy / length * half_thickness
    ny =  dx / length * half_thickness
    return [
        [p1[0] + nx, p1[1] + ny],
        [p2[0] + nx, p2[1] + ny],
        [p2[0] - nx, p2[1] - ny],
        [p1[0] - nx, p1[1] - ny],
        [p1[0] + nx, p1[1] + ny],
    ]


# =============================================================================
# GRID RASTERIZATION
# =============================================================================

def _rasterize_polygon(polygon_pts, grid, cols, rows, ox, oy, cs, value):
    n = len(polygon_pts)
    if n < 3:
        return
    gpts = [((p[0] - ox) / cs, (p[1] - oy) / cs) for p in polygon_pts]
    min_gy = max(0, int(math.floor(min(p[1] for p in gpts))))
    max_gy = min(rows - 1, int(math.floor(max(p[1] for p in gpts))))
    for gy in range(min_gy, max_gy + 1):
        scanline_y = gy + 0.5
        intersections = []
        for i in range(n - 1):
            y0, y1 = gpts[i][1], gpts[i + 1][1]
            if y0 == y1:
                continue
            if min(y0, y1) <= scanline_y < max(y0, y1):
                t = (scanline_y - y0) / (y1 - y0)
                intersections.append(gpts[i][0] + t * (gpts[i + 1][0] - gpts[i][0]))
        intersections.sort()
        for k in range(0, len(intersections) - 1, 2):
            x_start = max(0, int(math.floor(intersections[k])))
            x_end   = min(cols - 1, int(math.floor(intersections[k + 1])))
            for gx in range(x_start, x_end + 1):
                grid[gy * cols + gx] = value


# =============================================================================
# DISTANCE FIELD (BFS)
# =============================================================================

def _compute_distance_field(grid, cols, rows):
    total = cols * rows
    dist  = [0] * total
    queue = deque()
    for idx in range(total):
        if grid[idx] == -2:
            dist[idx] = 0
            queue.append(idx)
        elif grid[idx] == -1:
            dist[idx] = -1
        else:
            dist[idx] = 999999
    while queue:
        idx = queue.popleft()
        x = idx % cols
        y = idx // cols
        d = dist[idx]
        for nidx in [idx-1, idx+1, idx-cols, idx+cols]:
            nx = nidx % cols
            ny = nidx // cols
            if 0 <= nx < cols and 0 <= ny < rows and dist[nidx] > d + 1:
                dist[nidx] = d + 1
                queue.append(nidx)
    return dist


# =============================================================================
# VISUALIZATION HELPERS
# =============================================================================

def _cells_to_zones(cell_list, cols, rows, ox, oy, cs):
    if not cell_list:
        return []
    cell_set   = set(cell_list)
    visited    = set()
    rectangles = []
    for cell in cell_list:
        if cell in visited:
            continue
        cluster = []
        stack   = [cell]
        while stack:
            c = stack.pop()
            if c in visited or c not in cell_set:
                continue
            visited.add(c)
            cluster.append(c)
            x = c % cols
            y = c // cols
            if x > 0:               stack.append(c - 1)
            if x < cols - 1:        stack.append(c + 1)
            if y > 0:               stack.append(c - cols)
            if y < rows - 1:        stack.append(c + cols)
        if len(cluster) < 4:
            continue
        xs     = [c % cols for c in cluster]
        ys     = [c // cols for c in cluster]
        min_wx = min(xs) * cs + ox
        max_wx = (max(xs) + 1) * cs + ox
        min_wy = min(ys) * cs + oy
        max_wy = (max(ys) + 1) * cs + oy
        pts    = [rg.Point3d(min_wx, min_wy, 0), rg.Point3d(max_wx, min_wy, 0),
                  rg.Point3d(max_wx, max_wy, 0), rg.Point3d(min_wx, max_wy, 0),
                  rg.Point3d(min_wx, min_wy, 0)]
        rectangles.append(rg.Polyline(pts).ToPolylineCurve())
    return rectangles


def _create_clearance_mesh(dist, cols, rows, ox, oy, cs, threshold_cells):
    mesh  = rg.Mesh()
    limit = threshold_cells * 3
    for idx in range(cols * rows):
        d = dist[idx]
        if d < 0 or d > limit:
            continue
        x  = idx % cols
        y  = idx // cols
        wx = ox + x * cs
        wy = oy + y * cs
        vi = mesh.Vertices.Count
        mesh.Vertices.Add(wx,      wy,      0)
        mesh.Vertices.Add(wx + cs, wy,      0)
        mesh.Vertices.Add(wx + cs, wy + cs, 0)
        mesh.Vertices.Add(wx,      wy + cs, 0)
        mesh.Faces.AddFace(vi, vi + 1, vi + 2, vi + 3)
        if d < threshold_cells:
            r, g, b = 220, 40, 40
        elif d < threshold_cells * 1.5:
            t = (d - threshold_cells) / (threshold_cells * 0.5)
            r = int(220 - t * 100)
            g = int(40  + t * 125)
            b = 40
        else:
            r, g, b = 60, 180, 60
        color = System.Drawing.Color.FromArgb(180, r, g, b)
        for _ in range(4):
            mesh.VertexColors.Add(color)
    return mesh


# =============================================================================
# MAIN ANALYSIS — visualization only
# =============================================================================

def _analyze(layout, profile, wall_thick, cs):
    outline = layout.get("outline", [])
    if not outline or len(outline) < 3:
        return None

    all_x = [p[0] for p in outline]
    all_y = [p[1] for p in outline]
    ox    = min(all_x)
    oy    = min(all_y)
    cols  = int(math.ceil((max(all_x) - ox) / cs)) + 1
    rows  = int(math.ceil((max(all_y) - oy) / cs)) + 1
    total = cols * rows
    grid  = [-1] * total

    # Free space
    _rasterize_polygon(outline, grid, cols, rows, ox, oy, cs, 0)

    # Door segments for wall splitting
    door_segments = [
        (d["geometry"][0], d["geometry"][1])
        for d in layout.get("doors", [])
        if len(d.get("geometry", [])) == 2
    ]
    half_t = wall_thick / 2.0

    # Walls
    for wall in layout.get("structure", []):
        geom = wall.get("geometry", [])
        if len(geom) != 2:
            continue
        for seg_p1, seg_p2 in _split_wall_at_doors(geom[0], geom[1], door_segments, half_t):
            rect = _buffer_wall_segment(seg_p1, seg_p2, half_t)
            if rect:
                _rasterize_polygon(rect, grid, cols, rows, ox, oy, cs, -2)

    # Furniture
    for furn in layout.get("furniture", []):
        geom = furn.get("geometry", [])
        if len(geom) >= 3:
            _rasterize_polygon(geom, grid, cols, rows, ox, oy, cs, -2)

    # MEP
    for mep in layout.get("mep", []):
        geom = mep.get("geometry", [])
        if len(geom) >= 3:
            _rasterize_polygon(geom, grid, cols, rows, ox, oy, cs, -2)

    dist = _compute_distance_field(grid, cols, rows)

    body_half_cells     = int(math.ceil((profile["body_width_m"]         / 2.0) / cs))
    corridor_half_cells = int(math.ceil((profile["min_corridor_width_m"] / 2.0) / cs))

    violation_cells = []
    warning_cells   = []
    violations      = []

    for idx in range(total):
        d = dist[idx]
        if d <= 0 or d == -1:
            continue
        if d < body_half_cells:
            violation_cells.append(idx)
        elif d < corridor_half_cells:
            warning_cells.append(idx)

    if violation_cells:
        violations.append(
            "BLOCKED: {} cells ({:.2f}m²) clearance < {:.2f}m".format(
                len(violation_cells),
                len(violation_cells) * cs * cs,
                profile["body_width_m"] / 2.0,
            )
        )
    if warning_cells:
        violations.append(
            "WARNING: {} cells ({:.2f}m²) below corridor spec {:.2f}m".format(
                len(warning_cells),
                len(warning_cells) * cs * cs,
                profile["min_corridor_width_m"] / 2.0,
            )
        )

    # Door width check
    for door in layout.get("doors", []):
        geom = door.get("geometry", [])
        if len(geom) == 2:
            dx    = geom[1][0] - geom[0][0]
            dy    = geom[1][1] - geom[0][1]
            width = math.sqrt(dx*dx + dy*dy)
            if width < profile["min_door_width_m"] - 0.01:
                violations.append(
                    "DOOR_WIDTH: '{}' {:.2f}m < required {:.2f}m".format(
                        door.get("name", door.get("id", "?")),
                        width, profile["min_door_width_m"],
                    )
                )

    hard   = [v for v in violations if not v.startswith("WARNING:")]
    passed = len(hard) == 0

    return {
        "passed":          passed,
        "violations":      violations,
        "violation_cells": violation_cells,
        "warning_cells":   warning_cells,
        "dist":            dist,
        "cols":            cols,
        "rows":            rows,
        "ox":              ox,
        "oy":              oy,
    }


# =============================================================================
# MAIN EXECUTION
# =============================================================================

a = True
b = []
c = []
d = None
e = ""

try:
    _layout_json = layout_json
except NameError:
    _layout_json = None

try:
    _user_profile = user_profile
except NameError:
    _user_profile = None

try:
    _wall_thickness = float(wall_thickness) if wall_thickness is not None else 0.20
except (NameError, TypeError, ValueError):
    _wall_thickness = 0.20

try:
    _cell_size = float(cell_size) if cell_size is not None else 0.10
except (NameError, TypeError, ValueError):
    _cell_size = 0.10

layout = parse_layout(_layout_json)
if layout is None:
    a = False
    b = ["ERROR: Could not parse layout_json input"]
    e = json.dumps({"pass": False, "error": "Could not parse layout_json"})
else:
    profile = get_profile(_user_profile)
    result  = _analyze(layout, profile, _wall_thickness, _cell_size)

    if result is None:
        a = False
        b = ["ERROR: No valid outline in layout"]
        e = json.dumps({"pass": False, "error": "No valid outline"})
    else:
        a = result["passed"]
        b = result["violations"]

        all_flagged = result["violation_cells"] + result["warning_cells"]
        if all_flagged:
            c = _cells_to_zones(
                all_flagged,
                result["cols"], result["rows"],
                result["ox"], result["oy"], _cell_size,
            )

        if result["dist"] is not None:
            corridor_half = int(math.ceil(
                (profile["min_corridor_width_m"] / 2.0) / _cell_size))
            d = _create_clearance_mesh(
                result["dist"],
                result["cols"], result["rows"],
                result["ox"], result["oy"],
                _cell_size, corridor_half,
            )

        e = json.dumps({
            "pass":           a,
            "profile":        profile,
            "total_blocked":  round(len(result["violation_cells"]) * _cell_size ** 2, 3),
            "total_warning":  round(len(result["warning_cells"])   * _cell_size ** 2, 3),
            "violations":     b,
        })
# ---------- end py3_6 ----------
panel_15 = Panel(py3_6.e)
parse_json_string_6 = ParseJSONString(Text=panel_15)
respond_3 = MCPToolResponse(Request=decall_6.Request, Content=parse_json_string_6, IsError=False)

py3_7 = Python3Script(
    layout_json=rjv_10.AsString,
    user_profile=rjv_11.AsString,
    wall_thickness=rjv_12.AsNumber,
    cell_size="0.2",
    compare_json=rjv_13.AsString)  # -> out, a, b, c, d, e, f, g; inputs wall_thickness: Double, cell_size: Double; disabled
# ---------- py3_7: Python ----------
"""
GHPython Component: Grid-Based Collision Detector
Analyzes layout JSON for accessibility collisions using a clearance field.
Supports use_point / functional_point analysis for furniture interaction zones.

INPUTS:
    layout_json    (str)   Item  - Layout JSON string or file path
    user_profile   (str)   Item  - User profile JSON (user_type, body_width_m, etc.)
    wall_thickness (float) Item  - Wall thickness in meters (default: 0.20)
    cell_size      (float) Item  - Grid resolution in meters (default: 0.10)
    compare_json   (str)   Item  - Optional previous layout for before/after diff

OUTPUTS:
    a = pass_fail        (bool)
    b = violations       (list of str)
    c = violation_zones  (list of Curve)
    d = clearance_mesh   (Mesh)
    e = unified_json     (str) - Comprehensive unified report JSON
    f = new_violations   (list of str)
    g = new_zones        (list of Curve)
"""
import json
import math
import os
from collections import deque
import Rhino.Geometry as rg
import System.Drawing


# =============================================================================
# PROFILE PARSER
# All values are injected by the Python agent — no hardcoded defaults needed.
# =============================================================================

def get_profile(profile_json):
    """Parse user profile from injected JSON — all values provided by Python agent."""
    try:
        profile = json.loads(str(profile_json).strip())
    except Exception:
        profile = {}
    return {
        "user_type":            profile.get("user_type",            "standard_worker"),
        "body_width_m":         float(profile.get("body_width_m",         0.70)),
        "min_corridor_width_m": float(profile.get("min_corridor_width_m", 0.915)),
        "min_door_width_m":     float(profile.get("min_door_width_m",     0.85)),
        "turning_radius_m":     float(profile.get("turning_radius_m",     0.30)),
    }


# =============================================================================
# GEOMETRY HELPERS
# =============================================================================

def parse_layout(text):
    """Parse JSON string or file path into layout dict."""
    if text is None:
        return None
    text = str(text).strip()
    if not text:
        return None
    try:
        return json.loads(text)
    except:
        pass
    if os.path.isfile(text):
        try:
            with open(text, "r") as fh:
                return json.load(fh)
        except:
            pass
    return None


def _point_on_segment_t(seg_p1, seg_p2, pt, tolerance=0.02):
    dx = seg_p2[0] - seg_p1[0]
    dy = seg_p2[1] - seg_p1[1]
    seg_len_sq = dx * dx + dy * dy
    if seg_len_sq < 1e-12:
        return None
    t = ((pt[0] - seg_p1[0]) * dx + (pt[1] - seg_p1[1]) * dy) / seg_len_sq
    proj_x = seg_p1[0] + t * dx
    proj_y = seg_p1[1] + t * dy
    dist_sq = (pt[0] - proj_x) ** 2 + (pt[1] - proj_y) ** 2
    if dist_sq > tolerance * tolerance:
        return None
    return t


def _split_wall_at_doors(wp1, wp2, door_segments, half_thickness):
    door_intervals = []
    for dp1, dp2 in door_segments:
        t1 = _point_on_segment_t(wp1, wp2, dp1)
        t2 = _point_on_segment_t(wp1, wp2, dp2)
        if t1 is not None and t2 is not None:
            t_min = min(t1, t2)
            t_max = max(t1, t2)
            door_intervals.append((t_min, t_max))

    if not door_intervals:
        return [(wp1, wp2)]

    door_intervals.sort()
    merged = [door_intervals[0]]
    for start, end in door_intervals[1:]:
        if start <= merged[-1][1]:
            merged[-1] = (merged[-1][0], max(merged[-1][1], end))
        else:
            merged.append((start, end))

    dx = wp2[0] - wp1[0]
    dy = wp2[1] - wp1[1]
    parts = []
    prev_t = 0.0
    for t_start, t_end in merged:
        if t_start > prev_t + 0.001:
            p_a = [wp1[0] + prev_t * dx, wp1[1] + prev_t * dy]
            p_b = [wp1[0] + t_start * dx, wp1[1] + t_start * dy]
            parts.append((p_a, p_b))
        prev_t = t_end
    if prev_t < 1.0 - 0.001:
        p_a = [wp1[0] + prev_t * dx, wp1[1] + prev_t * dy]
        parts.append((p_a, list(wp2)))

    return parts


def buffer_wall_segment(p1, p2, half_thickness):
    dx = p2[0] - p1[0]
    dy = p2[1] - p1[1]
    length = math.sqrt(dx * dx + dy * dy)
    if length < 1e-9:
        return None
    nx = -dy / length * half_thickness
    ny = dx / length * half_thickness
    return [
        [p1[0] + nx, p1[1] + ny],
        [p2[0] + nx, p2[1] + ny],
        [p2[0] - nx, p2[1] - ny],
        [p1[0] - nx, p1[1] - ny],
        [p1[0] + nx, p1[1] + ny],
    ]


# =============================================================================
# GRID RASTERIZATION
# =============================================================================

def rasterize_polygon(polygon_pts, grid, cols, rows, ox, oy, cs, value):
    n = len(polygon_pts)
    if n < 3:
        return
    gpts = []
    for pt in polygon_pts:
        gx = (pt[0] - ox) / cs
        gy = (pt[1] - oy) / cs
        gpts.append((gx, gy))

    min_gy = max(0, int(math.floor(min(p[1] for p in gpts))))
    max_gy = min(rows - 1, int(math.floor(max(p[1] for p in gpts))))

    for gy in range(min_gy, max_gy + 1):
        scanline_y = gy + 0.5
        intersections = []
        for i in range(n - 1):
            y0 = gpts[i][1]
            y1 = gpts[i + 1][1]
            if y0 == y1:
                continue
            if min(y0, y1) <= scanline_y < max(y0, y1):
                t = (scanline_y - y0) / (y1 - y0)
                x_int = gpts[i][0] + t * (gpts[i + 1][0] - gpts[i][0])
                intersections.append(x_int)
        intersections.sort()
        for k in range(0, len(intersections) - 1, 2):
            x_start = max(0, int(math.floor(intersections[k])))
            x_end = min(cols - 1, int(math.floor(intersections[k + 1])))
            for gx in range(x_start, x_end + 1):
                idx = gy * cols + gx
                grid[idx] = value


def rasterize_polygon_attributed(polygon_pts, grid, attrib_grid, cols, rows, ox, oy, cs, value, obj_index):
    n = len(polygon_pts)
    if n < 3:
        return
    gpts = []
    for pt in polygon_pts:
        gx = (pt[0] - ox) / cs
        gy = (pt[1] - oy) / cs
        gpts.append((gx, gy))

    min_gy = max(0, int(math.floor(min(p[1] for p in gpts))))
    max_gy = min(rows - 1, int(math.floor(max(p[1] for p in gpts))))

    for gy in range(min_gy, max_gy + 1):
        scanline_y = gy + 0.5
        intersections = []
        for i in range(n - 1):
            y0 = gpts[i][1]
            y1 = gpts[i + 1][1]
            if y0 == y1:
                continue
            if min(y0, y1) <= scanline_y < max(y0, y1):
                t = (scanline_y - y0) / (y1 - y0)
                x_int = gpts[i][0] + t * (gpts[i + 1][0] - gpts[i][0])
                intersections.append(x_int)
        intersections.sort()
        for k in range(0, len(intersections) - 1, 2):
            x_start = max(0, int(math.floor(intersections[k])))
            x_end = min(cols - 1, int(math.floor(intersections[k + 1])))
            for gx in range(x_start, x_end + 1):
                idx = gy * cols + gx
                grid[idx] = value
                attrib_grid[idx] = obj_index


# =============================================================================
# DISTANCE FIELD & ATTRIBUTION
# =============================================================================

def compute_distance_field(grid, cols, rows):
    total = cols * rows
    dist = [0] * total
    queue = deque()

    for idx in range(total):
        if grid[idx] == -2:
            dist[idx] = 0
            queue.append(idx)
        elif grid[idx] == -1:
            dist[idx] = -1
        else:
            dist[idx] = 999999

    while queue:
        idx = queue.popleft()
        x = idx % cols
        y = idx // cols
        d = dist[idx]
        if x > 0:
            nidx = idx - 1
            if dist[nidx] > d + 1:
                dist[nidx] = d + 1
                queue.append(nidx)
        if x < cols - 1:
            nidx = idx + 1
            if dist[nidx] > d + 1:
                dist[nidx] = d + 1
                queue.append(nidx)
        if y > 0:
            nidx = idx - cols
            if dist[nidx] > d + 1:
                dist[nidx] = d + 1
                queue.append(nidx)
        if y < rows - 1:
            nidx = idx + cols
            if dist[nidx] > d + 1:
                dist[nidx] = d + 1
                queue.append(nidx)

    return dist


def compute_nearest_obstacle(grid, attrib_grid, cols, rows):
    total = cols * rows
    dist = [0] * total
    nearest = [-1] * total
    queue = deque()

    for idx in range(total):
        if grid[idx] == -2:
            dist[idx] = 0
            nearest[idx] = attrib_grid[idx]
            queue.append(idx)
        elif grid[idx] == -1:
            dist[idx] = -1
        else:
            dist[idx] = 999999

    while queue:
        idx = queue.popleft()
        x = idx % cols
        y = idx // cols
        d = dist[idx]
        obj_i = nearest[idx]
        if x > 0:
            nidx = idx - 1
            if dist[nidx] > d + 1:
                dist[nidx] = d + 1
                nearest[nidx] = obj_i
                queue.append(nidx)
        if x < cols - 1:
            nidx = idx + 1
            if dist[nidx] > d + 1:
                dist[nidx] = d + 1
                nearest[nidx] = obj_i
                queue.append(nidx)
        if y > 0:
            nidx = idx - cols
            if dist[nidx] > d + 1:
                dist[nidx] = d + 1
                nearest[nidx] = obj_i
                queue.append(nidx)
        if y < rows - 1:
            nidx = idx + cols
            if dist[nidx] > d + 1:
                dist[nidx] = d + 1
                nearest[nidx] = obj_i
                queue.append(nidx)

    return nearest


# =============================================================================
# USE-POINT & FUNCTIONAL-LINE ANALYSIS
# =============================================================================

def check_use_point_clearance(use_point, dist, attrib_grid, self_obj_index, cols, rows, ox, oy, cs, body_half_cells):
    gx = int(round((use_point[0] - ox) / cs))
    gy = int(round((use_point[1] - oy) / cs))
    if gx < 0 or gx >= cols or gy < 0 or gy >= rows:
        required_m = body_half_cells * cs
        return {"clearance_m": 0.0, "sufficient": False, "deficit_m": round(required_m, 3)}

    idx = gy * cols + gx
    d = dist[idx]

    if d <= 0 and attrib_grid[idx] == self_obj_index:
        best_d = 999999
        search_r = body_half_cells + 3
        for dy_s in range(-search_r, search_r + 1):
            for dx_s in range(-search_r, search_r + 1):
                nx, ny = gx + dx_s, gy + dy_s
                if 0 <= nx < cols and 0 <= ny < rows:
                    ni = ny * cols + nx
                    if dist[ni] > 0 and dist[ni] < best_d:
                        best_d = dist[ni]
        d = best_d if best_d < 999999 else 0

    if d < 0:
        required_m = body_half_cells * cs
        return {"clearance_m": 0.0, "sufficient": False, "deficit_m": round(required_m, 3)}

    clearance_m = d * cs
    required_m = body_half_cells * cs
    return {
        "clearance_m": round(clearance_m, 3),
        "sufficient": d >= body_half_cells,
        "deficit_m": round(max(0, required_m - clearance_m), 3),
    }


def compute_reachable_from_doors(doors, dist, cols, rows, ox, oy, cs, body_half_cells):
    if not doors:
        return set()

    first_door = None
    for door in doors:
        geom = door.get("geometry", [])
        if len(geom) == 2:
            first_door = door
            break
    if first_door is None:
        return set()

    geom = first_door["geometry"]
    mid_x = (geom[0][0] + geom[1][0]) / 2.0
    mid_y = (geom[0][1] + geom[1][1]) / 2.0
    dcx = int((mid_x - ox) / cs)
    dcy = int((mid_y - oy) / cs)

    search_radius = body_half_cells + 4
    seeds = set()
    for dy in range(-search_radius, search_radius + 1):
        for dx in range(-search_radius, search_radius + 1):
            nx, ny = dcx + dx, dcy + dy
            if 0 <= nx < cols and 0 <= ny < rows:
                ni = ny * cols + nx
                if dist[ni] >= body_half_cells:
                    seeds.add(ni)

    if not seeds:
        return set()

    reachable = set(seeds)
    bfs_q = deque(list(seeds))
    while bfs_q:
        ci = bfs_q.popleft()
        cx_pos = ci % cols
        cy_pos = ci // cols
        neighbors = []
        if cx_pos > 0:
            neighbors.append(ci - 1)
        if cx_pos < cols - 1:
            neighbors.append(ci + 1)
        if cy_pos > 0:
            neighbors.append(ci - cols)
        if cy_pos < rows - 1:
            neighbors.append(ci + cols)
        for ni in neighbors:
            if ni not in reachable and dist[ni] >= body_half_cells:
                reachable.add(ni)
                bfs_q.append(ni)

    return reachable


def check_use_point_reachability(use_point, reachable_set, dist, cols, rows, ox, oy, cs, body_half_cells):
    if not reachable_set:
        return {"reachable": False, "reason": "no reachable cells computed (no doors?)"}

    gx = int(round((use_point[0] - ox) / cs))
    gy = int(round((use_point[1] - oy) / cs))
    if gx < 0 or gx >= cols or gy < 0 or gy >= rows:
        return {"reachable": False, "reason": "use_point outside grid bounds"}

    search_r = max(3, body_half_cells + 1)
    for dy in range(-search_r, search_r + 1):
        for dx in range(-search_r, search_r + 1):
            nx, ny = gx + dx, gy + dy
            if 0 <= nx < cols and 0 <= ny < rows:
                ni = ny * cols + nx
                if ni in reachable_set:
                    return {"reachable": True, "reason": None}

    return {"reachable": False, "reason": "no passable path from doors to use_point"}


def bresenham(x0, y0, x1, y1):
    cells = []
    dx = abs(x1 - x0)
    dy = abs(y1 - y0)
    sx = 1 if x0 < x1 else -1
    sy = 1 if y0 < y1 else -1
    err = dx - dy
    while True:
        cells.append((x0, y0))
        if x0 == x1 and y0 == y1:
            break
        e2 = 2 * err
        if e2 > -dy:
            err -= dy
            x0 += sx
        if e2 < dx:
            err += dx
            y0 += sy
    return cells


def check_functional_line(use_point, functional_point, grid, attrib_grid, obj_registry, self_obj_index, cols, rows, ox, oy, cs):
    x0 = int(round((use_point[0] - ox) / cs))
    y0 = int(round((use_point[1] - oy) / cs))
    x1 = int(round((functional_point[0] - ox) / cs))
    y1 = int(round((functional_point[1] - oy) / cs))

    x0 = max(0, min(cols - 1, x0))
    y0 = max(0, min(rows - 1, y0))
    x1 = max(0, min(cols - 1, x1))
    y1 = max(0, min(rows - 1, y1))

    cells = bresenham(x0, y0, x1, y1)

    for (cx, cy) in cells:
        if cx < 0 or cx >= cols or cy < 0 or cy >= rows:
            continue
        idx = cy * cols + cx
        if grid[idx] == -2:
            obj_i = attrib_grid[idx]
            if obj_i == self_obj_index:
                continue
            blocking_obj = obj_registry[obj_i] if 0 <= obj_i < len(obj_registry) else {"id": "unknown", "name": "unknown", "type": "unknown"}
            block_world = [round(ox + cx * cs, 3), round(oy + cy * cs, 3)]
            return {
                "blocked": True,
                "blocking_object_id": blocking_obj["id"],
                "blocking_object_name": blocking_obj["name"],
                "blocking_object_type": blocking_obj["type"],
                "block_point": block_world,
            }

    return {"blocked": False}


def compute_move_suggestion(use_point, dist, nearest, obj_registry, cols, rows, ox, oy, cs, body_half_cells):
    gx = int(round((use_point[0] - ox) / cs))
    gy = int(round((use_point[1] - oy) / cs))

    if gx < 1 or gx >= cols - 1 or gy < 1 or gy >= rows - 1:
        return None

    idx = gy * cols + gx
    current_d = dist[idx]
    if current_d < 0 or current_d >= body_half_cells:
        return None

    d_right = dist[idx + 1] if dist[idx + 1] >= 0 else 0
    d_left  = dist[idx - 1] if dist[idx - 1] >= 0 else 0
    d_up    = dist[idx + cols] if dist[idx + cols] >= 0 else 0
    d_down  = dist[idx - cols] if dist[idx - cols] >= 0 else 0

    grad_x = (d_right - d_left) / 2.0
    grad_y = (d_up - d_down) / 2.0

    mag = math.sqrt(grad_x * grad_x + grad_y * grad_y)
    if mag < 0.01:
        return None

    dx_norm = grad_x / mag
    dy_norm = grad_y / mag

    deficit_cells = body_half_cells - current_d
    deficit_m = deficit_cells * cs
    move_distance_m = deficit_m / min(mag, 1.0)

    nearest_obj_id = None
    if nearest[idx] >= 0 and nearest[idx] < len(obj_registry):
        nearest_obj_id = obj_registry[nearest[idx]]["id"]

    return {
        "direction":           [round(dx_norm, 3), round(dy_norm, 3)],
        "distance_m":          round(move_distance_m, 3),
        "deficit_m":           round(deficit_m, 3),
        "nearest_obstacle_id": nearest_obj_id,
    }


# =============================================================================
# ANALYSIS
# =============================================================================

def analyze_layout(layout, profile, wall_thick, cs):
    outline = layout.get("outline", [])
    if not outline or len(outline) < 3:
        return {
            "violations": ["No valid outline found"],
            "violation_cells": [], "warning_cells": [],
            "dist": None, "cols": 0, "rows": 0, "ox": 0, "oy": 0,
            "object_violations": [], "use_point_results": {},
            "door_violations": [], "turning_violations": [],
        }

    all_x = [p[0] for p in outline]
    all_y = [p[1] for p in outline]
    ox     = min(all_x)
    oy     = min(all_y)
    max_x  = max(all_x)
    max_y  = max(all_y)
    cols   = int(math.ceil((max_x - ox) / cs)) + 1
    rows   = int(math.ceil((max_y - oy) / cs)) + 1

    total       = cols * rows
    grid        = [-1] * total
    attrib_grid = [-1] * total
    obj_registry = []

    rasterize_polygon(outline, grid, cols, rows, ox, oy, cs, 0)

    half_t = wall_thick / 2.0

    door_segments = []
    for door in layout.get("doors", []):
        dg = door.get("geometry", [])
        if len(dg) == 2:
            door_segments.append((dg[0], dg[1]))

    for wall in layout.get("structure", []):
        geom = wall.get("geometry", [])
        if len(geom) != 2:
            continue
        obj_index = len(obj_registry)
        obj_registry.append({
            "id":               wall.get("id", "unknown"),
            "name":             wall.get("name", "unnamed wall"),
            "type":             "structure",
            "use_point":        None,
            "functional_point": None,
        })
        wp1, wp2 = geom[0], geom[1]
        wall_parts = _split_wall_at_doors(wp1, wp2, door_segments, half_t)
        for seg_p1, seg_p2 in wall_parts:
            rect = buffer_wall_segment(seg_p1, seg_p2, half_t)
            if rect:
                rasterize_polygon_attributed(rect, grid, attrib_grid, cols, rows, ox, oy, cs, -2, obj_index)

    for furn in layout.get("furniture", []):
        geom = furn.get("geometry", [])
        if len(geom) >= 3:
            obj_index = len(obj_registry)
            obj_registry.append({
                "id":               furn.get("id", "unknown"),
                "name":             furn.get("name", "unnamed furniture"),
                "type":             "furniture",
                "use_point":        furn.get("use_point", None),
                "functional_point": furn.get("functional_point", None),
            })
            rasterize_polygon_attributed(furn["geometry"], grid, attrib_grid, cols, rows, ox, oy, cs, -2, obj_index)

    for mep_item in layout.get("mep", []):
        geom = mep_item.get("geometry", [])
        if len(geom) >= 3:
            obj_index = len(obj_registry)
            obj_registry.append({
                "id":               mep_item.get("id", "unknown"),
                "name":             mep_item.get("name", "unnamed mep"),
                "type":             "mep",
                "use_point":        mep_item.get("use_point", None),
                "functional_point": mep_item.get("functional_point", None),
            })
            rasterize_polygon_attributed(mep_item["geometry"], grid, attrib_grid, cols, rows, ox, oy, cs, -2, obj_index)

    dist    = compute_distance_field(grid, cols, rows)
    nearest = compute_nearest_obstacle(grid, attrib_grid, cols, rows)

    body_half_cells     = int(math.ceil((profile["body_width_m"] / 2.0) / cs))
    corridor_half_cells = int(math.ceil((profile["min_corridor_width_m"] / 2.0) / cs))

    violation_cells    = []
    warning_cells      = []
    obj_violation_data = {}

    for idx in range(total):
        if dist[idx] <= 0 or dist[idx] == -1:
            continue
        if dist[idx] < body_half_cells:
            violation_cells.append(idx)
            obj_i = nearest[idx]
            if obj_i >= 0:
                if obj_i not in obj_violation_data:
                    obj_violation_data[obj_i] = {"blocked_cells": 0, "warning_cells": 0, "min_clearance_m": 999.0}
                obj_violation_data[obj_i]["blocked_cells"] += 1
                clearance_m = dist[idx] * cs
                if clearance_m < obj_violation_data[obj_i]["min_clearance_m"]:
                    obj_violation_data[obj_i]["min_clearance_m"] = clearance_m
        elif dist[idx] < corridor_half_cells:
            warning_cells.append(idx)
            obj_i = nearest[idx]
            if obj_i >= 0:
                if obj_i not in obj_violation_data:
                    obj_violation_data[obj_i] = {"blocked_cells": 0, "warning_cells": 0, "min_clearance_m": 999.0}
                obj_violation_data[obj_i]["warning_cells"] += 1
                clearance_m = dist[idx] * cs
                if clearance_m < obj_violation_data[obj_i]["min_clearance_m"]:
                    obj_violation_data[obj_i]["min_clearance_m"] = clearance_m

    violations = []

    if violation_cells:
        violations.append(
            "BLOCKED: {} cells ({:.2f} m^2) impassable - clearance < {:.2f}m (body width {:.2f}m)".format(
                len(violation_cells),
                len(violation_cells) * cs * cs,
                profile["body_width_m"] / 2.0,
                profile["body_width_m"],
            )
        )
    if warning_cells:
        violations.append(
            "WARNING: {} cells ({:.2f} m^2) below corridor spec - clearance < {:.2f}m (min corridor {:.2f}m)".format(
                len(warning_cells),
                len(warning_cells) * cs * cs,
                profile["min_corridor_width_m"] / 2.0,
                profile["min_corridor_width_m"],
            )
        )

    DOOR_TOLERANCE = 0.01
    door_violations = []
    for door in layout.get("doors", []):
        geom = door.get("geometry", [])
        if len(geom) == 2:
            dx = geom[1][0] - geom[0][0]
            dy = geom[1][1] - geom[0][1]
            width = math.sqrt(dx * dx + dy * dy)
            if width < profile["min_door_width_m"] - DOOR_TOLERANCE:
                violations.append(
                    "DOOR_WIDTH: '{}' ({}) width {:.2f}m < required {:.2f}m (deficit {:.2f}m)".format(
                        door.get("name", door.get("id", "?")),
                        door.get("id", "?"),
                        width,
                        profile["min_door_width_m"],
                        profile["min_door_width_m"] - width,
                    )
                )
                door_violations.append({
                    "id":          door.get("id", "unknown"),
                    "name":        door.get("name", "unnamed door"),
                    "violation_type": "width",
                    "actual_m":    round(width, 3),
                    "required_m":  profile["min_door_width_m"],
                    "deficit_m":   round(profile["min_door_width_m"] - width, 3),
                })

    turning_cells     = int(math.ceil(profile["turning_radius_m"] / cs))
    turning_violations = []
    for door in layout.get("doors", []):
        geom = door.get("geometry", [])
        if len(geom) != 2:
            continue
        mid_x = (geom[0][0] + geom[1][0]) / 2.0
        mid_y = (geom[0][1] + geom[1][1]) / 2.0
        cx = int((mid_x - ox) / cs)
        cy = int((mid_y - oy) / cs)
        search_r = min(turning_cells * 2, 60)
        found = False
        max_clearance_found = 0
        for dy_s in range(-search_r, search_r + 1, 2):
            for dx_s in range(-search_r, search_r + 1, 2):
                gx = cx + dx_s
                gy = cy + dy_s
                if 0 <= gx < cols and 0 <= gy < rows:
                    nidx = gy * cols + gx
                    cell_dist = dist[nidx]
                    if cell_dist >= turning_cells:
                        found = True
                        break
                    if cell_dist > max_clearance_found:
                        max_clearance_found = cell_dist
            if found:
                break
        if not found:
            available_radius = max_clearance_found * cs
            violations.append(
                "TURNING: '{}' ({}) need {:.2f}m radius, available {:.2f}m (deficit {:.2f}m)".format(
                    door.get("name", door.get("id", "?")),
                    door.get("id", "?"),
                    profile["turning_radius_m"],
                    available_radius,
                    profile["turning_radius_m"] - available_radius,
                )
            )
            turning_violations.append({
                "id":           door.get("id", "unknown"),
                "name":         door.get("name", "unnamed door"),
                "violation_type": "turning_radius",
                "required_m":   profile["turning_radius_m"],
                "available_m":  round(available_radius, 3),
                "deficit_m":    round(profile["turning_radius_m"] - available_radius, 3),
            })

    reachable_set = compute_reachable_from_doors(layout.get("doors", []), dist, cols, rows, ox, oy, cs, body_half_cells)

    doors = layout.get("doors", [])
    if len(doors) > 1 and reachable_set:
        search_radius = body_half_cells + 4
        for door in doors[1:]:
            geom = door.get("geometry", [])
            if len(geom) != 2:
                continue
            mid_x = (geom[0][0] + geom[1][0]) / 2.0
            mid_y = (geom[0][1] + geom[1][1]) / 2.0
            dcx = int((mid_x - ox) / cs)
            dcy = int((mid_y - oy) / cs)
            seeds = set()
            for ddy in range(-search_radius, search_radius + 1):
                for ddx in range(-search_radius, search_radius + 1):
                    nx, ny = dcx + ddx, dcy + ddy
                    if 0 <= nx < cols and 0 <= ny < rows:
                        ni = ny * cols + nx
                        if dist[ni] >= body_half_cells:
                            seeds.add(ni)
            if not seeds or not seeds.intersection(reachable_set):
                violations.append(
                    "CONNECTIVITY: Door '{}' ({}) unreachable for {} profile".format(
                        door.get("name", door.get("id", "?")),
                        door.get("id", "?"),
                        profile["user_type"],
                    )
                )

    use_point_results = {}
    for obj_i, obj_info in enumerate(obj_registry):
        up = obj_info.get("use_point")
        if up is None:
            continue

        clearance    = check_use_point_clearance(up, dist, attrib_grid, obj_i, cols, rows, ox, oy, cs, body_half_cells)
        reachability = check_use_point_reachability(up, reachable_set, dist, cols, rows, ox, oy, cs, body_half_cells)

        move_sug = None
        if not clearance["sufficient"]:
            move_sug = compute_move_suggestion(up, dist, nearest, obj_registry, cols, rows, ox, oy, cs, body_half_cells)

        fp        = obj_info.get("functional_point")
        func_line = None
        if fp is not None:
            func_line = check_functional_line(up, fp, grid, attrib_grid, obj_registry, obj_i, cols, rows, ox, oy, cs)

        use_point_results[obj_i] = {
            "use_point":            up,
            "clearance_m":          clearance["clearance_m"],
            "clearance_sufficient": clearance["sufficient"],
            "deficit_m":            clearance["deficit_m"],
            "reachable":            reachability["reachable"],
            "reachability_reason":  reachability.get("reason"),
            "move_suggestion":      move_sug,
            "functional_point":     fp,
            "functional_line":      func_line,
        }

        if not clearance["sufficient"]:
            violations.append(
                "USE_POINT: '{}' ({}) clearance {:.2f}m < required {:.2f}m (deficit {:.2f}m)".format(
                    obj_info["name"], obj_info["id"],
                    clearance["clearance_m"], body_half_cells * cs, clearance["deficit_m"],
                )
            )
        if not reachability["reachable"]:
            violations.append(
                "USE_POINT_UNREACHABLE: '{}' ({}) - {}".format(
                    obj_info["name"], obj_info["id"],
                    reachability.get("reason", "blocked"),
                )
            )
        if func_line and func_line.get("blocked"):
            violations.append(
                "FUNCTIONAL_LINE: '{}' ({}) line to functional_point blocked by '{}' ({})".format(
                    obj_info["name"], obj_info["id"],
                    func_line["blocking_object_name"], func_line["blocking_object_id"],
                )
            )

    return {
        "violations":        violations,
        "violation_cells":   violation_cells,
        "warning_cells":     warning_cells,
        "dist":              dist,
        "cols":              cols,
        "rows":              rows,
        "ox":                ox,
        "oy":                oy,
        "obj_registry":      obj_registry,
        "obj_violation_data": obj_violation_data,
        "use_point_results": use_point_results,
        "door_violations":   door_violations,
        "turning_violations": turning_violations,
        "grid":              grid,
        "attrib_grid":       attrib_grid,
        "nearest":           nearest,
    }


# =============================================================================
# VISUALIZATION HELPERS
# =============================================================================

def cells_to_zones(cell_list, cols, rows, ox, oy, cs):
    if not cell_list:
        return []

    cell_set = set(cell_list)
    visited  = set()
    rectangles = []

    for cell in cell_list:
        if cell in visited:
            continue
        cluster = []
        stack   = [cell]
        while stack:
            c = stack.pop()
            if c in visited or c not in cell_set:
                continue
            visited.add(c)
            cluster.append(c)
            x = c % cols
            y = c // cols
            if x > 0 and (c - 1) not in visited:
                stack.append(c - 1)
            if x < cols - 1 and (c + 1) not in visited:
                stack.append(c + 1)
            if y > 0 and (c - cols) not in visited:
                stack.append(c - cols)
            if y < rows - 1 and (c + cols) not in visited:
                stack.append(c + cols)

        if len(cluster) < 4:
            continue

        xs     = [c % cols for c in cluster]
        ys     = [c // cols for c in cluster]
        min_wx = min(xs) * cs + ox
        max_wx = (max(xs) + 1) * cs + ox
        min_wy = min(ys) * cs + oy
        max_wy = (max(ys) + 1) * cs + oy

        pts      = [rg.Point3d(min_wx, min_wy, 0), rg.Point3d(max_wx, min_wy, 0),
                    rg.Point3d(max_wx, max_wy, 0), rg.Point3d(min_wx, max_wy, 0),
                    rg.Point3d(min_wx, min_wy, 0)]
        polyline = rg.Polyline(pts)
        rectangles.append(polyline.ToPolylineCurve())

    return rectangles


def create_clearance_mesh(dist, cols, rows, ox, oy, cs, threshold_cells):
    mesh  = rg.Mesh()
    limit = threshold_cells * 3
    for idx in range(cols * rows):
        d = dist[idx]
        if d < 0 or d > limit:
            continue
        x  = idx % cols
        y  = idx // cols
        wx = ox + x * cs
        wy = oy + y * cs
        vi = mesh.Vertices.Count
        mesh.Vertices.Add(wx,      wy,      0)
        mesh.Vertices.Add(wx + cs, wy,      0)
        mesh.Vertices.Add(wx + cs, wy + cs, 0)
        mesh.Vertices.Add(wx,      wy + cs, 0)
        mesh.Faces.AddFace(vi, vi + 1, vi + 2, vi + 3)
        if d < threshold_cells:
            r, g, b = 220, 40, 40
        elif d < threshold_cells * 1.5:
            t = (d - threshold_cells) / (threshold_cells * 0.5)
            r = int(220 - t * 100)
            g = int(40 + t * 125)
            b = 40
        else:
            r, g, b = 60, 180, 60
        color = System.Drawing.Color.FromArgb(180, r, g, b)
        mesh.VertexColors.Add(color)
        mesh.VertexColors.Add(color)
        mesh.VertexColors.Add(color)
        mesh.VertexColors.Add(color)
    return mesh


# =============================================================================
# UNIFIED REPORT BUILDER
# =============================================================================

def build_unified_report(result, profile, cs):
    obj_registry       = result["obj_registry"]
    obj_violation_data = result["obj_violation_data"]
    use_point_results  = result["use_point_results"]
    door_violations    = result["door_violations"]
    turning_violations = result["turning_violations"]
    violations         = result["violations"]
    violation_cells    = result["violation_cells"]
    warning_cells      = result["warning_cells"]

    body_half_cells = int(math.ceil((profile["body_width_m"] / 2.0) / cs))

    up_violations_count = 0
    func_line_blocks    = 0
    unreachable_count   = 0
    for obj_i, upr in use_point_results.items():
        if not upr["clearance_sufficient"]:
            up_violations_count += 1
        if not upr["reachable"]:
            unreachable_count += 1
        if upr["functional_line"] and upr["functional_line"].get("blocked"):
            func_line_blocks += 1

    hard_violations = [v for v in violations if not v.startswith("WARNING:")]
    pass_fail       = len(hard_violations) == 0

    summary = {
        "total_violations":       len(violations),
        "blocked_area_m2":        round(len(violation_cells) * cs * cs, 3),
        "warning_area_m2":        round(len(warning_cells) * cs * cs, 3),
        "use_point_violations":   up_violations_count,
        "functional_line_blocks": func_line_blocks,
        "unreachable_use_points": unreachable_count,
    }

    objects_list = []
    for obj_i, obj_info in enumerate(obj_registry):
        has_clearance_violation = obj_i in obj_violation_data
        has_use_point           = obj_i in use_point_results

        if not has_clearance_violation and not has_use_point:
            continue

        entry = {
            "id":                       obj_info["id"],
            "name":                     obj_info["name"],
            "object_type":              obj_info["type"],
            "clearance_violation":      None,
            "use_point_analysis":       None,
            "functional_line_analysis": None,
        }

        if has_clearance_violation:
            data = obj_violation_data[obj_i]
            entry["clearance_violation"] = {
                "blocked_cells":       data["blocked_cells"],
                "blocked_area_m2":     round(data["blocked_cells"] * cs * cs, 3),
                "warning_cells":       data["warning_cells"],
                "warning_area_m2":     round(data["warning_cells"] * cs * cs, 3),
                "min_clearance_m":     round(data["min_clearance_m"], 3),
                "required_clearance_m": round(body_half_cells * cs, 3),
                "deficit_m":           round(max(0, body_half_cells * cs - data["min_clearance_m"]), 3),
            }

        if has_use_point:
            upr = use_point_results[obj_i]
            entry["use_point_analysis"] = {
                "use_point":          upr["use_point"],
                "clearance_m":        upr["clearance_m"],
                "sufficient":         upr["clearance_sufficient"],
                "deficit_m":          upr["deficit_m"],
                "reachable":          upr["reachable"],
                "reachability_reason": upr["reachability_reason"],
                "move_suggestion":    upr["move_suggestion"],
            }
            if upr["functional_line"] is not None:
                entry["functional_line_analysis"] = {
                    "functional_point": upr["functional_point"],
                    "blocked":          upr["functional_line"]["blocked"],
                }
                if upr["functional_line"]["blocked"]:
                    entry["functional_line_analysis"]["blocking_object_id"]   = upr["functional_line"]["blocking_object_id"]
                    entry["functional_line_analysis"]["blocking_object_name"] = upr["functional_line"]["blocking_object_name"]
                    entry["functional_line_analysis"]["blocking_object_type"] = upr["functional_line"]["blocking_object_type"]
                    entry["functional_line_analysis"]["block_point"]          = upr["functional_line"]["block_point"]

        objects_list.append(entry)

    objects_list.sort(key=lambda obj: (0, -obj["clearance_violation"]["blocked_cells"])
                      if obj.get("clearance_violation") else (1, 0))

    doors_grouped = {}
    for dv in door_violations:
        did = dv["id"]
        if did not in doors_grouped:
            doors_grouped[did] = {"id": did, "name": dv["name"], "violations": []}
        doors_grouped[did]["violations"].append({
            "type":       dv["violation_type"],
            "actual_m":   dv["actual_m"],
            "required_m": dv["required_m"],
            "deficit_m":  dv["deficit_m"],
        })
    for tv in turning_violations:
        did = tv["id"]
        if did not in doors_grouped:
            doors_grouped[did] = {"id": did, "name": tv["name"], "violations": []}
        doors_grouped[did]["violations"].append({
            "type":        tv["violation_type"],
            "required_m":  tv["required_m"],
            "available_m": tv["available_m"],
            "deficit_m":   tv["deficit_m"],
        })

    report = {
        "pass": pass_fail,
        "profile": {
            "user_type":            profile["user_type"],
            "body_width_m":         profile["body_width_m"],
            "min_corridor_width_m": profile["min_corridor_width_m"],
            "min_door_width_m":     profile["min_door_width_m"],
            "turning_radius_m":     profile["turning_radius_m"],
        },
        "grid": {
            "resolution_m": cs,
            "cols":         result["cols"],
            "rows":         result["rows"],
        },
        "summary": summary,
        "objects": objects_list,
        "doors":   list(doors_grouped.values()),
    }

    return report, pass_fail


# =============================================================================
# MAIN EXECUTION
# =============================================================================

a = True
b = []
c = []
d = None
e = ""
f = []
g = []

try:
    _layout_json = layout_json
except NameError:
    _layout_json = None

try:
    _user_profile = user_profile
except NameError:
    _user_profile = None

try:
    _wall_thickness = float(wall_thickness) if wall_thickness is not None else 0.20
except (NameError, TypeError, ValueError):
    _wall_thickness = 0.20

try:
    _cell_size = float(cell_size) if cell_size is not None else 0.10
except (NameError, TypeError, ValueError):
    _cell_size = 0.10

try:
    _compare_json = compare_json
except NameError:
    _compare_json = None

layout = parse_layout(_layout_json)
if layout is None:
    a = False
    b = ["ERROR: Could not parse layout_json input"]
    e = json.dumps({"pass": False, "error": "Could not parse layout_json"})
else:
    profile = get_profile(_user_profile)
    result  = analyze_layout(layout, profile, _wall_thickness, _cell_size)

    violations     = result["violations"]
    violation_cells = result["violation_cells"]
    warning_cells  = result["warning_cells"]
    dist           = result["dist"]
    cols           = result["cols"]
    rows           = result["rows"]
    ox             = result["ox"]
    oy             = result["oy"]

    report, pass_fail = build_unified_report(result, profile, _cell_size)
    a = pass_fail
    b = violations

    all_flagged = violation_cells + warning_cells
    if all_flagged:
        c = cells_to_zones(all_flagged, cols, rows, ox, oy, _cell_size)

    if dist is not None:
        corridor_half_cells = int(math.ceil((profile["min_corridor_width_m"] / 2.0) / _cell_size))
        d = create_clearance_mesh(dist, cols, rows, ox, oy, _cell_size, corridor_half_cells)

    compare_layout = parse_layout(_compare_json)
    if compare_layout is not None:
        prev_result    = analyze_layout(compare_layout, profile, _wall_thickness, _cell_size)
        prev_violations = prev_result["violations"]
        prev_cells     = prev_result["violation_cells"]
        prev_set       = set(prev_violations)
        f = [v for v in violations if v not in prev_set]
        prev_cell_set = set(prev_cells)
        new_cells = [c_idx for c_idx in violation_cells if c_idx not in prev_cell_set]
        if new_cells and dist is not None:
            g = cells_to_zones(new_cells, cols, rows, ox, oy, _cell_size)
        report["comparison"] = {
            "has_previous":        True,
            "new_violation_count": len(f),
            "new_violations":      f,
        }
    else:
        f = violations
        g = c

    e = json.dumps(report, indent=2)
# ---------- end py3_7 ----------

deconstruct_tool_call_2 = DeconstructToolCall(Request=sift.Output0)  # -> Request, Tool, Arguments

# ---- group: place_objects
place_object = Python3Script(json_str=deconstruct_tool_call_2.Arguments)  # -> a
# ---------- place_object: Python ----------
import json
import scriptcontext as sc
import Rhino
import Rhino.Geometry as rg
import Rhino.Display as rd
import System.Drawing

STICKY_KEY = "team_03_objects_display"

try:
    raw = json_str.ToString() if hasattr(json_str, 'ToString') else str(json_str)
    args = json.loads(raw)
    objects_raw = args.get("objects_list", "[]")
    if isinstance(objects_raw, str):
        placed = json.loads(objects_raw)
    else:
        placed = objects_raw
except Exception:
    placed = []

if not placed:
    a = json.dumps({"status": "ok", "drawn": 0})
else:
    prev = sc.sticky.get(STICKY_KEY)
    if prev is not None:
        try:
            prev.Dispose()
        except Exception:
            pass
        sc.sticky[STICKY_KEY] = None

    edge_color  = System.Drawing.Color.FromArgb(255, 40, 120, 60)
    label_color = System.Drawing.Color.White
    disp = rd.CustomDisplay(True)

    for obj in placed:
        x0, y0 = obj["position"]
        fw, fd, fh = obj["size"]
        pt    = rg.Point3d(x0, y0, 0)
        plane = rg.Plane(pt, rg.Vector3d.ZAxis)
        box   = rg.Box(plane, rg.Interval(0, fw), rg.Interval(0, fd), rg.Interval(0, fh))
        brep  = box.ToBrep()
        if brep:
            for b_edge in brep.Edges:
                disp.AddCurve(b_edge.EdgeCurve, edge_color, 2)
        cx = x0 + fw / 2.0
        cy = y0 + fd / 2.0
        lp = rg.Plane(rg.Point3d(cx, cy, fh + 0.05), rg.Vector3d.ZAxis)
        try:
            t3d = rd.Text3d(obj["name"], lp, 0.12)
            t3d.HorizontalAlignment = rd.TextHorizontalAlignment.Center
            disp.AddText(t3d, label_color)
        except Exception:
            pass

    sc.sticky[STICKY_KEY] = disp
    Rhino.RhinoDoc.ActiveDoc.Views.Redraw()
    a = json.dumps({"status": "ok", "drawn": len(placed)})
# ---------- end place_object ----------

# ----
parse_json_string_7 = ParseJSONString(Text=place_object)
mcp_tool_response_4 = MCPToolResponse(Request=deconstruct_tool_call_2.Request, Content=parse_json_string_7, IsError=False)

or = GateOr(
    A=mcp_tool_response_4,
    F=mcp_tool_response_3,
    B=mcp_tool_response,
    C=mcp_tool_response_2,
    D=respond_3,
    E=respond_2,
    G=respond)
tool_call_success = ClusterOutput(or)
