# Grasshopper definition team_04_working.gh (Grasshopper 1.0.8)
# plug-ins: Swiftlet

# ----
# Connect MCP Tools to Decall and Update All Clusters
button = Button()
# IF SOMETHING IS NOT
# WORKING PRESS THIS
# BUTTON FIRST
toggle = BooleanToggle(True)
update_all_clusters = CSharpScript(update=button, recursive=toggle)  # -> out, A; inputs update: Boolean, recursive: Boolean, passwords: list of String, localPath: String
# ---------- update_all_clusters: C# ----------
using System;
using System.Collections;
using System.Collections.Generic;

using Rhino;
using Rhino.Geometry;

using Grasshopper;
using Grasshopper.Kernel;
using Grasshopper.Kernel.Data;
using Grasshopper.Kernel.Types;
using System.Windows.Forms;
using System.Linq;
/// <summary>
/// This class will be instantiated on demand by the Script component.
/// </summary>
public class Script_Instance : GH_ScriptInstance
{
  /// <summary>Print a String to the [Out] Parameter of the Script component.</summary>
  /// <param name="text">String to print.</param>
  private void Print(string text) { /* Implementation hidden. */ }
  /// <summary>Print a formatted String to the [Out] Parameter of the Script component.</summary>
  /// <param name="format">String format.</param>
  /// <param name="args">Formatting parameters.</param>
  private void Print(string format, params object[] args) { /* Implementation hidden. */ }
  /// <summary>Print useful information about an object instance to the [Out] Parameter of the Script component. </summary>
  /// <param name="obj">Object instance to parse.</param>
  private void Reflect(object obj) { /* Implementation hidden. */ }
  /// <summary>Print the signatures of all the overloads of a specific method to the [Out] Parameter of the Script component. </summary>
  /// <param name="obj">Object instance to parse.</param>
  private void Reflect(object obj, string method_name) { /* Implementation hidden. */ }

  /// <summary>Gets the current Rhino document.</summary>
  private readonly RhinoDoc RhinoDocument;
  /// <summary>Gets the Grasshopper document that owns this script.</summary>
  private readonly GH_Document GrasshopperDocument;
  /// <summary>Gets the Grasshopper script component that owns this script.</summary>
  private readonly IGH_Component Component;
  /// <summary>
  /// Gets the current iteration count. The first call to RunScript() is associated with Iteration==0.
  /// Any subsequent call within the same solution will increment the Iteration count.
  /// </summary>
  private readonly int Iteration;

  /// <summary>
  /// This procedure contains the user code. Input parameters are provided as regular arguments,
  /// Output parameters as ref arguments. You don't have to assign output parameters,
  /// they will have a default value.
  /// </summary>
  private void RunScript(
		bool update,
		bool recursive,
		List<string> passwords,
		string localPath,
		ref object A)
  {

    A = updateLog;
    if (update)
    {
      updateLog = new List<string>();
      _passwords = passwords;
      UpdateClusters(GrasshopperDocument, recursive, localPath);
    }

  }

  // <Custom additional code> 
  List<string> updateLog;
  List<String> _passwords;

  void UpdateClusters (GH_Document ghDoc, bool recursive, string localPath)
  {
    foreach (var obj in ghDoc.Objects)
    {
      var cluster = obj as Grasshopper.Kernel.Special.GH_Cluster;
      if (cluster != null)
      {
        var clusterPath = cluster.FilePath;
        if (!string.IsNullOrEmpty(clusterPath))
        {
          if (cluster.Synchronisation == Grasshopper.Kernel.Special.GH_Synchronisation.OutOfDate)
          {
            cluster.CreateFromFilePath(clusterPath);
            updateLog.Add("Updated: " + clusterPath);
          }
          else if (cluster.Synchronisation == Grasshopper.Kernel.Special.GH_Synchronisation.MissingReference)
          {
            string newPath = ReplacePath(localPath, clusterPath);
            if (!string.IsNullOrEmpty(newPath))
            {
              cluster.CreateFromFilePath(newPath);
              updateLog.Add("Replaced and updated: " + newPath);
            }
            else
            {
              updateLog.Add("Missing reference: " + clusterPath);
            }

          }
        }

        //Update recursively
        if (recursive)
        {
          GH_Document clusterDoc = GetClusterDoc(cluster);
          if (clusterDoc != null)
            UpdateClusters(clusterDoc, recursive, localPath);
        }
      }
    }
  }

  GH_Document GetClusterDoc(Grasshopper.Kernel.Special.GH_Cluster cluster)
  {
    //no pass needed
    var doc = cluster.Document(string.Empty);
    if (doc != null)
      return doc;

    //try passwords
    if (_passwords != null && _passwords.Any())
    {
      foreach (var pass in _passwords)
      {
        doc = cluster.Document(pass);
        if (doc != null)
          return doc;
      }
    }

    return null;
  }

  string ReplacePath(string localPath, string missingPath)
  {
    if (String.IsNullOrEmpty(missingPath) || string.IsNullOrEmpty(localPath))
      return null;
    else
    {
      string lastLocalPart = localPath.Split('\\').Last();
      string[] parts = missingPath.Split('\\');
      if (parts.Contains(lastLocalPart))
      {
        int i = Array.IndexOf(parts, lastLocalPart);
        string clusterPath = String.Join("\\", parts.Skip(i + 1));
        string result = String.Join("\\", localPath, clusterPath);
        return result;
      }
      else
        return null;
    }
  }
  // </Custom additional code> 
}
# ---------- end update_all_clusters ----------
connect_mcp_tools_to_decall = CSharpScript(nickname_From="Central MCP Server", nickname_To="Central DeCall", connect=button)  # -> out; inputs nickname_From: String, nickname_To: String, connect: Boolean
# ---------- connect_mcp_tools_to_decall: C# ----------
using System;
using System.Linq;
using Grasshopper;
using Grasshopper.Kernel;

public class Script_Instance : GH_ScriptInstance
{
    private void RunScript(string nickname_From, string nickname_To, bool connect)
    {
        if (!connect) return;
        Console.Write($"Attempting to connect outputs from '{nickname_From}' to '{nickname_To}'...");

        var ghDoc = Instances.ActiveCanvas?.Document;
        if (ghDoc == null) return;

        var compFrom = ghDoc.Objects
            .OfType<IGH_Component>()
            .FirstOrDefault(o => o.NickName == nickname_From);

        var compTo = ghDoc.Objects
            .OfType<IGH_Param>()
            .FirstOrDefault(o => o.NickName == nickname_To);

        if (compFrom != null && compTo != null)
        {
            ghDoc.ScheduleSolution(5, doc => Connect(doc, compFrom, compTo));
        }
    }

    // <Custom additional code> 
    private void Connect(GH_Document doc, IGH_Component compFrom, IGH_Param compTo)
    {
        if (compFrom == null || compTo == null) return;

        foreach (IGH_Param param in compFrom.Params.Output)
        {
            compTo.AddSource(param);
        }
    }
}
# ---------- end connect_mcp_tools_to_decall ----------
panel = Panel(connect_mcp_tools_to_decall)

c_script = CSharpScript()  # -> out, availablePort
# ---------- c_script: C# ----------
// Grasshopper Script Instance
// This script finds an available port on the local machine.
#region Usings
using System;
using System.Linq;
using System.Collections;
using System.Collections.Generic;
using System.Drawing;
using System.Net;
using System.Net.Sockets;

using Rhino;
using Rhino.Geometry;

using Grasshopper;
using Grasshopper.Kernel;
using Grasshopper.Kernel.Data;
using Grasshopper.Kernel.Types;
#endregion

public class Script_Instance : GH_ScriptInstance
{
    #region Notes
    /* 
      Members:
        RhinoDoc RhinoDocument
        GH_Document GrasshopperDocument
        IGH_Component Component
        int Iteration

      Methods (Virtual & overridable):
        Print(string text)
        Print(string format, params object[] args)
        Reflect(object obj)
        Reflect(object obj, string method_name)
    */
    #endregion

    private void RunScript(object start, object end, ref object availablePort)
    {
        // Use default values if parameters are not provided
        int startPort = (start != null && int.TryParse(start.ToString(), out int s)) ? s : 3001;
        int endPort = (end != null && int.TryParse(end.ToString(), out int e)) ? e : 3100;

        // Find an available port in the specified range
        try
        {
            availablePort = FindAvailablePortInRange(startPort, endPort);
            Print($"Available port found: {availablePort}");
        }
        catch (Exception ex)
        {
            Print($"Error: {ex.Message}");
            availablePort = null;
        }
    }

    /// <summary>
    /// Checks if a local TCP port is available for binding (i.e., not in use).
    /// Returns True if available, False otherwise.
    /// </summary>
    private bool IsPortAvailableForBind(int port)
    {
        try
        {
            // Create a new TCP socket
            using (Socket socket = new Socket(AddressFamily.InterNetwork, SocketType.Stream, ProtocolType.Tcp))
            {
                // Try to bind to the port on all interfaces (0.0.0.0)
                socket.Bind(new IPEndPoint(IPAddress.Any, port));
                // If successful, the socket is closed by the using statement and return True
                return true;
            }
        }
        catch (SocketException)
        {
            // If binding fails, it means the port is already in use
            return false;
        }
    }

    /// <summary>
    /// Finds an available port by letting the OS assign one.
    /// </summary>
    private int FindAvailablePort()
    {
        Socket socket = new Socket(AddressFamily.InterNetwork, SocketType.Stream, ProtocolType.Tcp);
        socket.Bind(new IPEndPoint(IPAddress.Any, 0)); // Bind to an available port assigned by the OS
        int availablePort = ((IPEndPoint)socket.LocalEndPoint).Port; // Get the assigned port number
        socket.Close(); // Close the socket
        return availablePort;
    }

    /// <summary>
    /// Finds the first available port in a given range.
    /// </summary>
    private int FindAvailablePortInRange(int start = 3001, int end = 3100)
    {
        for (int port = start; port <= end; port++)
        {
            if (IsPortAvailableForBind(port))
                return port;
        }
        throw new Exception($"No available ports found in the range {start}-{end}.");
    }
}
# ---------- end c_script ----------
team_04_definition_cluster = Team04DefinitionCluster()
panel_2 = Panel(c_script.availablePort)
central_mcp_server = MCPServer(Port=c_script.availablePort, Tools=team_04_definition_cluster, ServerName="Swiftlet")  # -> Parametric_shape_generator, Manipulation_tools
get_tool_names = CSharpScript(x=team_04_definition_cluster)  # -> flatten(out)
# ---------- get_tool_names: C# ----------
// Grasshopper Script Instance
#region Usings
using System;
using System.Linq;
using System.Collections;
using System.Collections.Generic;
using System.Drawing;

using Rhino;
using Rhino.Geometry;

using Grasshopper;
using Grasshopper.Kernel;
using Grasshopper.Kernel.Data;
using Grasshopper.Kernel.Types;
#endregion

public class Script_Instance : GH_ScriptInstance
{
    #region Notes
    /* 
      Members:
        RhinoDoc RhinoDocument
        GH_Document GrasshopperDocument
        IGH_Component Component
        int Iteration

      Methods (Virtual & overridable):
        Print(string text)
        Print(string format, params object[] args)
        Reflect(object obj)
        Reflect(object obj, string method_name)
    */
    #endregion

    private void RunScript(object x)
    {
        dynamic dynamicX = x;
        Console.Write(dynamicX.Name);
    }
}
# ---------- end get_tool_names ----------
central_decall = Data([central_mcp_server.Parametric_shape_generator, central_mcp_server.Manipulation_tools])
clean = CleanTree(RemoveNulls=True, RemoveInvalid=True, RemoveEmpty=False, Tree=central_decall)
team_04_result_cluster = Team04ResultCluster(tool_call_request=clean)  # -> tool_names_3, tool_call_success

# ----
# Tool Names from the Results Clusters
# Tool Names from the Definition Clusters
# These Two Clusters should be EXACTLY THE SAME
panel_3 = Panel(get_tool_names)
panel_4 = Panel(team_04_result_cluster.tool_names_3)

rec = DataRecorder(team_04_result_cluster.tool_call_success, DataLimit=-10, RecordData=True)
rec_2 = DataRecorder(clean, DataLimit=-10, RecordData=True)
response_ok = Panel(rec)
called_tool_name = Panel(rec_2)

# ----
# Debug Tool Names
# This Panel should always be TRUE
tool_names_from_the_results_clusters = Data(panel_4)
tool_names_from_the_definition_clusters = Data(panel_3)
join = TextJoin(Text=flatten(tool_names_from_the_definition_clusters))
join_2 = TextJoin(Text=flatten(tool_names_from_the_results_clusters))
tstat = TreeStatistics(Tree=tool_names_from_the_definition_clusters)  # -> Paths, Length, Count
tstat_2 = TreeStatistics(Tree=tool_names_from_the_results_clusters)  # -> Paths, Length, Count
dpath = DeconstructPath(Branch=tstat.Paths)
dpath_2 = DeconstructPath(Branch=tstat_2.Paths)
equals = Equality(FirstNumber=tstat.Length, SecondNumber=tstat_2.Length)  # -> Equality, Inequality
equals_2 = Equality(FirstNumber=tstat.Count, SecondNumber=tstat_2.Count)  # -> Equality, Inequality
ma = MassAddition(Input=flatten(equals.Equality))  # -> Result, PartialResults
equals_3 = Equality(FirstNumber=dpath, SecondNumber=dpath_2)  # -> Equality, Inequality
lng = ListLength(List=equals.Equality)
ma_2 = MassAddition(Input=flatten(equals_3.Inequality))  # -> Result, PartialResults
equals_4 = Equality(FirstNumber=ma.Result, SecondNumber=lng)  # -> Equality, Inequality
does_quantity_of_tools_match = Panel(equals_2.Equality)
equals_5 = Equality(FirstNumber=ma_2.Result, SecondNumber="0")  # -> Equality, Inequality
does_quantity_of_tools_match_per_team = Panel(equals_4.Equality)
are_all_teams_included = Panel(equals_5.Equality)

tmatch = MatchText(Text=join, Pattern=join_2, Case=True)

do_all_names_match = Panel(tmatch)
and = GateAnd(A=equals_5.Equality, B=equals_4.Equality, C=equals_2.Equality, D=tmatch)  # -> flatten(Result)
do_trees_match = Panel(and)

# ==== cluster Team04ResultCluster

siteboundary = Curve(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)
# Team 04 Result Cluster
# CYLINDER TEAM
context = Brep([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])
road = Curve([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])
surface = Surface(siteboundary)
surface_2 = Surface(road)
divide_domain² = DivideDomain²(Domain=surface, UCount=10, VCount=10)
isotrim = Isotrim(Surface=surface, Domain=divide_domain²)
area = Area(Geometry=isotrim)  # -> Area, Centroid
point_in_curve = PointInCurve(Point=area.Centroid, Curve=siteboundary)  # -> Relationship, Point
cull_pattern = CullPattern(List=area.Centroid, CullPattern=point_in_curve.Relationship)  # -> flatten(List)
cull_pattern_2 = CullPattern(List=area.Centroid, CullPattern=point_in_curve.Relationship)
flatten_tree = FlattenTree(Tree=cull_pattern_2, Path="{0}")

# ----
# Edit Tool Names to
# Match Definition Cluster
tool_names = Panel("""parametric_shape_generator
manipulation_tools""")

# ----
# Sorting Logic, Please Do Not Edit
tool_call_request = ClusterInput()
tool_names_2 = Text(tool_names)
decall = DeconstructToolCall(Request=tool_call_request)  # -> Request, Tool, Arguments
mindex = MemberIndex(Set=tool_names, Member=decall.Tool)  # -> Index, Count

# ---- group: Cluster Output
tool_names_3 = ClusterOutput(tool_names_2)

# ----
sift = SiftPattern(List=decall.Request, SiftPattern=mindex.Index)  # -> Output0, Output1
deconstruct_tool_call = DeconstructToolCall(Request=sift.Output1)  # -> Request, Tool, Arguments
panel = Panel(deconstruct_tool_call.Arguments)
deconstruct_tool_call_2 = DeconstructToolCall(Request=sift.Output0)  # -> Request, Tool, Arguments
get_json_object_key = GetJSONObjectKey(JObject=deconstruct_tool_call_2.Arguments, Key="tree_sizes")
get_json_object_key_2 = GetJSONObjectKey(JObject=deconstruct_tool_call_2.Arguments, Key="tree_points")
get_json_object_key_3 = GetJSONObjectKey(JObject=deconstruct_tool_call_2.Arguments, Key="iterations")
get_json_object_key_4 = GetJSONObjectKey(JObject=deconstruct_tool_call_2.Arguments, Key="seed")
get_json_object_key_5 = GetJSONObjectKey(JObject=deconstruct_tool_call_2.Arguments, Key="genes_json")
get_json_object_key_6 = GetJSONObjectKey(JObject=deconstruct_tool_call_2.Arguments, Key="locked_shape_type")
get_json_object_key_7 = GetJSONObjectKey(JObject=deconstruct_tool_call_2.Arguments, Key="tree_count")
get_json_object_key_8 = GetJSONObjectKey(JObject=deconstruct_tool_call.Arguments, Key="move_left")
read_json_value = ReadJSONValue(JValue=get_json_object_key_2)  # -> AsString, AsNumber, AsBool
read_json_value_2 = ReadJSONValue(JValue=get_json_object_key_7)  # -> AsString, AsNumber, AsBool
read_json_value_3 = ReadJSONValue(JValue=get_json_object_key)  # -> AsString, AsNumber, AsBool
get_json_object_key_9 = GetJSONObjectKey(JObject=deconstruct_tool_call.Arguments, Key="move_right")
read_json_value_4 = ReadJSONValue(JValue=get_json_object_key_6)  # -> AsString, AsNumber, AsBool
read_json_value_5 = ReadJSONValue(JValue=get_json_object_key_3)  # -> AsString, AsNumber, AsBool
read_json_value_6 = ReadJSONValue(JValue=get_json_object_key_4)  # -> AsString, AsNumber, AsBool
read_json_value_7 = ReadJSONValue(JValue=get_json_object_key_5)  # -> AsString, AsNumber, AsBool
get_json_object_key_10 = GetJSONObjectKey(JObject=deconstruct_tool_call.Arguments, Key="move_front/up")
get_json_object_key_11 = GetJSONObjectKey(JObject=deconstruct_tool_call.Arguments, Key="move_back/Down")
get_json_object_key_12 = GetJSONObjectKey(JObject=deconstruct_tool_call.Arguments, Key="rotate_clockwise")
get_json_object_key_13 = GetJSONObjectKey(JObject=deconstruct_tool_call.Arguments, Key="scale_left_wing")
get_json_object_key_14 = GetJSONObjectKey(JObject=deconstruct_tool_call.Arguments, Key="scale_right_wing")
get_json_object_key_15 = GetJSONObjectKey(JObject=deconstruct_tool_call.Arguments, Key="scale_center_wing")
get_json_object_key_16 = GetJSONObjectKey(JObject=deconstruct_tool_call.Arguments, Key="scale_front_wing")
get_json_object_key_17 = GetJSONObjectKey(JObject=deconstruct_tool_call.Arguments, Key="scale_back_wing")
get_json_object_key_18 = GetJSONObjectKey(JObject=deconstruct_tool_call.Arguments, Key="rotate_anticlockwise")
get_json_object_key_19 = GetJSONObjectKey(JObject=deconstruct_tool_call.Arguments, Key="scale_up")
get_json_object_key_20 = GetJSONObjectKey(JObject=deconstruct_tool_call.Arguments, Key="scale_down")
get_json_object_key_21 = GetJSONObjectKey(JObject=deconstruct_tool_call.Arguments, Key="scale_factor")
read_json_value_8 = ReadJSONValue(JValue=get_json_object_key_8)  # -> AsString, AsNumber, AsBool
read_json_value_9 = ReadJSONValue(JValue=get_json_object_key_9)  # -> AsString, AsNumber, AsBool
read_json_value_10 = ReadJSONValue(JValue=get_json_object_key_10)  # -> AsString, AsNumber, AsBool
read_json_value_11 = ReadJSONValue(JValue=get_json_object_key_13)  # -> AsString, AsNumber, AsBool
read_json_value_12 = ReadJSONValue(JValue=get_json_object_key_14)  # -> AsString, AsNumber, AsBool
read_json_value_13 = ReadJSONValue(JValue=get_json_object_key_15)  # -> AsString, AsNumber, AsBool
read_json_value_14 = ReadJSONValue(JValue=get_json_object_key_16)  # -> AsString, AsNumber, AsBool
read_json_value_15 = ReadJSONValue(JValue=get_json_object_key_17)  # -> AsString, AsNumber, AsBool
read_json_value_16 = ReadJSONValue(JValue=get_json_object_key_11)  # -> AsString, AsNumber, AsBool
read_json_value_17 = ReadJSONValue(JValue=get_json_object_key_12)  # -> AsString, AsNumber, AsBool
read_json_value_18 = ReadJSONValue(JValue=get_json_object_key_18)  # -> AsString, AsNumber, AsBool
panel_2 = Panel(read_json_value.AsString)
read_json_value_19 = ReadJSONValue(JValue=get_json_object_key_19)  # -> AsString, AsNumber, AsBool
read_json_value_20 = ReadJSONValue(JValue=get_json_object_key_20)  # -> AsString, AsNumber, AsBool
read_json_value_21 = ReadJSONValue(JValue=get_json_object_key_21)  # -> AsString, AsNumber, AsBool
panel_3 = Panel(read_json_value_2.AsString)
panel_4 = Panel(read_json_value_3.AsString)
panel_5 = Panel(read_json_value_7.AsString)
script = Script(
    genes_json=read_json_value_7.AsString,
    locked_shape_type=read_json_value_4.AsString,
    site_boundary=siteboundary,
    tree_points=read_json_value.AsString,
    tree_count=read_json_value_2.AsString,
    tree_sizes=read_json_value_3.AsString,
    iterations=read_json_value_5.AsString,
    seed=read_json_value_6.AsString)  # -> mesh, vertices, faces, metadata, genes_payload, error
# ---------- script: Python ----------
"""
Grasshopper Python component - generative design optimizer.

Inputs to create in Grasshopper:
- genes_json or genes: JSON string or dictionary with the user request / seed genes
- iterations: number of candidates to evaluate
- seed: optional integer random seed
- locked_shape_type: optional override for typology lock
- site_boundary: optional site boundary polygon or boundary payload
- tree_points: optional list of tree positions for overlap penalties
- tree_sizes: optional list of tree size values aligned with tree_points
- tree_count: optional tree count used when points/sizes are provided as strings or omitted

Example genes:
{
  "shape_type": "u_shape",
  "length": 40,
  "width": 30,
  "height": 15,
  "rotation": 45
}

Outputs:
- mesh: Rhino mesh for the best candidate
- vertices: text summary of vertices
- faces: text summary of faces
- metadata: fitness summary text
- genes_payload: normalized best genes JSON
- error: error message if any
"""

from __future__ import annotations

import importlib
import json
import math
import random
import sys
from typing import Any

mesh = None
vertices = None
faces = None
metadata = None
genes_payload = None
error = None


def _coerce_text(value: Any) -> str:
    if value is None:
        return ""
    if hasattr(value, "ToString"):
        value = value.ToString()
    return str(value)


def _is_null_like_text(value: Any) -> bool:
    if value is None:
        return True
    if not isinstance(value, str):
        return False
    text = value.strip().lower()
    return text in {"", "null", "none", "undefined", "nan"}


def _coerce_payload(value: Any) -> dict[str, Any]:
    if value is None:
        return {}
    if isinstance(value, dict):
        payload = dict(value)
        raw_shape_type = payload.get("shape_type")
        if raw_shape_type is None or _is_null_like_text(raw_shape_type):
            payload.pop("shape_type", None)
        if not payload or (len(payload) == 1 and payload.get("shape_type") is None):
            return {}
        return payload
    if hasattr(value, "ToString"):
        value = value.ToString()
    if not isinstance(value, str):
        value = str(value)
    value = value.strip()
    if _is_null_like_text(value):
        return {}
    if value.startswith("{") or value.startswith("["):
        parsed = json.loads(value)
        if isinstance(parsed, dict):
            raw_shape_type = parsed.get("shape_type")
            if raw_shape_type is None or _is_null_like_text(raw_shape_type):
                parsed.pop("shape_type", None)
            if not parsed:
                return {}
            return parsed
        return {"genes_list": parsed}
    return {"shape_type": value}


def _coerce_list_payload(value: Any) -> list[Any]:
    if value is None:
        return []
    if isinstance(value, list):
        return value
    if hasattr(value, "ToString"):
        value = value.ToString()
    if not isinstance(value, str):
        value = str(value)
    value = value.strip()
    if _is_null_like_text(value):
        return []
    if value.startswith("["):
        parsed = json.loads(value)
        return parsed if isinstance(parsed, list) else []
    return []


def _coerce_int_payload(value: Any, default: int = 0) -> int:
    if value is None:
        return default
    if isinstance(value, bool):
        return int(value)
    if isinstance(value, int):
        return value
    if isinstance(value, float):
        return int(value)
    if hasattr(value, "ToString"):
        value = value.ToString()
    if not isinstance(value, str):
        value = str(value)
    text = value.strip()
    if not text:
        return default
    try:
        return int(float(text))
    except Exception:
        try:
            parsed = json.loads(text)
            if isinstance(parsed, (int, float)):
                return int(parsed)
        except Exception:
            pass
    return default


def _coerce_float_payload(value: Any, default: float = 0.0) -> float:
    if value is None:
        return default
    if isinstance(value, bool):
        return float(int(value))
    if isinstance(value, (int, float)):
        return float(value)
    if hasattr(value, "ToString"):
        value = value.ToString()
    if not isinstance(value, str):
        value = str(value)
    text = value.strip()
    if not text:
        return default
    try:
        return float(text)
    except Exception:
        try:
            parsed = json.loads(text)
            if isinstance(parsed, (int, float)):
                return float(parsed)
        except Exception:
            pass
    return default


def _has_meaningful_input(
    raw_payload: Any,
    shape_lock: Any,
    site_boundary: Any,
    tree_count: int,
    tree_points: Any,
    tree_sizes: Any,
) -> bool:
    if isinstance(raw_payload, dict):
        if raw_payload:
            if any(key in raw_payload for key in ("shape_type", "length", "width", "height", "rotation", "vertices", "arm_a_length", "arm_b_length", "wing_depth", "courtyard_size")):
                if any(not _is_null_like_text(raw_payload.get(key)) for key in raw_payload.keys() if key != "shape_type"):
                    return True
                if not _is_null_like_text(raw_payload.get("shape_type")) and str(raw_payload.get("shape_type")).strip().lower() != "rectangle":
                    return True
        else:
            raw_payload = None
    elif isinstance(raw_payload, str):
        if not _is_null_like_text(raw_payload):
            return True
    elif raw_payload not in (None, [], {}):
        return True
    if isinstance(shape_lock, str) and shape_lock.strip():
        return True
    if site_boundary:
        return True
    if tree_count > 0:
        return True
    if tree_points:
        return True
    if tree_sizes:
        return True
    return False


def _point_in_polygon(point: list[float], polygon: list[list[float]]) -> bool:
    x = float(point[0])
    y = float(point[1])
    inside = False
    count = len(polygon)
    for index in range(count):
        x1, y1 = polygon[index][0], polygon[index][1]
        x2, y2 = polygon[(index + 1) % count][0], polygon[(index + 1) % count][1]
        if ((y1 > y) != (y2 > y)) and (x < (x2 - x1) * (y - y1) / ((y2 - y1) or 1e-9) + x1):
            inside = not inside
    return inside


def _extract_site_boundary(raw_boundary: Any) -> list[list[float]]:
    if raw_boundary is None:
        return []
    boundary = raw_boundary
    if isinstance(boundary, dict):
        for key in ("boundary", "points", "vertices", "polyline"):
            if key in boundary:
                boundary = boundary[key]
                break
    if isinstance(boundary, list):
        points: list[list[float]] = []
        for item in boundary:
            if isinstance(item, (list, tuple)) and len(item) >= 2:
                points.append([float(item[0]), float(item[1])])
        return points
    return []


def _extract_tree_points(raw_trees: Any) -> list[list[float]]:
    if raw_trees is None:
        return []
    trees = raw_trees
    if isinstance(trees, dict):
        for key in ("trees", "points", "tree_points", "locations"):
            if key in trees:
                trees = trees[key]
                break
    if isinstance(trees, str):
        parsed = _coerce_list_payload(trees)
        trees = parsed if parsed else trees
    if isinstance(trees, list):
        points: list[list[float]] = []
        for item in trees:
            if hasattr(item, "ToString"):
                item = item.ToString()
            if isinstance(item, str):
                item_text = item.strip()
                if not item_text:
                    continue
                try:
                    parsed_item = json.loads(item_text)
                    item = parsed_item
                except Exception:
                    continue
            if isinstance(item, (list, tuple)) and len(item) >= 2:
                points.append([float(item[0]), float(item[1])])
        return points
    return []


def _extract_tree_sizes(raw_sizes: Any, tree_count: int) -> list[float]:
    if raw_sizes is None:
        return []
    sizes = raw_sizes
    if isinstance(sizes, dict):
        for key in ("sizes", "tree_sizes", "radii", "canopy_sizes"):
            if key in sizes:
                sizes = sizes[key]
                break
    if isinstance(sizes, str):
        parsed = _coerce_list_payload(sizes)
        sizes = parsed if parsed else sizes
    if isinstance(sizes, list):
        result: list[float] = []
        for item in sizes:
            if hasattr(item, "ToString"):
                item = item.ToString()
            try:
                result.append(float(item))
            except Exception:
                continue
        return result[:tree_count] if tree_count else result
    if isinstance(sizes, (int, float)):
        return [float(sizes)] * max(0, tree_count)
    return []


def _infer_tree_sizes_from_points(tree_points: list[list[float]]) -> list[float]:
    if not tree_points:
        return []

    y_values = [point[1] for point in tree_points if len(point) >= 2]
    if not y_values:
        return [5.0 for _ in tree_points]

    min_y = min(y_values)
    max_y = max(y_values)
    y_span = max(max_y - min_y, 1e-9)

    inferred_sizes: list[float] = []
    for point in tree_points:
        y_value = point[1] if len(point) >= 2 else min_y
        normalized = (y_value - min_y) / y_span
        inferred_sizes.append(round(4.5 + (normalized * 2.0), 2))
    return inferred_sizes


def _infer_tree_points_from_count(tree_count: int) -> list[list[float]]:
    if tree_count <= 0:
        return []
    if tree_count == 1:
        return [[0.5, 0.92]]
    if tree_count == 2:
        return [[0.333, 0.92], [0.667, 0.92]]
    return [[round((index + 1) / (tree_count + 1), 3), 0.92] for index in range(tree_count)]


def _evaluate_candidate(
    shape: Any,
    site_boundary: list[list[float]],
    tree_points: list[list[float]],
    tree_sizes: list[float],
) -> tuple[float, dict[str, float]]:
    area = float(shape.metadata.get("area", 0.0) or 0.0)
    volume = float(shape.metadata.get("volume", 0.0) or 0.0)
    perimeter = float(shape.metadata.get("perimeter", 0.0) or 0.0)
    bbox = shape.metadata.get("bounding_box", {})
    min_pt = bbox.get("min", [0.0, 0.0, 0.0])
    max_pt = bbox.get("max", [0.0, 0.0, 0.0])

    score = area + volume * 0.05 - perimeter * 0.1
    penalties = 0.0

    if site_boundary:
        outside_count = 0
        for vertex in shape.vertices_2d:
            if not _point_in_polygon(vertex, site_boundary):
                outside_count += 1
        boundary_penalty = outside_count * 500.0
        penalties += boundary_penalty

    if tree_points:
        overlap_penalty = 0.0
        for index, (tree_x, tree_y) in enumerate(tree_points):
            if min_pt[0] <= tree_x <= max_pt[0] and min_pt[1] <= tree_y <= max_pt[1]:
                size_factor = 1.0
                if index < len(tree_sizes):
                    try:
                        size_factor = max(0.5, float(tree_sizes[index]) / 5.0)
                    except Exception:
                        size_factor = 1.0
                overlap_penalty += 200.0 * size_factor
        penalties += overlap_penalty

    score -= penalties
    return score, {
        "area": area,
        "volume": volume,
        "perimeter": perimeter,
        "penalties": penalties,
        "score": score,
    }


def _build_mesh(rg_module: Any, vertices_3d: list[list[float]], face_indices: list[list[int]]) -> tuple[Any, int]:
    gh_mesh = rg_module.Mesh()
    for vertex in vertices_3d:
        gh_mesh.Vertices.Add(float(vertex[0]), float(vertex[1]), float(vertex[2]))

    face_count = 0
    for face in face_indices:
        if len(face) == 3:
            gh_mesh.Faces.AddFace(int(face[0]), int(face[1]), int(face[2]))
            face_count += 1
        elif len(face) == 4:
            gh_mesh.Faces.AddFace(int(face[0]), int(face[1]), int(face[2]), int(face[3]))
            face_count += 1
        elif len(face) > 4:
            for index in range(1, len(face) - 1):
                gh_mesh.Faces.AddFace(int(face[0]), int(face[index]), int(face[index + 1]))
                face_count += 1

    gh_mesh.Normals.ComputeNormals()
    gh_mesh.Compact()
    return gh_mesh, face_count


def load_shape_generator_module() -> Any:
    """Import or reload the VSCode shape generator module."""
    shape_module = importlib.import_module("shape_generator_node")
    return importlib.reload(shape_module)


def generate_shape_from_genes(generator: Any, genes: dict[str, Any], locked_shape_type: str | None, rng: random.Random) -> dict[str, Any]:
    """Create one candidate genes payload, respecting any typology lock."""
    return generator.generate_random_genes(
        shape_type=genes.get("shape_type"),
        locked_shape_type=locked_shape_type,
        overrides=genes,
        rng=rng,
    )


def apply_site_transform(shape: Any, genes: dict[str, Any]) -> Any:
    """Placeholder for site placement logic.

    The current generator already applies base_point and rotation inside the
    shape generator, so this function remains the hook for future site-specific
    transforms if you decide to add them later.
    """
    return shape


def convert_to_rhino_mesh(rg_module: Any, shape: Any) -> tuple[Any, int]:
    """Convert a generated shape into a Rhino mesh."""
    return _build_mesh(rg_module, shape.vertices_3d, shape.faces)


def run_generative_loop(
    rg_module: Any,
    generator: Any,
    seed_genes: dict[str, Any],
    seed_genes_obj: Any,
    iterations: int,
    locked_shape_type: str | None,
    site_boundary: list[list[float]],
    tree_points: list[list[float]],
    tree_sizes: list[float],
    rng: random.Random,
) -> tuple[Any, Any, int, dict[str, Any], Any, dict[str, float]]:
    """Run the optimization loop and return the best mesh and metadata."""
    best_candidate = None
    best_mesh = None
    best_face_count = 0
    best_score = -1.0e18
    best_metrics: dict[str, float] = {}
    best_shape = None

    for _ in range(iterations):
        candidate_genes = generate_shape_from_genes(
            generator=generator,
            genes=seed_genes,
            locked_shape_type=locked_shape_type,
            rng=rng,
        )

        shape = generator.generate_from_genes(candidate_genes)
        shape = apply_site_transform(shape, candidate_genes)
        score, metrics = _evaluate_candidate(shape, site_boundary, tree_points, tree_sizes)

        if best_candidate is None or score > best_score:
            best_candidate = candidate_genes
            best_score = score
            best_metrics = metrics
            best_mesh, best_face_count = convert_to_rhino_mesh(rg_module, shape)
            best_shape = shape

    if best_candidate is None or best_shape is None:
        raise RuntimeError("No valid candidates were generated")

    return best_mesh, best_shape, best_face_count, best_candidate, best_metrics, {"score": best_score}


try:
    py_folder = r"D:\3rd sem\STUDIO\AIA26_Studio - Copy (2)\team_04\PY"
    if py_folder not in sys.path:
        sys.path.insert(0, py_folder)

    rg = importlib.import_module("Rhino.Geometry")
    shape_module = load_shape_generator_module()
    ShapeGenerator = shape_module.ShapeGenerator
    ShapeGenes = shape_module.ShapeGenes

    rng = random.Random()
    seed_value = globals().get("seed")
    if seed_value is not None:
        try:
            rng.seed(int(seed_value))
        except Exception:
            rng.seed(str(seed_value))

    iterations_value = globals().get("iterations", 24)
    try:
        iterations = max(1, int(iterations_value))
    except Exception:
        iterations = 24

    raw_payload = globals().get("genes_json")
    if raw_payload is None:
        raw_payload = globals().get("genes")
    if raw_payload is None:
        raw_payload = globals().get("design_request")

    seed_genes = _coerce_payload(raw_payload)
    seed_genes_obj = ShapeGenes.from_dict(seed_genes)

    shape_lock = globals().get("locked_shape_type")
    if not shape_lock:
        shape_generation = _coerce_payload(globals().get("shape_generation"))
        shape_lock = shape_generation.get("locked_shape_type")
    if not shape_lock:
        shape_lock = seed_genes.get("shape_type")

    site_boundary = _extract_site_boundary(globals().get("site_boundary"))
    tree_count = _coerce_int_payload(globals().get("tree_count"), 0)
    if tree_count <= 0:
        tree_count = _coerce_int_payload(globals().get("number_of_trees"), 0)

    tree_points = _extract_tree_points(globals().get("tree_points"))
    if not tree_points:
        tree_points = _extract_tree_points(globals().get("tree_locations"))
    if not tree_points and tree_count > 0:
        tree_points = _infer_tree_points_from_count(tree_count)
    tree_sizes = _extract_tree_sizes(globals().get("tree_sizes"), len(tree_points))
    if not tree_sizes and tree_points:
        tree_sizes = _infer_tree_sizes_from_points(tree_points)
    if tree_sizes and len(tree_sizes) < len(tree_points):
        tree_sizes.extend([tree_sizes[-1]] * (len(tree_points) - len(tree_sizes)))
    elif len(tree_sizes) > len(tree_points):
        tree_sizes = tree_sizes[:len(tree_points)]

    if not _has_meaningful_input(raw_payload, shape_lock, site_boundary, tree_count, tree_points, tree_sizes):
        mesh = None
        vertices = None
        faces = None
        metadata = "No input provided."
        genes_payload = None
        error = "No generative input was provided to GRASSHOPPER_GENE_MESH.py."
    else:
        generator = ShapeGenerator(shape_id_prefix="GH")
        best_mesh, best_shape, best_face_count, best_candidate, best_metrics, fitness_info = run_generative_loop(
            rg_module=rg,
            generator=generator,
            seed_genes=seed_genes,
            seed_genes_obj=seed_genes_obj,
            iterations=iterations,
            locked_shape_type=shape_lock,
            site_boundary=site_boundary,
            tree_points=tree_points,
            tree_sizes=tree_sizes,
            rng=rng,
        )

        mesh = best_mesh
        vertices = "%d vertices" % len(best_shape.vertices_3d)
        faces = "%d faces" % best_face_count
        genes_payload = json.dumps(best_candidate, indent=2)
        metadata = (
            "Shape: {shape_type}\n"
            "Iterations: {iterations}\n"
            "Locked shape: {locked_shape}\n"
            "Area: {area:.2f}\n"
            "Volume: {volume:.2f}\n"
            "Perimeter: {perimeter:.2f}\n"
            "Penalties: {penalties:.2f}\n"
            "Fitness: {score:.2f}"
        ).format(
            shape_type=best_shape.shape_type,
            iterations=iterations,
            locked_shape=shape_lock or "none",
            area=best_metrics.get("area", 0.0),
            volume=best_metrics.get("volume", 0.0),
            perimeter=best_metrics.get("perimeter", 0.0),
            penalties=best_metrics.get("penalties", 0.0),
            score=fitness_info.get("score", 0.0),
        )

except Exception as exc:
    import traceback

    error = "ERROR: %s\n\n%s" % (exc, traceback.format_exc())
    mesh = None
    vertices = None
    faces = None
    metadata = None
    genes_payload = None
# ---------- end script ----------
panel_6 = Panel(read_json_value_8.AsString)
mesh_join = MeshJoin(Meshes=script.mesh)
panel_7 = Panel(script.mesh)
panel_8 = Panel(script.error)
python_3_script = Python3Script(
    move_left=read_json_value_8.AsString,
    move_right=read_json_value_9.AsString,
    move_front=read_json_value_10.AsString,
    move_back=read_json_value_16.AsString,
    rotate_clockwise=read_json_value_17.AsString,
    rotate_anticlockwise=read_json_value_18.AsString,
    scale_up=read_json_value_19.AsString,
    scale_down=read_json_value_20.AsString,
    scale_factor=read_json_value_21.AsString,
    scale_left_wing=read_json_value_11.AsString,
    scale_right_wing=read_json_value_12.AsString,
    scale_center_wing=read_json_value_13.AsString,
    scale_front_wing=read_json_value_14.AsString,
    scale_back_wing=read_json_value_15.AsString,
    reset=Toggle(False))  # -> move_left, move_right, move_front, move_back, rotate_clockwise, rotate_anticlockwise, scale_up, scale_down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; inputs reset: Boolean
# ---------- python_3_script: Python ----------
import scriptcontext as sc

# ==========================================================
# MEMORY KEYS
# ==========================================================

KEYS = {
    "move_left": "MEM_MOVE_LEFT",
    "move_right": "MEM_MOVE_RIGHT",
    "move_front": "MEM_MOVE_FRONT",
    "move_back": "MEM_MOVE_BACK",

    "rotate_clockwise": "MEM_ROTATE_CLOCKWISE",
    "rotate_anticlockwise": "MEM_ROTATE_ANTICLOCKWISE",

    "scale_up": "MEM_SCALE_UP",
    "scale_down": "MEM_SCALE_DOWN",
    "scale_factor": "MEM_SCALE_FACTOR",

    "scale_left_wing": "MEM_SCALE_LEFT_WING",
    "scale_right_wing": "MEM_SCALE_RIGHT_WING",
    "scale_center_wing": "MEM_SCALE_CENTER_WING",
    "scale_front_wing": "MEM_SCALE_FRONT_WING",
    "scale_back_wing": "MEM_SCALE_BACK_WING"
}


# ==========================================================
# DEFAULT VALUES
# Everything starts from 0 until user gives input
# ==========================================================

DEFAULTS = {
    "move_left": 0.0,
    "move_right": 0.0,
    "move_front": 0.0,
    "move_back": 0.0,

    "rotate_clockwise": 0.0,
    "rotate_anticlockwise": 0.0,

    "scale_up": 0.0,
    "scale_down": 0.0,
    "scale_factor": 0.0,

    "scale_left_wing": 0.0,
    "scale_right_wing": 0.0,
    "scale_center_wing": 0.0,
    "scale_front_wing": 0.0,
    "scale_back_wing": 0.0
}


# ==========================================================
# SAFE NUMBER READER
# ==========================================================

def read_number(x):
    if x is None:
        return None

    try:
        text = str(x).strip()

        if text == "":
            return None

        return float(text)

    except:
        return None


# ==========================================================
# MEMORY FUNCTION
# ==========================================================

def remember_value(name, input_value):
    key = KEYS[name]
    default = DEFAULTS[name]

    new_value = read_number(input_value)

    # If user gives new value, update only this input
    if new_value is not None:
        sc.sticky[key] = new_value
        return new_value

    # If input is empty, keep previous stored value
    if key in sc.sticky:
        return sc.sticky[key]

    # First run default
    sc.sticky[key] = default
    return default


# ==========================================================
# RESET MEMORY
# ==========================================================

try:
    reset_value = bool(reset)
except:
    reset_value = False

if reset_value:
    for key in KEYS.values():
        if key in sc.sticky:
            del sc.sticky[key]


# ==========================================================
# STORE VALUES
# ==========================================================

move_left_value = remember_value("move_left", move_left)
move_right_value = remember_value("move_right", move_right)
move_front_value = remember_value("move_front", move_front)
move_back_value = remember_value("move_back", move_back)

rotate_clockwise_value = remember_value("rotate_clockwise", rotate_clockwise)
rotate_anticlockwise_value = remember_value("rotate_anticlockwise", rotate_anticlockwise)

scale_up_value = remember_value("scale_up", scale_up)
scale_down_value = remember_value("scale_down", scale_down)
scale_factor_value = remember_value("scale_factor", scale_factor)

scale_left_wing_value = remember_value("scale_left_wing", scale_left_wing)
scale_right_wing_value = remember_value("scale_right_wing", scale_right_wing)
scale_center_wing_value = remember_value("scale_center_wing", scale_center_wing)
scale_front_wing_value = remember_value("scale_front_wing", scale_front_wing)
scale_back_wing_value = remember_value("scale_back_wing", scale_back_wing)


# ==========================================================
# OUTPUTS
# Rename GhPython outputs exactly like these names
# ==========================================================

move_left = move_left_value
move_right = move_right_value
move_front = move_front_value
move_back = move_back_value

rotate_clockwise = rotate_clockwise_value
rotate_anticlockwise = rotate_anticlockwise_value

scale_up = scale_up_value
scale_down = scale_down_value
scale_factor = scale_factor_value

scale_left_wing = scale_left_wing_value
scale_right_wing = scale_right_wing_value
scale_center_wing = scale_center_wing_value
scale_front_wing = scale_front_wing_value
scale_back_wing = scale_back_wing_value
# ---------- end python_3_script ----------
script_2 = Script(
    site_crv=siteboundary,
    site_srf=surface,
    grid_pts=flatten_tree,
    building_mesh=flatten(mesh_join),
    road_crv=flatten(road),
    preferred_angle=Slider(90, range=0..100),
    iterations=read_json_value_5.AsString,
    tree_points=read_json_value.AsString,
    tree_count=read_json_value_2.AsString,
    tree_sizes=read_json_value_3.AsString)  # -> best_building, best_trees, best_index, best_angle, best_score, record, design_report; inputs site_crv: Curve, site_srf: Surface, grid_pts: list of Point3d, building_mesh: list of Mesh, road_crv: Curve, preferred_angle: Double, iterations: String, tree_points: String, tree_count: String, tree_sizes: String
# ---------- script_2: Python ----------
import Rhino.Geometry as rg
import rhinoscriptsyntax as rs
import random, math, json, ast

# ============================================================
# SAFE CONVERTERS
# ============================================================

def get_float(x, default):
    try:    return float(x)
    except: return default

def get_int(x, default):
    try:    return int(float(x))
    except: return default

def flatten_any(x):
    out = []
    if x is None: return out
    if hasattr(x, "Branches"):
        for b in x.Branches: out += flatten_any(b)
        return out
    if isinstance(x, (list, tuple)):
        for i in x: out += flatten_any(i)
        return out
    out.append(x)
    return out

def to_point3d(p):
    if p is None: return None
    if isinstance(p, rg.Point3d): return p
    if isinstance(p, rg.Point):   return p.Location
    try:
        cp = rs.coerce3dpoint(p)
        if cp: return cp
    except: pass
    if hasattr(p, "X") and hasattr(p, "Y"):
        return rg.Point3d(float(p.X), float(p.Y), float(getattr(p, "Z", 0.0)))
    return None

def get_curve(crv):
    if crv is None: return None
    if isinstance(crv, rg.Curve): return crv
    try:    return rs.coercecurve(crv)
    except: return None

def to_mesh(obj):
    if obj is None: return None
    if isinstance(obj, rg.Mesh):
        m = obj.DuplicateMesh()
        m.Weld(math.pi); m.Normals.ComputeNormals(); m.Compact()
        return m
    if isinstance(obj, rg.Brep):
        meshes = rg.Mesh.CreateFromBrep(obj)
        if not meshes: return None
        joined = rg.Mesh()
        for m in meshes: joined.Append(m)
        joined.Weld(math.pi); joined.Normals.ComputeNormals(); joined.Compact()
        return joined
    try:
        geo = rs.coercegeometry(obj)
        return to_mesh(geo)
    except: return None

def largest_mesh_piece(mesh):
    if mesh is None: return None
    try:
        pieces = mesh.SplitDisjointPieces()
        if pieces and len(pieces) > 0:
            largest = max(pieces, key=lambda m: m.GetBoundingBox(True).Diagonal.Length)
            largest.Weld(math.pi); largest.Normals.ComputeNormals(); largest.Compact()
            return largest.DuplicateMesh()
    except: pass
    mesh.Weld(math.pi); mesh.Normals.ComputeNormals(); mesh.Compact()
    return mesh.DuplicateMesh()

def get_single_building_mesh(x):
    items = flatten_any(x)
    meshes = [largest_mesh_piece(to_mesh(item)) for item in items if to_mesh(item)]
    if not meshes: return None
    biggest = max(meshes, key=lambda m: m.GetBoundingBox(True).Diagonal.Length)
    biggest.Weld(math.pi); biggest.Normals.ComputeNormals(); biggest.Compact()
    return biggest.DuplicateMesh()


# ============================================================
# INPUTS
# ============================================================

site_curve      = get_curve(site_crv)
road_curve      = get_curve(road_crv)
iterations      = get_int(iterations, 500)
preferred_angle = get_float(preferred_angle, 90.0)

if iterations < 1: iterations = 500

angles = [0, 45, 90, 135, 180, 225, 270, 315]
tol    = 0.01

ROAD_WEIGHT       = -1.0
SUN_WEIGHT        = -1.0
OPEN_SPACE_WEIGHT =  1.0


# ============================================================
# SITE HELPERS
# ============================================================

def point_inside_curve_xy(crv, pt):
    if crv is None or pt is None: return False
    test = rg.Point3d(pt.X, pt.Y, 0)
    return crv.Contains(test, rg.Plane.WorldXY, tol) != rg.PointContainment.Outside

def point_inside_site_xy(pt):
    return point_inside_curve_xy(site_curve, pt)

def get_site_z_point(pt):
    if pt is None: return None
    test = rg.Point3d(pt.X, pt.Y, pt.Z)
    if site_srf is not None:
        try:
            if isinstance(site_srf, rg.Brep):
                ok, closest = site_srf.ClosestPoint(test)
                if ok: return closest
            elif isinstance(site_srf, rg.Surface):
                ok, u, v = site_srf.ClosestPoint(test)
                if ok: return site_srf.PointAt(u, v)
            elif isinstance(site_srf, rg.Mesh):
                mp = site_srf.ClosestMeshPoint(test, 999999)
                if mp: return mp.Point
        except: pass
    return test

def snap_point_inside_site(pt, offset=2.0):
    if site_curve is None or pt is None: return pt
    if point_inside_site_xy(pt): return pt
    ok, t = site_curve.ClosestPoint(pt)
    if not ok: return pt
    boundary_pt = site_curve.PointAt(t)
    bbox   = site_curve.GetBoundingBox(True)
    center = bbox.Center
    inward = rg.Vector3d(center.X - boundary_pt.X, center.Y - boundary_pt.Y, 0)
    if inward.Length > 0:
        inward.Unitize()
        inward *= offset
    return rg.Point3d(boundary_pt.X + inward.X, boundary_pt.Y + inward.Y, pt.Z)

def site_area_approx():
    """Approximate site area from bounding box diagonal."""
    if site_curve is None: return 0.0
    bbox = site_curve.GetBoundingBox(True)
    return (bbox.Max.X - bbox.Min.X) * (bbox.Max.Y - bbox.Min.Y)

def compute_auto_inset(building_mesh):
    """
    Compute the required inset = half the building footprint diagonal.
    This ensures any grid point that passes is truly far enough from
    the boundary that the building fits when centred there.
    """
    if building_mesh is None: return 2.0
    bbox = building_mesh.GetBoundingBox(True)
    half_diag = math.sqrt(
        ((bbox.Max.X - bbox.Min.X) ** 2) +
        ((bbox.Max.Y - bbox.Min.Y) ** 2)
    ) * 0.5
    return half_diag + 0.5   # add 0.5 m safety margin

def make_inset_curve(crv, dist):
    if crv is None or dist <= 0: return crv
    for sign in [-1, 1]:
        try:
            results = crv.Offset(rg.Plane.WorldXY, sign * dist, tol,
                                 rg.CurveOffsetCornerStyle.Sharp)
            if results and len(results) > 0:
                # pick the result that is inside the original
                for r in results:
                    test_pt = r.PointAtNormalizedLength(0.5)
                    if point_inside_curve_xy(crv, test_pt):
                        return r
                return results[0]
        except: pass
    return crv

def scale_building_to_fit_site(mesh, site_crv):
    """
    If the building footprint is larger than ~60 % of the site bbox,
    scale it down uniformly so it fits with room for trees.
    Returns (scaled_mesh, scale_factor).
    """
    if mesh is None or site_crv is None:
        return mesh, 1.0

    site_bbox = site_crv.GetBoundingBox(True)
    site_w = site_bbox.Max.X - site_bbox.Min.X
    site_h = site_bbox.Max.Y - site_bbox.Min.Y

    bldg_bbox = mesh.GetBoundingBox(True)
    bldg_w = bldg_bbox.Max.X - bldg_bbox.Min.X
    bldg_h = bldg_bbox.Max.Y - bldg_bbox.Min.Y

    max_allowed_w = site_w * 0.60
    max_allowed_h = site_h * 0.60

    scale = 1.0
    if bldg_w > max_allowed_w:
        scale = min(scale, max_allowed_w / bldg_w)
    if bldg_h > max_allowed_h:
        scale = min(scale, max_allowed_h / bldg_h)

    if scale >= 1.0:
        return mesh, 1.0

    m = mesh.DuplicateMesh()
    center = bldg_bbox.Center
    xform  = rg.Transform.Scale(
        rg.Plane(center, rg.Vector3d.ZAxis),
        scale, scale, 1.0   # keep Z (height) unchanged
    )
    m.Transform(xform)
    m.Weld(math.pi); m.Normals.ComputeNormals(); m.Compact()
    return m, scale

def mesh_fully_inside_site(mesh):
    """
    Returns True only if EVERY bottom-face vertex is inside the site curve.
    Uses actual mesh vertices projected to Z=0 — much more accurate than bbox corners.
    """
    if mesh is None or site_curve is None: return False

    bbox     = mesh.GetBoundingBox(True)
    z_bottom = bbox.Min.Z + (bbox.Max.Z - bbox.Min.Z) * 0.05  # near-bottom slice

    checked = 0
    for v in mesh.Vertices:
        if v.Z <= z_bottom + (bbox.Max.Z - bbox.Min.Z) * 0.1:
            pt2d = rg.Point3d(v.X, v.Y, 0)
            if not point_inside_site_xy(pt2d):
                return False
            checked += 1

    # also check bbox corners for safety
    corners = [
        rg.Point3d(bbox.Min.X, bbox.Min.Y, 0),
        rg.Point3d(bbox.Max.X, bbox.Min.Y, 0),
        rg.Point3d(bbox.Max.X, bbox.Max.Y, 0),
        rg.Point3d(bbox.Min.X, bbox.Max.Y, 0),
    ]
    for c in corners:
        if not point_inside_site_xy(c):
            return False

    return checked > 0 or True   # if no bottom verts found, trust bbox corners


# ============================================================
# TREE PARSERS
# ============================================================

def parse_tree_count(data, default=0):
    try:    return int(float(str(data).strip()))
    except: return default

def parse_tree_sizes(data):
    sizes = []
    if data is None: return sizes
    try:
        parsed = ast.literal_eval(str(data))
        if isinstance(parsed, (list, tuple)):
            for item in parsed:
                try: sizes.append(float(item))
                except: pass
        else:
            sizes.append(float(parsed))
        return sizes
    except: pass
    try:
        parts = str(data).replace("[","").replace("]","").split(",")
        for p in parts:
            try: sizes.append(float(p.strip()))
            except: pass
    except: pass
    return sizes

def parse_tree_points(data):
    points = []
    if data is None: return points
    for item in flatten_any(data):
        pt = to_point3d(item)
        if pt: points.append(pt)
    if points: return points
    text = str(data).strip()
    try:
        parsed = ast.literal_eval(text)
        if isinstance(parsed, (list, tuple)):
            for item in parsed:
                if isinstance(item, (list, tuple)):
                    if   len(item) == 2: points.append(rg.Point3d(float(item[0]), float(item[1]), 0))
                    elif len(item) >= 3: points.append(rg.Point3d(float(item[0]), float(item[1]), float(item[2])))
        return points
    except: pass
    try:
        for ps in text.split(";"):
            coords = ps.replace("[","").replace("]","").split(",")
            if   len(coords) == 2: points.append(rg.Point3d(float(coords[0]), float(coords[1]), 0))
            elif len(coords) >= 3: points.append(rg.Point3d(float(coords[0]), float(coords[1]), float(coords[2])))
    except: pass
    return points

def remap_normalized_tree_points(points):
    if site_curve is None: return points
    bbox = site_curve.GetBoundingBox(True)
    remapped = []
    for pt in points:
        if 0 <= pt.X <= 1 and 0 <= pt.Y <= 1:
            new_pt = rg.Point3d(
                bbox.Min.X + pt.X * (bbox.Max.X - bbox.Min.X),
                bbox.Min.Y + pt.Y * (bbox.Max.Y - bbox.Min.Y), 0)
        else:
            new_pt = pt
        new_pt = snap_point_inside_site(new_pt, 2.0)
        remapped.append(new_pt)
    return remapped

tree_count        = parse_tree_count(tree_count, 6)
tree_sizes_clean  = parse_tree_sizes(tree_sizes)
tree_points_clean = remap_normalized_tree_points(parse_tree_points(tree_points))
if tree_count < 0: tree_count = 0


# ============================================================
# CLEAN GEOMETRY INPUTS
# ============================================================

grid_pts_clean = []
for p in flatten_any(grid_pts):
    pt = to_point3d(p)
    if pt: grid_pts_clean.append(pt)

building_base_raw = get_single_building_mesh(building_mesh)

# --- auto-scale building if it is too big for the site ---
applied_scale   = 1.0
building_base   = building_base_raw
scale_note      = "No scaling applied."
if building_base_raw is not None and site_curve is not None:
    building_base, applied_scale = scale_building_to_fit_site(building_base_raw, site_curve)
    if applied_scale < 1.0:
        scale_note = "Building scaled by {:.3f} to fit site.".format(applied_scale)

# --- compute auto inset from (possibly scaled) building ---
auto_inset   = compute_auto_inset(building_base)
inset_curve  = make_inset_curve(site_curve, auto_inset)


# ============================================================
# VALID GRID POINTS
# ============================================================

def point_inside_inset_xy(pt):
    return point_inside_curve_xy(inset_curve, pt)

valid_pts = [get_site_z_point(pt) for pt in grid_pts_clean if point_inside_inset_xy(pt)]

# fallback 1: relax to original site curve
if not valid_pts:
    valid_pts = [get_site_z_point(pt) for pt in grid_pts_clean if point_inside_site_xy(pt)]

# fallback 2: bbox centre
if not valid_pts and site_curve is not None:
    bbox      = site_curve.GetBoundingBox(True)
    center_pt = snap_point_inside_site(rg.Point3d(bbox.Center.X, bbox.Center.Y, 0), 2.0)
    if point_inside_site_xy(center_pt):
        valid_pts.append(get_site_z_point(center_pt))


# ============================================================
# BUILDING PLACEMENT FUNCTIONS
# ============================================================

def move_mesh_to_point(mesh, target):
    if mesh is None or target is None: return None
    m      = mesh.DuplicateMesh()
    bbox   = m.GetBoundingBox(True)
    target = get_site_z_point(target)
    m.Transform(rg.Transform.Translation(rg.Vector3d(
        target.X - bbox.Center.X,
        target.Y - bbox.Center.Y,
        target.Z - bbox.Min.Z
    )))
    return m

def rotate_mesh(mesh, angle):
    if mesh is None: return None
    m    = mesh.DuplicateMesh()
    bbox = m.GetBoundingBox(True)
    center = rg.Point3d(bbox.Center.X, bbox.Center.Y, bbox.Min.Z)
    m.Transform(rg.Transform.Rotation(math.radians(float(angle)), rg.Vector3d.ZAxis, center))
    return m

def road_distance(mesh):
    if road_curve is None or mesh is None: return 0.0
    center = mesh.GetBoundingBox(True).Center
    ok, t  = road_curve.ClosestPoint(center)
    if not ok: return 999999.0
    return center.DistanceTo(road_curve.PointAt(t))

def open_space_score(mesh):
    if site_curve is None or mesh is None: return 0.0
    center = mesh.GetBoundingBox(True).Center
    ok, t  = site_curve.ClosestPoint(center)
    if not ok: return 0.0
    return center.DistanceTo(site_curve.PointAt(t))

def sun_diff(angle):
    d = abs(float(angle) - preferred_angle)
    return min(d, 360.0 - d)

def building_fitness(mesh, angle):
    return (road_distance(mesh)    * ROAD_WEIGHT +
            open_space_score(mesh) * OPEN_SPACE_WEIGHT +
            sun_diff(angle)        * SUN_WEIGHT)


# ============================================================
# TREE FUNCTIONS
# ============================================================

def get_tree_size(i):
    default_radius = 1.2
    default_height = 5.0
    if not tree_sizes_clean: return default_radius, default_height
    if len(tree_sizes_clean) == 1: return tree_sizes_clean[0], default_height
    if len(tree_sizes_clean) == len(tree_points_clean): return tree_sizes_clean[i], default_height
    pair_index = i * 2
    if pair_index + 1 < len(tree_sizes_clean):
        return tree_sizes_clean[pair_index], tree_sizes_clean[pair_index + 1]
    return tree_sizes_clean[i % len(tree_sizes_clean)], default_height

def create_tree(pt, radius, height):
    base_pt  = get_site_z_point(pt)
    cylinder = rg.Cylinder(rg.Circle(rg.Plane(base_pt, rg.Vector3d.ZAxis), radius), height)
    return rg.Brep.CreateFromCylinder(cylinder, True, True)

def tree_clear_from_building(pt, radius, mesh):
    if mesh is None or pt is None: return False
    bbox = mesh.GetBoundingBox(True)
    safe = radius + 0.5
    return not (bbox.Min.X - safe <= pt.X <= bbox.Max.X + safe and
                bbox.Min.Y - safe <= pt.Y <= bbox.Max.Y + safe)

def tree_tree_clear(pt, radius, existing_tree_data):
    for old_pt, old_radius in existing_tree_data:
        if pt.DistanceTo(old_pt) < (radius + old_radius) * 1.2:
            return False
    return True


# ============================================================
# FIND BEST BUILDING
# ============================================================

best_building   = None
best_index      = -1
best_angle      = 0.0
best_score      = -1e18
checked         = 0
valid_buildings = 0
failure_reason  = ""

if site_curve is None:
    failure_reason = "site_crv is missing or invalid."
elif building_base is None:
    failure_reason = "building_mesh is missing or invalid."
elif not valid_pts:
    failure_reason = "No valid grid points found inside the site."
else:
    for _ in range(iterations):
        idx   = random.randint(0, len(valid_pts) - 1)
        angle = random.choice(angles)

        rotated = largest_mesh_piece(rotate_mesh(move_mesh_to_point(building_base, valid_pts[idx]), angle))
        if rotated is None: continue
        checked += 1

        # ---- KEY FIX: use vertex-level containment check ----
        if not mesh_fully_inside_site(rotated): continue

        valid_buildings += 1
        score = building_fitness(rotated, angle)
        if score > best_score:
            best_score    = score
            best_building = rotated.DuplicateMesh()
            best_index    = idx
            best_angle    = angle

    # fallback: force-place at site centre
    if best_building is None and valid_pts:
        # use the inset-centred point if possible, else site bbox centre
        site_bbox = site_curve.GetBoundingBox(True)
        cx = site_bbox.Center.X
        cy = site_bbox.Center.Y
        centre_pt = snap_point_inside_site(rg.Point3d(cx, cy, 0), 2.0)
        centre_pt = get_site_z_point(centre_pt)

        fallback      = rotate_mesh(move_mesh_to_point(building_base, centre_pt), preferred_angle)
        best_building = largest_mesh_piece(fallback)
        best_index    = 0
        best_angle    = preferred_angle
        best_score    = -999999.0
        failure_reason = "No valid placement in {} tries; placed at site centre.".format(iterations)


# ============================================================
# PLACE TREES
# ============================================================

best_trees    = []
tree_pts      = []
tree_data     = []
skipped_trees = []

if best_building is not None:
    for i, raw_pt in enumerate(tree_points_clean):
        if len(best_trees) >= tree_count: break
        pt             = get_site_z_point(snap_point_inside_site(raw_pt, 2.0))
        radius, height = get_tree_size(i)
        if radius <= 0:
            skipped_trees.append("tree {} skipped: radius <= 0".format(i)); continue
        if height <= 0: height = 5.0
        if not point_inside_site_xy(pt):
            skipped_trees.append("tree {} skipped: outside site".format(i)); continue
        if not tree_clear_from_building(pt, radius, best_building):
            skipped_trees.append("tree {} skipped: too close to building".format(i)); continue
        if not tree_tree_clear(pt, radius, tree_data):
            skipped_trees.append("tree {} skipped: too close to another tree".format(i)); continue
        tree_pts.append(pt)
        tree_data.append((pt, radius))
        best_trees.append(create_tree(pt, radius, height))


# ============================================================
# FINAL CLEANUP  — single unified mesh
# ============================================================

if best_building is not None:
    best_building = largest_mesh_piece(best_building)
    best_building.Weld(math.pi)
    best_building.Normals.ComputeNormals()
    best_building.Compact()
    pieces = best_building.SplitDisjointPieces()
    if pieces and len(pieces) > 1:
        best_building = max(pieces, key=lambda m: m.Faces.Count)
        best_building.Weld(math.pi)
        best_building.Normals.ComputeNormals()
        best_building.Compact()
else:
    best_trees = []; best_index = -1; best_angle = 0.0; best_score = -999999.0


# ============================================================
# RECORD JSON
# ============================================================

record = json.dumps({
    "status"                 : "success" if best_building is not None else "failed",
    "failure_reason"         : failure_reason,
    "scale_note"             : scale_note,
    "applied_scale"          : round(applied_scale, 4),
    "auto_inset_used"        : round(auto_inset, 3),
    "has_site_curve"         : site_curve is not None,
    "has_building_mesh"      : building_base is not None,
    "input_grid_point_count" : len(grid_pts_clean),
    "valid_grid_point_count" : len(valid_pts),
    "best_grid_index"        : int(best_index),
    "best_rotation_angle"    : float(best_angle),
    "best_fitness_score"     : float(best_score),
    "checked_options"        : int(checked),
    "valid_inside_buildings" : int(valid_buildings),
    "tree_input_point_count" : int(len(tree_points_clean)),
    "tree_size_count"        : int(len(tree_sizes_clean)),
    "trees_created"          : int(len(best_trees)),
    "requested_tree_count"   : int(tree_count),
    "remapped_tree_points"   : [[p.X, p.Y, p.Z] for p in tree_points_clean],
    "skipped_trees"          : skipped_trees
}, indent=4)


# ============================================================
# DESIGN REPORT
# ============================================================

design_lines = [
    "SITE OPTIMIZATION REPORT",
    "----------------------------------", "",
    "Optimization {}.".format("completed successfully" if best_building else "failed"),
]
if failure_reason:
    design_lines.append("Note: {}".format(failure_reason))
design_lines += [
    "", scale_note,
    "Auto-computed inset: {:.2f} m".format(auto_inset), "",
    "Input check:",
    "- Site curve received: {}".format(site_curve is not None),
    "- Building mesh received: {}".format(building_base is not None),
    "- Input grid points: {}".format(len(grid_pts_clean)),
    "- Valid grid points (inside inset): {}".format(len(valid_pts)), "",
    "Optimization result:",
    "- Checked options: {}".format(checked),
    "- Valid building placements: {}".format(valid_buildings),
    "- Best grid index: {}".format(best_index),
    "- Best rotation angle: {} deg".format(best_angle),
    "- Best fitness score: {:.2f}".format(best_score), "",
    "Tree placement:",
    "- Tree input points received: {}".format(len(tree_points_clean)),
    "- Requested tree count: {}".format(tree_count),
    "- Trees created: {}".format(len(best_trees)),
]
if skipped_trees:
    design_lines.append("Skipped trees:")
    for s in skipped_trees: design_lines.append("  - " + s)
design_lines += [
    "",
    "Solution prioritizes site containment, open space, road access,",
    "sun orientation, and tree clearance."
]
design_report = "\n".join(design_lines)
# ---------- end script_2 ----------
panel_9 = Panel(script_2.record)
panel_10 = Panel(mesh_join)
number_slider = Slider(0, range=0..1)
panel_11 = Panel(script_2.best_building)
number_slider_2 = Slider(0.1, range=0..50)  # disabled
number_slider_3 = Slider(0, range=0..50)  # disabled
number_slider_4 = Slider(0, range=0..50)  # disabled
number_slider_5 = Slider(0, range=0..50)  # disabled
number_slider_6 = Slider(0, range=0..50)  # disabled
number_slider_7 = Slider(0, range=0..50)  # disabled
number_slider_8 = Slider(0, range=0..50)  # disabled
number_slider_9 = Slider(0, range=0..50)  # disabled
number_slider_10 = Slider(0, range=0..50)  # disabled
number_slider_11 = Slider(0, range=0..50)  # disabled
number_slider_12 = Slider(0, range=0..50)  # disabled
list_item = ListItem(List=script_2.design_report, Index=number_slider, Wrap=True)
boolean_toggle = BooleanToggle(False)  # disabled
boolean_toggle_2 = BooleanToggle(True)
panel_12 = Panel(script_2.best_trees)
list_item_2 = ListItem(List=script_2.best_building, Index=number_slider, Wrap=True)
mesh = Mesh(script_2.best_trees)
mesh_2 = Mesh(list_item_2)
mesh_join_2 = MeshJoin(Meshes=mesh_2)
python_3_script_2 = Python3Script(building_in=mesh_join_2, trees_in=mesh, reset=Toggle(False))  # -> building_out, trees_out, status; inputs building_in: Mesh, trees_in: list of Mesh
# ---------- python_3_script_2: Python ----------
import scriptcontext as sc
import Rhino.Geometry as rg

KEY_BUILDING = "LAST_VALID_BUILDING_AUTO"
KEY_TREES = "LAST_VALID_TREES_AUTO"

def is_valid_geo(g):
    if g is None:
        return False

    if isinstance(g, rg.Mesh):
        return g.IsValid and g.Vertices.Count > 0 and g.Faces.Count > 0

    if isinstance(g, rg.Brep):
        return g.IsValid and g.Faces.Count > 0

    if hasattr(g, "IsValid"):
        return g.IsValid

    return False

def duplicate_geo(g):
    if g is None:
        return None

    try:
        return g.Duplicate()
    except:
        pass

    try:
        return g.DuplicateMesh()
    except:
        pass

    try:
        return g.DuplicateBrep()
    except:
        pass

    return g

def flatten_input(x):
    result = []

    if x is None:
        return result

    if hasattr(x, "Branches"):
        for branch in x.Branches:
            for item in branch:
                result.append(item)
        return result

    try:
        for item in x:
            result.append(item)
        return result
    except:
        return [x]


# IMPORTANT:
# If reset is True, clear memory and output nothing.
# Do not allow the same run to store input again.
if reset:
    sc.sticky.pop(KEY_BUILDING, None)
    sc.sticky.pop(KEY_TREES, None)

    building_out = None
    trees_out = []

    status = "Reset is TRUE. Stored building and trees were cleared."

else:
    tree_list = flatten_input(trees_in)

    valid_building = is_valid_geo(building_in)
    valid_trees = [t for t in tree_list if is_valid_geo(t)]

    # Store only when new valid input exists
    if valid_building:
        sc.sticky[KEY_BUILDING] = duplicate_geo(building_in)

    if len(valid_trees) > 0:
        sc.sticky[KEY_TREES] = [duplicate_geo(t) for t in valid_trees]

    # If current input is null, use previous stored version
    if valid_building:
        building_out = duplicate_geo(building_in)
    elif KEY_BUILDING in sc.sticky:
        building_out = duplicate_geo(sc.sticky[KEY_BUILDING])
    else:
        building_out = None

    if len(valid_trees) > 0:
        trees_out = [duplicate_geo(t) for t in valid_trees]
    elif KEY_TREES in sc.sticky:
        trees_out = [duplicate_geo(t) for t in sc.sticky[KEY_TREES]]
    else:
        trees_out = []

    status = (
        "Current building valid: {}\n"
        "Current tree count: {}\n"
        "Stored building exists: {}\n"
        "Stored tree count: {}\n"
        "Output tree count: {}"
    ).format(
        valid_building,
        len(valid_trees),
        KEY_BUILDING in sc.sticky,
        len(sc.sticky[KEY_TREES]) if KEY_TREES in sc.sticky else 0,
        len(trees_out)
    )
# ---------- end python_3_script_2 ----------
mesh_3 = Mesh(python_3_script_2.trees_out)
panel_13 = Panel(mesh_2)
python_3_script_3 = Python3Script(
    best_building=python_3_script_2.building_out,
    site_crv=siteboundary,
    road_crv=road,
    tree_breps=mesh_3,
    move_left=python_3_script.move_left,
    move_right=python_3_script.move_right,
    move_front=python_3_script.move_front,
    move_back=python_3_script.move_back,
    rotate_clockwise=python_3_script.rotate_clockwise,
    rotate_anticlockwise=python_3_script.rotate_anticlockwise,
    scale_up=python_3_script.scale_up,
    scale_down=python_3_script.scale_down,
    scale_factor=python_3_script.scale_factor,
    scale_left_wing=python_3_script.scale_left_wing,
    scale_right_wing=python_3_script.scale_right_wing,
    scale_center_wing=python_3_script.scale_center_wing,
    scale_front_wing=python_3_script.scale_front_wing,
    scale_back_wing=python_3_script.scale_back_wing,
    apply_manipulation=boolean_toggle_2,
    reset=Toggle(False))  # -> flatten(final_building), final_trees, manipulation_status, manipulation_report, flatten(human_report); inputs tree_breps: Mesh
# ---------- python_3_script_3: Python ----------
import Rhino.Geometry as rg
import rhinoscriptsyntax as rs
import scriptcontext as sc
import json
import ast
import re
import math

tol = 0.01

# ==========================================================
# MEMORY KEY
# ==========================================================

MEM_KEY = "LAST_SAFE_BUILDING_AFTER_MANIPULATION"

# ==========================================================
# DEAD ZONES
# ==========================================================

MOVE_DEADZONE       = 0.001
ANGLE_DEADZONE      = 0.001
SCALE_DEADZONE      = 0.001
WING_SCALE_DEADZONE = 0.001
FACTOR_DEADZONE     = 0.001


# ==========================================================
# BASIC HELPERS
# ==========================================================

def flatten_any(x):
    out = []
    if x is None:
        return out
    if hasattr(x, "Branches"):
        for b in x.Branches:
            out += flatten_any(b)
        return out
    if isinstance(x, (list, tuple)):
        for item in x:
            out += flatten_any(item)
        return out
    out.append(x)
    return out


def get_bool(x):
    try:
        if isinstance(x, str):
            return x.strip().lower() in ["true", "1", "yes"]
        return bool(x)
    except:
        return False


def parse_input_value(x, key):
    if x is None:
        return None
    items = flatten_any(x)
    last_valid = None
    for item in items:
        if item is None:
            continue
        text = str(item).strip()
        try:
            data = json.loads(text)
            if isinstance(data, dict) and key in data:
                last_valid = float(data[key])
                continue
        except:
            pass
        try:
            data = ast.literal_eval(text)
            if isinstance(data, dict) and key in data:
                last_valid = float(data[key])
                continue
        except:
            pass
        try:
            last_valid = float(text)
            continue
        except:
            pass
        nums = re.findall(r"-?\d+(?:\.\d+)?", text)
        if nums:
            try:
                last_valid = float(nums[-1])
            except:
                pass
    return last_valid


def get_curve(x):
    if isinstance(x, rg.Curve):
        return x
    try:
        return rs.coercecurve(x)
    except:
        return None


def to_mesh(obj):
    if obj is None:
        return None
    if isinstance(obj, rg.Mesh):
        return obj.DuplicateMesh()
    if isinstance(obj, rg.Brep):
        meshes = rg.Mesh.CreateFromBrep(obj)
        if not meshes:
            return None
        joined = rg.Mesh()
        for m in meshes:
            joined.Append(m)
        joined.Normals.ComputeNormals()
        joined.Compact()
        return joined
    try:
        geo = rs.coercegeometry(obj)
        return to_mesh(geo)
    except:
        return None


def get_building_mesh(x):
    meshes = []
    for item in flatten_any(x):
        m = to_mesh(item)
        if is_valid_mesh(m):
            meshes.append(m)
    if not meshes:
        return None
    return max(meshes, key=lambda m: m.GetBoundingBox(True).Diagonal.Length)


def get_tree_meshes(x):
    meshes = []
    for item in flatten_any(x):
        m = to_mesh(item)
        if is_valid_mesh(m):
            meshes.append(m)
    return meshes


def duplicate_mesh(mesh):
    if mesh is None:
        return None
    try:
        return mesh.DuplicateMesh()
    except:
        return None


def is_valid_mesh(mesh):
    try:
        if mesh is None:
            return False
        if mesh.Vertices.Count == 0:
            return False
        if mesh.Faces.Count == 0:
            return False
        if hasattr(mesh, "IsValid"):
            return mesh.IsValid
        return True
    except:
        return False


def get_mesh_center(mesh):
    return mesh.GetBoundingBox(True).Center


# ==========================================================
# MEMORY HELPERS
# ==========================================================

def save_safe_building(mesh):
    if is_valid_mesh(mesh):
        sc.sticky[MEM_KEY] = mesh.DuplicateMesh()


def get_safe_building():
    try:
        if MEM_KEY in sc.sticky:
            m = sc.sticky[MEM_KEY]
            if is_valid_mesh(m):
                return m.DuplicateMesh()
    except:
        pass
    return None


def clear_safe_building():
    try:
        if MEM_KEY in sc.sticky:
            del sc.sticky[MEM_KEY]
    except:
        pass


def safe_fallback_mesh(base_building, incoming_building):
    saved = get_safe_building()
    if is_valid_mesh(saved):
        return saved
    if is_valid_mesh(base_building):
        return duplicate_mesh(base_building)
    if is_valid_mesh(incoming_building):
        return duplicate_mesh(incoming_building)
    return None


# ==========================================================
# MESH OPERATIONS
# ==========================================================

def apply_move(mesh, dx, dy, dz):
    if not is_valid_mesh(mesh):
        return None
    result = mesh.DuplicateMesh()
    for i in range(result.Vertices.Count):
        v = result.Vertices[i]
        result.Vertices.SetVertex(i, v.X + dx, v.Y + dy, v.Z + dz)
    result.Normals.ComputeNormals()
    result.Compact()
    if is_valid_mesh(result):
        return result
    return None


def apply_rotate_z(mesh, angle_degrees):
    if not is_valid_mesh(mesh):
        return None
    result = mesh.DuplicateMesh()
    center = get_mesh_center(result)
    a  = math.radians(angle_degrees)
    ca = math.cos(a)
    sa = math.sin(a)
    for i in range(result.Vertices.Count):
        v  = result.Vertices[i]
        x  = v.X - center.X
        y  = v.Y - center.Y
        nx = center.X + x * ca - y * sa
        ny = center.Y + x * sa + y * ca
        result.Vertices.SetVertex(i, nx, ny, v.Z)
    result.Normals.ComputeNormals()
    result.Compact()
    if is_valid_mesh(result):
        return result
    return None


def apply_scale_xy(mesh, factor):
    if not is_valid_mesh(mesh):
        return None
    if factor <= 0:
        return None
    result = mesh.DuplicateMesh()
    center = get_mesh_center(result)
    for i in range(result.Vertices.Count):
        v = result.Vertices[i]
        result.Vertices.SetVertex(
            i,
            center.X + (v.X - center.X) * factor,
            center.Y + (v.Y - center.Y) * factor,
            v.Z
        )
    result.Normals.ComputeNormals()
    result.Compact()
    if result is None:
        return None
    if result.Vertices.Count == 0 or result.Faces.Count == 0:
        return None
    if is_valid_mesh(result):
        return result
    return None


# ==========================================================
# WING OPERATIONS
# ==========================================================

def get_wing_indices(mesh, wing_name):
    if not is_valid_mesh(mesh):
        return []
    bbox  = mesh.GetBoundingBox(True)
    min_x = bbox.Min.X
    max_x = bbox.Max.X
    min_y = bbox.Min.Y
    max_y = bbox.Max.Y
    wx = max_x - min_x
    wy = max_y - min_y
    left_lim  = min_x + wx / 3.0
    right_lim = max_x - wx / 3.0
    back_lim  = min_y + wy / 3.0
    front_lim = max_y - wy / 3.0
    indices = []
    for i in range(mesh.Vertices.Count):
        v = mesh.Vertices[i]
        if wing_name == "left_wing"   and v.X <= left_lim:            indices.append(i)
        elif wing_name == "right_wing"  and v.X >= right_lim:         indices.append(i)
        elif wing_name == "center_wing" and left_lim < v.X < right_lim: indices.append(i)
        elif wing_name == "front_wing"  and v.Y >= front_lim:         indices.append(i)
        elif wing_name == "back_wing"   and v.Y <= back_lim:          indices.append(i)
    return indices


def apply_wing_scale(mesh, wing_name, factor):
    if not is_valid_mesh(mesh):
        return None, 0
    if factor <= 0:
        return None, 0
    result  = mesh.DuplicateMesh()
    indices = get_wing_indices(result, wing_name)
    if not indices:
        return result, 0
    pts = []
    for i in indices:
        v = result.Vertices[i]
        pts.append(rg.Point3d(v.X, v.Y, v.Z))
    center = rg.BoundingBox(pts).Center
    for i in indices:
        v = result.Vertices[i]
        result.Vertices.SetVertex(
            i,
            center.X + (v.X - center.X) * factor,
            center.Y + (v.Y - center.Y) * factor,
            v.Z
        )
    result.Normals.ComputeNormals()
    result.Compact()
    if is_valid_mesh(result):
        return result, len(indices)
    return None, 0


# ==========================================================
# VALIDATION
# ==========================================================

def check_inside_site(mesh, site_curve):
    if not is_valid_mesh(mesh):
        return False, "Building mesh is invalid."
    if site_curve is None:
        return True, "No site boundary. Site check skipped."
    outside = 0
    for v in mesh.Vertices:
        pt = rg.Point3d(v.X, v.Y, 0)
        contain = site_curve.Contains(pt, rg.Plane.WorldXY, tol)
        if contain == rg.PointContainment.Outside:
            outside += 1
    if outside > 0:
        return False, "{} vertex/vertices outside site boundary.".format(outside)
    return True, "Building remains inside site boundary."


def check_tree_overlap(mesh, tree_meshes):
    if not is_valid_mesh(mesh):
        return False, "Building mesh is invalid."
    if not tree_meshes:
        return False, "No tree zones. Tree check skipped."
    hits = 0
    for tree in tree_meshes:
        try:
            inter = rg.Intersect.Intersection.MeshMeshFast(mesh, tree)
            if inter is not None and len(inter) > 0:
                hits += 1
        except:
            pass
    if hits > 0:
        return True, "Building overlaps {} tree zone(s).".format(hits)
    return False, "No tree overlap detected."


def check_road_distance(mesh, road_curve):
    if not is_valid_mesh(mesh):
        return "Building mesh is invalid."
    if road_curve is None:
        return "No road curve. Road check skipped."
    center = get_mesh_center(mesh)
    try:
        ok, t = road_curve.ClosestPoint(center)
        if ok:
            return "Building center is {:.2f}m from the road.".format(
                center.DistanceTo(road_curve.PointAt(t))
            )
    except:
        pass
    return "Road check could not be calculated."


# ==========================================================
# READ INPUTS
# ==========================================================

site_curve = get_curve(site_crv)
road_curve = get_curve(road_crv)

incoming_building = get_building_mesh(best_building)
tree_meshes       = get_tree_meshes(tree_breps)

run_tool   = get_bool(apply_manipulation)
reset_tool = get_bool(reset)

# ==========================================================
# RESET
# ==========================================================

if reset_tool:
    clear_safe_building()

# ==========================================================
# INITIALIZE / SELECT BASE SHAPE
# ==========================================================

saved_building = get_safe_building()

if is_valid_mesh(saved_building):
    base_building = saved_building
elif is_valid_mesh(incoming_building):
    base_building = duplicate_mesh(incoming_building)
    save_safe_building(base_building)
else:
    base_building = None

# ==========================================================
# READ MANIPULATION VALUES
# ==========================================================

left_dist  = parse_input_value(move_left,  "move_left")  or 0.0
right_dist = parse_input_value(move_right, "move_right") or 0.0
front_dist = parse_input_value(move_front, "move_front") or 0.0
back_dist  = parse_input_value(move_back,  "move_back")  or 0.0

cw_angle  = parse_input_value(rotate_clockwise,     "rotate_clockwise")     or 0.0
acw_angle = parse_input_value(rotate_anticlockwise, "rotate_anticlockwise") or 0.0

scale_up_pct   = parse_input_value(scale_up,     "scale_up")     or 0.0
scale_down_pct = parse_input_value(scale_down,   "scale_down")   or 0.0
scale_fac      = parse_input_value(scale_factor, "scale_factor") or 1.0

wing_left_fac   = parse_input_value(scale_left_wing,   "scale_left_wing")   or 1.0
wing_right_fac  = parse_input_value(scale_right_wing,  "scale_right_wing")  or 1.0
wing_center_fac = parse_input_value(scale_center_wing, "scale_center_wing") or 1.0
wing_front_fac  = parse_input_value(scale_front_wing,  "scale_front_wing")  or 1.0
wing_back_fac   = parse_input_value(scale_back_wing,   "scale_back_wing")   or 1.0

# ==========================================================
# RESOLVE VALUES
#
# Each input is fully independent — no cancellation logic.
# move_left  → moves by exactly -abs(value) on X
# move_right → moves by exactly +abs(value) on X
# move_front → moves by exactly +abs(value) on Y
# move_back  → moves by exactly -abs(value) on Y
# If the GH slider for an unused direction is non-zero,
# zero it on the GH side — inputs are trusted as-is here.
# ==========================================================

# X: left is negative, right is positive — independent
net_dx = 0.0
if abs(left_dist) > MOVE_DEADZONE:
    net_dx = -abs(left_dist)
elif abs(right_dist) > MOVE_DEADZONE:
    net_dx = abs(right_dist)

# Y: back is negative, front is positive — independent
net_dy = 0.0
if abs(front_dist) > MOVE_DEADZONE:
    net_dy = abs(front_dist)
elif abs(back_dist) > MOVE_DEADZONE:
    net_dy = -abs(back_dist)

# Rotate: clockwise negative, anticlockwise positive — independent
net_angle = 0.0
if abs(cw_angle) > ANGLE_DEADZONE:
    net_angle = -abs(cw_angle)
elif abs(acw_angle) > ANGLE_DEADZONE:
    net_angle = abs(acw_angle)

# Scale: explicit factor takes priority, then up%, then down%
if abs(scale_fac - 1.0) > FACTOR_DEADZONE and scale_fac > 0:
    net_scale = scale_fac
elif abs(scale_up_pct) > SCALE_DEADZONE:
    net_scale = 1.0 + abs(scale_up_pct) / 100.0
elif abs(scale_down_pct) > SCALE_DEADZONE:
    net_scale = max(0.01, 1.0 - abs(scale_down_pct) / 100.0)
else:
    net_scale = 1.0

# Wings — each is independent
wing_ops = []
if abs(wing_left_fac - 1.0) > WING_SCALE_DEADZONE:
    wing_ops.append(("left_wing",   wing_left_fac))
if abs(wing_right_fac - 1.0) > WING_SCALE_DEADZONE:
    wing_ops.append(("right_wing",  wing_right_fac))
if abs(wing_center_fac - 1.0) > WING_SCALE_DEADZONE:
    wing_ops.append(("center_wing", wing_center_fac))
if abs(wing_front_fac - 1.0) > WING_SCALE_DEADZONE:
    wing_ops.append(("front_wing",  wing_front_fac))
if abs(wing_back_fac - 1.0) > WING_SCALE_DEADZONE:
    wing_ops.append(("back_wing",   wing_back_fac))

do_move   = abs(net_dx) > MOVE_DEADZONE or abs(net_dy) > MOVE_DEADZONE
do_rotate = abs(net_angle) > ANGLE_DEADZONE
do_scale  = abs(net_scale - 1.0) > FACTOR_DEADZONE
do_wings  = len(wing_ops) > 0

any_op = do_move or do_rotate or do_scale or do_wings

# ==========================================================
# DEFAULT OUTPUTS
# ==========================================================

final_building = safe_fallback_mesh(base_building, incoming_building)
final_trees    = tree_meshes

manipulation_status = "not_applied"
manipulation_report = ""
human_report        = ""

site_msg = "Not checked."
tree_msg = "Not checked."
road_msg = "Not checked."

applied_ops = []

# ==========================================================
# EXECUTION
# ==========================================================

if not is_valid_mesh(base_building):

    final_building      = safe_fallback_mesh(base_building, incoming_building)
    manipulation_status = "failed"

    manipulation_report = json.dumps({
        "status":            "failed",
        "message":           "No valid building mesh available.",
        "returned_geometry": "safe_previous_shape_if_available"
    }, indent=4)

    human_report = (
        "MANIPULATION FAILED\n"
        "No valid building mesh available."
    )

elif reset_tool:

    if is_valid_mesh(incoming_building):
        final_building = duplicate_mesh(incoming_building)
        save_safe_building(final_building)
    else:
        final_building = safe_fallback_mesh(base_building, incoming_building)

    manipulation_status = "reset"

    manipulation_report = json.dumps({
        "status":  "reset",
        "message": "Memory reset. Current valid building stored again."
    }, indent=4)

    human_report = (
        "RESET COMPLETE\n"
        "Current valid building is stored."
    )

elif not run_tool:

    if is_valid_mesh(incoming_building):
        final_building = duplicate_mesh(incoming_building)
        save_safe_building(final_building)
    else:
        final_building = safe_fallback_mesh(base_building, incoming_building)

    manipulation_status = "stored"

    manipulation_report = json.dumps({
        "status":  "stored",
        "message": "Current optimized building stored as safe previous shape."
    }, indent=4)

    human_report = (
        "CURRENT SHAPE STORED\n"
        "This optimized building is now the safe previous shape."
    )

elif not any_op:

    final_building      = safe_fallback_mesh(base_building, incoming_building)
    manipulation_status = "not_applied"

    manipulation_report = json.dumps({
        "status":  "not_applied",
        "message": "No active manipulation value received. Previous valid shape returned."
    }, indent=4)

    human_report = (
        "NO MANIPULATION APPLIED\n"
        "Previous valid building returned."
    )

else:

    candidate      = duplicate_mesh(base_building)
    invalid_reason = None

    # ----------------------------------------------------------
    # MOVE
    # ----------------------------------------------------------
    if do_move:
        candidate = apply_move(candidate, net_dx, net_dy, 0)
        applied_ops.append({
            "op": "move",
            "dx": round(net_dx, 4),
            "dy": round(net_dy, 4)
        })
        if not is_valid_mesh(candidate):
            invalid_reason = "Move operation created invalid geometry."
            candidate      = None

    # ----------------------------------------------------------
    # ROTATE
    # ----------------------------------------------------------
    if invalid_reason is None and do_rotate:
        candidate = apply_rotate_z(candidate, net_angle)
        applied_ops.append({
            "op":        "rotate",
            "angle_deg": round(net_angle, 4)
        })
        if not is_valid_mesh(candidate):
            invalid_reason = "Rotate operation created invalid geometry."
            candidate      = None

    # ----------------------------------------------------------
    # SCALE
    # ----------------------------------------------------------
    if invalid_reason is None and do_scale:
        candidate = apply_scale_xy(candidate, net_scale)
        applied_ops.append({
            "op":           "scale_building",
            "scale_factor": round(net_scale, 6)
        })
        if not is_valid_mesh(candidate):
            invalid_reason = (
                "Scale factor {:.4f} produced invalid or collapsed geometry. "
                "Previous valid shape kept.".format(net_scale)
            )
            candidate = None

    # ----------------------------------------------------------
    # WING SCALE
    # ----------------------------------------------------------
    if invalid_reason is None and do_wings:
        for wing_name, wing_factor in wing_ops:
            candidate, affected = apply_wing_scale(candidate, wing_name, wing_factor)
            applied_ops.append({
                "op":                "scale_wing",
                "wing":              wing_name,
                "scale_factor":      round(wing_factor, 6),
                "affected_vertices": affected
            })
            if not is_valid_mesh(candidate):
                invalid_reason = (
                    "Wing scale '{}' with factor {:.4f} created invalid geometry.".format(
                        wing_name, wing_factor
                    )
                )
                candidate = None
                break

    # ----------------------------------------------------------
    # GEOMETRY VALIDITY GATE
    # ----------------------------------------------------------
    if invalid_reason is not None or not is_valid_mesh(candidate):

        final_building      = safe_fallback_mesh(base_building, incoming_building)
        manipulation_status = "rejected"

        manipulation_report = json.dumps({
            "status":            "rejected",
            "message":           "Manipulation failed because geometry became invalid.",
            "reason":            invalid_reason,
            "applied_ops":       applied_ops,
            "returned_geometry": "previous_valid_shape_kept"
        }, indent=4)

        human_report = (
            "MANIPULATION FAILED\n"
            "The modified geometry became invalid.\n"
            "Reason: {}\n"
            "Previous valid building shape is kept unchanged.".format(invalid_reason)
        )

    else:

        # ----------------------------------------------------------
        # SITE / TREE / ROAD CHECKS
        # ----------------------------------------------------------
        site_ok,  site_msg = check_inside_site(candidate, site_curve)
        tree_hit, tree_msg = check_tree_overlap(candidate, tree_meshes)
        road_msg           = check_road_distance(candidate, road_curve)

        if site_ok and not tree_hit:

            final_building = duplicate_mesh(candidate)
            save_safe_building(final_building)

            manipulation_status = "accepted"

            manipulation_report = json.dumps({
                "status":      "accepted",
                "message":     "Manipulation accepted. Shape updated and stored.",
                "applied_ops": applied_ops,
                "site_check":  site_msg,
                "tree_check":  tree_msg,
                "road_check":  road_msg
            }, indent=4)

            human_report = (
                "MANIPULATION ACCEPTED\n"
                "Shape updated successfully.\n"
                "dx={:.3f}  dy={:.3f}  angle={:.3f}  scale={:.4f}".format(
                    net_dx, net_dy, net_angle, net_scale
                )
            )

        else:

            final_building      = safe_fallback_mesh(base_building, incoming_building)
            manipulation_status = "rejected"

            reasons = []
            if not site_ok:
                reasons.append(site_msg)
            if tree_hit:
                reasons.append(tree_msg)

            manipulation_report = json.dumps({
                "status":            "rejected",
                "message":           "Manipulation failed due to site constraints.",
                "reasons":           reasons,
                "applied_ops":       applied_ops,
                "site_check":        site_msg,
                "tree_check":        tree_msg,
                "road_check":        road_msg,
                "returned_geometry": "previous_valid_shape_kept"
            }, indent=4)

            human_report = (
                "MANIPULATION FAILED\n"
                "Manipulation rejected due to site constraints.\n"
                "Previous valid building shape is kept unchanged."
            )
# ---------- end python_3_script_3 ----------
python_3_script_4 = Python3Script(
    best_building=python_3_script_2.building_out,
    site_crv=siteboundary,
    road_crv=road,
    tree_breps=mesh_3,
    move_left=number_slider_12,
    move_right=number_slider_9,
    move_front=number_slider_3,
    move_back=number_slider_4,
    rotate_clockwise=number_slider_5,
    rotate_anticlockwise=number_slider_6,
    scale_up=python_3_script.scale_up,
    scale_down=python_3_script.scale_down,
    scale_factor=python_3_script.scale_factor,
    scale_left_wing=number_slider_7,
    scale_right_wing=number_slider_8,
    scale_center_wing=number_slider_10,
    scale_front_wing=number_slider_11,
    scale_back_wing=number_slider_2,
    apply_manipulation=boolean_toggle_2,
    reset=boolean_toggle)  # -> flatten(final_building), final_trees, manipulation_status, manipulation_report, flatten(human_report); inputs tree_breps: Mesh; disabled
# ---------- python_3_script_4: Python ----------
import Rhino.Geometry as rg
import rhinoscriptsyntax as rs
import scriptcontext as sc
import json
import ast
import re
import math

tol = 0.01

# ==========================================================
# MEMORY KEY
# ==========================================================

MEM_KEY = "LAST_SAFE_BUILDING_AFTER_MANIPULATION"

# ==========================================================
# DEAD ZONES
# ==========================================================

MOVE_DEADZONE       = 0.001
ANGLE_DEADZONE      = 0.001
SCALE_DEADZONE      = 0.001
WING_SCALE_DEADZONE = 0.001
FACTOR_DEADZONE     = 0.001

# Wing factor safe range — clamp to prevent collapse
WING_FACTOR_MIN = 0.5
WING_FACTOR_MAX = 3.0


# ==========================================================
# BASIC HELPERS
# ==========================================================

def flatten_any(x):
    out = []
    if x is None:
        return out
    if hasattr(x, "Branches"):
        for b in x.Branches:
            out += flatten_any(b)
        return out
    if isinstance(x, (list, tuple)):
        for item in x:
            out += flatten_any(item)
        return out
    out.append(x)
    return out


def get_bool(x):
    try:
        if isinstance(x, str):
            return x.strip().lower() in ["true", "1", "yes"]
        return bool(x)
    except:
        return False


def parse_input_value(x, key):
    if x is None:
        return None
    items = flatten_any(x)
    last_valid = None
    for item in items:
        if item is None:
            continue
        text = str(item).strip()
        try:
            data = json.loads(text)
            if isinstance(data, dict) and key in data:
                last_valid = float(data[key])
                continue
        except:
            pass
        try:
            data = ast.literal_eval(text)
            if isinstance(data, dict) and key in data:
                last_valid = float(data[key])
                continue
        except:
            pass
        try:
            last_valid = float(text)
            continue
        except:
            pass
        nums = re.findall(r"-?\d+(?:\.\d+)?", text)
        if nums:
            try:
                last_valid = float(nums[-1])
            except:
                pass
    return last_valid


def get_curve(x):
    if isinstance(x, rg.Curve):
        return x
    try:
        return rs.coercecurve(x)
    except:
        return None


def to_mesh(obj):
    if obj is None:
        return None
    if isinstance(obj, rg.Mesh):
        return obj.DuplicateMesh()
    if isinstance(obj, rg.Brep):
        meshes = rg.Mesh.CreateFromBrep(obj)
        if not meshes:
            return None
        joined = rg.Mesh()
        for m in meshes:
            joined.Append(m)
        joined.Normals.ComputeNormals()
        joined.Compact()
        return joined
    try:
        geo = rs.coercegeometry(obj)
        return to_mesh(geo)
    except:
        return None


def get_building_mesh(x):
    meshes = []
    for item in flatten_any(x):
        m = to_mesh(item)
        if is_valid_mesh(m):
            meshes.append(m)
    if not meshes:
        return None
    return max(meshes, key=lambda m: m.GetBoundingBox(True).Diagonal.Length)


def get_tree_meshes(x):
    meshes = []
    for item in flatten_any(x):
        m = to_mesh(item)
        if is_valid_mesh(m):
            meshes.append(m)
    return meshes


def duplicate_mesh(mesh):
    if mesh is None:
        return None
    try:
        return mesh.DuplicateMesh()
    except:
        return None


def is_valid_mesh(mesh):
    try:
        if mesh is None:
            return False
        if mesh.Vertices.Count == 0:
            return False
        if mesh.Faces.Count == 0:
            return False
        if hasattr(mesh, "IsValid"):
            return mesh.IsValid
        return True
    except:
        return False


def get_mesh_center(mesh):
    return mesh.GetBoundingBox(True).Center


# ==========================================================
# MEMORY HELPERS
# ==========================================================

def save_safe_building(mesh):
    if is_valid_mesh(mesh):
        sc.sticky[MEM_KEY] = mesh.DuplicateMesh()


def get_safe_building():
    try:
        if MEM_KEY in sc.sticky:
            m = sc.sticky[MEM_KEY]
            if is_valid_mesh(m):
                return m.DuplicateMesh()
    except:
        pass
    return None


def clear_safe_building():
    try:
        if MEM_KEY in sc.sticky:
            del sc.sticky[MEM_KEY]
    except:
        pass


def safe_fallback_mesh(base_building, incoming_building):
    saved = get_safe_building()
    if is_valid_mesh(saved):
        return saved
    if is_valid_mesh(base_building):
        return duplicate_mesh(base_building)
    if is_valid_mesh(incoming_building):
        return duplicate_mesh(incoming_building)
    return None


# ==========================================================
# MESH OPERATIONS
# ==========================================================

def apply_move(mesh, dx, dy, dz):
    if not is_valid_mesh(mesh):
        return None
    result = mesh.DuplicateMesh()
    for i in range(result.Vertices.Count):
        v = result.Vertices[i]
        result.Vertices.SetVertex(i, v.X + dx, v.Y + dy, v.Z + dz)
    result.Normals.ComputeNormals()
    result.Compact()
    if is_valid_mesh(result):
        return result
    return None


def apply_rotate_z(mesh, angle_degrees):
    if not is_valid_mesh(mesh):
        return None
    result = mesh.DuplicateMesh()
    center = get_mesh_center(result)
    a  = math.radians(angle_degrees)
    ca = math.cos(a)
    sa = math.sin(a)
    for i in range(result.Vertices.Count):
        v  = result.Vertices[i]
        x  = v.X - center.X
        y  = v.Y - center.Y
        nx = center.X + x * ca - y * sa
        ny = center.Y + x * sa + y * ca
        result.Vertices.SetVertex(i, nx, ny, v.Z)
    result.Normals.ComputeNormals()
    result.Compact()
    if is_valid_mesh(result):
        return result
    return None


def apply_scale_xy(mesh, factor):
    if not is_valid_mesh(mesh):
        return None
    if factor <= 0:
        return None
    result = mesh.DuplicateMesh()
    center = get_mesh_center(result)
    for i in range(result.Vertices.Count):
        v = result.Vertices[i]
        result.Vertices.SetVertex(
            i,
            center.X + (v.X - center.X) * factor,
            center.Y + (v.Y - center.Y) * factor,
            v.Z
        )
    result.Normals.ComputeNormals()
    result.Compact()
    if result is None:
        return None
    if result.Vertices.Count == 0 or result.Faces.Count == 0:
        return None
    if is_valid_mesh(result):
        return result
    return None


# ==========================================================
# WING OPERATIONS
# ==========================================================

def get_wing_indices(mesh, wing_name):
    if not is_valid_mesh(mesh):
        return []
    bbox  = mesh.GetBoundingBox(True)
    min_x = bbox.Min.X
    max_x = bbox.Max.X
    min_y = bbox.Min.Y
    max_y = bbox.Max.Y
    wx = max_x - min_x
    wy = max_y - min_y
    left_lim  = min_x + wx / 3.0
    right_lim = max_x - wx / 3.0
    back_lim  = min_y + wy / 3.0
    front_lim = max_y - wy / 3.0
    indices = []
    for i in range(mesh.Vertices.Count):
        v = mesh.Vertices[i]
        if   wing_name == "left_wing"   and v.X <= left_lim:              indices.append(i)
        elif wing_name == "right_wing"  and v.X >= right_lim:             indices.append(i)
        elif wing_name == "center_wing" and left_lim < v.X < right_lim:   indices.append(i)
        elif wing_name == "front_wing"  and v.Y >= front_lim:             indices.append(i)
        elif wing_name == "back_wing"   and v.Y <= back_lim:              indices.append(i)
    return indices


def apply_wing_scale(mesh, wing_name, factor):
    if not is_valid_mesh(mesh):
        return None, 0

    # Clamp factor to safe range — prevents collapse or explosion
    factor = max(WING_FACTOR_MIN, min(WING_FACTOR_MAX, factor))

    result     = mesh.DuplicateMesh()
    indices    = get_wing_indices(result, wing_name)
    if not indices:
        return result, 0

    bbox       = result.GetBoundingBox(True)
    bld_center = bbox.Center

    # Scale each wing outward along ONE axis only, anchored at
    # the building centre. Vertices near the body connection
    # barely move; only the outer tip extends. This preserves
    # mesh coherence and prevents tearing.
    for i in indices:
        v = result.Vertices[i]

        if wing_name == "left_wing":
            # push left (−X) only — Y unchanged
            nx = bld_center.X + (v.X - bld_center.X) * factor
            ny = v.Y

        elif wing_name == "right_wing":
            # push right (+X) only — Y unchanged
            nx = bld_center.X + (v.X - bld_center.X) * factor
            ny = v.Y

        elif wing_name == "front_wing":
            # push forward (+Y) only — X unchanged
            nx = v.X
            ny = bld_center.Y + (v.Y - bld_center.Y) * factor

        elif wing_name == "back_wing":
            # push backward (−Y) only — X unchanged
            nx = v.X
            ny = bld_center.Y + (v.Y - bld_center.Y) * factor

        elif wing_name == "center_wing":
            # uniform scale from building centre (centre band only)
            nx = bld_center.X + (v.X - bld_center.X) * factor
            ny = bld_center.Y + (v.Y - bld_center.Y) * factor

        else:
            nx = v.X
            ny = v.Y

        result.Vertices.SetVertex(i, nx, ny, v.Z)

    result.Normals.ComputeNormals()
    result.Compact()
    if is_valid_mesh(result):
        return result, len(indices)
    return None, 0


# ==========================================================
# VALIDATION
# ==========================================================

def check_inside_site(mesh, site_curve):
    if not is_valid_mesh(mesh):
        return False, "Building mesh is invalid."
    if site_curve is None:
        return True, "No site boundary. Site check skipped."
    outside = 0
    for v in mesh.Vertices:
        pt = rg.Point3d(v.X, v.Y, 0)
        contain = site_curve.Contains(pt, rg.Plane.WorldXY, tol)
        if contain == rg.PointContainment.Outside:
            outside += 1
    if outside > 0:
        return False, "{} vertex/vertices outside site boundary.".format(outside)
    return True, "Building remains inside site boundary."


def check_tree_overlap(mesh, tree_meshes):
    if not is_valid_mesh(mesh):
        return False, "Building mesh is invalid."
    if not tree_meshes:
        return False, "No tree zones. Tree check skipped."
    hits = 0
    for tree in tree_meshes:
        try:
            inter = rg.Intersect.Intersection.MeshMeshFast(mesh, tree)
            if inter is not None and len(inter) > 0:
                hits += 1
        except:
            pass
    if hits > 0:
        return True, "Building overlaps {} tree zone(s).".format(hits)
    return False, "No tree overlap detected."


def check_road_distance(mesh, road_curve):
    if not is_valid_mesh(mesh):
        return "Building mesh is invalid."
    if road_curve is None:
        return "No road curve. Road check skipped."
    center = get_mesh_center(mesh)
    try:
        ok, t = road_curve.ClosestPoint(center)
        if ok:
            return "Building center is {:.2f}m from the road.".format(
                center.DistanceTo(road_curve.PointAt(t))
            )
    except:
        pass
    return "Road check could not be calculated."


# ==========================================================
# READ INPUTS
# ==========================================================

site_curve = get_curve(site_crv)
road_curve = get_curve(road_crv)

incoming_building = get_building_mesh(best_building)
tree_meshes       = get_tree_meshes(tree_breps)

run_tool   = get_bool(apply_manipulation)
reset_tool = get_bool(reset)

# ==========================================================
# RESET
# ==========================================================

if reset_tool:
    clear_safe_building()

# ==========================================================
# INITIALIZE / SELECT BASE SHAPE
# ==========================================================

saved_building = get_safe_building()

if is_valid_mesh(saved_building):
    base_building = saved_building
elif is_valid_mesh(incoming_building):
    base_building = duplicate_mesh(incoming_building)
    save_safe_building(base_building)
else:
    base_building = None

# ==========================================================
# READ MANIPULATION VALUES
# ==========================================================

left_dist  = parse_input_value(move_left,  "move_left")  or 0.0
right_dist = parse_input_value(move_right, "move_right") or 0.0
front_dist = parse_input_value(move_front, "move_front") or 0.0
back_dist  = parse_input_value(move_back,  "move_back")  or 0.0

cw_angle  = parse_input_value(rotate_clockwise,     "rotate_clockwise")     or 0.0
acw_angle = parse_input_value(rotate_anticlockwise, "rotate_anticlockwise") or 0.0

scale_up_pct   = parse_input_value(scale_up,   "scale_up")   or 0.0
scale_down_pct = parse_input_value(scale_down, "scale_down") or 0.0

# scale_factor: 0 = no scaling (GH slider default = 0)
raw_scale_fac = parse_input_value(scale_factor, "scale_factor")
if raw_scale_fac is None or abs(raw_scale_fac) < FACTOR_DEADZONE:
    scale_fac = 1.0
else:
    scale_fac = raw_scale_fac

# Wing factors: default 1.0 = no change
# GH sliders for wings should default to 1.0
wing_left_fac   = parse_input_value(scale_left_wing,   "scale_left_wing")   or 1.0
wing_right_fac  = parse_input_value(scale_right_wing,  "scale_right_wing")  or 1.0
wing_center_fac = parse_input_value(scale_center_wing, "scale_center_wing") or 1.0
wing_front_fac  = parse_input_value(scale_front_wing,  "scale_front_wing")  or 1.0
wing_back_fac   = parse_input_value(scale_back_wing,   "scale_back_wing")   or 1.0

# ==========================================================
# RESOLVE VALUES
#
# move_left  → -X   move_right → +X
# move_front → +Y   move_back  → -Y
# scale_factor 0 = no scale, non-zero = explicit multiplier
# wing factors: 1.0 = no change, >1 = expand, <1 = shrink
#               clamped to [WING_FACTOR_MIN, WING_FACTOR_MAX]
# ==========================================================

# X: left = −X, right = +X
net_dx = 0.0
if abs(left_dist) > MOVE_DEADZONE:
    net_dx = -abs(left_dist)
elif abs(right_dist) > MOVE_DEADZONE:
    net_dx = abs(right_dist)

# Y: front = +Y, back = −Y
net_dy = 0.0
if abs(front_dist) > MOVE_DEADZONE:
    net_dy = abs(front_dist)
elif abs(back_dist) > MOVE_DEADZONE:
    net_dy = -abs(back_dist)

# Rotate: clockwise = −angle, anticlockwise = +angle
net_angle = 0.0
if abs(cw_angle) > ANGLE_DEADZONE:
    net_angle = -abs(cw_angle)
elif abs(acw_angle) > ANGLE_DEADZONE:
    net_angle = abs(acw_angle)

# Scale: explicit factor → scale_up% → scale_down%
if abs(scale_fac - 1.0) > FACTOR_DEADZONE and scale_fac > 0:
    net_scale = scale_fac
elif abs(scale_up_pct) > SCALE_DEADZONE:
    net_scale = 1.0 + abs(scale_up_pct) / 100.0
elif abs(scale_down_pct) > SCALE_DEADZONE:
    net_scale = max(0.01, 1.0 - abs(scale_down_pct) / 100.0)
else:
    net_scale = 1.0

# Wings — each independent, only added if differs from 1.0
wing_ops = []
if abs(wing_left_fac   - 1.0) > WING_SCALE_DEADZONE:  wing_ops.append(("left_wing",   wing_left_fac))
if abs(wing_right_fac  - 1.0) > WING_SCALE_DEADZONE:  wing_ops.append(("right_wing",  wing_right_fac))
if abs(wing_center_fac - 1.0) > WING_SCALE_DEADZONE:  wing_ops.append(("center_wing", wing_center_fac))
if abs(wing_front_fac  - 1.0) > WING_SCALE_DEADZONE:  wing_ops.append(("front_wing",  wing_front_fac))
if abs(wing_back_fac   - 1.0) > WING_SCALE_DEADZONE:  wing_ops.append(("back_wing",   wing_back_fac))

do_move   = abs(net_dx) > MOVE_DEADZONE or abs(net_dy) > MOVE_DEADZONE
do_rotate = abs(net_angle) > ANGLE_DEADZONE
do_scale  = abs(net_scale - 1.0) > FACTOR_DEADZONE
do_wings  = len(wing_ops) > 0

any_op = do_move or do_rotate or do_scale or do_wings

# ==========================================================
# DEFAULT OUTPUTS
# ==========================================================

final_building = safe_fallback_mesh(base_building, incoming_building)
final_trees    = tree_meshes

manipulation_status = "not_applied"
manipulation_report = ""
human_report        = ""

site_msg = "Not checked."
tree_msg = "Not checked."
road_msg = "Not checked."

applied_ops = []

# ==========================================================
# EXECUTION
# ==========================================================

if not is_valid_mesh(base_building):

    final_building      = safe_fallback_mesh(base_building, incoming_building)
    manipulation_status = "failed"

    manipulation_report = json.dumps({
        "status":            "failed",
        "message":           "No valid building mesh available.",
        "returned_geometry": "safe_previous_shape_if_available"
    }, indent=4)

    human_report = (
        "MANIPULATION FAILED\n"
        "No valid building mesh available."
    )

elif reset_tool:

    if is_valid_mesh(incoming_building):
        final_building = duplicate_mesh(incoming_building)
        save_safe_building(final_building)
    else:
        final_building = safe_fallback_mesh(base_building, incoming_building)

    manipulation_status = "reset"

    manipulation_report = json.dumps({
        "status":  "reset",
        "message": "Memory reset. Current valid building stored again."
    }, indent=4)

    human_report = (
        "RESET COMPLETE\n"
        "Current valid building is stored."
    )

elif not run_tool:

    if is_valid_mesh(incoming_building):
        final_building = duplicate_mesh(incoming_building)
        save_safe_building(final_building)
    else:
        final_building = safe_fallback_mesh(base_building, incoming_building)

    manipulation_status = "stored"

    manipulation_report = json.dumps({
        "status":  "stored",
        "message": "Current optimized building stored as safe previous shape."
    }, indent=4)

    human_report = (
        "CURRENT SHAPE STORED\n"
        "This optimized building is now the safe previous shape."
    )

elif not any_op:

    final_building      = safe_fallback_mesh(base_building, incoming_building)
    manipulation_status = "not_applied"

    manipulation_report = json.dumps({
        "status":  "not_applied",
        "message": "No active manipulation value received. Previous valid shape returned."
    }, indent=4)

    human_report = (
        "NO MANIPULATION APPLIED\n"
        "Previous valid building returned."
    )

else:

    candidate      = duplicate_mesh(base_building)
    invalid_reason = None

    # ----------------------------------------------------------
    # MOVE
    # ----------------------------------------------------------
    if do_move:
        candidate = apply_move(candidate, net_dx, net_dy, 0)
        applied_ops.append({
            "op": "move",
            "dx": round(net_dx, 4),
            "dy": round(net_dy, 4)
        })
        if not is_valid_mesh(candidate):
            invalid_reason = "Move operation created invalid geometry."
            candidate      = None

    # ----------------------------------------------------------
    # ROTATE
    # ----------------------------------------------------------
    if invalid_reason is None and do_rotate:
        candidate = apply_rotate_z(candidate, net_angle)
        applied_ops.append({
            "op":        "rotate",
            "angle_deg": round(net_angle, 4)
        })
        if not is_valid_mesh(candidate):
            invalid_reason = "Rotate operation created invalid geometry."
            candidate      = None

    # ----------------------------------------------------------
    # SCALE
    # ----------------------------------------------------------
    if invalid_reason is None and do_scale:
        candidate = apply_scale_xy(candidate, net_scale)
        applied_ops.append({
            "op":           "scale_building",
            "scale_factor": round(net_scale, 6)
        })
        if not is_valid_mesh(candidate):
            invalid_reason = (
                "Scale factor {:.4f} produced invalid or collapsed geometry. "
                "Previous valid shape kept.".format(net_scale)
            )
            candidate = None

    # ----------------------------------------------------------
    # WING SCALE
    # ----------------------------------------------------------
    if invalid_reason is None and do_wings:
        for wing_name, wing_factor in wing_ops:
            candidate, affected = apply_wing_scale(candidate, wing_name, wing_factor)
            applied_ops.append({
                "op":                "scale_wing",
                "wing":              wing_name,
                "scale_factor":      round(wing_factor, 6),
                "affected_vertices": affected
            })
            if not is_valid_mesh(candidate):
                invalid_reason = (
                    "Wing scale '{}' with factor {:.4f} created invalid geometry.".format(
                        wing_name, wing_factor
                    )
                )
                candidate = None
                break

    # ----------------------------------------------------------
    # GEOMETRY VALIDITY GATE
    # ----------------------------------------------------------
    if invalid_reason is not None or not is_valid_mesh(candidate):

        final_building      = safe_fallback_mesh(base_building, incoming_building)
        manipulation_status = "rejected"

        manipulation_report = json.dumps({
            "status":            "rejected",
            "message":           "Manipulation failed because geometry became invalid.",
            "reason":            invalid_reason,
            "applied_ops":       applied_ops,
            "returned_geometry": "previous_valid_shape_kept"
        }, indent=4)

        human_report = (
            "MANIPULATION FAILED\n"
            "The modified geometry became invalid.\n"
            "Reason: {}\n"
            "Previous valid building shape is kept unchanged.".format(invalid_reason)
        )

    else:

        # ----------------------------------------------------------
        # SITE / TREE / ROAD CHECKS
        # ----------------------------------------------------------
        site_ok,  site_msg = check_inside_site(candidate, site_curve)
        tree_hit, tree_msg = check_tree_overlap(candidate, tree_meshes)
        road_msg           = check_road_distance(candidate, road_curve)

        if site_ok and not tree_hit:

            final_building = duplicate_mesh(candidate)
            save_safe_building(final_building)

            manipulation_status = "accepted"

            manipulation_report = json.dumps({
                "status":      "accepted",
                "message":     "Manipulation accepted. Shape updated and stored.",
                "applied_ops": applied_ops,
                "site_check":  site_msg,
                "tree_check":  tree_msg,
                "road_check":  road_msg
            }, indent=4)

            human_report = (
                "MANIPULATION ACCEPTED\n"
                "Shape updated successfully.\n"
                "dx={:.3f}  dy={:.3f}  angle={:.3f}  scale={:.4f}".format(
                    net_dx, net_dy, net_angle, net_scale
                )
            )

        else:

            final_building      = safe_fallback_mesh(base_building, incoming_building)
            manipulation_status = "rejected"

            reasons = []
            if not site_ok:
                reasons.append(site_msg)
            if tree_hit:
                reasons.append(tree_msg)

            manipulation_report = json.dumps({
                "status":            "rejected",
                "message":           "Manipulation failed due to site constraints.",
                "reasons":           reasons,
                "applied_ops":       applied_ops,
                "site_check":        site_msg,
                "tree_check":        tree_msg,
                "road_check":        road_msg,
                "returned_geometry": "previous_valid_shape_kept"
            }, indent=4)

            human_report = (
                "MANIPULATION FAILED\n"
                "Manipulation rejected due to site constraints.\n"
                "Previous valid building shape is kept unchanged."
            )
# ---------- end python_3_script_4 ----------
create_json_value = CreateJSONValue(Value=list_item)
mesh_4 = Mesh(python_3_script_2.building_out)
panel_14 = Panel(python_3_script_2.building_out)
panel_15 = Panel(python_3_script_2.trees_out)
mesh_join_3 = MeshJoin(Meshes=python_3_script_3.final_building)
create_json_object = CreateJSONObject(Keys="parametric_shape_generator", Values=create_json_value)
mesh_join_4 = MeshJoin(Meshes=python_3_script_4.final_building)  # disabled
panel_16 = Panel(python_3_script_4.human_report)  # disabled
list_item_3 = ListItem(List=python_3_script_3.final_building, Index=0, Wrap=True)
mesh_join_5 = MeshJoin(Meshes=python_3_script_3.final_trees)
panel_17 = Panel(python_3_script_3.human_report)
panel_18 = Panel(list_item)
mesh_5 = Mesh(mesh_join_4)  # disabled
mesh_6 = Mesh(list_item_3)
panel_19 = Panel(python_3_script_3.final_building)
panel_20 = Panel(python_3_script_3.manipulation_report)
mcp_tool_response = MCPToolResponse(Request=deconstruct_tool_call_2.Request, Content=create_json_object, IsError=False)
list_item_4 = ListItem(List=python_3_script_3.human_report, Index=0, Wrap=False)
create_json_value_2 = CreateJSONValue(Value=list_item_4)
create_json_object_2 = CreateJSONObject(Keys="move", Values=create_json_value_2)
mcp_tool_response_2 = MCPToolResponse(Request=deconstruct_tool_call.Request, Content=create_json_object_2, IsError=False)
panel_21 = Panel(list_item_4)
merge = Merge(Data1=mesh_2, Data2=mesh, Data3=mesh_6, Data4=mesh_join_5)
or = GateOr(A=mcp_tool_response, B=mcp_tool_response_2)
mesh_7 = Mesh(merge)
tool_call_success = ClusterOutput(or)
python_3_script_5 = Python3Script()  # -> flatten(final_building), flatten(move_status), flatten(move_report); inputs site_crv: Curve, move_back: tree of String; disabled
# ---------- python_3_script_5: Python ----------
import Rhino.Geometry as rg
import rhinoscriptsyntax as rs
import scriptcontext as sc
import json
import ast
import re

tol = 0.01

KEY_BUILDING = "MOVE_TOOL_LAST_BUILDING"
KEY_TREES = "MOVE_TOOL_LAST_TREES"

# -----------------------
# HELPERS
# -----------------------

def flatten_any(x):
    out = []

    if x is None:
        return out

    if hasattr(x, "Branches"):
        for b in x.Branches:
            out += flatten_any(b)
        return out

    if isinstance(x, (list, tuple)):
        for i in x:
            out += flatten_any(i)
        return out

    out.append(x)
    return out


def get_bool(x):
    try:
        if isinstance(x, str):
            return x.strip().lower() in ["true", "1", "yes"]
        return bool(x)
    except:
        return False


def parse_input_value(x, key):
    if x is None:
        return 0.0

    items = flatten_any(x)
    last_valid = None

    for item in items:
        if item is None:
            continue

        text = str(item).strip()

        try:
            data = json.loads(text)
            if isinstance(data, dict) and key in data:
                last_valid = float(data[key])
                continue
        except:
            pass

        try:
            data = ast.literal_eval(text)
            if isinstance(data, dict) and key in data:
                last_valid = float(data[key])
                continue
        except:
            pass

        try:
            last_valid = float(text)
            continue
        except:
            pass

        match = re.search(r"\d+\.\s*(-?\d+(?:\.\d+)?)", text)
        if match:
            try:
                last_valid = float(match.group(1))
                continue
            except:
                pass

        nums = re.findall(r"-?\d+(?:\.\d+)?", text)
        if nums:
            try:
                last_valid = float(nums[-1])
            except:
                pass

    if last_valid is None:
        return 0.0

    return last_valid


def get_curve(x):
    if isinstance(x, rg.Curve):
        return x
    try:
        return rs.coercecurve(x)
    except:
        return None


def to_mesh(obj):
    if obj is None:
        return None

    if isinstance(obj, rg.Mesh):
        return obj.DuplicateMesh()

    if isinstance(obj, rg.Brep):
        meshes = rg.Mesh.CreateFromBrep(obj)
        if not meshes:
            return None

        joined = rg.Mesh()
        for m in meshes:
            joined.Append(m)

        joined.Normals.ComputeNormals()
        joined.Compact()
        return joined

    try:
        geo = rs.coercegeometry(obj)
        return to_mesh(geo)
    except:
        return None


def get_building_mesh(x):
    meshes = []

    for item in flatten_any(x):
        m = to_mesh(item)
        if m:
            meshes.append(m)

    if not meshes:
        return None

    return max(meshes, key=lambda m: m.GetBoundingBox(True).Diagonal.Length)


def get_tree_meshes(x):
    meshes = []

    for item in flatten_any(x):
        m = to_mesh(item)
        if m:
            meshes.append(m)

    return meshes


# -----------------------
# VALIDATION
# -----------------------

def inside_site(mesh, site_curve):
    if mesh is None:
        return False, "Missing building mesh."

    if site_curve is None:
        return True, "No site boundary received. Site check skipped."

    outside_count = 0

    for v in mesh.Vertices:
        pt = rg.Point3d(v.X, v.Y, 0)

        result = site_curve.Contains(
            pt,
            rg.Plane.WorldXY,
            tol
        )

        if result == rg.PointContainment.Outside:
            outside_count += 1

    if outside_count > 0:
        return False, "Move rejected because {} building vertex point(s) would go outside the site boundary.".format(outside_count)

    return True, "Moved building remains inside the site boundary."


def overlaps_tree(mesh, tree_meshes):
    if mesh is None:
        return False, "No building mesh."

    if not tree_meshes:
        return False, "No tree zones received. Tree check skipped."

    overlap_count = 0

    for tree in tree_meshes:
        try:
            inter = rg.Intersect.Intersection.MeshMeshFast(mesh, tree)
            if inter is not None and len(inter) > 0:
                overlap_count += 1
        except:
            pass

    if overlap_count > 0:
        return True, "Move rejected because building would overlap {} tree zone(s).".format(overlap_count)

    return False, "No tree overlap detected."


# -----------------------
# INPUTS + MEMORY
# -----------------------

site_curve = get_curve(site_crv)

incoming_building = get_building_mesh(best_building)
incoming_trees = get_tree_meshes(tree_breps)

left_dist = parse_input_value(move_left, "move_left")
right_dist = parse_input_value(move_right, "move_right")
front_dist = parse_input_value(move_front, "move_front")
back_dist = parse_input_value(move_back, "move_back")

run_move = get_bool(apply_move)
reset_memory = get_bool(reset)

# -----------------------
# RESET MEMORY
# -----------------------

if reset_memory:

    sc.sticky.pop(KEY_BUILDING, None)
    sc.sticky.pop(KEY_TREES, None)

    building = None
    tree_meshes = []

    final_building = None
    move_status = "reset"

    move_report = json.dumps({
        "status": "reset",
        "message": "Stored building and tree memory cleared."
    }, indent=4)

else:

    if incoming_building is not None:
        sc.sticky[KEY_BUILDING] = incoming_building.DuplicateMesh()

    if incoming_trees:
        sc.sticky[KEY_TREES] = [t.DuplicateMesh() for t in incoming_trees]

    if incoming_building is not None:
        building = incoming_building
    elif KEY_BUILDING in sc.sticky:
        building = sc.sticky[KEY_BUILDING].DuplicateMesh()
    else:
        building = None

    if incoming_trees:
        tree_meshes = incoming_trees
    elif KEY_TREES in sc.sticky:
        tree_meshes = [t.DuplicateMesh() for t in sc.sticky[KEY_TREES]]
    else:
        tree_meshes = []

    final_building = building
    move_status = "not_applied"
    move_report = "Movement tool did not run."


# -----------------------
# FIND MOVEMENT
# Priority: left → right → front → back
# -----------------------

move_vec = rg.Vector3d(0, 0, 0)
direction_used = "none"
distance_used = 0.0

if not reset_memory:

    if left_dist > 0:
        move_vec = rg.Vector3d(-left_dist, 0, 0)
        direction_used = "left"
        distance_used = left_dist

    elif right_dist > 0:
        move_vec = rg.Vector3d(right_dist, 0, 0)
        direction_used = "right"
        distance_used = right_dist

    elif front_dist > 0:
        move_vec = rg.Vector3d(0, front_dist, 0)
        direction_used = "front"
        distance_used = front_dist

    elif back_dist > 0:
        move_vec = rg.Vector3d(0, -back_dist, 0)
        direction_used = "back"
        distance_used = back_dist


# -----------------------
# APPLY MOVE
# -----------------------

if not reset_memory:

    if building is None:

        final_building = None
        move_status = "failed"
        move_report = "Move failed because no optimized building was received."

    elif not run_move:

        final_building = building
        move_status = "not_applied"
        move_report = "apply_move is False. Optimized building remains unchanged."

    elif direction_used == "none":

        final_building = building
        move_status = "not_applied"

        move_report = json.dumps({
            "status": "not_applied",
            "reason": "No valid movement value was received.",
            "parsed_values": {
                "move_left": left_dist,
                "move_right": right_dist,
                "move_front": front_dist,
                "move_back": back_dist
            },
            "expected_input": "Use only one movement input at a time, for example move_back = 2."
        }, indent=4)

    else:

        moved = building.DuplicateMesh()
        moved.Transform(rg.Transform.Translation(move_vec))

        site_ok, site_msg = inside_site(moved, site_curve)
        tree_hit, tree_msg = overlaps_tree(moved, tree_meshes)

        if site_ok and not tree_hit:

            final_building = moved
            move_status = "accepted"

            move_report = json.dumps({
                "status": "accepted",
                "direction": direction_used,
                "distance": distance_used,
                "vector": [move_vec.X, move_vec.Y, move_vec.Z],
                "site_check": site_msg,
                "tree_check": tree_msg,
                "result": "Building moved successfully."
            }, indent=4)

            sc.sticky[KEY_BUILDING] = final_building.DuplicateMesh()

        else:

            final_building = building
            move_status = "rejected"

            reasons = []

            if not site_ok:
                reasons.append(site_msg)

            if tree_hit:
                reasons.append(tree_msg)

            move_report = json.dumps({
                "status": "rejected",
                "direction": direction_used,
                "distance": distance_used,
                "vector": [move_vec.X, move_vec.Y, move_vec.Z],
                "reasons": reasons,
                "result": "Original optimized building kept."
            }, indent=4)
# ---------- end python_3_script_5 ----------

# ==== cluster Team04DefinitionCluster
panel = Panel("Radius or size of each tree canopy/buffer zone. Used to control tree collision distance from the building.")
panel_2 = Panel("Site boundary geometry used for placement and constraint checking. Defines the allowable region for building and tree generation.")
panel_3 = Panel("Tree location coordinates, usually as X,Y,Z points. Used as fixed tree positions on the site.")
panel_4 = Panel("Number of generative design candidates evaluated during optimization. Higher values increase exploration quality but also increase computation time.")
# Team 04 Definition Cluster
# CYLINDER TEAM
panel_5 = Panel("Text / JSON String")
panel_6 = Panel("Random seed value used to reproduce the same generative results consistently across runs. Changing the seed creates different design variations.")
panel_7 = Panel("Optional building typology lock. Example values: h_shape, l_shape, u_shape, courtyard, tower. When connected, the system only generates variations of this selected shape type.")
panel_8 = Panel("JSON data coming from VS Code or MCP containing all generated gene values for the building configuration, optimization parameters, and generative rules.")
panel_9 = Panel("Scales only the center wing/core portion of the building independently using the provided scale factor.")
panel_10 = Panel("Generates procedural site boundaries using area, proportion, distortion, subdivision, and rotation parameters.")
panel_11 = Panel("Rotate the optimized building anti-clockwise by a specified degree value around the Z-axis while validating site boundary and tree constraints.")
panel_12 = Panel("Scales only the right wing portion of the building independently using the provided scale factor.")
panel_13 = Panel("Rotate the optimized building clockwise by a specified degree value around the Z-axis while keeping the building inside the site boundary.")
panel_14 = Panel("Scales only the back wing portion of the building independently using the provided scale factor.")
panel_15 = Panel("Uniformly decreases the overall building scale. Can be used as a trigger or with a scale multiplier value.")
panel_16 = Panel("Scales only the left wing portion of the building independently using the provided scale factor.")
panel_17 = Panel("Scales only the front wing portion of the building independently using the provided scale factor.")
panel_18 = Panel("Uniformly increases the overall building scale. Can be used as a trigger or with a scale multiplier value.")
panel_19 = Panel("Defines the multiplier value used for scaling operations. Example: 1.2 = 20% larger, 0.8 = 20% smaller.")
define_tool_parameter = DefineToolParameter(Name="tree_sizes", Type="Number / Float", Description=panel, Required=Toggle(True))
define_tool_parameter_2 = DefineToolParameter(
    Name="tree_count",
    Type="Number / Integer",
    Description="Total number of trees to generate or place on the site.",
    Required=Toggle(True))
define_tool_parameter_3 = DefineToolParameter(Name="locked_shape_type", Type="Text", Description=panel_7, Required=Toggle(True))
define_tool_parameter_4 = DefineToolParameter(Name="site_boundary", Type="Curve / Polyline / Point List", Description=panel_2, Required=Toggle(True))
define_tool_parameter_5 = DefineToolParameter(Name="genes_json", Type=panel_5, Description=panel_8, Required=Toggle(True))
define_tool_parameter_6 = DefineToolParameter(Name="tree_points", Type="Point / Coordinate List/Number", Description=panel_3, Required=Toggle(True))
define_tool_parameter_7 = DefineToolParameter(Name="iterations", Type="Integer / Number", Description=panel_4, Required=Toggle(True))
define_tool_parameter_8 = DefineToolParameter(Name="seed", Type="Integer", Description=panel_6, Required=Toggle(True))
define_tool_parameter_9 = DefineToolParameter(Name="move_right", Type="number", Description="move building on +x", Required=Toggle(True))
define_tool_parameter_10 = DefineToolParameter(Name="move_front/Up", Type="number", Description="move building on +y", Required=Toggle(True))
define_tool_parameter_11 = DefineToolParameter(Name="move_back/Down", Type="number", Description="move building on -y", Required=Toggle(True))
define_tool_parameter_12 = DefineToolParameter(Name="move_left", Type="number", Description="move building on -x", Required=Toggle(True))
define_tool_parameter_13 = DefineToolParameter(Name="scale_center_wing", Type="number", Description=panel_9, Required=Toggle(True))
define_tool_parameter_14 = DefineToolParameter(Name="rotate_anticlockwise", Type="number", Description=panel_11, Required=Toggle(True))
define_tool_parameter_15 = DefineToolParameter(Name="scale_right_wing", Type="number", Description=panel_12, Required=Toggle(True))
define_tool_parameter_16 = DefineToolParameter(Name="scale_back_wing", Type="number", Description=panel_14, Required=Toggle(True))
define_tool_parameter_17 = DefineToolParameter(Name="rotate_clockwise", Type="number", Description=panel_13, Required=Toggle(True))
define_tool_parameter_18 = DefineToolParameter(Name="scale_down", Type="number", Description=panel_15, Required=Toggle(True))
define_tool_parameter_19 = DefineToolParameter(Name="scale_left_wing", Type="number", Description=panel_16, Required=Toggle(True))
define_tool_parameter_20 = DefineToolParameter(Name="scale_front_wing", Type="number", Description=panel_17, Required=Toggle(True))
define_tool_parameter_21 = DefineToolParameter(Name="scale_up", Type="number", Description=panel_18, Required=Toggle(True))
define_tool_parameter_22 = DefineToolParameter(Name="scale_factor", Type="number", Description=panel_19, Required=Toggle(True))
merge = Merge(
    Data1=define_tool_parameter_5,
    Data2=define_tool_parameter_3,
    Data3=define_tool_parameter_4,
    Data4=define_tool_parameter_6,
    Data5=define_tool_parameter_2,
    Data6=define_tool_parameter,
    Data7=define_tool_parameter_7,
    Data8=define_tool_parameter_8)
merge_2 = Merge(
    Data1=define_tool_parameter_12,
    Data2=define_tool_parameter_9,
    Data3=define_tool_parameter_10,
    Data4=define_tool_parameter_11,
    Data5=define_tool_parameter_17,
    Data6=define_tool_parameter_14,
    Data7=define_tool_parameter_21,
    Data8=define_tool_parameter_18,
    Data9=define_tool_parameter_22,
    Data10=define_tool_parameter_19,
    Data11=define_tool_parameter_15,
    Data12=define_tool_parameter_13,
    Data13=define_tool_parameter_20,
    Data14=define_tool_parameter_16)
define_tool = DefineTool(Name="parametric_shape_generator", Description=panel_10, Parameters=merge)
define_tool_2 = DefineTool(Name="manipulation_tools", Description="based on user requirement the building will be manipulated", Parameters=merge_2)
merge_3 = Merge(Data1=define_tool, Data2=define_tool_2)
panel_20 = Panel(merge_3)
result = ClusterOutput(merge_3)
