# Grasshopper definition Building shapes (2).gh (Grasshopper 1.0.8)

# with building form
number_slider = Slider(10963, range=0..100000)
python_3_script = Python3Script(
    site_area=number_slider,
    setback=Slider(0, range=0..10),
    seed=Slider(6, range=0..10),
    road_count=Slider(3, range=0..10),
    building_count=Slider(50, range=0..50),
    shape_type=Slider(1, range=0..4),
    coverage=Slider(0.1, range=0.1..0.9))  # -> site_polyline, setback_boundary, buildable_area, roads, buildings, actual_area, buildable_sqm, centroid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; inputs site_area: Double, setback: Double, seed: Int32, road_count: Int32, building_count: Int32, shape_type: Int32, coverage: Double
# ---------- python_3_script: Python ----------
import math
import random
import Rhino.Geometry as rg

# ━━━━━━━━━━━━━━━━━━━━━━━━━━━━━━━━━━━━━━━━━━━━━━━━━━━━━━━━━━━━━━━━━━━━━━━━━━━
# INPUTS
# ━━━━━━━━━━━━━━━━━━━━━━━━━━━━━━━━━━━━━━━━━━━━━━━━━━━━━━━━━━━━━━━━━━━━━━━━━━━
# site_area       float  10000   target site area m²
# setback         float  5.0     setback from site edge m
# seed            int    0       random seed
# road_count      int    3       number of roads
# building_count  int    6       number of context buildings
# shape_type      int    0       0=I  1=H  2=L  3=E  4=Z
# coverage        float  0.5     building footprint / buildable area (0.1–0.9)

_area   = float(site_area)      if site_area      is not None else 10000.0
_setbk  = float(setback)        if setback        is not None else 5.0
_seed   = int(seed)             if seed           is not None else 0
_rcnt   = int(road_count)       if road_count     is not None else 3
_bcnt   = int(building_count)   if building_count is not None else 6
_stype  = int(shape_type)       if shape_type     is not None else 0
_cov    = float(coverage)       if coverage       is not None else 0.5

_area   = max(100.0, _area)
_setbk  = max(0.5, min(20.0, _setbk))
_rcnt   = max(1, min(6, _rcnt))
_bcnt   = max(0, min(12, _bcnt))
_stype  = max(0, min(4, _stype))
_cov    = max(0.1, min(0.9, _cov))

rng     = random.Random(_seed)
R       = math.sqrt(_area / math.pi)

# ━━━━━━━━━━━━━━━━━━━━━━━━━━━━━━━━━━━━━━━━━━━━━━━━━━━━━━━━━━━━━━━━━━━━━━━━━━━
# HELPERS
# ━━━━━━━━━━━━━━━━━━━━━━━━━━━━━━━━━━━━━━━━━━━━━━━━━━━━━━━━━━━━━━━━━━━━━━━━━━━
def cross2(a,b): return a[0]*b[1]-a[1]*b[0]
def dot2(a,b):   return a[0]*b[0]+a[1]*b[1]
def sub2(a,b):   return (a[0]-b[0],a[1]-b[1])
def add2(a,b):   return (a[0]+b[0],a[1]+b[1])
def scale2(v,s): return (v[0]*s,v[1]*s)

def norm2(v):
    d = math.sqrt(v[0]**2+v[1]**2)
    return (v[0]/d,v[1]/d) if d>1e-9 else (1.0,0.0)

def pt3(x,y):
    return rg.Point3d(x,y,0.0)

def make_polyline(pts2d):
    pts = [pt3(x,y) for x,y in pts2d]
    pts.append(pt3(pts2d[0][0],pts2d[0][1]))
    return rg.PolylineCurve(pts)

def shoelace(c):
    s = 0.0
    for i in range(len(c)):
        s += c[i][0]*c[(i+1)%len(c)][1] - c[(i+1)%len(c)][0]*c[i][1]
    return abs(s)*0.5

def signed_area(c):
    """Return signed area (positive = CCW, negative = CW)."""
    s = 0.0
    for i in range(len(c)):
        s += c[i][0]*c[(i+1)%len(c)][1] - c[(i+1)%len(c)][0]*c[i][1]
    return s * 0.5

def inset_polygon(pts2d, dist):
    n = len(pts2d)
    area_signed = 0.0
    for i in range(n):
        area_signed += pts2d[i][0]*pts2d[(i+1)%n][1] - pts2d[(i+1)%n][0]*pts2d[i][1]

    normals = []
    for i in range(n):
        a = pts2d[i]; b = pts2d[(i+1)%n]
        d = norm2(sub2(b,a))
        nx,ny = -d[1],d[0]
        if area_signed < 0: nx,ny = -nx,-ny
        normals.append((nx,ny))

    offset_edges = []
    for i in range(n):
        a,b  = pts2d[i],pts2d[(i+1)%n]
        nrm  = normals[i]
        offset_edges.append((add2(a,scale2(nrm,dist)), add2(b,scale2(nrm,dist))))

    new_pts = []
    for i in range(n):
        e1 = offset_edges[i]
        e2 = offset_edges[(i+1)%n]
        p  = e1[0]; rv = sub2(e1[1],e1[0])
        q  = e2[0]; sv = sub2(e2[1],e2[0])
        rxs = cross2(rv,sv)
        if abs(rxs)<1e-9:
            new_pts.append(e1[1])
        else:
            t = cross2(sub2(q,p),sv)/rxs
            new_pts.append((p[0]+t*rv[0], p[1]+t*rv[1]))
    return new_pts

def rotate_pts(pts2d, angle):
    c,s = math.cos(angle),math.sin(angle)
    return [(x*c-y*s, x*s+y*c) for x,y in pts2d]

def translate_pts(pts2d, tx, ty):
    return [(x+tx, y+ty) for x,y in pts2d]

# ━━━━━━━━━━━━━━━━━━━━━━━━━━━━━━━━━━━━━━━━━━━━━━━━━━━━━━━━━━━━━━━━━━━━━━━━━━━
# BUILDING SHAPES — defined on unit box W=1.0, H=1.0, centred at origin
# Each returns a list of polygons (list of list of (x,y))
# Some shapes (H, E, Z) are multi-polygon
# ━━━━━━━━━━━━━━━━━━━━━━━━━━━━━━━━━━━━━━━━━━━━━━━━━━━━━━━━━━━━━━━━━━━━━━━━━━━
def shape_I(W, H):
    hw,hh = W*0.5, H*0.5
    return [[(-hw,-hh),(hw,-hh),(hw,hh),(-hw,hh)]]

def shape_H(W, H):
    tw  = W * 0.28
    bh  = H * 0.20
    hw  = W * 0.5
    hh  = H * 0.5
    L = [(-hw,-hh),(-hw+tw,-hh),(-hw+tw,hh),(-hw,hh)]
    Rr = [(hw-tw,-hh),(hw,-hh),(hw,hh),(hw-tw,hh)]
    C  = [(-hw+tw,-bh*0.5),(hw-tw,-bh*0.5),(hw-tw,bh*0.5),(-hw+tw,bh*0.5)]
    return [L, Rr, C]

def shape_L(W, H):
    tw  = W * 0.30
    fh  = H * 0.28
    hw  = W * 0.5
    hh  = H * 0.5
    V = [(-hw,-hh),(-hw+tw,-hh),(-hw+tw,hh),(-hw,hh)]
    F = [(-hw,-hh),(hw,-hh),(hw,-hh+fh),(-hw,-hh+fh)]
    return [V, F]

def shape_E(W, H):
    sw  = W * 0.30
    ah  = H * 0.14
    hw  = W * 0.5
    hh  = H * 0.5
    S   = [(-hw,-hh),(-hw+sw,-hh),(-hw+sw,hh),(-hw,hh)]
    T   = [(-hw+sw, hh-ah),(hw, hh-ah),(hw,hh),(-hw+sw,hh)]
    aw  = hw*0.75
    M   = [(-hw+sw,-ah*0.5),(aw,-ah*0.5),(aw,ah*0.5),(-hw+sw,ah*0.5)]
    B   = [(-hw+sw,-hh),(hw,-hh),(hw,-hh+ah),(-hw+sw,-hh+ah)]
    return [S, T, M, B]

def shape_Z(W, H):
    bh  = H * 0.22
    tw  = W * 0.28
    hw  = W * 0.5
    hh  = H * 0.5
    T  = [(-hw, hh-bh),(hw,hh-bh),(hw,hh),(-hw,hh)]
    Bo = [(-hw,-hh),(hw,-hh),(hw,-hh+bh),(-hw,-hh+bh)]
    D  = [(hw-tw, -hh+bh),(hw,-hh+bh),(-hw+tw,hh-bh),(-hw,hh-bh)]
    return [T, Bo, D]

SHAPES     = [shape_I, shape_H, shape_L, shape_E, shape_Z]
SHAPE_NAME = ["I", "H", "L", "E", "Z"]

# ━━━━━━━━━━━━━━━━━━━━━━━━━━━━━━━━━━━━━━━━━━━━━━━━━━━━━━━━━━━━━━━━━━━━━━━━━━━
# STEP 1: GENERATE SITE FIRST
# ━━━━━━━━━━━━━━━━━━━━━━━━━━━━━━━━━━━━━━━━━━━━━━━━━━━━━━━━━━━━━━━━━━━━━━━━━━━
_n     = 6
_irreg = 0.3
r_base = math.sqrt((2.0*_area)/(_n*math.sin(2.0*math.pi/_n)))

temp_align_angle = 0.0

raw = []
for i in range(_n):
    base_a = temp_align_angle + 2.0*math.pi*i/_n
    r      = r_base*(1.0+_irreg*(rng.random()*2.0-1.0)*0.4)
    a      = base_a +_irreg*(rng.random()*2.0-1.0)*(math.pi/_n)*0.4
    raw.append((r*math.cos(a), r*math.sin(a)))

sc       = math.sqrt(_area/max(shoelace(raw),1e-9))
site_pts = [(x*sc,y*sc) for x,y in raw]

cx = sum(x for x,y in site_pts)/len(site_pts)
cy = sum(y for x,y in site_pts)/len(site_pts)

# ━━━━━━━━━━━━━━━━━━━━━━━━━━━━━━━━━━━━━━━━━━━━━━━━━━━━━━━━━━━━━━━━━━━━━━━━━━━
# STEP 2: ROADS — placed along/parallel to site boundary perimeter (OUTWARD)
# ━━━━━━━━━━━━━━━━━━━━━━━━━━━━━━━━━━━━━━━━━━━━━━━━━━━━━━━━━━━━━━━━━━━━━━━━━━━
def get_boundary_roads(poly_pts, num_roads):
    """Generate roads that run along/parallel to site boundary edges, offset OUTWARD."""
    roads = []
    angles = []
    n = len(poly_pts)
    
    if num_roads > n:
        num_roads = n
    
    # Determine polygon winding (signed area)
    s_area = signed_area(poly_pts)
    is_ccw = s_area > 0
    
    # Select evenly spaced edges
    edge_indices = [int(i * n / num_roads) for i in range(num_roads)]
    
    for idx in edge_indices:
        # Get edge from poly_pts[idx] to poly_pts[(idx+1) % n]
        p1 = poly_pts[idx]
        p2 = poly_pts[(idx + 1) % n]
        
        # Edge direction and angle
        edge_vec = sub2(p2, p1)
        edge_len = math.sqrt(edge_vec[0]**2 + edge_vec[1]**2)
        
        if edge_len < 1e-6:
            continue
        
        edge_dir = (edge_vec[0] / edge_len, edge_vec[1] / edge_len)
        edge_angle = math.atan2(edge_dir[1], edge_dir[0])
        
        # Perpendicular normal: rotate edge direction by 90°
        # For CCW polygon, outward normal = rotate edge left (90° counterclockwise)
        # For CW polygon, outward normal = rotate edge right (90° clockwise)
        if is_ccw:
            # CCW: perpendicular points left (outward)
            perp_x = -edge_dir[1]
            perp_y = edge_dir[0]
        else:
            # CW: perpendicular points right (outward)
            perp_x = edge_dir[1]
            perp_y = -edge_dir[0]
        
        # Offset perpendicular to edge (outward from site)
        offset_dist = R * 0.5
        offset_x = perp_x * offset_dist
        offset_y = perp_y * offset_dist
        
        # Place road along the edge, offset outward
        road_p1 = (p1[0] + offset_x, p1[1] + offset_y)
        road_p2 = (p2[0] + offset_x, p2[1] + offset_y)
        
        roads.append((road_p1, road_p2))
        angles.append(edge_angle)
    
    return roads, angles

road_lines, road_angles = get_boundary_roads(site_pts, _rcnt)

road_curves = []
for pa, pb in road_lines:
    road_curves.append(rg.LineCurve(pt3(pa[0],pa[1]),pt3(pb[0],pb[1])))

# ━━━━━━━━━━━━━━━━━━━━━━━━━━━━━━━━━━━━━━━━━━━━━━━━━━━━━━━━━━━━━━━━━━━━━━━━━━━
# STEP 3: NEAREST ROAD ALIGNMENT ANGLE
# ━━━━━━━━━━━━━━━━━━━━━━━━━━━━━━━━━━━━━━━━━━━━━━━━━━━━━━━━━━━━━━━━━━━━━━━━━━━
def dist_pt_line(pt, pa, pb):
    d = norm2(sub2(pb,pa))
    n = (-d[1],d[0])
    return abs(dot2(sub2(pt,pa),n))

min_dist    = 1e18
align_angle = road_angles[0] if road_angles else 0
for i,(pa,pb) in enumerate(road_lines):
    d = dist_pt_line((0.0,0.0),pa,pb)
    if d < min_dist:
        min_dist    = d
        align_angle = road_angles[i]

# ━━━━━━━━━━━━━━━━━━━━━━━━━━━━━━━━━━━━━━━━━━━━━━━━━━━━━━━━━━━━━━━━━━━━━━━━━━━
# STEP 4: FINALIZE SITE
# ━━━━━━━━━━━━━━━━━━━━━━━━━━━━━━━━━━━━━━━━━━━━━━━━━━━━━━━━━━━━━━━━━━━━━━━━━━━
site_polyline = make_polyline(site_pts)
actual_area   = round(shoelace(site_pts),2)
centroid = pt3(cx,cy)

# ━━━━━━━━━━━━━━━━━━━━━━━━━━━━━━━━━━━━━━━━━━━━━━━━━━━━━━━━━━━━━━━━━━━━━━━━━━━
# STEP 5: SETBACK BOUNDARY
# ━━━━━━━━━━━━━━━━━━━━━━━━━━━━━━━━━━━━━━━━━━━━━━━━━━━━━━━━━━━━━━━━━━━━━━━━━━━
setback_pts      = inset_polygon(site_pts, _setbk)
setback_boundary = make_polyline(setback_pts)
setback_area_val = round(shoelace(setback_pts),2)

# ━━━━━━━━━━━━━━━━━━━━━━━━━━━━━━━━━━━━━━━━━━━━━━━━━━━━━━━━━━━━━━━━━━━━━━━━━━━
# STEP 6: BUILDABLE AREA = setback polygon
# ━━━━━━━━━━━━━━━━━━━━━━━━━━━━━━━━━━━━━━━━━━━━━━━━━━━━━━━━━━━━━━━━━━━━━━━━━━━
buildable_pts  = setback_pts
buildable_area = setback_boundary
buildable_sqm  = setback_area_val

# ━━━━━━━━━━━━━━━━━━━━━━━━━━━━━━━━━━━━━━━━━━━━━━━━━━━━━━━━━━━━━━━━━━━━━━━━━━━
# STEP 7: BUILDING FOOTPRINT inside buildable area
# ━━━━━━━━━━━━━━━━━━━━━━━━━━━━━━━━━━━━━━━━━━━━━━━━━━━━━━━━━━━━━━━━━━━━━━━━━━━
def rotate2(pt, a):
    c,s = math.cos(a),math.sin(a)
    return (pt[0]*c-pt[1]*s, pt[0]*s+pt[1]*c)

rot_build = [rotate2(p,-align_angle) for p in buildable_pts]
min_x = min(p[0] for p in rot_build)
max_x = max(p[0] for p in rot_build)
min_y = min(p[1] for p in rot_build)
max_y = max(p[1] for p in rot_build)

box_W = max_x - min_x
box_H = max_y - min_y
box_cx = (min_x + max_x) * 0.5
box_cy = (min_y + max_y) * 0.5

target_bldg_area = buildable_sqm * _cov
aspect = box_H / max(box_W, 1e-9)

unit_polys = SHAPES[_stype](1.0, aspect)
unit_area  = sum(shoelace(p) for p in unit_polys)

if unit_area > 1e-9:
    sf = math.sqrt(target_bldg_area / unit_area)
else:
    sf = 1.0

margin  = 0.95
max_sf  = min(box_W * margin / 1.0, box_H * margin / aspect) if aspect > 0 else box_W * margin
sf      = min(sf, max_sf)

bldg_W  = sf * 1.0
bldg_H  = sf * aspect

raw_polys = SHAPES[_stype](bldg_W, bldg_H)

building_footprint = []
for poly in raw_polys:
    world = [rotate2(p, align_angle) for p in poly]
    world = translate_pts(world, cx, cy)
    building_footprint.append(make_polyline(world))

bldg_area_sqm = round(sum(shoelace(p) for p in
    [SHAPES[_stype](bldg_W, bldg_H)[i] for i in range(len(SHAPES[_stype](bldg_W, bldg_H)))]), 2)

shape_name = SHAPE_NAME[_stype]

# ━━━━━━━━━━━━━━━━━━━━━━━━━━━━━━━━━━━━━━━━━━━━━━━━━━━━━━━━━━━━━━━━━━━━━━━━━━━
# STEP 8: CONTEXT BUILDINGS
# ━━━━━━━━━━━━━━━━━━━━━━━━━━━━━━━━━━━━━━━━━━━━━━━━━━━━━━━━━━━━━━━━━━━━━━━━━━━
context_buildings = []
for i in range(_bcnt):
    if road_lines:
        rd_idx = rng.randint(0, len(road_lines)-1)
        pa,pb  = road_lines[rd_idx]
        rd_ang = road_angles[rd_idx]
        t      = rng.uniform(0.0, 1.0)
        side   = rng.choice([-1,1])
        gap    = rng.uniform(R*0.3, R*1.2)
        perp_a = rd_ang+math.pi*0.5
        bx     = pa[0]+t*(pb[0]-pa[0])+math.cos(perp_a)*gap*side
        by     = pa[1]+t*(pb[1]-pa[1])+math.sin(perp_a)*gap*side
        bw     = rng.uniform(R*0.15, R*0.35)
        bd     = rng.uniform(R*0.10, R*0.25)
        bang   = rd_ang+rng.uniform(-0.15,0.15)
        c,s    = math.cos(bang),math.sin(bang)
        hw,hd  = bw*0.5,bd*0.5
        corners= [(-hw,-hd),(hw,-hd),(hw,hd),(-hw,hd)]
        world  = [(bx+p[0]*c-p[1]*s, by+p[0]*s+p[1]*c) for p in corners]
        context_buildings.append(make_polyline(world))

# ━━━━━━━━━━━━━━━━━━━━━━━━━━━━━━━━━━━━━━━━━━━━━━━━━━━━━━━━━━━━━━━━━━━━━━━━━━━
# OUTPUTS
# ━━━━━━━━━━━━━━━━━━━━━━━━━━━━━━━━━━━━━━━━━━━━━━━━━━━━━━━━━━━━━━━━━━━━━━━━━━━

roads     = road_curves
buildings = context_buildings
# ---------- end python_3_script ----------
curve = Curve(python_3_script.building_footprint)
curve_2 = Curve(python_3_script.buildings)
curve_3 = Curve(python_3_script.roads)
curve_4 = Curve(python_3_script.buildable_area)

# ----
# Height
building_height = Slider(30, range=0..100)

number_slider_2 = Slider(5000, range=0..10000)  # disabled
number_slider_3 = Slider(12.97, range=0..100)  # disabled
number_slider_4 = Slider(77.5946, range=0..100)  # disabled

# ----
# only site boundary and context
number_slider_5 = Slider(2, range=0..10)
python_3_script_2 = Python3Script(
    site_area=Slider(4517, range=0..100000),
    setback=Slider(10, range=0..10),
    seed=Slider(4, range=0..10),
    road_count=number_slider_5,
    building_count=Slider(35, range=0..50))  # -> site_polyline, setback_boundary, buildable_area, roads, buildings, actual_area, buildable_sqm, centroid, buildable_pts_str, align_angle; inputs site_area: Double, setback: Double, seed: Int32, road_count: Int32, building_count: Int32
# ---------- python_3_script_2: Python ----------
import math
import random
import Rhino.Geometry as rg

# ── INPUTS ────────────────────────────────────────────────────────────────────
# Wire these into the GHPython component as inputs:
#   site_area      (float) — total site area in m²          default 10000
#   setback        (float) — setback distance in m           default 5
#   seed           (int)   — random seed                     default 0
#   road_count     (int)   — number of context roads (1–6)   default 3
#   building_count (int)   — number of context buildings     default 6

_area   = float(site_area)      if site_area      is not None else 10000.0
_setbk  = float(setback)        if setback        is not None else 5.0
_seed   = int(seed)             if seed           is not None else 0
_rcnt   = int(road_count)       if road_count     is not None else 3
_bcnt   = int(building_count)   if building_count is not None else 6

_area   = max(100.0, _area)
_setbk  = max(0.5, min(20.0, _setbk))
_rcnt   = max(1, min(6, _rcnt))
_bcnt   = max(1, min(12, _bcnt))

rng = random.Random(_seed)
R   = math.sqrt(_area / math.pi)   # characteristic radius of the site

# ── HELPERS ───────────────────────────────────────────────────────────────────
def cross2(a, b):  return a[0]*b[1] - a[1]*b[0]
def dot2(a, b):    return a[0]*b[0] + a[1]*b[1]
def sub2(a, b):    return (a[0]-b[0], a[1]-b[1])
def add2(a, b):    return (a[0]+b[0], a[1]+b[1])
def scale2(v, s):  return (v[0]*s, v[1]*s)

def norm2(v):
    d = math.sqrt(v[0]**2 + v[1]**2)
    return (v[0]/d, v[1]/d) if d > 1e-9 else (1.0, 0.0)

def pt3(x, y):
    return rg.Point3d(x, y, 0.0)

def make_polyline(pts2d):
    pts = [pt3(x, y) for x, y in pts2d]
    pts.append(pt3(pts2d[0][0], pts2d[0][1]))   # close the loop
    return rg.PolylineCurve(pts)

def shoelace(c):
    s = 0.0
    for i in range(len(c)):
        s += c[i][0]*c[(i+1)%len(c)][1] - c[(i+1)%len(c)][0]*c[i][1]
    return abs(s) * 0.5

def inset_polygon(pts2d, dist):
    """Shrink a polygon inward by dist on every edge."""
    n = len(pts2d)
    normals = []
    for i in range(n):
        a  = pts2d[i]
        b  = pts2d[(i+1) % n]
        d  = norm2(sub2(b, a))
        normals.append((-d[1], d[0]))

    # ensure normals point inward (check CCW winding)
    area_signed = 0.0
    for i in range(n):
        area_signed += pts2d[i][0]*pts2d[(i+1)%n][1] - pts2d[(i+1)%n][0]*pts2d[i][1]
    if area_signed < 0:   # CW polygon → flip normals
        normals = [(-nx, -ny) for nx, ny in normals]

    # offset each edge inward
    offset_edges = []
    for i in range(n):
        a, b = pts2d[i], pts2d[(i+1) % n]
        nrm  = normals[i]
        oa   = add2(a, scale2(nrm, dist))
        ob   = add2(b, scale2(nrm, dist))
        offset_edges.append((oa, ob))

    # intersect consecutive offset edges → new vertices
    new_pts = []
    for i in range(n):
        e1 = offset_edges[i]
        e2 = offset_edges[(i+1) % n]
        p  = e1[0]; rv = sub2(e1[1], e1[0])
        q  = e2[0]; sv = sub2(e2[1], e2[0])
        rxs = cross2(rv, sv)
        if abs(rxs) < 1e-9:
            new_pts.append(e1[1])
        else:
            t  = cross2(sub2(q, p), sv) / rxs
            new_pts.append((p[0] + t*rv[0], p[1] + t*rv[1]))

    return new_pts


# ── STEP 1: ROADS — guaranteed outside site boundary ─────────────────────────
# The site is built centred on the world origin (0, 0).
# R is the characteristic radius, so we push every road at least
# (R + ROAD_GAP) from the origin, ensuring no road crosses the site.

span     = R * 4.0
ROAD_GAP = R * 0.15   # clearance between site edge and road; increase for more breathing room

road_lines  = []
road_curves = []
road_angles = []

for i in range(_rcnt):
    angle = rng.uniform(0, math.pi)
    # Random signed perpendicular offset — will be corrected if it lands inside the site
    raw_offset = rng.uniform(-R * 1.5, R * 1.5)

    perp = angle + math.pi * 0.5
    ox   = raw_offset * math.cos(perp)
    oy   = raw_offset * math.sin(perp)

    # Signed distance from the site centre (origin) to this road line.
    # Road direction: (cos angle, sin angle)
    # Road normal:   (-sin angle,  cos angle)
    nx, ny      = -math.sin(angle), math.cos(angle)
    signed_dist = nx * (0.0 - ox) + ny * (0.0 - oy)
    # signed_dist > 0  →  origin is on the positive-normal side of the road

    min_clearance = R + ROAD_GAP

    if abs(signed_dist) < min_clearance:
        # Push road to the same side but far enough to clear the site
        sign       = 1 if signed_dist >= 0 else -1
        new_offset = -sign * min_clearance   # offset measured along perp direction
        ox = new_offset * math.cos(perp)
        oy = new_offset * math.sin(perp)

    dx, dy = math.cos(angle), math.sin(angle)
    pa     = (ox - dx*span, oy - dy*span)
    pb     = (ox + dx*span, oy + dy*span)

    road_lines.append((pa, pb))
    road_angles.append(angle)
    road_curves.append(rg.LineCurve(pt3(*pa), pt3(*pb)))


# ── STEP 2: FIND NEAREST ROAD — align site to it ─────────────────────────────
def dist_pt_line(pt, pa, pb):
    d = sub2(pb, pa)
    n = norm2((-d[1], d[0]))
    return abs(dot2(sub2(pt, pa), n))

min_dist    = 1e18
align_angle = road_angles[0]
for idx, (pa, pb) in enumerate(road_lines):
    d = dist_pt_line((0.0, 0.0), pa, pb)
    if d < min_dist:
        min_dist    = d
        align_angle = road_angles[idx]


# ── STEP 3: SITE POLYLINE (irregular hexagon aligned to nearest road) ─────────
_n     = 6
_irreg = 0.3
r_base = math.sqrt((2.0 * _area) / (_n * math.sin(2.0 * math.pi / _n)))

raw = []
for i in range(_n):
    base_a = align_angle + 2.0 * math.pi * i / _n
    r      = r_base * (1.0 + _irreg * (rng.random() * 2.0 - 1.0) * 0.4)
    a      = base_a  + _irreg * (rng.random() * 2.0 - 1.0) * (math.pi / _n) * 0.4
    raw.append((r * math.cos(a), r * math.sin(a)))

sc       = math.sqrt(_area / max(shoelace(raw), 1e-9))
site_pts = [(x*sc, y*sc) for x, y in raw]

site_polyline = make_polyline(site_pts)
actual_area   = round(shoelace(site_pts), 2)

cx = sum(x for x, y in site_pts) / len(site_pts)
cy = sum(y for x, y in site_pts) / len(site_pts)
centroid = pt3(cx, cy)


# ── STEP 4: SETBACK BOUNDARY ──────────────────────────────────────────────────
setback_pts      = inset_polygon(site_pts, _setbk)
setback_boundary = make_polyline(setback_pts)
setback_area     = round(shoelace(setback_pts), 2)


# ── STEP 5: BUILDABLE AREA (extra inner margin for clarity) ───────────────────
buildable_pts  = inset_polygon(setback_pts, _setbk * 0.5)
buildable_area = make_polyline(buildable_pts)
buildable_sqm  = round(shoelace(buildable_pts), 2)


# ── STEP 6: CONTEXT BUILDINGS (along roads, outside site) ────────────────────
context_buildings = []
for i in range(_bcnt):
    rd_idx = rng.randint(0, _rcnt - 1)
    pa, pb = road_lines[rd_idx]
    rd_ang = road_angles[rd_idx]
    t      = rng.uniform(-span * 0.4, span * 0.4)
    side   = rng.choice([-1, 1])
    gap    = rng.uniform(R * 0.05, R * 0.4)   # small gap between road and building
    perp_a = rd_ang + math.pi * 0.5
    bx     = pa[0] + math.cos(rd_ang)*t + math.cos(perp_a)*gap*side
    by     = pa[1] + math.sin(rd_ang)*t + math.sin(perp_a)*gap*side
    bw     = rng.uniform(R * 0.15, R * 0.35)
    bd     = rng.uniform(R * 0.10, R * 0.25)
    bang   = rd_ang + rng.uniform(-0.15, 0.15)
    c      = math.cos(bang)
    s      = math.sin(bang)
    hw, hd = bw * 0.5, bd * 0.5
    corners = [(-hw, -hd), (hw, -hd), (hw, hd), (-hw, hd)]
    world   = [(bx + p[0]*c - p[1]*s, by + p[0]*s + p[1]*c) for p in corners]
    context_buildings.append(make_polyline(world))


# ── OUTPUTS ───────────────────────────────────────────────────────────────────
# Add these output parameters to the GHPython component and wire to
# Custom Preview components with the colours shown below:
#
#   site_polyline    → white  / light grey   outer site boundary
#   setback_boundary → yellow                setback line
#   buildable_area   → green                 buildable zone
#   roads            → red                   context roads
#   buildings        → grey                  context buildings
#   centroid         → point                 site centre
#   actual_area      → float  (panel)        site area m²
#   setback_area     → float  (panel)        area inside setback m²
#   buildable_sqm    → float  (panel)        buildable area m²

roads     = road_curves
buildings = context_buildings

# ── PASS-THROUGH VALUES FOR DOWNSTREAM SCRIPTS ────────────────────────────────
# Serialise buildable polygon vertices as a single string so Grasshopper
# does not confuse them with a list of separate geometry items.
buildable_pts_str = ";".join(["{},{}".format(p[0], p[1]) for p in buildable_pts])

# Site centroid coordinates as a two-item list [cx, cy]
cx_cy = [cx, cy]
# ---------- end python_3_script_2 ----------
curve_5 = Curve(python_3_script_2.buildings)
curve_6 = Curve(python_3_script_2.setback_boundary)
curve_7 = Curve(python_3_script_2.buildable_area)
curve_8 = Curve(python_3_script_2.roads)

boolean_toggle = BooleanToggle(True)  # disabled
script = Script(lat=number_slider_3, lon=number_slider_4, radius=number_slider_2, run=boolean_toggle)  # -> building_footprints, building_volumes, building_info, origin_pt, status; disabled
# ---------- script: Python ----------
# ============================================================
#  OSM Buildings Loader for Grasshopper (GHPython Component)
#  AUTO-FETCH via PowerShell (bypasses urllib 403/406 block)
#  No plugins required. Works on Windows + Rhino 6/7/8
# ============================================================
#
#  INPUTS:
#    lat     (float)  - Site latitude      e.g. 12.9716
#    lon     (float)  - Site longitude     e.g. 77.5946
#    radius  (float)  - Radius in metres   e.g. 5000
#    run     (bool)   - Boolean Toggle → True to fetch
#
#  OUTPUTS:
#    building_footprints  - Closed polyline curves
#    building_volumes     - Extruded Brep solids
#    building_info        - Metadata strings per building
#    origin_pt            - World origin point
#    status               - Status / error message
# ============================================================

import Rhino.Geometry as rg
import math, json, os, subprocess, tempfile

# ── Settings ───────────────────────────────────────────────
DEFAULT_FLOOR_HEIGHT = 3.5
DEFAULT_BLDG_HEIGHT  = 10.0
SCALE                = 1.0   # 1 = metres | 1000 = mm

OVERPASS_MIRRORS = [
    "https://overpass-api.de/api/interpreter",
    "https://overpass.kumi.systems/api/interpreter",
    "https://overpass.openstreetmap.ru/api/interpreter",
]

# ── Geometry helpers ───────────────────────────────────────

def latlon_to_xy(lat, lon, olat, olon):
    R = 6378137.0
    x = R * math.radians(lon - olon) * math.cos(math.radians(olat))
    y = R * math.radians(lat - olat)
    return x * SCALE, y * SCALE

def parse_height(tags):
    if "height" in tags:
        try: return float(str(tags["height"]).split()[0])
        except: pass
    if "building:levels" in tags:
        try: return float(tags["building:levels"]) * DEFAULT_FLOOR_HEIGHT
        except: pass
    return DEFAULT_BLDG_HEIGHT

def build_footprint(node_map, way_nodes, olat, olon):
    pts = []
    for nid in way_nodes:
        if nid not in node_map: continue
        n = node_map[nid]
        x, y = latlon_to_xy(n["lat"], n["lon"], olat, olon)
        pts.append(rg.Point3d(x, y, 0.0))
    if len(pts) < 3: return None
    if pts[0].DistanceTo(pts[-1]) > 1e-6: pts.append(pts[0])
    return rg.Polyline(pts).ToNurbsCurve()

def extrude_footprint(curve, height):
    surf = rg.Surface.CreateExtrusion(curve, rg.Vector3d(0, 0, height * SCALE))
    if surf is None: return None
    brep = surf.ToBrep()
    capped = brep.CapPlanarHoles(0.01)
    return capped if capped else brep

# ── Download via PowerShell (avoids urllib 403/406) ────────

def download_via_powershell(query, out_path):
    """
    Uses PowerShell's Invoke-WebRequest which sends proper browser-like
    headers — not blocked by Overpass servers.
    Tries each mirror in turn.
    """
    errors = []
    for mirror in OVERPASS_MIRRORS:
        # Escape single quotes in query for PowerShell
        ps_query = query.replace("'", "''")
        ps_script = (
            "$body = '{query}';"
            "$url  = '{url}';"
            "try {{"
            "  $r = Invoke-WebRequest -Uri $url -Method POST"
            "    -Body $body"
            "    -ContentType 'application/x-www-form-urlencoded'"
            "    -UseBasicParsing"
            "    -TimeoutSec 90;"
            "  [System.IO.File]::WriteAllText('{path}', $r.Content);"
            "  exit 0"
            "}} catch {{"
            "  Write-Error $_.Exception.Message;"
            "  exit 1"
            "}}"
        ).format(query=ps_query, url=mirror, path=out_path.replace("\\", "\\\\"))

        result = subprocess.call(
            ["powershell", "-NoProfile", "-NonInteractive",
             "-ExecutionPolicy", "Bypass", "-Command", ps_script],
            stdout=subprocess.PIPE,
            stderr=subprocess.PIPE
        )

        if result == 0 and os.path.isfile(out_path) and os.path.getsize(out_path) > 100:
            return True, mirror
        else:
            errors.append("Failed: " + mirror)

    return False, " | ".join(errors)


def download_via_curl(query, out_path):
    """
    Fallback: use curl.exe (built into Windows 10/11)
    """
    errors = []
    for mirror in OVERPASS_MIRRORS:
        try:
            result = subprocess.call(
                [
                    "curl.exe", "-s", "-X", "POST",
                    "-H", "User-Agent: Mozilla/5.0",
                    "-H", "Content-Type: application/x-www-form-urlencoded",
                    "--data", query,
                    "--output", out_path,
                    "--max-time", "90",
                    mirror
                ],
                stdout=subprocess.PIPE,
                stderr=subprocess.PIPE
            )
            if result == 0 and os.path.isfile(out_path) and os.path.getsize(out_path) > 100:
                return True, mirror
            else:
                errors.append("curl failed: " + mirror)
        except Exception as e:
            errors.append(str(e))
    return False, " | ".join(errors)

# ── Parse OSM JSON and build geometry ──────────────────────

def process_json(raw_data, lat, lon):
    elements = raw_data.get("elements", [])
    node_map = {el["id"]: {"lat": el["lat"], "lon": el["lon"]}
                for el in elements if el["type"] == "node"}

    footprints, volumes, infos = [], [], []
    count = skipped = 0

    for el in elements:
        if el["type"] != "way": continue
        tags  = el.get("tags", {})
        nodes = el.get("nodes", [])

        fp = build_footprint(node_map, nodes, lat, lon)
        if fp is None:
            skipped += 1
            continue

        h   = parse_height(tags)
        vol = extrude_footprint(fp, h)

        footprints.append(fp)
        if vol: volumes.append(vol)

        name = tags.get("name", tags.get("addr:street", "unnamed"))
        infos.append("name={} | h={:.1f}m | type={}".format(
            name, h, tags.get("building", "yes")))
        count += 1

    return footprints, volumes, infos, count, skipped

# ── Main ───────────────────────────────────────────────────

building_footprints = []
building_volumes    = []
building_info       = []
origin_pt           = rg.Point3d(0, 0, 0)
status              = "Idle — flip 'run' to True."

if run:
    if lat is None or lon is None:
        status = "ERROR: Provide lat and lon inputs."
    else:
        _r = float(radius) if (radius is not None and float(radius) > 0) else 5000.0

        query = (
            "[out:json][timeout:90];"
            "(way['building'](around:{r},{lat},{lon});"
            "(._;>;););"
            "out body;"
        ).format(r=int(_r), lat=lat, lon=lon)

        # Temp file for downloaded JSON
        tmp_path = os.path.join(tempfile.gettempdir(), "gh_osm_buildings.json")

        status = "Downloading via PowerShell…"

        # Try PowerShell first, then curl
        ok, source = download_via_powershell(query, tmp_path)
        if not ok:
            status = "PowerShell failed, trying curl… ({})".format(source)
            ok, source = download_via_curl(query, tmp_path)

        if not ok:
            status = "ERROR: All download methods failed.\n{}".format(source)
        else:
            try:
                with open(tmp_path, "r") as f:
                    raw = json.load(f)

                building_footprints, building_volumes, building_info, count, skipped = \
                    process_json(raw, lat, lon)

                status = "Done! {} buildings loaded, {} skipped. (via {})".format(
                    count, skipped, source)

            except ValueError as e:
                status = "JSON parse error: {}".format(str(e))
            except Exception as e:
                status = "ERROR: " + str(e)
# ---------- end script ----------

# ----
# H - shape
gap_between_wings = Slider(12, range=0..100)
connector_depth = Slider(6, range=0..10)
wing_width = Slider(8, range=0..10)
wing_length = Slider(30, range=0..100)
subtraction = Subtraction(A=wing_length, B=connector_depth)
subtraction_2 = Subtraction(B=wing_width)
division = Division(A=subtraction, B="2")
division_2 = Division(A=subtraction_2, B="2")
addition = Addition(A=wing_width, B=gap_between_wings)
rectangle = Rectangle(Plane=PlaneXY(0, 0, 0), XSize=wing_width, YSize=wing_length, Radius=0)  # -> Rectangle, Length
rectangle_2 = Rectangle(Plane=PlaneXY(0, 0, 0), XSize=gap_between_wings, YSize=connector_depth, Radius=0)  # -> Rectangle, Length
vector_xyz = VectorXYZ(XComponent=wing_width, YComponent=division, ZComponent=0)  # -> Vector, Length
vector_xyz_2 = VectorXYZ(XComponent=addition, YComponent=0, ZComponent=0)  # -> Vector, Length
move = Move(Geometry=rectangle.Rectangle, Motion=vector_xyz_2.Vector)  # -> Geometry, Transform
move_2 = Move(Geometry=rectangle_2.Rectangle, Motion=vector_xyz.Vector)  # -> Geometry, Transform
merge = Merge(Data1=rectangle.Rectangle, Data2=move.Geometry, Data3=move_2.Geometry)
region_union = RegionUnion(Curves=merge)
unit_z = UnitZ(Factor=building_height)
extrude = Extrude(Base=region_union, Direction=unit_z)
cap_holes = CapHoles(Brep=extrude)

# ----
# C - shape
wing_depthder = Slider(8, range=0..10)
wing_width_2 = Slider(32, range=0..100)
stem_width = Slider(4, range=0..15)
stem_length = Slider(31, range=0..100)
rectangle_3 = Rectangle(Plane=PlaneXY(0, 0, 0), XSize=wing_width_2, YSize=wing_depthder, Radius=0)  # -> Rectangle, Length
rectangle_4 = Rectangle(Plane=PlaneXY(0, 0, 0), XSize=stem_width, YSize=stem_length, Radius=0)  # -> Rectangle, Length
rectangle_5 = Rectangle(Plane=PlaneXY(0, 0, 0), XSize=wing_width_2, YSize=wing_depthder, Radius=0)  # -> Rectangle, Length
subtraction_3 = Subtraction(A=stem_length, B=wing_depthder)
move_3 = Move(Geometry=rectangle_5.Rectangle, Motion=Vector(0, 0, 0))  # -> Geometry, Transform
vector_xyz_3 = VectorXYZ(XComponent=0, YComponent=subtraction_3, ZComponent=0)  # -> Vector, Length
move_4 = Move(Geometry=rectangle_3.Rectangle, Motion=vector_xyz_3.Vector)  # -> Geometry, Transform
merge_2 = Merge(Data1=rectangle_4.Rectangle, Data2=move_3.Geometry, Data3=move_4.Geometry)
region_union_2 = RegionUnion(Curves=merge_2)
unit_z_2 = UnitZ(Factor=building_height)
extrude_2 = Extrude(Base=region_union_2, Direction=unit_z_2)
cap_holes_2 = CapHoles(Brep=extrude_2)

# ----
# I - shape
stem_width_2 = Slider(8, range=0..10)
stem_length_2 = Slider(30, range=0..100)
wing_width_3 = Slider(20, range=0..100)
wing_depth = Slider(6, range=0..10)
subtraction_4 = Subtraction(A=wing_width_3, B=stem_width_2)
rectangle_6 = Rectangle(Plane=PlaneXY(0, 0, 0), XSize=stem_width_2, YSize=stem_length_2, Radius=0)  # -> Rectangle, Length
rectangle_7 = Rectangle(Plane=PlaneXY(0, 0, 0), XSize=wing_width_3, YSize=wing_depth, Radius=0)  # -> Rectangle, Length
rectangle_8 = Rectangle(Plane=PlaneXY(0, 0, 0), XSize=wing_width_3, YSize=wing_depth, Radius=0)  # -> Rectangle, Length
division_3 = Division(A=subtraction_4, B="2")
subtraction_5 = Subtraction(A=stem_length_2, B=wing_depth)
move_5 = Move(Geometry=rectangle_7.Rectangle, Motion=Vector(0, 0, 0))  # -> Geometry, Transform
vector_xyz_4 = VectorXYZ(XComponent=0, YComponent=subtraction_5, ZComponent=0)  # -> Vector, Length
vector_xyz_5 = VectorXYZ(XComponent=division_3, YComponent=0, ZComponent=0)  # -> Vector, Length
move_6 = Move(Geometry=rectangle_8.Rectangle, Motion=vector_xyz_4.Vector)  # -> Geometry, Transform
move_7 = Move(Geometry=rectangle_6.Rectangle, Motion=vector_xyz_5.Vector)  # -> Geometry, Transform
merge_3 = Merge(Data1=move_7.Geometry, Data2=move_5.Geometry, Data3=move_6.Geometry)
region_union_3 = RegionUnion(Curves=merge_3)
unit_z_3 = UnitZ(Factor=building_height)
extrude_3 = Extrude(Base=region_union_3, Direction=unit_z_3)
cap_holes_3 = CapHoles(Brep=extrude_3)

# ----
# L - shape
width_b = Slider(33, range=0..100)
length_b = Slider(8, range=0..10)
length_a = Slider(39, range=0..100)
width_a = Slider(7, range=0..10)
rectangle_9 = Rectangle(Plane=PlaneXY(0, 0, 0), XSize=length_a, YSize=width_a, Radius=0)  # -> Rectangle, Length
rectangle_10 = Rectangle(Plane=PlaneXY(0, 0, 0), XSize=width_b, YSize=length_b, Radius=0)  # -> Rectangle, Length
subtraction_6 = Subtraction(A=length_a, B=width_b)
vector_xyz_6 = VectorXYZ(XComponent=0, YComponent=subtraction_6, ZComponent=0)  # -> Vector, Length
move_8 = Move(Geometry=rectangle_10.Rectangle, Motion=vector_xyz_6.Vector)  # -> Geometry, Transform
merge_4 = Merge(Data1=rectangle_9.Rectangle, Data2=move_8.Geometry)
region_union_4 = RegionUnion(Curves=merge_4)
unit_z_4 = UnitZ(Factor=building_height)
extrude_4 = Extrude(Base=region_union_4, Direction=unit_z_4)
cap_holes_4 = CapHoles(Brep=extrude_4)

curve_9 = Curve(script.building_footprints)  # disabled
brep = Brep(script.building_volumes)  # disabled
panel = Panel(script.building_info)  # disabled
panel_2 = Panel(script.origin_pt)  # disabled
panel_3 = Panel(script.status)  # disabled
site_curve = Curve(python_3_script_2.site_polyline)
merge_5 = Merge(Data1=cap_holes_4, Data2=cap_holes_2, Data3=cap_holes_3, Data4=cap_holes)
merge_6 = Merge(Data1=region_union_4, Data2=region_union_2, Data3=region_union_3, Data4=region_union)
number_slider_6 = Slider(1.5, range=1..4)
gene_pool = GenePool(Decimals=0, Maximum=70, Minimum=0, Value=[10, 13, 28, 47, 0, 32, 1, 14, 32, 0])
gene_pool_2 = GenePool(Decimals=0, Maximum=6, Minimum=2, Value=[3, 3, 2, 2, 2, 2, 2, 2])
gene_pool_3 = GenePool(Decimals=0, Maximum=8, Minimum=1, Value=[2.75, 4.5, 6.25, 8, 2.75, 4.5, 8, 4.5, 1, 6.25])
vector_xyz_7 = VectorXYZ(XComponent=0, YComponent=0, ZComponent=gene_pool_3)  # -> Vector, Length
galapagos = Galapagos(fitness=data, gene=[location_gene, rotate_angle, gene_pool, gene_pool_2])

surface = Surface(site_curve)
divide_domain² = DivideDomain²(Domain=surface, UCount=10, VCount=10)
number_slider_7 = Slider(3, range=0..3)
isotrim = Isotrim(Surface=surface, Domain=divide_domain²)
area = Area(Geometry=isotrim)  # -> Area, Centroid
location_gene = Slider(39, range=0..50)
rotate_angle = Slider(90, range=0..180)
list_item = ListItem(List=merge_5, Index=number_slider_7, Wrap=True)
point_in_curve = PointInCurve(Point=area.Centroid, Curve=site_curve)  # -> Relationship, Point
cull_pattern = CullPattern(List=area.Centroid, CullPattern=point_in_curve.Relationship)
list_item_2 = ListItem(List=cull_pattern, Index=location_gene, Wrap=True)

list_item_3 = ListItem(List=merge_6, Index=number_slider_7, Wrap=True)
area_2 = Area(Geometry=list_item_3)  # -> Area, Centroid
scale_nu = ScaleNU(Geometry=list_item, Plane=area_2.Centroid, ScaleX=number_slider_6, ScaleY=number_slider_6, ScaleZ=number_slider_6)  # -> Geometry, Transform

move_9 = Move(Geometry=scale_nu.Geometry, Motion=list_item_2)  # -> Geometry, Transform
rotate = Rotate(Geometry=move_9.Geometry, Angle=degrees(rotate_angle), Plane=PlaneXY(0, 0, 0))  # -> Geometry, Transform

list_item_4 = ListItem(List=cull_pattern, Index=gene_pool, Wrap=False)
circle = Circle(Plane=list_item_4, Radius=gene_pool_2)
extrude_5 = Extrude(Base=circle, Direction=vector_xyz_7.Vector)

# ---- group: Tree relationship
deconstruct_brep = DeconstructBrep(Brep=rotate.Geometry)  # -> Faces, Edges, Vertices
list_item_5 = ListItem(List=reverse(deconstruct_brep.Faces), Index=0, Wrap=True)
area_3 = Area(Geometry=list_item_5)  # -> Area, Centroid
closest_points = ClosestPoints(Point=area_3.Centroid, Cloud=list_item_4, Count=3)  # -> ClosestPoint, CPIndex, Distance
subtraction_7 = Subtraction(A=closest_points.Distance, B=Slider(-5, range=-10..-5))
absolute = Absolute(Value=subtraction_7)
multiplication = Multiplication(A=absolute, B=Slider(-5, range=-10..-5))
mass_addition = MassAddition(Input=multiplication)  # -> flatten(Result), PartialResults

# ----
cap_holes_5 = CapHoles(Brep=extrude_5)

# ---- group: site fit check
bounding_box = BoundingBox(Content=rotate.Geometry, Plane=PlaneXY(0, 0, 0))  # -> Box, Box_2
box_corners = BoxCorners(Box=bounding_box.Box)  # -> CornerA, CornerB, CornerC, CornerD, CornerE, CornerF, CornerG, CornerH
merge_7 = Merge(
    Data1=box_corners.CornerA,
    Data2=box_corners.CornerB,
    Data3=box_corners.CornerC,
    Data4=box_corners.CornerD,
    Data5=box_corners.CornerE,
    Data6=box_corners.CornerF,
    Data7=box_corners.CornerG,
    Data8=box_corners.CornerH)
point_in_curve_2 = PointInCurve(Point=merge_7, Curve=site_curve)  # -> Relationship, Point
smaller_than = SmallerThan(FirstNumber=point_in_curve_2.Relationship, SecondNumber=Slider(1, range=0..2))  # -> SmallerThan, OrEqualTo
mass_addition_2 = MassAddition(Input=smaller_than.SmallerThan)  # -> Result, PartialResults
multiplication_2 = Multiplication(A=mass_addition_2.Result, B=Slider(-10000000, range=-10000000..1))

# ---- group: road
area_4 = Area(Geometry=rotate.Geometry)  # -> Area, Centroid
curve_closest_point = CurveClosestPoint(Point=area_4.Centroid, Curve=curve_8)  # -> Point, Parameter, Distance
multiplication_3 = Multiplication(A=curve_closest_point.Distance, B=Slider(-1, range=-1..1))

# ---- group: Open Space Score
area_5 = Area(Geometry=rotate.Geometry)  # -> Area, Centroid
curve_closest_point_2 = CurveClosestPoint(Point=area_5.Centroid, Curve=site_curve)  # -> Point, Parameter, Distance
multiplication_4 = Multiplication(A=curve_closest_point_2.Distance, B=Slider(1, range=0..1))

# ---- group: sun angle
preferred_angle = Slider(90, range=0..100)
subtraction_8 = Subtraction(A=rotate_angle, B=preferred_angle)
absolute_2 = Absolute(Value=subtraction_8)
multiplication_5 = Multiplication(A=absolute_2, B=Slider(-1, range=-1..0))

# ---- group: tree
proximity_2d = Proximity2D(Points=list_item_4, Plane=PlaneXY(0, 0, 0), Group=5, MinRadius=gene_pool_2)  # -> Links, Topology
length = Length(Curve=proximity_2d.Links)
mass_addition_3 = MassAddition(Input=length)  # -> Result, PartialResults
multiplication_6 = Multiplication(A=mass_addition_3.Result, B=Slider(-5000, range=-10000..-5000))
mass_addition_4 = MassAddition(Input=multiplication_6)  # -> flatten(Result), PartialResults

# ---- group: Center attraction
area_6 = Area(Geometry=surface)  # -> Area, Centroid
distance = Distance(PointA=area_3.Centroid, PointB=area_6.Centroid)
multiplication_7 = Multiplication(A=distance, B=Slider(-2, range=-10..-2))
mass_addition_5 = MassAddition(Input=multiplication_7)  # -> flatten(Result), PartialResults

# ----
solid_intersection = SolidIntersection(BrepsA=list_item_5, BrepsB=cap_holes_5)

# ---- group: Tree overlap
area_7 = Area(Geometry=solid_intersection)  # -> Area, Centroid
mass_addition_6 = MassAddition(Input=area_7.Area)  # -> Result, PartialResults
multiplication_8 = Multiplication(A=mass_addition_6.Result, B=Slider(-20000, range=-20000..0))

# ----
mass_addition_7 = MassAddition(Input=multiplication_3)  # -> flatten(Result), PartialResults
mass_addition_8 = MassAddition(Input=multiplication_4)  # -> flatten(Result), PartialResults
mass_addition_9 = MassAddition(Input=multiplication_5)  # -> Result, PartialResults
mass_addition_10 = MassAddition(Input=multiplication_8)  # -> flatten(Result), PartialResults
mass_addition_11 = MassAddition(Input=multiplication_2)  # -> flatten(Result), PartialResults
merge_8 = Merge(
    Data1=mass_addition_11.Result,
    Data2=mass_addition_7.Result,
    Data3=mass_addition_8.Result,
    Data4=mass_addition_9.Result,
    Data5=mass_addition_10.Result)
mass_addition_12 = MassAddition(Input=merge_8)  # -> Result, PartialResults
data = Data(mass_addition_12.Result)
panel_4 = Panel(data)
