# Grasshopper definition test.gh (Grasshopper 1.0.8)
# plug-ins: froGH, Swiftlet

panel = Panel("Distance from the site boundary used to clip or filter contextual elements.")
panel_2 = Panel("Optional mapping of semantic layer names such as `roads`, `buildings`, `entrances`, and `green`")
panel_3 = Panel("Neighbor building footprints for adjacency and overshadowing context")
define_tool_parameter = DefineToolParameter(Name="building_boundary", Type="array of `[x, y, z]` points", Required=True)
define_tool_parameter_2 = DefineToolParameter(Name="building_boundary", Type="array of `[x, y, z]` points", Required=True)
define_tool_parameter_3 = DefineToolParameter(Name="site_boundary", Type="array of `[x, y, z]` points", Required=True)
define_tool_parameter_4 = DefineToolParameter(Name="layer_name", Type="string", Required=True)
define_tool_parameter_5 = DefineToolParameter(Name="geometry_id", Type="string", Required=True)
define_tool_parameter_6 = DefineToolParameter(Name="boundary", Type="array of `[x, y, z]` points", Required=True)
define_tool_parameter_7 = DefineToolParameter(Name="shape_type", Type="string", Required=True)
define_tool_parameter_8 = DefineToolParameter(Name="closed", Type="boolean", Required=True)
define_tool_parameter_9 = DefineToolParameter(Name="site_boundary", Type="array of `[x, y, z]` points", Required=True)
define_tool_parameter_10 = DefineToolParameter(Name="site_guid", Type="string", Required=True)
define_tool_parameter_11 = DefineToolParameter(Name="buildings", Type="array of `[x, y, z]` points", Description=panel_3, Required=True)
define_tool_parameter_12 = DefineToolParameter(Name="site_boundary", Type="array of `[x, y, z]` points", Required=True)
define_tool_parameter_13 = DefineToolParameter(Name="roads", Type="array of `[x, y, z]` points", Required=True)
define_tool_parameter_14 = DefineToolParameter(Name="analysis_radius_m", Type="number", Description=panel, Required=True)
define_tool_parameter_15 = DefineToolParameter(Name="layer_map", Type="Rhino_geometry", Description=panel_2, Required=True)
panel_4 = Panel("Reads surrounding roads, neighboring buildings, entrances, and optional context layers, then returns organized geometry and proximity-ready metadata.")
panel_5 = Panel("Tool that test if the building boundary is inside the site without overlapping the set boundary")
define_tool_parameter_16 = DefineToolParameter(Name="entrances", Type="array of `[x, y]`", Required=True)
panel_6 = Panel("Read a closed site boundary polyline from Grasshopper/Rhino and return corrdinates for downstream building fit checks.")
panel_7 = Panel("Create Rhino/Grasshopper geometry from a Python-generated closed building boundary.")
define_tool = DefineTool(Name="test_fit", Description=panel_5, Parameters=[define_tool_parameter_3, define_tool_parameter_2])
define_tool_2 = DefineTool(
    Name="import_building_boundary",
    Description=panel_7,
    Parameters=[define_tool_parameter_5, define_tool_parameter_6, define_tool_parameter_7, define_tool_parameter_4, define_tool_parameter_8])
define_tool_3 = DefineTool(
    Name="context_reader",
    Description=panel_4,
    Parameters=[define_tool_parameter_14, define_tool_parameter_12, define_tool_parameter_13, define_tool_parameter_11, define_tool_parameter_16, define_tool_parameter_15])
define_tool_4 = DefineTool(Name="site_boundary_reader", Description=panel_6, Parameters=[define_tool_parameter_10, define_tool_parameter_9])
mcp_server = MCPServer(Port=3001, Tools=[define_tool_2, define_tool_4, define_tool, define_tool_3], ServerName="Swiftlet")  # -> Import_building_boundary, Site_boundary_reader, Test_fit, Context_reader
get_json_object_key = GetJSONObjectKey()
read_json_array = ReadJSONArray(Array=get_json_object_key)
read_json_array_2 = ReadJSONArray(Array=read_json_array)
read_json_value = ReadJSONValue(JValue=read_json_array_2)  # -> AsString, AsNumber, AsBool
curve = Curve(<curve referenced from the Rhino model>)
list_item = ListItem(List=read_json_value.AsString, Index=0, Wrap=True)  # -> Item, Item1, Item2
curve_2 = Curve(<curve referenced from the Rhino model>)
curve_3 = Curve()
geometry = Geometry()
curve_4 = Curve()
curve_5 = Curve()
construct_point = ConstructPoint(XCoordinate=list_item.Item, YCoordinate=list_item.Item1, ZCoordinate=list_item.Item2)
polyline = PolyLine(Vertices=flatten(construct_point), Closed=False)
cluster = Cluster_2(jobject=geometry, key="layer_map")
cluster_2 = Cluster(jobject=curve_4, key="buildings")
cluster_3 = Cluster(jobject=curve_5, key="entrances")
cluster_4 = Cluster(jobject=curve_3, key="roads")
cluster_5 = Cluster_3(crv=curve_2)  # -> json_2, crv_4, json
deconstruct_tool_call = DeconstructToolCall()  # -> Request, Tool, Arguments
deconstruct_tool_call_2 = DeconstructToolCall()  # -> Request, Tool, Arguments
crvtojson = CrvToJson(crv=curve, key="site_boundary")
jsontocrv = JsonToCrv(jsonobj=deconstruct_tool_call.Arguments, key="boundary")
jsontocrv_2 = JsonToCrv_2(jsonobj=deconstruct_tool_call_2.Arguments, key="site_boundary")
jsontocrv_3 = JsonToCrv_2(jsonobj=deconstruct_tool_call_2.Arguments, key="building_boundary")
deconstruct_tool_call_3 = DeconstructToolCall()  # -> Request, Tool, Arguments
geometry_2 = Geometry(cluster)
curve_6 = Curve(cluster_5.crv_4)
curve_7 = Curve(cluster_4)
curve_8 = Curve(cluster_2)
curve_9 = Curve(cluster_3)
area = Area(Geometry=curve)  # -> Area, Centroid
curve_10 = Curve(jsontocrv)
explode = Explode(Curve=curve_7, Recursive=True)  # -> Segments, Vertices
explode_2 = Explode(Curve=curve_8, Recursive=True)  # -> Segments, Vertices
explode_3 = Explode(Curve=curve_6, Recursive=True)  # -> Segments, Vertices
explode_4 = Explode(Curve=curve_9, Recursive=True)  # -> Segments, Vertices
explode_5 = Explode(Curve=jsontocrv_3, Recursive=True)  # -> Segments, Vertices
area_2 = Area(Geometry=curve_10)  # -> Area, Centroid
cull_index = CullIndex(List=explode_5.Vertices, Indices="-1", Wrap=True)
point_in_curve = PointInCurve(Point=cull_index, Curve=deconstruct_tool_call_2.Request)  # -> Relationship, Point
merge = Merge(Data1=explode_3.Vertices, Data2=explode.Vertices, Data3=explode_2.Vertices, Data4=explode_4.Vertices)
equality = Equality(FirstNumber=point_in_curve.Relationship, SecondNumber=2)  # -> Equality, Inequality
panel_8 = Panel(area.Area)
create_json_value = CreateJSONValue(Value=area_2.Area)
panel_9 = Panel("""arrays
rhino_geometry""")
create_json_value_2 = CreateJSONValue(Value=area.Area)
create_json_object = CreateJSONObject(Keys="area", Values=create_json_value_2)
mass_boolean = MassBoolean(Values=equality.Equality, BooleanOperator="AND")
mcp_tool_response = MCPToolResponse(Request=deconstruct_tool_call_3.Request, Content=crvtojson, IsError=False)
create_json_object_2 = CreateJSONObject(Keys="area", Values=create_json_value)
mcp_tool_response_2 = MCPToolResponse(Request=deconstruct_tool_call.Request, Content=create_json_object_2, IsError=False)
panel_10 = Panel(area_2.Area)
create_json_value_3 = CreateJSONValue(Value=geometry_2)
create_json_value_4 = CreateJSONValue(Value=merge)
deconstruct_tool_call_4 = DeconstructToolCall()  # -> Request, Tool, Arguments
panel_11 = Panel(mcp_tool_response_2)
create_json_value_5 = CreateJSONValue(Value=mass_boolean)
panel_12 = Panel(mcp_tool_response)
create_json_object_3 = CreateJSONObject(Keys=panel_9, Values=[create_json_value_4, create_json_value_3])
create_json_object_4 = CreateJSONObject(Keys="IsFit", Values=create_json_value_5)
mcp_tool_response_3 = MCPToolResponse(Request=deconstruct_tool_call_2.Request, Content=create_json_object_4, IsError=False)
panel_13 = Panel(mcp_tool_response_3)
panel_14 = Panel(create_json_value_4)
mcp_tool_response_4 = MCPToolResponse(Request=deconstruct_tool_call_4.Request, Content=create_json_object_3, IsError=False)
panel_15 = Panel(mcp_tool_response_4)

# ==== cluster CrvToJson
crv = ClusterInput()
explode = Explode(Curve=crv, Recursive=True)  # -> Segments, Vertices
deconstruct = Deconstruct(Point=explode.Vertices)  # -> XComponent, YComponent, ZComponent
merge = Merge(Data1=graft(deconstruct.XComponent), Data2=graft(deconstruct.YComponent), Data3=graft(deconstruct.ZComponent))
create_json_value = CreateJSONValue(Value=merge)
create_json_array = CreateJSONArray(JTokens=create_json_value)  # -> flatten(JArray)
key = ClusterInput()
create_json_array_2 = CreateJSONArray(JTokens=create_json_array)
create_json_object = CreateJSONObject(Keys=key, Values=create_json_array_2)
json = ClusterOutput(create_json_object)

# ==== cluster JsonToCrv
jsonobj = ClusterInput()
key = ClusterInput()
get_json_object_key = GetJSONObjectKey(JObject=jsonobj, Key=key)
read_json_array = ReadJSONArray(Array=get_json_object_key)
read_json_array_2 = ReadJSONArray(Array=read_json_array)
read_json_value = ReadJSONValue(JValue=read_json_array_2)  # -> AsString, AsNumber, AsBool
list_item = ListItem(List=read_json_value.AsString, Index=0, Wrap=True)  # -> Item, Item1, Item2
construct_point = ConstructPoint(XCoordinate=list_item.Item, YCoordinate=list_item.Item1, ZCoordinate=list_item.Item2)
polyline = PolyLine(Vertices=flatten(construct_point), Closed=False)
crv = ClusterOutput(polyline)

# ==== cluster JsonToCrv_2
jsonobj = ClusterInput()
key = ClusterInput()
get_json_object_key = GetJSONObjectKey(JObject=jsonobj, Key=key)
read_json_value = ReadJSONValue(JValue=get_json_object_key)  # -> AsString, AsNumber, AsBool
deserialize_json = DeserializeJson(JSON=read_json_value.AsString, OutputsLocked=False)
deserialize_json_2 = DeserializeJson(JSON=deserialize_json, OutputsLocked=False)
list_item = ListItem(List=deserialize_json_2, Index=0, Wrap=True)  # -> Item, Item1, Item2
construct_point = ConstructPoint(XCoordinate=list_item.Item, YCoordinate=list_item.Item1, ZCoordinate=list_item.Item2)
polyline = PolyLine(Vertices=flatten(construct_point), Closed=False)
crv = ClusterOutput(polyline)

# ==== cluster Cluster
jobject = ClusterInput()
key = ClusterInput()
get_json_object_key = GetJSONObjectKey(JObject=jobject, Key=key)
read_json_array = ReadJSONArray(Array=get_json_object_key)
read_json_array_2 = ReadJSONArray(Array=read_json_array)
read_json_value = ReadJSONValue(JValue=read_json_array_2)  # -> AsString, AsNumber, AsBool
list_item = ListItem(List=read_json_value.AsString, Index=0, Wrap=True)  # -> Item, Item1, Item2
construct_point = ConstructPoint(XCoordinate=list_item.Item, YCoordinate=list_item.Item1, ZCoordinate=list_item.Item2)
polyline = PolyLine(Vertices=flatten(construct_point), Closed=False)
crv = ClusterOutput(polyline)

# ==== cluster Cluster_2
jobject = ClusterInput()
key = ClusterInput()
get_json_object_key = GetJSONObjectKey(JObject=jobject, Key=key)
read_json_array = ReadJSONArray(Array=get_json_object_key)
read_json_array_2 = ReadJSONArray(Array=read_json_array)
read_json_value = ReadJSONValue(JValue=read_json_array_2)  # -> AsString, AsNumber, AsBool
geometry = Geometry(read_json_value.AsString)
geometry_2 = ClusterOutput(geometry)

# ==== cluster Cluster_3
crv = ClusterInput()
key = ClusterInput()
crv_2 = ClusterInput()
create_json_object = CreateJSONObject(Keys=key, Values=crv)
explode = Explode(Curve=crv, Recursive=True)  # -> Segments, Vertices
deconstruct = Deconstruct(Point=explode.Vertices)  # -> XComponent, YComponent, ZComponent
explode_2 = Explode(Curve=crv_2, Recursive=True)  # -> Segments, Vertices
deconstruct_2 = Deconstruct(Point=explode_2.Vertices)  # -> XComponent, YComponent, ZComponent
merge = Merge(Data1=graft(deconstruct.XComponent), Data2=graft(deconstruct.YComponent), Data3=graft(deconstruct.ZComponent))
merge_2 = Merge(Data1=graft(deconstruct_2.XComponent), Data2=graft(deconstruct_2.YComponent), Data3=graft(deconstruct_2.ZComponent))
create_json_value = CreateJSONValue(Value=merge)
create_json_value_2 = CreateJSONValue(Value=merge_2)
create_json_array = CreateJSONArray(JTokens=create_json_value)  # -> flatten(JArray)
create_json_array_2 = CreateJSONArray(JTokens=create_json_value_2)  # -> flatten(JArray)
create_json_array_3 = CreateJSONArray(JTokens=create_json_array)
create_json_array_4 = CreateJSONArray(JTokens=create_json_array_2)
crv_3 = ClusterInput()
read_json_array = ReadJSONArray(Array=create_json_array_3)
read_json_array_2 = ReadJSONArray(Array=read_json_array)
read_json_value = ReadJSONValue(JValue=read_json_array_2)  # -> AsString, AsNumber, AsBool
explode_3 = Explode(Curve=crv_3, Recursive=True)  # -> Segments, Vertices
deconstruct_3 = Deconstruct(Point=explode_3.Vertices)  # -> XComponent, YComponent, ZComponent
list_item = ListItem(List=read_json_value.AsString, Index=0, Wrap=True)  # -> Item, Item1, Item2
json = ClusterOutput(create_json_object)
merge_3 = Merge(Data1=graft(deconstruct_3.XComponent), Data2=graft(deconstruct_3.YComponent), Data3=graft(deconstruct_3.ZComponent))
construct_point = ConstructPoint(XCoordinate=list_item.Item, YCoordinate=list_item.Item1, ZCoordinate=list_item.Item2)
create_json_value_3 = CreateJSONValue(Value=merge_3)
polyline = PolyLine(Vertices=flatten(construct_point), Closed=False)
create_json_array_5 = CreateJSONArray(JTokens=create_json_value_3)  # -> flatten(JArray)
key_2 = ClusterInput()
create_json_array_6 = CreateJSONArray(JTokens=create_json_array_5)
crv_4 = ClusterOutput(polyline)
create_json_object_2 = CreateJSONObject(Keys=key_2, Values=create_json_array_6)
json_2 = ClusterOutput(create_json_object_2)
