# Grasshopper definition mf-xx.gh (Grasshopper 1.0.8)
# plug-ins: Bifocals, Swiftlet

# compute_ structurel element
panel = Panel("Computes volume and cost of a structural element (slab, wall, beam, column, footing). Returns volume and cost.")

# ----
# COUNT ELEMENTS BY TYPE
panel_2 = Panel("This tool counts how many doors and windows of a curtain type are there in a layout ")
param = DefineToolParameter(Name="door_count", Type="number", Description="how many doors are there", Required=Toggle(True))
param_2 = DefineToolParameter(Name="door_type", Type="string", Description="what type the doors is", Required=Toggle(True))
param_3 = DefineToolParameter(Name="window_count", Type="number", Description="how many windows are there", Required=Toggle(True))
param_4 = DefineToolParameter(Name="window_type", Type="string", Description="what type the window is", Required=Toggle(True))
merge = Merge(Data1=param, Data2=param_2, Data3=param_3, Data4=param_4)
tool = DefineTool(Name="count_elements_by_type", Description=panel_2, Parameters=merge)

# ----
# GET WALL GEOMETRY
panel_3 = Panel("This tools gets the wall geometry information inside the model and returns a json file")
toggle = BooleanToggle(True)
param_5 = DefineToolParameter(Name="type", Type="string", Description="The thickness of the wall", Required=Toggle(True))
param_6 = DefineToolParameter(Name="thickness", Type="number", Description="The thickness of the wall", Required=Toggle(True))
param_7 = DefineToolParameter(Name="width", Type="number", Description="the width of the wall", Required=Toggle(True))
param_8 = DefineToolParameter(Name="heigth", Type="number", Description="The heigth of the wall", Required=Toggle(True))
param_9 = DefineToolParameter(Name="length", Type="number", Description="The length of the wall", Required=Toggle(True))
merge_2 = Merge(Data1=param_7, Data2=param_9, Data3=param_8, Data4=param_6, Data5=param_5)
tool_2 = DefineTool(Name="get_wall_geometry", Description=panel_3, Parameters=merge_2)

# ----
# COMPUTE VOLUME OF A WALL
panel_4 = Panel("This tool calculates the volume of the walls")
param_10 = DefineToolParameter(Name="wall_length", Type="number", Description="the length of the wall", Required=Toggle(True))
param_11 = DefineToolParameter(Name="wall_unit_rate", Type="number", Description="the unit rate of the wall", Required=True)
param_12 = DefineToolParameter(Name="wall_width", Type="number", Description="the width of the wall", Required=Toggle(True))
param_13 = DefineToolParameter(Name="wall_type", Type="string", Description="the type of the wall", Required=Toggle(True))
param_14 = DefineToolParameter(Name="wall_heigth", Type="number", Description="the heigth of the wall", Required=Toggle(True))
merge_3 = Merge(Data1=param_10, Data2=param_12, Data3=param_14, Data4=param_13, Data5=param_11)
tool_3 = DefineTool(Name="compute_volume_of_wall", Description=panel_4, Parameters=merge_3)

# ----
# Team 05 Definition Cluster
# CUBE TEAM
panel_5 = Panel("This tool computes the volume of a cube by giving it a length of a side.  The output unit is the input unit cubed.")
param_15 = DefineToolParameter(Name="count", Type="number", Description="number of identical elements (default 1)", Required=True)
param_16 = DefineToolParameter(
    Name="element_type",
    Type="string",
    Description="type of element: slab, wall, beam, column, footing",
    Required=Toggle(True))
param_17 = DefineToolParameter(Name="unit_rate", Type="number", Description="cost per unit volume", Required=True)
param_18 = DefineToolParameter(Name="length", Type="number", Description="length of the element", Required=Toggle(True))
param_19 = DefineToolParameter(Name="height", Type="number", Description="height or thickness of the element", Required=Toggle(True))
param_20 = DefineToolParameter(Name="width", Type="number", Description="width of the element", Required=Toggle(True))
param_21 = DefineToolParameter(Name="length", Type="number", Description="The Radius of a Cube", Required=Toggle(True))
merge_4 = Merge(Data1=param_16, Data2=param_18, Data3=param_20, Data4=param_19, Data5=param_17)
merge_5 = Merge(Data1=param_21)
tool_4 = DefineTool(Name="compute_element", Description=panel, Parameters=merge_4)
tool_5 = DefineTool(Name="compute_volume_of_cube", Description=panel_5, Parameters=merge_5)
merge_6 = Merge(Data1=tool_5, Data2=tool_3, Data3=tool_2, Data4=tool, Data5=tool_4)
R = Result(merge_6)
