# Grasshopper definition team_05_working.gh (Grasshopper 1.0.8)
# plug-ins: Swiftlet

# ----
# Connect MCP Tools to Decall and Update All Clusters
button = Button()
# IF SOMETHING IS NOT
# WORKING PRESS THIS
# BUTTON FIRST
toggle = BooleanToggle(True)
connect_mcp_tools_to_decall = CSharpScript(nickname_From="Central MCP Server", nickname_To="Central DeCall", connect=button)  # -> out; inputs nickname_From: String, nickname_To: String, connect: Boolean
# ---------- connect_mcp_tools_to_decall: C# ----------
using System;
using System.Linq;
using Grasshopper;
using Grasshopper.Kernel;

public class Script_Instance : GH_ScriptInstance
{
    private void RunScript(string nickname_From, string nickname_To, bool connect)
    {
        if (!connect) return;
        Console.Write($"Attempting to connect outputs from '{nickname_From}' to '{nickname_To}'...");

        var ghDoc = Instances.ActiveCanvas?.Document;
        if (ghDoc == null) return;

        var compFrom = ghDoc.Objects
            .OfType<IGH_Component>()
            .FirstOrDefault(o => o.NickName == nickname_From);

        var compTo = ghDoc.Objects
            .OfType<IGH_Param>()
            .FirstOrDefault(o => o.NickName == nickname_To);

        if (compFrom != null && compTo != null)
        {
            ghDoc.ScheduleSolution(5, doc => Connect(doc, compFrom, compTo));
        }
    }

    // <Custom additional code> 
    private void Connect(GH_Document doc, IGH_Component compFrom, IGH_Param compTo)
    {
        if (compFrom == null || compTo == null) return;

        foreach (IGH_Param param in compFrom.Params.Output)
        {
            compTo.AddSource(param);
        }
    }
}
# ---------- end connect_mcp_tools_to_decall ----------
update_all_clusters = CSharpScript(update=button, recursive=toggle)  # -> out, A; inputs update: Boolean, recursive: Boolean, passwords: list of String, localPath: String
# ---------- update_all_clusters: C# ----------
using System;
using System.Collections;
using System.Collections.Generic;

using Rhino;
using Rhino.Geometry;

using Grasshopper;
using Grasshopper.Kernel;
using Grasshopper.Kernel.Data;
using Grasshopper.Kernel.Types;
using System.Windows.Forms;
using System.Linq;
/// <summary>
/// This class will be instantiated on demand by the Script component.
/// </summary>
public class Script_Instance : GH_ScriptInstance
{
  /// <summary>Print a String to the [Out] Parameter of the Script component.</summary>
  /// <param name="text">String to print.</param>
  private void Print(string text) { /* Implementation hidden. */ }
  /// <summary>Print a formatted String to the [Out] Parameter of the Script component.</summary>
  /// <param name="format">String format.</param>
  /// <param name="args">Formatting parameters.</param>
  private void Print(string format, params object[] args) { /* Implementation hidden. */ }
  /// <summary>Print useful information about an object instance to the [Out] Parameter of the Script component. </summary>
  /// <param name="obj">Object instance to parse.</param>
  private void Reflect(object obj) { /* Implementation hidden. */ }
  /// <summary>Print the signatures of all the overloads of a specific method to the [Out] Parameter of the Script component. </summary>
  /// <param name="obj">Object instance to parse.</param>
  private void Reflect(object obj, string method_name) { /* Implementation hidden. */ }

  /// <summary>Gets the current Rhino document.</summary>
  private readonly RhinoDoc RhinoDocument;
  /// <summary>Gets the Grasshopper document that owns this script.</summary>
  private readonly GH_Document GrasshopperDocument;
  /// <summary>Gets the Grasshopper script component that owns this script.</summary>
  private readonly IGH_Component Component;
  /// <summary>
  /// Gets the current iteration count. The first call to RunScript() is associated with Iteration==0.
  /// Any subsequent call within the same solution will increment the Iteration count.
  /// </summary>
  private readonly int Iteration;

  /// <summary>
  /// This procedure contains the user code. Input parameters are provided as regular arguments,
  /// Output parameters as ref arguments. You don't have to assign output parameters,
  /// they will have a default value.
  /// </summary>
  private void RunScript(
		bool update,
		bool recursive,
		List<string> passwords,
		string localPath,
		ref object A)
  {

    A = updateLog;
    if (update)
    {
      updateLog = new List<string>();
      _passwords = passwords;
      UpdateClusters(GrasshopperDocument, recursive, localPath);
    }

  }

  // <Custom additional code> 
  List<string> updateLog;
  List<String> _passwords;

  void UpdateClusters (GH_Document ghDoc, bool recursive, string localPath)
  {
    foreach (var obj in ghDoc.Objects)
    {
      var cluster = obj as Grasshopper.Kernel.Special.GH_Cluster;
      if (cluster != null)
      {
        var clusterPath = cluster.FilePath;
        if (!string.IsNullOrEmpty(clusterPath))
        {
          if (cluster.Synchronisation == Grasshopper.Kernel.Special.GH_Synchronisation.OutOfDate)
          {
            cluster.CreateFromFilePath(clusterPath);
            updateLog.Add("Updated: " + clusterPath);
          }
          else if (cluster.Synchronisation == Grasshopper.Kernel.Special.GH_Synchronisation.MissingReference)
          {
            string newPath = ReplacePath(localPath, clusterPath);
            if (!string.IsNullOrEmpty(newPath))
            {
              cluster.CreateFromFilePath(newPath);
              updateLog.Add("Replaced and updated: " + newPath);
            }
            else
            {
              updateLog.Add("Missing reference: " + clusterPath);
            }

          }
        }

        //Update recursively
        if (recursive)
        {
          GH_Document clusterDoc = GetClusterDoc(cluster);
          if (clusterDoc != null)
            UpdateClusters(clusterDoc, recursive, localPath);
        }
      }
    }
  }

  GH_Document GetClusterDoc(Grasshopper.Kernel.Special.GH_Cluster cluster)
  {
    //no pass needed
    var doc = cluster.Document(string.Empty);
    if (doc != null)
      return doc;

    //try passwords
    if (_passwords != null && _passwords.Any())
    {
      foreach (var pass in _passwords)
      {
        doc = cluster.Document(pass);
        if (doc != null)
          return doc;
      }
    }

    return null;
  }

  string ReplacePath(string localPath, string missingPath)
  {
    if (String.IsNullOrEmpty(missingPath) || string.IsNullOrEmpty(localPath))
      return null;
    else
    {
      string lastLocalPart = localPath.Split('\\').Last();
      string[] parts = missingPath.Split('\\');
      if (parts.Contains(lastLocalPart))
      {
        int i = Array.IndexOf(parts, lastLocalPart);
        string clusterPath = String.Join("\\", parts.Skip(i + 1));
        string result = String.Join("\\", localPath, clusterPath);
        return result;
      }
      else
        return null;
    }
  }
  // </Custom additional code> 
}
# ---------- end update_all_clusters ----------
panel = Panel(connect_mcp_tools_to_decall)

team_05_definition_cluster = Team05DefinitionCluster()
c_script = CSharpScript()  # -> out, availablePort
# ---------- c_script: C# ----------
// Grasshopper Script Instance
// This script finds an available port on the local machine.
#region Usings
using System;
using System.Linq;
using System.Collections;
using System.Collections.Generic;
using System.Drawing;
using System.Net;
using System.Net.Sockets;

using Rhino;
using Rhino.Geometry;

using Grasshopper;
using Grasshopper.Kernel;
using Grasshopper.Kernel.Data;
using Grasshopper.Kernel.Types;
#endregion

public class Script_Instance : GH_ScriptInstance
{
    #region Notes
    /* 
      Members:
        RhinoDoc RhinoDocument
        GH_Document GrasshopperDocument
        IGH_Component Component
        int Iteration

      Methods (Virtual & overridable):
        Print(string text)
        Print(string format, params object[] args)
        Reflect(object obj)
        Reflect(object obj, string method_name)
    */
    #endregion

    private void RunScript(object start, object end, ref object availablePort)
    {
        // Use default values if parameters are not provided
        int startPort = (start != null && int.TryParse(start.ToString(), out int s)) ? s : 3001;
        int endPort = (end != null && int.TryParse(end.ToString(), out int e)) ? e : 3100;

        // Find an available port in the specified range
        try
        {
            availablePort = FindAvailablePortInRange(startPort, endPort);
            Print($"Available port found: {availablePort}");
        }
        catch (Exception ex)
        {
            Print($"Error: {ex.Message}");
            availablePort = null;
        }
    }

    /// <summary>
    /// Checks if a local TCP port is available for binding (i.e., not in use).
    /// Returns True if available, False otherwise.
    /// </summary>
    private bool IsPortAvailableForBind(int port)
    {
        try
        {
            // Create a new TCP socket
            using (Socket socket = new Socket(AddressFamily.InterNetwork, SocketType.Stream, ProtocolType.Tcp))
            {
                // Try to bind to the port on all interfaces (0.0.0.0)
                socket.Bind(new IPEndPoint(IPAddress.Any, port));
                // If successful, the socket is closed by the using statement and return True
                return true;
            }
        }
        catch (SocketException)
        {
            // If binding fails, it means the port is already in use
            return false;
        }
    }

    /// <summary>
    /// Finds an available port by letting the OS assign one.
    /// </summary>
    private int FindAvailablePort()
    {
        Socket socket = new Socket(AddressFamily.InterNetwork, SocketType.Stream, ProtocolType.Tcp);
        socket.Bind(new IPEndPoint(IPAddress.Any, 0)); // Bind to an available port assigned by the OS
        int availablePort = ((IPEndPoint)socket.LocalEndPoint).Port; // Get the assigned port number
        socket.Close(); // Close the socket
        return availablePort;
    }

    /// <summary>
    /// Finds the first available port in a given range.
    /// </summary>
    private int FindAvailablePortInRange(int start = 3001, int end = 3100)
    {
        for (int port = start; port <= end; port++)
        {
            if (IsPortAvailableForBind(port))
                return port;
        }
        throw new Exception($"No available ports found in the range {start}-{end}.");
    }
}
# ---------- end c_script ----------
central_mcp_server = MCPServer(Port=c_script.availablePort, Tools=team_05_definition_cluster, ServerName="Swiftlet")  # -> Compute_volume_of_cube, Compute_area_of_element, VolumeBasedCostCalculatorTool, AreaBasedCostCalculatorTool, Count_elements_by_type
panel_2 = Panel(c_script.availablePort)
get_tool_names = CSharpScript(x=team_05_definition_cluster)  # -> flatten(out)
# ---------- get_tool_names: C# ----------
// Grasshopper Script Instance
#region Usings
using System;
using System.Linq;
using System.Collections;
using System.Collections.Generic;
using System.Drawing;

using Rhino;
using Rhino.Geometry;

using Grasshopper;
using Grasshopper.Kernel;
using Grasshopper.Kernel.Data;
using Grasshopper.Kernel.Types;
#endregion

public class Script_Instance : GH_ScriptInstance
{
    #region Notes
    /* 
      Members:
        RhinoDoc RhinoDocument
        GH_Document GrasshopperDocument
        IGH_Component Component
        int Iteration

      Methods (Virtual & overridable):
        Print(string text)
        Print(string format, params object[] args)
        Reflect(object obj)
        Reflect(object obj, string method_name)
    */
    #endregion

    private void RunScript(object x)
    {
        dynamic dynamicX = x;
        Console.Write(dynamicX.Name);
    }
}
# ---------- end get_tool_names ----------
central_decall = Data([central_mcp_server.Compute_volume_of_cube, central_mcp_server.Compute_area_of_element, central_mcp_server.VolumeBasedCostCalculatorTool, central_mcp_server.AreaBasedCostCalculatorTool, central_mcp_server.Count_elements_by_type])
clean = CleanTree(RemoveNulls=True, RemoveInvalid=True, RemoveEmpty=False, Tree=central_decall)
team_05_result_cluster = Team05ResultCluster(tool_call_request=clean)  # -> tool_call_success, tool_names_3

# ----
# Tool Names from the Results Clusters
# Tool Names from the Definition Clusters
# These Two Clusters should be EXACTLY THE SAME
panel_3 = Panel(get_tool_names)
panel_4 = Panel(team_05_result_cluster.tool_names_3)

rec = DataRecorder(team_05_result_cluster.tool_call_success, DataLimit=-10, RecordData=True)
rec_2 = DataRecorder(clean, DataLimit=-10, RecordData=True)

# ---- group: Request Parameters
decall = DeconstructToolCall(Request=clean)  # -> Request, Tool, Arguments
rjo = ReadJSONObject(JObject=decall.Arguments)  # -> Keys, JTokens
# Debug: Check request input data
panel_5 = Panel("room_name")
tmatch = MatchText(Text=rjo.Keys, Pattern=panel_5, Case=True)
tmatch_2 = MatchText(Text=rjo.Keys, Pattern="layout_json", Case=True)
dispatch = Dispatch(List=rjo.JTokens, DispatchPattern=tmatch)  # -> ListA, ListB
dispatch_2 = Dispatch(List=rjo.JTokens, DispatchPattern=tmatch_2)  # -> ListA, ListB
panel_6 = Panel(dispatch.ListA)
panel_7 = Panel(dispatch_2.ListA)

# ----
response_ok = Panel(rec)
called_tool_name = Panel(rec_2)

# ----
# Debug Tool Names
# This Panel should always be TRUE
tool_names_from_the_results_clusters = Data(panel_4)
tool_names_from_the_definition_clusters = Data(panel_3)
join = TextJoin(Text=flatten(tool_names_from_the_definition_clusters))
join_2 = TextJoin(Text=flatten(tool_names_from_the_results_clusters))
tstat = TreeStatistics(Tree=tool_names_from_the_definition_clusters)  # -> Paths, Length, Count
tstat_2 = TreeStatistics(Tree=tool_names_from_the_results_clusters)  # -> Paths, Length, Count
dpath = DeconstructPath(Branch=tstat.Paths)
dpath_2 = DeconstructPath(Branch=tstat_2.Paths)
equals = Equality(FirstNumber=tstat.Length, SecondNumber=tstat_2.Length)  # -> Equality, Inequality
equals_2 = Equality(FirstNumber=tstat.Count, SecondNumber=tstat_2.Count)  # -> Equality, Inequality
ma = MassAddition(Input=flatten(equals.Equality))  # -> Result, PartialResults
equals_3 = Equality(FirstNumber=dpath, SecondNumber=dpath_2)  # -> Equality, Inequality
lng = ListLength(List=equals.Equality)
ma_2 = MassAddition(Input=flatten(equals_3.Inequality))  # -> Result, PartialResults
equals_4 = Equality(FirstNumber=ma.Result, SecondNumber=lng)  # -> Equality, Inequality
does_quantity_of_tools_match = Panel(equals_2.Equality)
equals_5 = Equality(FirstNumber=ma_2.Result, SecondNumber="0")  # -> Equality, Inequality
does_quantity_of_tools_match_per_team = Panel(equals_4.Equality)
are_all_teams_included = Panel(equals_5.Equality)

tmatch_3 = MatchText(Text=join, Pattern=join_2, Case=True)

do_all_names_match = Panel(tmatch_3)
and = GateAnd(A=equals_5.Equality, B=equals_4.Equality, C=equals_2.Equality, D=tmatch_3)  # -> flatten(Result)
do_trees_match = Panel(and)

# ==== cluster Team05DefinitionCluster
panel = Panel("name of any updated element in lauout schema related to volume")
panel_2 = Panel("Full layout schema as a JSON string. Must contain rooms with name, area_m2, and rate_per_m2 fields.")
panel_3 = Panel("Full layout schema as a JSON string. Must contain rooms with name, area_m2, and rate_per_m2 fields.")
panel_4 = Panel("Full layout schema as a JSON string. Must contain rooms with name, area_m2, and rate_per_m2 fields.")
panel_5 = Panel("This tool computes the volume of a cube by giving it a length of a side.  The output unit is the input unit cubed.")
panel_6 = Panel("name of any updated element in lauout schema related to area")

# ----
# COMPUTE AREA OF A ELEMENT
panel_7 = Panel("This tools computes the area of an element")
define_tool_parameter = DefineToolParameter(Name="geometry", Type="object", Description="the geomtry of a object", Required=Toggle(True))
define_tool = DefineTool(Name="compute_area_of_element", Description=panel_7, Parameters=define_tool_parameter)

panel_8 = Panel("Computes the total construction cost of a single room element in the layout schema by multiplying its surface area (m²) by a cost rate per square meter. Used for finishes, cladding, flooring, and other area-dependent assemblies.")
panel_9 = Panel("Computes the total construction cost of a single room element by calculating its volumetric mass and multiplying by a cost rate per cubic meter. Used for bulk materials and volumetric structural elements.")

panel_10 = Panel("This tool counts how many doors and windows of a curtain type are there in a layout ")
param = DefineToolParameter(Name="door_count", Type="number", Description="how many doors are there", Required=Toggle(True))
param_2 = DefineToolParameter(Name="door_type", Type="string", Description="what type the doors is", Required=Toggle(True))
param_3 = DefineToolParameter(Name="window_count", Type="number", Description="how many windows are there", Required=Toggle(True))
param_4 = DefineToolParameter(Name="window_type", Type="string", Description="what type the window is", Required=Toggle(True))
merge = Merge(Data1=param, Data2=param_2, Data3=param_3, Data4=param_4)
tool = DefineTool(Name="count_elements_by_type", Description=panel_10, Parameters=merge)

define_tool_parameter_2 = DefineToolParameter(Name="length", Type="number", Description="The Radius of a Cube", Required=Toggle(True))
define_tool_parameter_3 = DefineToolParameter(Name="element_name", Type="STRING ", Description=panel_2, Required=Toggle(True))
define_tool_parameter_4 = DefineToolParameter(Name="element_name", Type="STRING ", Description=panel, Required=Toggle(True))
define_tool_parameter_5 = DefineToolParameter(Name="layout_schema", Type="STRING ", Description=panel_4, Required=Toggle(True))
define_tool_parameter_6 = DefineToolParameter(
    Name="element_volume",
    Type="float",
    Description="volume of any updated element in lauout schema ",
    Required=Toggle(True))
define_tool_parameter_7 = DefineToolParameter(Name="layout_schema", Type="STRING ", Description=panel_3, Required=Toggle(True))
merge_2 = Merge(Data1=define_tool_parameter_2)
define_tool_parameter_8 = DefineToolParameter(Name="element_area", Type="float", Description=panel_6, Required=Toggle(True))
define_tool_2 = DefineTool(Name="compute_volume_of_cube", Description=panel_5, Parameters=merge_2)
merge_3 = Merge(Data1=define_tool_parameter_8, Data2=define_tool_parameter_3, Data3=define_tool_parameter_5)
define_tool_3 = DefineTool(Name="Area-Based Cost Calculator Tool", Description=panel_8, Parameters=merge_3)
merge_4 = Merge(Data1=define_tool_parameter_6, Data2=define_tool_parameter_4, Data3=define_tool_parameter_7)
define_tool_4 = DefineTool(Name="Volume-Based Cost Calculator Tool", Description=panel_9, Parameters=merge_4)
merge_5 = Merge(Data1=define_tool_2, Data2=define_tool, Data3=define_tool_4, Data4=define_tool_3, Data5=tool)
R = ClusterOutput(merge_5)

# ==== cluster Team05ResultCluster

# ----
# Team 05 Result Cluster
# CUBE TEAM
# Edit Tool Names to
# Match Definition Cluster
tool_names = Panel("""compute_volume_of_cube
compute_area_of_element
Volume-Based Cost Calculator Tool
Area-Based Cost Calculator Tool
count_elements_by_type""")

# ----
# Sorting Logic, Please Do Not Edit
tool_call_request = ClusterInput()
tool_names_2 = Text(tool_names)
decall = DeconstructToolCall(Request=tool_call_request)  # -> Request, Tool, Arguments
mindex = MemberIndex(Set=tool_names, Member=decall.Tool)  # -> Index, Count
sift = SiftPattern(List=decall.Request, SiftPattern=mindex.Index)  # -> Output0, Output1, Output2, Output3, Output4

# ---- group: Cluster Output
tool_names_3 = ClusterOutput(tool_names_2)

# ----
# COMPUTE_VOLUME_OF_CUBE
decall_2 = DeconstructToolCall(Request=sift.Output0)  # -> Request, Tool, Arguments
gjok = GetJSONObjectKey(JObject=decall_2.Arguments, Key="length")
rjv = ReadJSONValue(JValue=gjok)  # -> AsString, AsNumber, AsBool
rectangle = Rectangle(Plane=PlaneXY(0, 0, 0), XSize=rjv.AsNumber, YSize=rjv.AsNumber, Radius=0)  # -> Rectangle, Length
boxrec = BoxRectangle(Rectangle=rectangle.Rectangle, Height=rjv.AsNumber)
volume = Volume(Geometry=boxrec)  # -> Volume, Centroid
panel = Panel(volume.Volume)
cjv = CreateJSONValue(Value=panel)
cjo = CreateJSONObject(Keys="volume", Values=cjv)
respond = MCPToolResponse(Request=decall_2.Request, Content=cjo, IsError=False)

# ----
# area-Based Cost Calculator Tool
decall_3 = DeconstructToolCall(Request=sift.Output3)  # -> Request, Tool, Arguments
gjok_2 = GetJSONObjectKey(JObject=decall_3.Arguments, Key="element_area")
gjok_3 = GetJSONObjectKey(JObject=decall_3.Arguments, Key="element_name")
gjok_4 = GetJSONObjectKey(JObject=decall_3.Arguments, Key="layout_schema")
panel_2 = Panel(gjok_4)
rjv_2 = ReadJSONValue(JValue=gjok_4)  # -> AsString, AsNumber, AsBool
rjv_3 = ReadJSONValue(JValue=gjok_2)  # -> AsString, AsNumber, AsBool

# ---- group: Get the request sent from VSC Agent
decall_4 = DeconstructToolCall(Request=sift.Output4)  # -> Request, Tool, Arguments

# ----
# COMPUTE AREA OF ELEMENT
decall_5 = DeconstructToolCall(Request=sift.Output1)  # -> Request, Tool, Arguments
gjok_5 = GetJSONObjectKey(JObject=decall_5.Arguments, Key="geometry")
jobject = JObject(gjok_5)
bounding_rectangle = BoundingRectangle(Geometry=jobject, Plane=PlaneXY(0, 0, 0), Axis=0, Slide=0, Union=True)  # -> Bounding, DimensionX, DimensionY
boundary_surfaces = BoundarySurfaces(Edges=bounding_rectangle.Bounding)
area = Area(Geometry=boundary_surfaces)  # -> Area, Centroid
area_of_element = Panel(area.Area)
respond_2 = MCPToolResponse(Request=decall_5.Request, Content=area_of_element, IsError=False)

# ----
# Volume-Based Cost Calculator Tool
decall_6 = DeconstructToolCall(Request=sift.Output2)  # -> Request, Tool, Arguments
gjok_6 = GetJSONObjectKey(JObject=decall_6.Arguments, Key="element_volume")
gjok_7 = GetJSONObjectKey(JObject=decall_6.Arguments, Key="element_name")
gjok_8 = GetJSONObjectKey(JObject=decall_6.Arguments, Key="layout_schema")
panel_3 = Panel(gjok_8)
rjv_4 = ReadJSONValue(JValue=gjok_8)  # -> AsString, AsNumber, AsBool
rjv_5 = ReadJSONValue(JValue=gjok_6)  # -> AsString, AsNumber, AsBool

# ----
# COUNT_ELEMENTS_BY_TYPE
panel_4 = Panel("door_type")
gjok_9 = GetJSONObjectKey(JObject=decall_4.Arguments, Key="door_count")
gjok_10 = GetJSONObjectKey(JObject=decall_4.Arguments, Key=panel_4)
gjok_11 = GetJSONObjectKey(JObject=decall_4.Arguments, Key="window_count")
gjok_12 = GetJSONObjectKey(JObject=decall_4.Arguments, Key="window_type")
rjv_6 = ReadJSONValue(JValue=gjok_11)  # -> AsString, AsNumber, AsBool
rjv_7 = ReadJSONValue(JValue=gjok_12)  # -> AsString, AsNumber, AsBool
rjv_8 = ReadJSONValue(JValue=gjok_9)  # -> AsString, AsNumber, AsBool
rjv_9 = ReadJSONValue(JValue=gjok_10)  # -> AsString, AsNumber, AsBool
list_length = ListLength(List=rjv_8.AsNumber)
list_length_2 = ListLength(List=rjv_6.AsNumber)
panel_5 = Panel(list_length)
panel_6 = Panel(list_length_2)
panel_7 = Panel(rjv_7.AsString)
panel_8 = Panel(rjv_9.AsString)
cjv_2 = CreateJSONValue(Value=panel_5)
cjv_3 = CreateJSONValue(Value=panel_8)
cjv_4 = CreateJSONValue(Value=panel_6)
cjv_5 = CreateJSONValue(Value=panel_7)
cjo_2 = CreateJSONObject(Keys="door_count", Values=cjv_2)
cjo_3 = CreateJSONObject(Keys="door_type", Values=cjv_3)
cjo_4 = CreateJSONObject(Keys="window_count", Values=cjv_4)
cjo_5 = CreateJSONObject(Keys="window_type", Values=cjv_5)
merge = Merge(Data1=cjo_2, Data2=cjo_3, Data3=cjo_4, Data4=cjo_5)
respond_3 = MCPToolResponse(Request=decall_4.Request, Content=merge, IsError=False)

rjv_10 = ReadJSONValue(JValue=gjok_3)  # -> AsString, AsNumber, AsBool

panel_9 = Panel(cjo_2)

rjv_11 = ReadJSONValue(JValue=gjok_7)  # -> AsString, AsNumber, AsBool

panel_10 = Panel(rjv_2.AsString)
number_slider = Slider(0, range=0..10)
adding_colors = Python3Script(json_in=rjv_4.AsString, seed=number_slider)  # -> out, json_str; inputs json_in: String
# ---------- adding_colors: Python ----------
"""Embed cost-based colors into priced JSON, with seed-driven palette variation.

INPUT:
    json_in : str   priced JSON as text
    seed    : int   palette seed; 0 or empty = default ramps

OUTPUT:
    json_str : modified JSON as string
"""

import json
import random
import colorsys

DEFAULT_RAMPS = {
    "rooms":   [(0.0, "#FFF5DC"), (0.25, "#FED976"), (0.5, "#FEB24C"),
                (0.75, "#F06913"), (1.0, "#BD0026")],
    "doors":   [(0.0, "#E8CDAA"), (0.5, "#B27A41"), (1.0, "#643719")],
    "windows": [(0.0, "#D2E8F0"), (0.5, "#5AA0CD"), (1.0, "#194B91")],
    "columns": [(0.0, "#C8C8C8"), (0.5, "#828282"), (1.0, "#323232")],
}

RAMP_STOPS = {"rooms": 5, "doors": 3, "windows": 3, "columns": 3}


def hex_to_rgb(h):
    h = h.lstrip("#")
    return [int(h[0:2], 16), int(h[2:4], 16), int(h[4:6], 16)]


def rgb_to_hex(rgb):
    return "#{:02X}{:02X}{:02X}".format(int(rgb[0]), int(rgb[1]), int(rgb[2]))


def lerp(a, b, t):
    return a + (b - a) * t


def build_random_ramp(rng, n_stops):
    """Pick a random hue, build a light-to-dark ramp of that hue."""
    hue = rng.random()
    stops = []
    for i in range(n_stops):
        t = i / float(n_stops - 1)
        s = 0.15 + t * 0.75
        v = 0.97 - t * 0.55
        r, g, b = colorsys.hsv_to_rgb(hue, s, v)
        stops.append((round(t, 4), rgb_to_hex([r * 255, g * 255, b * 255])))
    return stops


def sample_ramp(ramp, t):
    t = max(0.0, min(1.0, t))
    for i in range(len(ramp) - 1):
        t0, h0 = ramp[i]
        t1, h1 = ramp[i + 1]
        if t0 <= t <= t1:
            u = (t - t0) / (t1 - t0) if t1 > t0 else 0.0
            r0, g0, b0 = hex_to_rgb(h0)
            r1, g1, b1 = hex_to_rgb(h1)
            return [int(lerp(r0, r1, u)),
                    int(lerp(g0, g1, u)),
                    int(lerp(b0, b1, u))]
    return hex_to_rgb(ramp[-1][1])


def paint(items, cost_key, ramp):
    """Rank-based mapping per category.
    Distinct costs -> distinct t -> distinct colors.
    Ties in cost share a color. Evenly spreads colors across the ramp."""
    if not items:
        return None, None
    costs = [it.get(cost_key, 0) or 0 for it in items]
    cmin, cmax = min(costs), max(costs)

    unique_sorted = sorted(set(costs))
    n_unique = len(unique_sorted)
    rank_map = {c: i for i, c in enumerate(unique_sorted)}

    for it in items:
        c = it.get(cost_key, 0) or 0
        rank = rank_map[c]
        t = rank / float(n_unique - 1) if n_unique > 1 else 0.5
        rgb = sample_ramp(ramp, t)
        it["heat_t"]    = round(t, 4)
        it["cost_rank"] = rank
        it["color_rgb"] = rgb
        it["color_hex"] = rgb_to_hex(rgb)
    return cmin, cmax


json_str = ""

if json_in:
    data = json.loads(json_in)

    if seed:
        rng = random.Random(seed)
        ramps = {k: build_random_ramp(rng, RAMP_STOPS[k]) for k in DEFAULT_RAMPS}
    else:
        ramps = DEFAULT_RAMPS

    openings = data.get("openings", [])
    doors   = [o for o in openings if o.get("type") == "door"]
    windows = [o for o in openings if o.get("type") == "window"]

    r_min, r_max = paint(data.get("rooms", []),   "total_cost", ramps["rooms"])
    d_min, d_max = paint(doors,                   "cost",       ramps["doors"])
    w_min, w_max = paint(windows,                 "cost",       ramps["windows"])
    k_min, k_max = paint(data.get("columns", []), "cost",       ramps["columns"])

    data["heatmap"] = {
        "ranges": {
            "rooms":   {"min": r_min or 0.0, "max": r_max or 0.0},
            "doors":   {"min": d_min or 0.0, "max": d_max or 0.0},
            "windows": {"min": w_min or 0.0, "max": w_max or 0.0},
            "columns": {"min": k_min or 0.0, "max": k_max or 0.0},
        },
        "ramps": {k: [{"t": t, "hex": h} for t, h in v] for k, v in ramps.items()},
        "seed":  seed if seed else None,
        "notes": "Rank-based per category: each distinct cost gets a distinct ramp position; ties share a color. color_hex / color_rgb / heat_t / cost_rank stored on each room, opening and column."
    }

    json_str = json.dumps(data, indent=2)
# ---------- end adding_colors ----------
adding_colors_2 = Python3Script(json_in=rjv_2.AsString, seed=number_slider)  # -> out, json_str; inputs json_in: String; same code as adding_colors
py3 = Python3Script(json_text_1=adding_colors.json_str, json_text_2=adding_colors_2.json_str)  # -> out, merged, output; inputs json_text_1: String, json_text_2: String
# ---------- py3: Python ----------
"""
GHPython Component: Merge Two JSON Text Inputs with Cost Summation
Drop into Grasshopper as a Python component.

Inputs:
  json_text_1 (str): JSON text string (first source)  - optional
  json_text_2 (str): JSON text string (second source) - optional

Outputs:
  merged (dict): Merged dictionary with summed costs
  output (str): JSON string of merged result

Behavior:
  - Both inputs present  -> merge them, summing costs for matching elements
  - Only one present     -> pass that one through unchanged
  - Neither present      -> return a message
"""

import json

COST_KEYS = ("cost", "price", "total", "amount", "value", "expense")


def parse_json(text, label):
    """Parse a JSON string. Returns (data, error). Empty/None -> (None, None)."""
    if not text or not str(text).strip():
        return None, None
    try:
        return json.loads(text), None
    except Exception as e:
        return None, "Error parsing " + label + ": " + str(e)


def merge_values(val1, val2, key=None):
    """Merge two values, summing only cost-type fields."""
    # Both dicts - recursive merge
    if isinstance(val1, dict) and isinstance(val2, dict):
        merged = val1.copy()
        for k, v in val2.items():
            if k in merged:
                merged[k] = merge_values(merged[k], v, key=k)
            else:
                merged[k] = v
        return merged

    # Both numbers and key is a cost field - sum them
    if isinstance(val1, (int, float)) and isinstance(val2, (int, float)) \
            and key in COST_KEYS:
        return val1 + val2

    # Anything else - second value wins
    return val2


def merge_dicts(data1, data2):
    """Merge two dictionaries with cost summation."""
    result = data1.copy()
    for key, value in data2.items():
        if key in result:
            result[key] = merge_values(result[key], value, key=key)
        else:
            result[key] = value
    return result


# ---- Main execution ----
data1, err1 = parse_json(json_text_1, "json_text_1")
data2, err2 = parse_json(json_text_2, "json_text_2")

if err1:
    merged = None
    output = err1
elif err2:
    merged = None
    output = err2
elif data1 is not None and data2 is not None:
    # Both present - merge
    if isinstance(data1, dict) and isinstance(data2, dict):
        merged = merge_dicts(data1, data2)
        output = json.dumps(merged, indent=2)
    else:
        merged = None
        output = "Both inputs must be JSON objects to merge"
elif data1 is not None:
    # Only first present - pass through
    merged = data1
    output = json.dumps(merged, indent=2)
elif data2 is not None:
    # Only second present - pass through
    merged = data2
    output = json.dumps(merged, indent=2)
else:
    # Neither present
    merged = None
    output = "No input - connect at least one JSON string"
# ---------- end py3 ----------
pjs = ParseJSONString(Text=py3.output)
pjs_2 = ParseJSONString(Text=py3.output)
panel_12 = Panel(pjs_2)
respond_4 = MCPToolResponse(Request=decall_3.Request, Content=pjs, IsError=False)
respond_5 = MCPToolResponse(Request=decall_6.Request, Content=pjs_2, IsError=False)

# ----
# heat map for cost
py3_2 = Python3Script(json_str=py3.output)  # -> out, room_srf, room_col, room_txt, room_pt, door_srf, door_col, door_txt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; inputs json_str: String
# ---------- py3_2: Python ----------
# -*- coding: utf-8 -*-
"""
JSON building plan -> Grasshopper surfaces, colors, labels, anchors.
Input:   json_str (str)  -- paste JSON content as a Panel
Outputs: room_/door_/win_/col_/leg_  *_srf *_col *_txt *_pt
"""
import json
import Rhino.Geometry as rg
import System.Drawing as sd

TOL = 0.001


def hex_to_color(h):
    if not h:
        return sd.Color.Gray
    h = h.lstrip("#")
    return sd.Color.FromArgb(255, int(h[0:2], 16), int(h[2:4], 16), int(h[4:6], 16))


def poly_to_srf(pts, z=0.0):
    p3 = [rg.Point3d(p[0], p[1], z) for p in pts]
    if p3[0].DistanceTo(p3[-1]) > TOL:
        p3.append(p3[0])
    crv = rg.Polyline(p3).ToNurbsCurve()
    breps = rg.Brep.CreatePlanarBreps(crv, TOL)
    return breps[0] if breps else None


def centroid(pts, z=0.05):
    xs = [p[0] for p in pts]
    ys = [p[1] for p in pts]
    return rg.Point3d(sum(xs) / len(xs), sum(ys) / len(ys), z)


def label(name, area, cost, currency):
    return "{}\nA: {} m2\nCost: {} {}".format(name, area, cost, currency)


# ---------- load ----------
if not json_str:
    raise Exception("Connect JSON text to json_str")

data = json.loads(json_str)
currency = data.get("project", {}).get("currency", "")

room_srf, room_col, room_txt, room_pt = [], [], [], []
door_srf, door_col, door_txt, door_pt = [], [], [], []
win_srf,  win_col,  win_txt,  win_pt  = [], [], [], []
col_srf,  col_col,  col_txt,  col_pt  = [], [], [], []
leg_srf,  leg_col,  leg_txt,  leg_pt  = [], [], [], []


# ---------- rooms ----------
for r in data.get("rooms", []):
    s = poly_to_srf(r["polygon"])
    if not s:
        continue
    room_srf.append(s)
    room_col.append(hex_to_color(r.get("color_hex")))
    room_txt.append(label(r.get("name", ""), r.get("area_m2", 0),
                          r.get("total_cost", 0), currency))
    room_pt.append(centroid(r["polygon"]))


# ---------- openings ----------
for o in data.get("openings", []):
    s = poly_to_srf(o["polygon"])
    if not s:
        continue
    color = hex_to_color(o.get("color_hex"))
    name = "{} ({})".format(o.get("id", ""), o.get("subtype", ""))
    txt = label(name, o.get("area_m2", 0), o.get("cost", 0), currency)
    pt = centroid(o["polygon"], 0.1)

    kind = (o.get("type") or "").lower()
    if kind == "door":
        door_srf.append(s); door_col.append(color)
        door_txt.append(txt); door_pt.append(pt)
    elif kind == "window":
        win_srf.append(s); win_col.append(color)
        win_txt.append(txt); win_pt.append(pt)


# ---------- columns ----------
for c in data.get("columns", []):
    s = poly_to_srf(c["polygon"])
    if not s:
        continue
    col_srf.append(s)
    col_col.append(hex_to_color(c.get("color_hex")))
    col_txt.append(label(c.get("id", ""), c.get("area_m2", 0),
                         c.get("cost", 0), currency))
    col_pt.append(centroid(c["polygon"], 0.1))


# ---------- legend ----------
xs, ys = [], []
for grp in ("rooms", "openings", "columns"):
    for it in data.get(grp, []):
        for p in it["polygon"]:
            xs.append(p[0]); ys.append(p[1])

ox = (max(xs) if xs else 0.0) + 3.0
oy = max(ys) if ys else 0.0
cw, ch, gap = 1.2, 0.7, 1.6

ramps  = data.get("heatmap", {}).get("ramps", {})
ranges = data.get("heatmap", {}).get("ranges", {})

for key, title in [("rooms", "Rooms"), ("doors", "Doors"),
                   ("windows", "Windows"), ("columns", "Columns")]:
    ramp = ramps.get(key, [])
    rng  = ranges.get(key, {})
    if not ramp:
        continue

    leg_txt.append("{}  ({:.0f} - {:.0f} {})".format(
        title, rng.get("min", 0), rng.get("max", 0), currency))
    leg_pt.append(rg.Point3d(ox, oy + 0.15, 0))

    for i, stop in enumerate(ramp):
        x0 = ox + i * cw
        y0 = oy - ch
        cell = poly_to_srf([(x0, y0), (x0 + cw, y0),
                            (x0 + cw, y0 + ch), (x0, y0 + ch)])
        if cell:
            leg_srf.append(cell)
            leg_col.append(hex_to_color(stop.get("hex")))

        t = stop.get("t", 0.0)
        v = rng.get("min", 0) + t * (rng.get("max", 0) - rng.get("min", 0))
        leg_txt.append("{:.0f}".format(v))
        leg_pt.append(rg.Point3d(x0 + cw * 0.5, y0 - 0.25, 0))

    oy -= (ch + gap)
# ---------- end py3_2 ----------
preview = CustomPreview(Geometry=py3_2.room_srf, Material=py3_2.room_col)
preview_2 = CustomPreview(Geometry=py3_2.door_srf, Material=py3_2.door_col)
preview_3 = CustomPreview(Geometry=py3_2.win_srf, Material=py3_2.win_col)
preview_4 = CustomPreview(Geometry=py3_2.col_srf, Material=py3_2.col_col)
preview_5 = CustomPreview(Geometry=py3_2.leg_srf, Material=py3_2.leg_col)
Z = UnitZ(Factor=Slider(0.1, range=0..0.1))
extr = Extrude(Base=py3_2.win_srf, Direction=Z)
panel_13 = Panel(py3_2.leg_col)
preview_6 = CustomPreview(Geometry=extr, Material=py3_2.win_col)
panel_14 = Panel(py3_2.room_txt)
Z_2 = UnitZ(Factor=Slider(0.4, range=0..1))
number_slider_2 = Slider(8, range=0..100)
wires = BrepWireframe(Brep=[py3_2.room_srf, py3_2.leg_srf], Density=-1)
move = Move(Geometry=py3_2.room_pt, Motion=Z_2)  # -> Geometry, Transform
text_tag_camera = TextTagCamera(Location=py3_2.leg_pt, Text=py3_2.leg_txt, Size=number_slider_2, Colour=RGB(0, 0, 0))
previewlw = CustomPreviewLineweights(Geometry=wires, Shader=ColourSwatch(SwatchColor=RGB(0, 0, 0)), Absolute=False)
tag = TextTag(Location=move.Geometry, Text=py3_2.room_txt, Colour=ColourSwatch(SwatchColor=RGB(38, 38, 38)))
text_tag_camera_2 = TextTagCamera(Location=move.Geometry, Text=py3_2.room_txt, Size=number_slider_2, Colour=RGB(0, 0, 0))

or = GateOr(A=respond, C=respond_2, D=respond_4, E=respond_5, B=respond_3)
tool_call_success = ClusterOutput(or)
