# Grasshopper definition DaylightAnalysis.gh (Grasshopper 1.0.8)
# plug-ins: Pufferfish

refrence_layout_sample = Text("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")
layout_4 = Text("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")
panel = Panel(layout_4)
l_l6_0_w9_0_de0_dp0_3_wp3_json = Panel("""{
  "layoutId": "L_L6.0_W9.0_de0_dp0.3_wp3",
  "apartment": {
    "id": "apartment-1",
    "name": "Apartment",
    "geometry": [
      [
        0.0,
        2.73
      ],
      [
        0.0,
        0.0
      ],
      [
        1.364,
        0.0
      ],
      [
        2.818,
        0.0
      ],
      [
        6.0,
        0.0
      ],
      [
        6.0,
        4.2
      ],
      [
        6.0,
        8.82
      ],
      [
        0.0,
        8.82
      ],
      [
        0.0,
        5.46
      ],
      [
        0.0,
        2.73
      ]
    ],
    "attributes": {
      "area": 52.92,
      "description": "1 bedroom, 1 bathroom, 1 living room, 2 extra rooms."
    }
  },
  "outline": [
    [
      0.0,
      2.73
    ],
    [
      0.0,
      0.0
    ],
    [
      1.364,
      0.0
    ],
    [
      2.818,
      0.0
    ],
    [
      6.0,
      0.0
    ],
    [
      6.0,
      4.2
    ],
    [
      6.0,
      8.82
    ],
    [
      0.0,
      8.82
    ],
    [
      0.0,
      5.46
    ],
    [
      0.0,
      2.73
    ]
  ],
  "rooms": [
    {
      "id": "room-1",
      "name": "Extra",
      "geometry": [
        [
          0.0,
          2.73
        ],
        [
          0.0,
          0.0
        ],
        [
          1.364,
          0.0
        ],
        [
          1.364,
          2.73
        ],
        [
          0.0,
          2.73
        ]
      ],
      "attributes": {
        "area": 3.7237,
        "program": "extra"
      }
    },
    {
      "id": "room-2",
      "name": "Bath",
      "geometry": [
        [
          1.636,
          2.73
        ],
        [
          1.636,
          5.46
        ],
        [
          0.0,
          5.46
        ],
        [
          0.0,
          2.73
        ],
        [
          1.636,
          2.73
        ]
      ],
      "attributes": {
        "area": 4.4663,
        "program": "bath"
      }
    },
    {
      "id": "room-3",
      "name": "Extra",
      "geometry": [
        [
          1.364,
          2.73
        ],
        [
          1.364,
          0.0
        ],
        [
          2.818,
          0.0
        ],
        [
          2.818,
          4.2
        ],
        [
          1.636,
          4.2
        ],
        [
          1.636,
          2.73
        ],
        [
          1.364,
          2.73
        ]
      ],
      "attributes": {
        "area": 5.707,
        "program": "extra"
      }
    },
    {
      "id": "room-4",
      "name": "Bed",
      "geometry": [
        [
          2.818,
          0.0
        ],
        [
          6.0,
          0.0
        ],
        [
          6.0,
          4.2
        ],
        [
          2.818,
          4.2
        ],
        [
          2.818,
          0.0
        ]
      ],
      "attributes": {
        "area": 13.3644,
        "program": "bed"
      }
    },
    {
      "id": "room-5",
      "name": "Living",
      "geometry": [
        [
          6.0,
          4.2
        ],
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""")
wwr = Slider(0.5, range=0.1..0.9)
py3 = Python3Script(x=wwr)  # -> out, a
# ---------- py3: Python ----------
if x:
    a=x
else:
    a=0.5
# ---------- end py3 ----------
wwr_2 = Data(py3.a)

# ----
# Schema to Geo
extractor = Python3Script(json_str=l_l6_0_w9_0_de0_dp0_3_wp3_json)  # -> out, outline_curve, room_ids, room_names, room_programs, room_curves, door_names, door_points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; disabled
# ---------- extractor: Python ----------
import json
import Rhino.Geometry as rg

def load_json_from_string(json_string):
    try:
        data = json.loads(json_string)
    except Exception as e:
        raise ValueError(f"Invalid JSON string: {e}")
    return data

def create_polyline(points, close=True):
    """Create a Rhino PolylineCurve from 2D points"""
    pts = [rg.Point3d(x, y, 0) for x, y in points]

    if close and pts[0] != pts[-1]:
        pts.append(pts[0])

    return rg.Polyline(pts).ToPolylineCurve()

def create_line(points):
    """Create a Rhino LineCurve from 2 points"""
    if len(points) != 2:
        return None
    p1 = rg.Point3d(points[0][0], points[0][1], 0)
    p2 = rg.Point3d(points[1][0], points[1][1], 0)
    return rg.LineCurve(p1, p2)

def create_point3d(point):
    """Create a Rhino Point3d from coordinates"""
    pt = rg.Point3d(point[0][0], point[0][1], 0)
    return pt


# Load JSON
layout = load_json_from_string(json_str)

# ------------------------
# FACADE (polylines)
# ------------------------
facade_curves = []
for facade in layout.get("facades", []):
    geometry = facade.get("geometry")
    if geometry:
        curve = create_polyline(geometry, close=False)
        facade_curves.append(curve)

# ------------------------
# CIRCULATION (polylines)
# ------------------------
circulation_curves = []
for circulation in layout.get("circulation", []):
    geometry = circulation.get("geometry")
    if geometry:
        curve = create_polyline(geometry, close=True)
        circulation_curves.append(curve)

# ------------------------
# ROOMS (polygons)
# ------------------------
room_ids = []
room_names = []
room_programs = []
room_curves = []

for room in layout.get("rooms", []):
    room_id = room.get("id", "unknown")
    name = room.get("name", "unknown")
    program = room.get("attributes", {}).get("program", "unknown")
    if program == "bedroom":
        program = "bed"
    if program =="bathroom":
        program = "bath"
    geometry = room.get("geometry")

    if room_id and name and program and geometry:
        curve = create_polyline(geometry, close=True)
        room_ids.append(room_id)
        room_names.append(name)
        room_programs.append(program)
        room_curves.append(curve)

# ------------------------
# DOORS (points)
# ------------------------
door_names = []
door_points = []

for door in layout.get("doors", []):
    name = door.get("name")
    geometry = door.get("geometry")

    if name and geometry:
            point = create_point3d(geometry)
            door_names.append(name)
            door_points.append(point)

# ------------------------
# WINDOWS (lines)
# ------------------------
window_names = []
window_curves = []

for window in layout.get("windows", []):
    name = window.get("name")
    geometry = window.get("geometry")

    if name and geometry:
        curve = create_line(geometry)
        if curve:
            window_names.append(name)
            window_curves.append(curve)

# ------------------------
# FURNITURE (polygons)
# ------------------------
furniture_names = []
furniture_curves = []

for furn in layout.get("furniture", []):
    name = furn.get("name")
    geometry = furn.get("geometry")

    if name and geometry:
        curve = create_polyline(geometry, close=True)
        furniture_names.append(name)
        furniture_curves.append(curve)

# ------------------------
# OUTLINE (optional)
# ------------------------
outline_curve = None
if "outline" in layout:
    outline_curve = create_polyline(layout["outline"], close=True)

# ------------------------
# OUTPUTS
# ------------------------
a = room_ids
b = room_names
c = room_programs
d = room_curves

e = door_names
f = door_points

g = window_names
h = window_curves

i = furniture_names
j = furniture_curves

k = outline_curve
l = facade_curves
m = circulation_curves
# ---------- end extractor ----------

room_curves = Data(extractor.room_curves)
room_names = Data(extractor.room_names)
room_ids = Data(extractor.room_ids)

# ----
# Facade edges: from rooms polylines cull pattern based on facade curves
room_curves_2 = Geometry(room_curves)
deconstruct_brep = DeconstructBrep(Brep=room_curves_2)  # -> Faces, Edges, Vertices
facade_curves = Geometry(extractor.facade_curves)
explode = Explode(Curve=facade_curves, Recursive=True)  # -> Segments, Vertices
curve_middle = CurveMiddle(Curve=deconstruct_brep.Edges)  # -> flatten(Midpoint)
pull_point = PullPoint(Point=curve_middle, Geometry=explode.Segments, ClosestOnly=True)  # -> ClosestPoint, Distance, Index
smaller_than = SmallerThan(FirstNumber=pull_point.Distance, SecondNumber="0.01")  # -> SmallerThan, OrEqualTo
cull_pattern = CullPattern(List=flatten(deconstruct_brep.Edges), CullPattern=smaller_than.SmallerThan)

area = Area(Geometry=room_curves)  # -> Area, Centroid
area_2 = Area(Geometry=room_curves)  # -> Area, Centroid
text_tag_3d = TextTag3D(Location=area.Centroid, Text=room_ids, Size=Slider(0.2, range=0..1), Justification=7)
text_tag_3d_2 = TextTag3D(Location=area_2.Centroid, Text=room_names, Size=Slider(0.2, range=0..1), Justification=7)

# ----
# Windows Openings: from facade surface scaled with WWR
floor_height = Panel("3")
unit_z = UnitZ(Factor=floor_height)
extrude = Extrude(Base=cull_pattern, Direction=unit_z)
area_3 = Area(Geometry=extrude)  # -> Area, Centroid
wwr_3 = Data(wwr_2)
scale = Scale(Geometry=extrude, Center=area_3.Centroid, Factor=wwr_3)  # -> Geometry, Transform
panel_2 = Panel(scale.Geometry)
windows_openings = Mesh(scale.Geometry)

# ----
# Rooms from floor surfaces
floor_height_2 = Panel("3")
room_curves_3 = Geometry(room_curves)
Z = UnitZ(Factor=floor_height_2)
extr = Extrude(Base=room_curves_3, Direction=Z)
cap_holes = CapHoles(Brep=extr)

room_ids_2 = Data(room_ids)

# ---- group: Opaque Faces
# OPAQUE FACES
panel_3 = Panel(room_ids_2)
opaque_faces = Geometry(cap_holes)
roomsolid = HBRoomFromSolid(geo=flatten(opaque_faces), name=panel_3, conditioned=True)  # -> report, rooms; plug-in component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

# ---- group: Apertures
# APERTURES
panel_4 = Panel("g_material")
windows_openings_2 = Mesh(windows_openings)
glassmod = HBGlassModifier(name=panel_4, trans="0.55")  # -> modifier; plug-in component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
aperture = HBAperture(geo=windows_openings_2, rad_mod=glassmod)  # -> report, apertures; plug-in component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
addsubface = HBAddSubface(hb_obj=flatten(roomsolid.rooms), sub_faces=flatten(aperture.apertures))  # -> report, hb_obj, unmatched; plug-in component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

# ----
panel_5 = Panel(addsubface.hb_obj)
list_item = ListItem(List=addsubface.hb_obj, Index=Slider(0, range=0..8), Wrap=True)

# ----
# The Sensor Grid changes the input room order
# MODEL & GRIDS
panel_6 = Panel("sample_model_grid")
model = HBModel(rooms=flatten(addsubface.hb_obj), name=panel_6)  # -> report, model; plug-in component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
gridrooms = HBSensorGridFromRooms(rooms=addsubface.hb_obj, grid_size="0.5", dist_floor="0.5", quad_only=Toggle(False))  # -> grid, points, mesh; plug-in component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
vizwiref = HBVisualizeWireframe(hb_objs=flatten(model.model))  # -> geo; plug-in component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
assigngridsviews = HBAssignGridsAndViews(model=model.model, grids=flatten(gridrooms.grid))  # -> model; plug-in component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

vizbytype = HBVisualizeByType(hb_objs=list_item)  # -> walls, interior_walls, roofs, ceilings, exterior_floors, interior_floors, air_walls, apertures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; plug-in component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
geometry = Geometry(vizbytype.walls)
preview = CustomPreview(Geometry=vizwiref, Material=ColourSwatch(SwatchColor=RGB(0, 0, 0)))

panel_7 = Panel(gridrooms.grid)
area_4 = Area(Geometry=gridrooms.mesh)  # -> Area, Centroid

# ----
# Daylight Factor(DF) - Indoors:
# Calculated as
# 
#  (Indoor illuminance/Outdoor illuminance)×100%, under an overcast sky.
# 
# 
# Sky View Factor (SVF) - Outdoors:
# Calculated as the ratio of visible sky area from a point to the entire sky hemisphere, ranging from 0 (no sky visible) to 1 (full sky view).
# DAYLIGHT
# Geometry Preparation
# The order from the Sensor grid is sorted and
# the results are reordered to match the sorted grid
toggle = BooleanToggle(True)

# ----
# RUN RECIPE
daylightfactor = HBDaylightFactor(model=assigngridsviews, run=toggle)  # -> report, results; plug-in component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

tag = TextTag(Location=gridrooms.points, Text=daylightfactor.results)
avr = Average(Input=daylightfactor.results)
bnd = Bounds(Numbers=daylightfactor.results)
roundd = RoundToDecimalPlace(NumberX=avr, DecimalPlace="1", RoundType=0)  # -> flatten(Rounded), Difference

# ----
# Visualize Results
number_slider = Slider(11, range=0..100)
legendpar = LBLegendParameters(min="0", max="15", seg_count=number_slider)  # -> leg_par; plug-in component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
mjoin = MeshJoin(Meshes=gridrooms.mesh)
data = Data(flatten(daylightfactor.results))
heatmap = LBSpatialHeatmap(values=data, mesh=mjoin, legend_par=legendpar, legend_title="%")  # -> mesh, legend, title, colors, legend_par, vis_set; plug-in component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
mesh = Mesh(heatmap.mesh)
data_2 = Data(heatmap.legend)

average_daylight_factor = Panel(bnd)
average_daylight_factor_2 = Panel(roundd.Rounded)

number = Number(flatten(roundd.Rounded))
python_3_script = Python3Script(grid=gridrooms.grid, results=average_daylight_factor_2)  # -> out, sorted_results; inputs grid: list, results: list
# ---------- python_3_script: Python ----------
# Inputs: grid (List Access), results (Tree Access)
# Output: sorted_results

# Get grid names in HB order
hb_names = [str(g) for g in grid]

# Sort names alphabetically/numerically
sorted_names = sorted(hb_names)

# Reorder results to match sorted names
sorted_results = [results[hb_names.index(n)] for n in sorted_names]

print(sorted_results)
# ---------- end python_3_script ----------
text_tag_3d_3 = TextTag3D(Location=area_4.Centroid, Text=number, Size=Slider(0.5, range=0..1), Justification=7)
