# Grasshopper definition planfinder_dataset_adapt.gh (Grasshopper 1.0.8)
# plug-ins: Pufferfish, Human, PlanFinderGH

button = Button()
json_dataset_path_planfinder = Panel("C:\Users\mosmo\OneDrive\Desktop\AIA Studio\AIA26_Studio\team_06\layout_inputs\Planfinder_Dataset")  # disabled
number_slider = Slider(0, range=0..44)  # disabled
trigger = Trigger(Interval=500, TimerInterval=500, Target=counter)  # disabled
python_3_script = Python3Script(folder_path=json_dataset_path_planfinder)  # -> out, items; inputs folder_path: String; disabled
# ---------- python_3_script: Python ----------
import os
files = sorted([
    os.path.join(folder_path, f)
    for f in os.listdir(folder_path)
    if f.endswith(".json")
])
a = files
# ---------- end python_3_script ----------
panel = Panel(python_3_script.items)  # disabled
list_item = ListItem(List=python_3_script.items, Index=number_slider, Wrap=True)  # disabled
# {
#   "layoutId": "L_L9.0_W16.5_de3_dp0.3_wp3",
#   "description": "A generous 135 sqm family apartment with three bedrooms and two bathrooms, designed around a very large open-plan living and kitchen area of 44 sqm. The kitchen is fully integrated into the living space with no dividing wall, so the person cooking is always part of the group — ideal for a parent who wants to prepare meals while supervising children playing, or for someone who loves hosting dinner parties and hates being separated from guests. The three bedrooms vary in size: one large master bedroom of 27 sqm suited to a couple, and two medium bedrooms of around 15 sqm each, perfect for two children or a child and a home office. The two bathrooms prevent morning bottleneck — one can serve the master bedroom, the other the rest of the household. A central corridor connects the private bedroom wing to the shared living zone, creating a clear separation between the quiet sleeping area and the active social spaces. The two facade sides bring natural light into the living area and at least one bedroom. This layout suits a family of three to four people, particularly a couple with one or two children aged school-age or younger, where the parent's visibility over the living area from the kitchen is a daily priority. It also works well for a couple who frequently entertain and need a spare bedroom for guests.",
#   "not_suitable_for": ["work from home", "closed kitchen", "acoustic separation needed", "single person", "studio", "quiet home office"],
#   "area": 135.135,
#   "rooms_summary": "3 bedroom, 2 bathroom, 1 living, 2 extra"
# }
read_file = ReadFile(File=list_item, PerLineParse=False)  # disabled
# {
#   "layoutId": "L_L9.0_W16.5_de3_dp0.3_wp3",
#   "description": "3-bedroom apartment with 1 master suite (en-suite bathroom) and 2 single bedrooms. The 2 single bedrooms can each function independently as a bedroom, home office, hobby room or guest room in any combination. Total area 135 sqm. Kitchen island present — hob is located on the island, sink on the long wall countertop. The person cooking at the island directly faces the dining table and seating area. The wall countertop runs along the 9m width of the room, allowing a continuous cabinet run of up to 9m with potential for full-height storage cabinets and large appliances. No wall separates the kitchen from the dining and seating area — suited to someone who wants to cook while remaining part of a group or supervising children in the same space. Living area furniture arrangement is linear: kitchen — dining — living in one continuous line along the 9m width of the room. A storage room is present adjacent to the kitchen, usable as pantry, general storage or laundry room. The living-kitchen room faces the 9m bottom facade. All three bedrooms face the 15m right facade, each with a full exterior wall. The apartment is double-aspect overall. Master bedroom 27 sqm with en-suite bathroom 9.8 sqm and walk-in wardrobe — open wardrobe area with two facing storage units separated from the sleeping area by a single wall, no closing door. The master suite is positioned at the far end of the apartment from the entry and living area, with the two secondary bedrooms between it and the living zone — this gives the master the greatest acoustic separation and privacy. Access from the master bedroom to the kitchen is via a straight corridor with no intermediate door, a reasonable distance but longer than in a compact layout. Secondary bedroom 1: 15.2 sqm with desk shown in plan. Secondary bedroom 2: 14.7 sqm with desk shown in plan. Both secondary bedrooms are accessed from the central corridor with a closing door, providing acoustic separation from the living area. Each secondary bedroom is large enough to accommodate a bunk bed for two siblings. Possible configurations for the two secondary bedrooms — these are mutually exclusive: (1) two children's bedrooms; (2) one children's bedroom and one home office or hobby room; (3) two home offices or hobby rooms; (4) one or both as guest rooms; (5) one or both as siblings' bunk bed rooms, extending total household capacity to 5 or 6 people. This layout cannot simultaneously provide two separate children's bedrooms and a dedicated home office without using a bunk bed arrangement in one of them. Two bathrooms allow parallel morning routines for a household of three to four, or five to six in a bunk bed configuration. Corridor 14.6 sqm connects all bedrooms to entry and living. Entry area 3.7 sqm provides sufficient space for coat and shoe storage at the entrance. Entry opens directly into the corridor which connects without a door to the living-kitchen area — no door separates the entrance from the kitchen. Suits households that prioritise communal cooking and dining, families with one or two children, couples using secondary rooms flexibly, and people working from home in a dedicated closed room.",
#   "not_suitable_for": ["closed kitchen preference", "studio or single-room living", "household with no use for secondary rooms", "jurisdictions requiring door separation between entry hall and kitchen", "household requiring two separate children's bedrooms AND a dedicated home office simultaneously without bunk bed arrangement"],
#   "area": 135.135,
#   "rooms_summary": "3 bedroom, 2 bathroom, 1 living, 1 storage"
# }
# {
#   "layoutId": "L_L9.0_W16.5_de3_dp0.3_wp3",
#   "description": "1 master suite with en-suite bathroom and walk-in wardrobe, 2 single bedrooms. Walk-in wardrobe is an open area with two facing storage units separated from the sleeping area by a single wall, no closing door. Kitchen island present — hob on island, sink on wall countertop. Cook at the island faces the dining table and seating area directly, suited to someone who cooks while remaining part of a group, entertaining guests, or supervising children in the same space. Wall countertop provides potential for abundant full-height cabinet storage along the full width of the room. Living area arrangement is linear: kitchen — dining — living in one continuous line. Storage room adjacent to kitchen, usable as pantry, laundry room or general storage. Entry area provides space for coat and shoe storage. No door separates the entry from the kitchen — relevant where local regulations require entry-to-kitchen separation. Master suite is positioned at the far end of the apartment from the living area, with secondary bedrooms between it and the living zone, giving the master the greatest acoustic separation and privacy from household activity. Access from master bedroom to kitchen is via a straight corridor with no intermediate door. Both secondary bedrooms have a desk visible in the plan and a closing door to the corridor, providing acoustic separation from the living area for work or sleep. Each secondary bedroom is large enough to accommodate a bunk bed. Possible configurations for the two secondary bedrooms — mutually exclusive: (1) two children's bedrooms; (2) one children's bedroom and one home office or hobby room; (3) two home offices or hobby rooms; (4) one or both as guest rooms; (5) bunk bed arrangement in one or both, extending household capacity to 5 or 6. This layout cannot simultaneously provide two separate children's bedrooms and a dedicated home office unless a bunk bed is used in one bedroom. Bathtub visible in en-suite bathroom. Two bathrooms support parallel morning routines for a household of 3 to 4, or up to 5 to 6 in bunk bed configuration. Suits families with one or two children, couples who entertain regularly, households where at least one person works from home in a dedicated room, and households that prioritise communal cooking and dining.",
#   "not_suitable_for": ["closed kitchen preference", "studio or single-room living", "household requiring two separate children's bedrooms and a dedicated home office simultaneously without bunk bed arrangement", "jurisdictions requiring door separation between entry and kitchen"],
#   "area": 135.135,
#   "rooms_summary": "3 bedroom, 2 bathroom, 1 living, 1 storage"
# }
planfinder_schema_to_geo = Python3Script(json_str=read_file)  # -> out, outline_curve, room_programs, room_curves, circulation_curves, door_names, door_points, a; inputs json_str: String; disabled
# ---------- planfinder_schema_to_geo: Python ----------
import json
import Rhino.Geometry as rg

data = json.loads(json_str)
out = data.get("layoutId", "unknown")

# Boundary
bnd_pts = [rg.Point3d(p[0], p[1], 0) for p in data["boundary"]]
bnd_pts.append(bnd_pts[0])
outline_curve = rg.PolylineCurve(bnd_pts)

# Rooms
room_curves, room_programs, room_names, circulation_curves = [], [], [], []
for room in data.get("rooms", []):
    pts = [rg.Point3d(p[0], p[1], 0) for p in room["geometry"]]
    crv = rg.PolylineCurve(pts)
    prog = room["attributes"].get("program", "").lower()
    room_curves.append(crv)
    room_programs.append(prog)
    room_names.append(room.get("name", ""))
    if prog == "circulation":
        circulation_curves.append(crv)

# Doors
door_points, door_names = [], []
for door in data.get("doors", []):
    g = door["geometry"][0]
    door_points.append(rg.Point3d(g[0], g[1], 0))
    door_names.append(door.get("name", ""))

# Empty outputs to match RPLAN interface
window_curves, window_names = [], []
furniture_curves, furniture_names = [], []
facade_curves = []
# ---------- end planfinder_schema_to_geo ----------
panel_2 = Panel("-5")  # disabled
layout_19_rplan = Text(flatten("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"))  # disabled
# PLANFINDER Schema to Geo
extractor = Python3Script()  # -> out, outline_curve, room_programs, flatten(room_curves), door_names, flatten(door_points), window_names, window_curves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; inputs json_str: String; disabled
# ---------- extractor: Python ----------
import json
import Rhino.Geometry as rg

# ==========================================
# 1. BULLETPROOF JSON PARSING
# ==========================================
layout = {}

if 'json_str' in globals() and json_str:
    try:
        # Check if Grasshopper passed a pre-parsed dictionary
        if type(json_str).__name__ == 'dict':
            layout = json_str
            
        else:
            raw_text = ""
            
            # Check if Grasshopper passed a list of strings (Multiline panel)
            if isinstance(json_str, (list, tuple)):
                raw_text = "".join([str(item) for item in json_str])
            else:
                # Force whatever it is into a standard python string
                raw_text = str(json_str)
            
            # Clean up Grasshopper's invisible formatting characters
            raw_text = raw_text.strip()
            
            # Parse the clean text
            if raw_text:
                layout = json.loads(raw_text)

    except Exception as e:
        print("JSON Parse Error: {}".format(e))
        layout = {} # Fallback so the component doesn't crash
else:
    print("Waiting for JSON input...")


# ==========================================
# 2. GEOMETRY FUNCTIONS
# ==========================================
def create_polyline(points, close=True):
    if not points or not isinstance(points, list): return None
    gh_pts = []
    for p in points:
        if isinstance(p, (list, tuple)) and len(p) >= 2:
            try:
                gh_pts.append(rg.Point3d(float(p[0]), float(p[1]), 0))
            except (ValueError, TypeError): continue
    if len(gh_pts) < 2: return None
    poly = rg.Polyline(gh_pts)
    if close and gh_pts[0].DistanceTo(gh_pts[-1]) > 0.001:
        poly.Add(gh_pts[0])
    return poly.ToPolylineCurve()

def create_point3d(geo_list):
    if not geo_list or not isinstance(geo_list, list) or len(geo_list) == 0: return None
    inner = geo_list[0]
    if isinstance(inner, list) and len(inner) >= 2:
        try: return rg.Point3d(float(inner[0]), float(inner[1]), 0)
        except: return None
    return None


# ==========================================
# 3. DATA EXTRACTION
# ==========================================
# All variables match the output pins on your component perfectly.

outline_curve = create_polyline(layout.get("outline", []), close=True)

room_programs = []
room_curves = []
for room in layout.get("rooms", []):
    room_programs.append(room.get("attributes", {}).get("program", "unknown"))
    room_curves.append(create_polyline(room.get("geometry", []), close=True))

door_names = []
door_points = []
seen_pairs = set()
for door in layout.get("doors", []):
    connected = door.get("attributes", {}).get("connectsRooms", [])
    if len(connected) >= 2:
        pair = tuple(sorted([connected[0], connected[1]]))
        if pair not in seen_pairs:
            seen_pairs.add(pair)
            door_names.append(door.get("name", "Door"))
            door_points.append(create_point3d(door.get("geometry", [])))


window_names = []
window_curves = []
for win in layout.get("windows", []):
    window_names.append(win.get("name", "Window"))
    window_curves.append(create_polyline(win.get("geometry", []), close=False))

furniture_names = []
furniture_curves = []
for fur in layout.get("furniture", []):
    furniture_names.append(fur.get("name", "Furniture"))
    furniture_curves.append(create_polyline(fur.get("geometry", []), close=True))

facade_curves = []
for fac in layout.get("facades", []):
    facade_curves.append(create_polyline(fac.get("geometry", []), close=False))

circulation_curves = []
for circ in layout.get("circulation", []):
    circulation_curves.append(create_polyline(circ.get("geometry", []), close=False))

# Entry door point
entry_pt = None
dp = layout.get("door_point")
if dp and len(dp) >= 2:
    entry_pt = rg.Point3d(float(dp[0]), float(dp[1]), 0)
# ---------- end extractor ----------
panel_3 = Panel(extractor.entry_pt)  # disabled
room_curves = Data(extractor.room_curves)  # disabled
panel_4 = Panel(extractor.room_programs)  # disabled
crv_facade = Curve(simplify(extractor.facade_curves))  # disabled
crv_circulation = Curve(flatten(extractor.circulation_curves))  # disabled
number_slider_2 = Slider(0.05, range=0..1)  # disabled
data = Data(extractor.door_points)  # disabled
bounding_box = BoundingBox(Content=extractor.outline_curve, Plane=PlaneXY(0, 0, 0))  # -> Box, Box_2; disabled
number_slider_3 = Slider(3.61, range=0..100)  # disabled
number_slider_4 = Slider(3.61, range=0..100)  # disabled
data_2 = Data(extractor.entry_pt)  # disabled
box_corners = BoxCorners(Box=bounding_box.Box)  # -> CornerA, CornerB, CornerC, CornerD, CornerE, CornerF, CornerG, CornerH; disabled
python_3_script_2 = Python3Script(curves=room_curves, tol=number_slider_2)  # -> flatten(a); inputs curves: list of Curve, tol: Double; disabled
# ---------- python_3_script_2: Python ----------
import Rhino.Geometry as rg

TOL = float(tol) if tol is not None else 0.05

# Gather vertex lists from each polyline
poly_pts = []
for crv in curves:
    if crv is None:
        poly_pts.append([])
        continue
    ok, pl = crv.TryGetPolyline()
    if ok and pl.Count > 0:
        poly_pts.append(list(pl))
    else:
        nc = crv.ToNurbsCurve()
        poly_pts.append([nc.Points[i].Location for i in range(nc.Points.Count)])

# For each vertex, snap to nearest vertex from a DIFFERENT polyline within tol
snapped = [[pt for pt in verts] for verts in poly_pts]
for ci in range(len(poly_pts)):
    for vi in range(len(poly_pts[ci])):
        pt = poly_pts[ci][vi]
        for cj in range(len(poly_pts)):
            if cj == ci:
                continue
            for vj in range(len(poly_pts[cj])):
                if pt.DistanceTo(poly_pts[cj][vj]) < TOL:
                    snapped[ci][vi] = poly_pts[cj][vj]
                    break

# Rebuild as NurbsCurves
a = []
for verts in snapped:
    if not verts:
        a.append(None)
        continue
    pl = rg.Polyline(verts)
    a.append(pl.ToNurbsCurve())
# ---------- end python_3_script_2 ----------
polyline = PolyLine(Vertices=[box_corners.CornerA, box_corners.CornerB, box_corners.CornerC, box_corners.CornerD], Closed=True)  # disabled
extractor_2 = Python3Script()  # -> out, outline_curve, room_programs, room_curves, door_names, door_points, window_names, window_curves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; inputs json_str: String; disabled
# ---------- extractor_2: Python ----------
import json
import Rhino.Geometry as rg

# ==========================================
# 1. BULLETPROOF JSON PARSING
# ==========================================
layout = {}

if 'json_str' in globals() and json_str:
    try:
        # Check if Grasshopper passed a pre-parsed dictionary
        if type(json_str).__name__ == 'dict':
            layout = json_str
            
        else:
            raw_text = ""
            
            # Check if Grasshopper passed a list of strings (Multiline panel)
            if isinstance(json_str, (list, tuple)):
                raw_text = "".join([str(item) for item in json_str])
            else:
                # Force whatever it is into a standard python string
                raw_text = str(json_str)
            
            # Clean up Grasshopper's invisible formatting characters
            raw_text = raw_text.strip()
            
            # Parse the clean text
            if raw_text:
                layout = json.loads(raw_text)

    except Exception as e:
        print("JSON Parse Error: {}".format(e))
        layout = {} # Fallback so the component doesn't crash
else:
    print("Waiting for JSON input...")


# ==========================================
# 2. GEOMETRY FUNCTIONS
# ==========================================
def create_polyline(points, close=True):
    if not points or not isinstance(points, list): return None
    gh_pts = []
    for p in points:
        if isinstance(p, (list, tuple)) and len(p) >= 2:
            try:
                gh_pts.append(rg.Point3d(float(p[0]), float(p[1]), 0))
            except (ValueError, TypeError): continue
    if len(gh_pts) < 2: return None
    poly = rg.Polyline(gh_pts)
    if close and gh_pts[0].DistanceTo(gh_pts[-1]) > 0.001:
        poly.Add(gh_pts[0])
    return poly.ToPolylineCurve()

def create_point3d(geo_list):
    if not geo_list or not isinstance(geo_list, list) or len(geo_list) == 0: return None
    inner = geo_list[0]
    if isinstance(inner, list) and len(inner) >= 2:
        try: return rg.Point3d(float(inner[0]), float(inner[1]), 0)
        except: return None
    return None


# ==========================================
# 3. DATA EXTRACTION
# ==========================================
# All variables match the output pins on your component perfectly.

outline_curve = create_polyline(layout.get("outline", []), close=True)

room_programs = []
room_curves = []
for room in layout.get("rooms", []):
    room_programs.append(room.get("attributes", {}).get("program", "unknown"))
    room_curves.append(create_polyline(room.get("geometry", []), close=True))

door_names = []
door_points = []
for door in layout.get("doors", []):
    door_names.append(door.get("name", "Door"))
    door_points.append(create_point3d(door.get("geometry", [])))

window_names = []
window_curves = []
for win in layout.get("windows", []):
    window_names.append(win.get("name", "Window"))
    window_curves.append(create_polyline(win.get("geometry", []), close=False))

furniture_names = []
furniture_curves = []
for fur in layout.get("furniture", []):
    furniture_names.append(fur.get("name", "Furniture"))
    furniture_curves.append(create_polyline(fur.get("geometry", []), close=True))

facade_curves = []
for fac in layout.get("facades", []):
    facade_curves.append(create_polyline(fac.get("geometry", []), close=False))

circulation_curves = []
for circ in layout.get("circulation", []):
    circulation_curves.append(create_polyline(circ.get("geometry", []), close=False))
# ---------- end extractor_2 ----------
custom_preview_lineweights = CustomPreviewLineweights(
    Geometry=crv_circulation,
    Shader={diffuse=RGB(253, 0, 210), emission=RGB(76, 0, 63), shine=0.5, specular=RGB(255, 255, 255), transparency=0},
    Thickness=number_slider_3,
    Absolute=False)  # disabled
custom_preview_lineweights_2 = CustomPreviewLineweights(
    Geometry=crv_facade,
    Shader={diffuse=RGB(103, 188, 255), emission=RGB(31, 56, 76), shine=0.5, specular=RGB(255, 255, 255), transparency=0},
    Thickness=number_slider_4,
    Absolute=False)  # disabled
crv_bounds = Curve(graft(polyline))  # disabled
# Target Layout
crv_apt_units = Curve(simplify(graft(crv_bounds)))  # disabled
crv_bounds_2 = Curve(crv_apt_units)  # disabled
flip = FlipCurve(Curve=crv_bounds_2)  # -> Curve, Flag; disabled
c_intersection = CSharpScript(
    crvA=crv_facade,
    crvB=crv_bounds,
    Reference=["C:\USERS\GIOFO\DESKTOP\ARCHIVIO\MASTERS\MACAD\2_MACAD\0_MACAD DRIVE\AIA\STUDIO\HYPERGRAPH_G06-AIA-STUDIO\DLLS\LIB\MathNet.Numerics.dll", "C:\USERS\GIOFO\DESKTOP\ARCHIVIO\MASTERS\MACAD\2_MACAD\0_MACAD DRIVE\AIA\STUDIO\HYPERGRAPH_G06-AIA-STUDIO\DLLS\LIB\RGeoLib.dll", "C:\USERS\GIOFO\DESKTOP\ARCHIVIO\MASTERS\MACAD\2_MACAD\0_MACAD DRIVE\AIA\STUDIO\HYPERGRAPH_G06-AIA-STUDIO\DLLS\LIB\DelaunatorSharp.dll", "C:\USERS\GIOFO\DESKTOP\ARCHIVIO\MASTERS\MACAD\2_MACAD\0_MACAD DRIVE\AIA\STUDIO\HYPERGRAPH_G06-AIA-STUDIO\DLLS\LIB\Clipper2Lib.dll"])  # -> out, simplify(A), B; inputs crvA: list of Polyline, crvB: list of Polyline; disabled
# ---------- c_intersection: C# usings ----------
using System.Linq;
using RGeoLib;
# ---------- c_intersection: C# ----------
    List<NLine> linesREF = RhConvert.RhPolylineListToNLineList(crvA);

    List<NLine> linesA = RhConvert.RhPolylineListToNLineList(crvA);
    List<NLine> linesB = RhConvert.RhPolylineListToNLineList(crvB);

    List<NLine> linesC = RIntersection.lineListBooleanIntersectionTol(linesB, linesA, 0.01);

    // conform lines to face
    List<Vec3d> vecOut = new List<Vec3d>();
    for (int i = 0;i < linesC.Count;i++)
    {
      // get closest line in list of lines
      List<NLine> SortedList = linesREF.OrderBy(o => Vec3d.Distance(o.MidPoint, linesC[i].MidPoint)).ToList();
      vecOut.Add(SortedList[0].MidPoint);
      double dotProd = Vec3d.DotProduct(linesC[i].Direction, SortedList[0].Direction);
      if (dotProd <= 0.005)
      {
        linesC[i].FlipLine();
      }
    }


    A = RhConvert.NLineListToRhLineCurveList(linesC);
    B = RhConvert.Vec3dListToRhPoint3dList(vecOut);
# ---------- end c_intersection ----------
crv_facade_2 = Curve(c_intersection.A)  # disabled
join = JoinCurves(Curves=crv_facade_2, Preserve=False)  # disabled
simplify = SimplifyCurve(Curve=join)  # -> Curve, Simplified; disabled
c_intersection_2 = CSharpScript(
    crvA=crv_bounds,
    crvB=crv_circulation,
    Reference=["C:\USERS\GIOFO\DESKTOP\ARCHIVIO\MASTERS\MACAD\2_MACAD\0_MACAD DRIVE\AIA\STUDIO\HYPERGRAPH_G06-AIA-STUDIO\DLLS\LIB\MathNet.Numerics.dll", "C:\USERS\GIOFO\DESKTOP\ARCHIVIO\MASTERS\MACAD\2_MACAD\0_MACAD DRIVE\AIA\STUDIO\HYPERGRAPH_G06-AIA-STUDIO\DLLS\LIB\RGeoLib.dll", "C:\USERS\GIOFO\DESKTOP\ARCHIVIO\MASTERS\MACAD\2_MACAD\0_MACAD DRIVE\AIA\STUDIO\HYPERGRAPH_G06-AIA-STUDIO\DLLS\LIB\DelaunatorSharp.dll", "C:\USERS\GIOFO\DESKTOP\ARCHIVIO\MASTERS\MACAD\2_MACAD\0_MACAD DRIVE\AIA\STUDIO\HYPERGRAPH_G06-AIA-STUDIO\DLLS\LIB\Clipper2Lib.dll"])  # -> out, simplify(A), B; inputs crvA: list of Polyline, crvB: list of Polyline; disabled
# ---------- c_intersection_2: C# ----------
    List<NLine> linesREF = RhConvert.RhPolylineListToNLineList(crvA);

    List<NLine> linesA = RhConvert.RhPolylineListToNLineList(crvA);
    List<NLine> linesB = RhConvert.RhPolylineListToNLineList(crvB);

    List<NLine> linesC = RIntersection.lineListBooleanIntersectionTol(linesB, linesA, 0.01);

    // conform lines to face
    List<Vec3d> vecOut = new List<Vec3d>();
    for (int i = 0;i < linesC.Count;i++)
    {
      // get closest line in list of lines
      List<NLine> SortedList = linesREF.OrderBy(o => Vec3d.Distance(o.MidPoint, linesC[i].MidPoint)).ToList();
      vecOut.Add(SortedList[0].MidPoint);
      double dotProd = Vec3d.DotProduct(linesC[i].Direction, SortedList[0].Direction);
      if (dotProd <= 0.005)
      {
        linesC[i].FlipLine();
      }
    }

    List<NLine> outLines = new List<NLine>();
    
    for (int i = 0; i < linesC.Count; i++)
    {
      if (linesC[i].Length > 0.8)
      {
        outLines.Add(linesC[i]);
      }
    }
    
    //A = RhConvert.NLineListToRhLineCurveList(linesC);
    A = RhConvert.NLineListToRhLineCurveList(outLines);

    B = RhConvert.Vec3dListToRhPoint3dList(vecOut);
# ---------- end c_intersection_2 ----------
crv_circulation_2 = Curve(c_intersection_2.A)  # disabled
join_2 = JoinCurves(Curves=crv_circulation_2, Preserve=False)  # disabled
simplify_2 = SimplifyCurve(Curve=join_2)  # -> Curve, Simplified; disabled

explode = Explode(Curve=simplify_2.Curve, Recursive=True)  # -> Segments, Vertices; disabled
explode_2 = Explode(Curve=simplify.Curve, Recursive=True)  # -> flatten(Segments), Vertices; disabled
simplify_outline = SimplifyCurve(Curve=crv_bounds_2)  # -> Curve, Simplified; disabled

# ----
# Reference Layout
# WITH TIMER
c_script = CSharpScript(
    crv=python_3_script_2,
    u=extractor.room_programs,
    ptCirc=extractor.door_points,
    crvBounds=simplify_outline.Curve,
    crvFacade=explode_2.Segments,
    crvCirc=explode.Segments,
    Reference=["C:\USERS\GIOFO\DESKTOP\ARCHIVIO\MASTERS\MACAD\2_MACAD\0_MACAD DRIVE\AIA\STUDIO\hypergraph_G06-AIA-studio\dlls\lib\MathNet.Numerics.dll", "C:\USERS\GIOFO\DESKTOP\ARCHIVIO\MASTERS\MACAD\2_MACAD\0_MACAD DRIVE\AIA\STUDIO\hypergraph_G06-AIA-studio\dlls\lib\RGeoLib.dll", "C:\USERS\GIOFO\DESKTOP\ARCHIVIO\MASTERS\MACAD\2_MACAD\0_MACAD DRIVE\AIA\STUDIO\hypergraph_G06-AIA-studio\dlls\lib\Microsoft.Bcl.AsyncInterfaces.dll", "C:\USERS\GIOFO\DESKTOP\ARCHIVIO\MASTERS\MACAD\2_MACAD\0_MACAD DRIVE\AIA\STUDIO\hypergraph_G06-AIA-studio\dlls\lib\System.Buffers.dll", "C:\USERS\GIOFO\DESKTOP\ARCHIVIO\MASTERS\MACAD\2_MACAD\0_MACAD DRIVE\AIA\STUDIO\hypergraph_G06-AIA-studio\dlls\lib\System.Memory.dll", "C:\USERS\GIOFO\DESKTOP\ARCHIVIO\MASTERS\MACAD\2_MACAD\0_MACAD DRIVE\AIA\STUDIO\hypergraph_G06-AIA-studio\dlls\lib\System.Numerics.Vectors.dll", "C:\USERS\GIOFO\DESKTOP\ARCHIVIO\MASTERS\MACAD\2_MACAD\0_MACAD DRIVE\AIA\STUDIO\hypergraph_G06-AIA-studio\dlls\lib\System.Runtime.CompilerServices.Unsafe.dll", "C:\USERS\GIOFO\DESKTOP\ARCHIVIO\MASTERS\MACAD\2_MACAD\0_MACAD DRIVE\AIA\STUDIO\hypergraph_G06-AIA-studio\dlls\lib\System.Text.Encodings.Web.dll", "C:\USERS\GIOFO\DESKTOP\ARCHIVIO\MASTERS\MACAD\2_MACAD\0_MACAD DRIVE\AIA\STUDIO\hypergraph_G06-AIA-studio\dlls\lib\System.Text.Json.dll", "C:\USERS\GIOFO\DESKTOP\ARCHIVIO\MASTERS\MACAD\2_MACAD\0_MACAD DRIVE\AIA\STUDIO\hypergraph_G06-AIA-studio\dlls\lib\System.Threading.Tasks.Extensions.dll", "C:\USERS\GIOFO\DESKTOP\ARCHIVIO\MASTERS\MACAD\2_MACAD\0_MACAD DRIVE\AIA\STUDIO\hypergraph_G06-AIA-studio\dlls\lib\System.ValueTuple.dll"])  # -> out, splitGraphJson, boundsJson, facadeJson, circulationJson, apt; inputs database: String, country: String, city: String, name: String, crv: list of Polyline, u: list of String, ptCirc: list of Point3d, crvBounds: Polyline, crvFacade: list of Polyline, crvCirc: list of Polyline, id: String; disabled
# ---------- c_script: C# ----------
    // IMPORT
    List<Vec3d> inputPt = RhConvert.RhPointListToVec3dList(ptCirc);
    NFace bounds = RhConvert.RhPolylineToNFace(crvBounds);
    List<NLine> facade = RhConvert.RhPolylineListToNLineList(crvFacade);
    List<NLine> circulation = RhConvert.RhPolylineListToNLineList(crvCirc);

    // CONVERT
    NMesh inputMesh = RhConvert.RhPolylineListToNMeshWithNames(crv, u);
    DataNode rootNode = DataNode.dataNodeFromNMeshAndBoundsWithConnectivity(inputMesh, bounds, inputPt);

    // JSON
    splitGraphJson = DataNode.serializeDataNode(rootNode);
    boundsJson = NFace.serializeNFace(bounds);
    facadeJson = NLine.serializeNLineList(facade);
    circulationJson = NLine.serializeNLineList(circulation);

    string jsonBounds = NFace.serializeNFace(bounds);
    string jsonFacade = NLine.serializeNLineList(facade);
    string jsonCirculation = NLine.serializeNLineList(circulation);
    string jsonSplit = DataNode.serializeDataNode(rootNode);


    Apartment newApartment = new Apartment(jsonBounds, jsonFacade, jsonCirculation, jsonSplit);
    newApartment.id = id;
    newApartment.database = database;
    newApartment.country = country;
    newApartment.city = city;
    newApartment.name = name;

    apt = newApartment;
# ---------- end c_script ----------

# ----
# Connect above to test layout adaption on its own boundary
target_boundary = Curve(simplify_outline.Curve)  # disabled
target_circulation = Curve(simplify(explode.Segments))  # disabled
target_facades = Curve(simplify(flatten(explode_2.Segments)))  # disabled
reference_layout = Data(flatten(c_script.apt))  # disabled

panel_5 = Panel(target_facades)  # disabled
panel_6 = Panel(c_script.out)  # disabled
panel_7 = Panel(c_script.apt)  # disabled

target_boundary_2 = Curve(target_boundary)  # disabled

path = FilePath("D:\Marina\MaCAD 2025\3 SEMESTER\STUDIO\planfinder dataset\planfinder_blacklist.txt")  # disabled
py3 = Python3Script()  # -> out, a
# ---------- py3: Python ----------
"""Classify live furniture by nearest-neighbour against the catalog and write it into
the apartment JSON (full element schema, ready for LLM search).

Two ways to use:
  * In Grasshopper: paste the CONFIG + helper functions, then the `=== GHPYTHON INPUTS ===`
    block, wiring the live feature lists + outlines + paths to component inputs.
  * Locally / test: `python classify_and_export_gh.py` runs a self-check on
    apartment_sample.json with a few mock pieces and prints the resulting furniture.

The NN logic (normalize by catalog min/max, then Euclidean) is the same as the user's
original classifier, just pointed at the rebuilt catalog (current feature convention).
"""

import json
import math
import os

# HERE = os.path.dirname(os.path.abspath(__file__))
# CATALOG_JSON = os.path.join(HERE, "furniture_catalog.json")
CATALOG_JSON = r"C:\Users\giofo\Desktop\ARCHIVIO\MASTERS\MACAD\2_MACAD\0_MACAD DRIVE\AIA\STUDIO\AIA26_Studio\team_06\gh\furniture_catalog.json"
NUM_FEATURES = 8


# ---------------------------------------------------------------------------
# Catalog + nearest-neighbour classifier
# ---------------------------------------------------------------------------
def load_catalog(path=CATALOG_JSON):
    data = json.load(open(path, "r", encoding="utf-8"))
    names = [t["name"] for t in data["types"]]
    anchors = [t["anchor"] for t in data["types"]]
    typ = {t["name"]: t.get("typology", "furniture") for t in data["types"]}
    mn = [min(a[i] for a in anchors) for i in range(NUM_FEATURES)]
    mx = [max(a[i] for a in anchors) for i in range(NUM_FEATURES)]
    rng = [mx[i] - mn[i] for i in range(NUM_FEATURES)]
    norm_anchors = [_normalize(a, mn, rng) for a in anchors]
    return {"names": names, "norm": norm_anchors, "typ": typ, "mn": mn, "rng": rng}


def _normalize(v, mn, rng):
    return [((v[i] - mn[i]) / rng[i]) if rng[i] else 0.0 for i in range(NUM_FEATURES)]


def classify(feat, cat):
    """feat = [Area, BB_short, BB_long, Prop, Verts, Geoms, Exp_edge, Closed]."""
    q = _normalize([float(x) for x in feat], cat["mn"], cat["rng"])
    best_d, best = float("inf"), "Unknown"
    for name, a in zip(cat["names"], cat["norm"]):
        d = math.sqrt(sum((l - r) ** 2 for l, r in zip(q, a)))
        if d < best_d:
            best_d, best = d, name
    return best, best_d


# ---------------------------------------------------------------------------
# Geometry helpers (room assignment + outline metrics)
# ---------------------------------------------------------------------------
def centroid(outline):
    xs = [p[0] for p in outline]
    ys = [p[1] for p in outline]
    return [sum(xs) / len(xs), sum(ys) / len(ys)]


def point_in_poly(pt, poly):
    x, y = pt
    inside = False
    n = len(poly)
    j = n - 1
    for i in range(n):
        xi, yi = poly[i]
        xj, yj = poly[j]
        if ((yi > y) != (yj > y)) and (x < (xj - xi) * (y - yi) / (yj - yi + 1e-12) + xi):
            inside = not inside
        j = i
    return inside


def assign_room(c, rooms):
    for r in rooms:
        if point_in_poly(c, r["geometry"]):
            return r["id"], r.get("name", "")
    return None, ""


def poly_area(outline):
    s = 0.0
    n = len(outline)
    for i in range(n - 1):
        s += outline[i][0] * outline[i + 1][1] - outline[i + 1][0] * outline[i][1]
    return abs(s) / 2.0


# ---------------------------------------------------------------------------
# Build furniture entries + write apartment JSON
# ---------------------------------------------------------------------------
def build_entry(i, name, typ, outline, rooms):
    c = centroid(outline)
    room_id, _ = assign_room(c, rooms)
    return {
        "id": "furniture-%d" % (i + 1),
        "name": name,
        "geometry": [[round(p[0], 4), round(p[1], 4)] for p in outline],
        "attributes": {
            "typology": typ,
            "room": room_id,
            "area": round(poly_area(outline), 4),
            "centroid": [round(c[0], 4), round(c[1], 4)],
        },
    }


def classify_and_export(features, outlines, apartment_path, out_path=None, cat=None):
    """features: list of 8-length live feature vectors; outlines: list of [[x,y],...]."""
    cat = cat or load_catalog()
    apt = json.load(open(apartment_path, "r", encoding="utf-8"))
    rooms = apt.get("rooms", [])
    furniture = []
    for i, (feat, outline) in enumerate(zip(features, outlines)):
        name, _ = classify(feat, cat)
        furniture.append(build_entry(i, name, cat["typ"].get(name, "furniture"),
                                     outline, rooms))
    apt["furniture"] = furniture
    if out_path:
        json.dump(apt, open(out_path, "w", encoding="utf-8"), indent=2)
    return apt


# ---------------------------------------------------------------------------
# === GHPYTHON INPUTS (uncomment & wire in Grasshopper) ======================
# ---------------------------------------------------------------------------
 Inputs (component params):
   Areas, BB_short_dim, BB_long_dim, Props, Verts, Geoms, Exp_edge_count, Closed_curves
       -> parallel lists, one value per live furniture piece
   outlines -> a DataTree: one branch per piece, each a list of (x,y) points
   apartment_path, out_path -> file paths; run -> Boolean

 if run:
     cat = load_catalog()  # uses furniture_catalog.json next to this file
     feats = [[float(Areas[i]), float(BB_short_dim[i]), float(BB_long_dim[i]),
               float(Props[i]), float(Verts[i]), float(Geoms[i]),
               float(Exp_edge_count[i]), float(Closed_curves[i])]
              for i in range(len(Areas))]
     outs = [[[pt.X, pt.Y] for pt in outlines.Branch(b)]
             for b in range(outlines.BranchCount)]
     apt = classify_and_export(feats, outs, apartment_path, out_path, cat)
     names = [f["name"] for f in apt["furniture"]]   # -> component output


# ---------------------------------------------------------------------------
# Local self-test
# ---------------------------------------------------------------------------
def _selftest():
    cat = load_catalog()
    # mock live pieces: a double bed in the bedroom, a toilet in the bath, a sofa in living.
    # features use the catalog anchors so the NN is exercised end-to-end.
    name_to_anchor = {t["name"]: t["anchor"]
                      for t in json.load(open(CATALOG_JSON))["types"]}
    def rect(cx, cy, w, h):
        return [[cx - w / 2, cy - h / 2], [cx + w / 2, cy - h / 2],
                [cx + w / 2, cy + h / 2], [cx - w / 2, cy + h / 2],
                [cx - w / 2, cy - h / 2]]
    pieces = [
        (name_to_anchor.get("BedDouble"), rect(7.4, 2.2, 2.0, 2.6)),       # room-3 Bed
        (name_to_anchor.get("Toilet"), rect(3.2, 0.5, 0.35, 0.57)),        # room-2 Bath
        (name_to_anchor.get("SofaCorner"), rect(2.5, 3.5, 1.4, 2.0)),      # room-4 Living
    ]
    feats = [p[0] for p in pieces]
    outs = [p[1] for p in pieces]
    out_path = os.path.join(HERE, "apartment_sample.furnished.json")
    apt = classify_and_export(feats, outs, os.path.join(HERE, "apartment_sample.json"),
                              out_path, cat)
    print("Classified furniture written to apartment.furniture:")
    for f in apt["furniture"]:
        print("  %-14s %-18s room=%s area=%.2f centroid=%s"
              % (f["id"], f["name"], f["attributes"]["room"],
                 f["attributes"]["area"], f["attributes"]["centroid"]))
    print("\nSaved:", out_path)


if __name__ == "__main__":
    _selftest()
# ---------- end py3 ----------
py3_2 = Python3Script()  # -> out, risultato_match; inputs Areas: list, BB_short_dim: list, BB_long_dim: list, Props: list, Verts: list, Geoms: list, Exp_edge_count: list, Closed_curves: list; disabled
# ---------- py3_2: Python ----------
import math

# =====================================================================
# CONFIGURAZIONE CATALOGO (47 Asset estratti correttamente)
# =====================================================================
CATALOG = {
    "PF_Chair_2D": [0.6000000000000006, -0.8000000000000012, -0.7499999999999998, 0.9374999999999983, 5.0, 2.0, 7.0, 1.0],
    "PF_SofaSmall_2D": [1.2800000000000002, -1.6000000000000005, -0.7999999999999998, 0.4999999999999997, 5.0, 5.0, 8.0, 1.0],
    "PF_SofaLarge_2D": [1.5999999999999996, -2.0, -0.7999999999999998, 0.3999999999999999, 5.0, 6.0, 9.0, 1.0],
    "PF_CoffeeSmall_2D": [0.5, -1.0, -0.5, 0.5, 5.0, 1.0, 4.0, 1.0],
    "PF_CoffeeLarge_2D": [1.3999999999999986, -1.3999999999999986, -1.0, 0.714285714285715, 5.0, 1.0, 4.0, 1.0],
    "PF_TV_2D": [0.34999999999999964, -1.3999999999999986, -0.25, 0.17857142857142874, 5.0, 2.0, 8.0, 2.0],
    "PF_DiningTwo_2D": [0.8649999999999975, -1.2999999999999972, -0.7999999999999998, 0.6153846153846166, 13.0, 3.0, 14.0, 1.0],
    "PF_DiningFour_2D": [1.6499999999999961, -1.5, -1.2999999999999972, 0.8666666666666648, 21.0, 3.0, 22.0, 1.0],
    "PF_DiningSix_2D": [2.199999999999994, -1.9999999999999996, -1.3000000000000256, 0.6500000000000129, 29.0, 3.0, 30.0, 1.0],
    "PF_Study_2D": [0.779999999999998, -1.2999999999999972, -0.5999999999999999, 0.46153846153846245, 5.0, 5.0, 14.0, 3.0],
    "PF_Bed_2D": [3.9200000000000017, -2.6000000000000014, -2.0, 0.7692307692307688, 11.0, 9.0, 23.0, 1.0],
    "PF_BedSingle_2D": [1.8000000000000007, -2.0, -0.9000000000000004, 0.4500000000000002, 5.0, 5.0, 12.0, 1.0],
    "PF_KitchenSink_2D": [0.2759999999999979, -0.5999999999999943, -0.46000000000000085, 0.7666666666666754, 5.0, 3.0, 13.0, 3.0],
    "PF_KitchenStove_2D": [0.3599999999999974, -0.6000000000000014, -0.5999999999999943, 0.9999999999999881, 5.0, 5.0, 84.0, 5.0],
    "PF_KitchenFridge_2D": [0.3599999999999964, -0.5999999999999996, -0.5999999999999943, 0.9999999999999911, 5.0, 3.0, 6.0, 1.0],
    "PF_Shower_2D": [0.810000000000001, -0.9000000000000083, -0.8999999999999986, 0.9999999999999891, 5.0, 3.0, 13.0, 3.0],
    "PF_Sink_2D": [0.23999999999999794, -0.5999999999999943, -0.40000000000000036, 0.6666666666666736, 5.0, 3.0, 13.0, 3.0],
    "PF_DoubleSink_2D": [0.6999999999999993, -1.3999999999999986, -0.5, 0.3571428571428575, 5.0, 5.0, 22.0, 5.0],
    "PF_Toilet_2D": [0.1888849102760865, -0.5737907492703158, -0.3524439598913425, 0.6142377867533453, 19.0, 2.0, 19.0, 1.0],
    "PF_Bath_2D": [1.3599999999999977, -1.6999999999999957, -0.8000000000000007, 0.47058823529411925, 5.0, 4.0, 19.0, 3.0],
    "PF_Door_2D": [0.039999999999997586, -0.7999999999999972, -0.04999999999999716, 0.06249999999999667, 5.0, 5.0, 28.0, 3.0],
    "PF_DoorEntrance_2D": [0.040493827160495294, -0.8888888888888857, -0.04555555555555735, 0.0512500000000022, 5.0, 5.0, 28.0, 3.0],
    "PF_DiningThree_2D": [0.9775, -1.2999999999999972, -1.0500000000000043, 0.8076923076923127, 17.0, 4.0, 19.0, 1.0],
    "PF_SofaCorner_2D": [2.0300000000000034, -2.000000000000001, -1.4000000000000021, 0.7000000000000007, 7.0, 4.0, 12.0, 1.0],
    "PF_SofaBed_2D": [1.2800000000000025, -1.6000000000000014, -0.8000000000000007, 0.5, 5.0, 32.0, 39.0, 1.0],
    "PF_SquareCoffeeTable_2D": [0.48999999999999905, -0.6999999999999993, -0.6999999999999993, 1.0, 5.0, 1.0, 4.0, 1.0],
    "PF_DiningRound_2D": [1.1180982748428927, -1.2000000000000028, -1.1999999999999957, 0.9999999999999941, 25.0, 5.0, 48.0, 1.0],
    "PF_BedWithoutSides_2D": [3.5999999999999943, -2.0, -1.7999999999999972, 0.8999999999999986, 5.0, 9.0, 17.0, 1.0],
    "PF_SinkToilet_2D": [0.17499999999999893, -0.5, -0.34999999999999787, 0.6999999999999957, 5.0, 3.0, 13.0, 3.0],
    "PF_SeatingXS_2D": [1.2799999999999967, -1.5999999999999943, -0.8000000000000007, 0.5000000000000022, 5.0, 8.0, 20.0, 4.0],
    "PF_SeatingS_2D": [1.6000000000000014, -2.0, -0.8000000000000007, 0.40000000000000036, 5.0, 9.0, 21.0, 4.0],
    "PF_SeatingSWide_2D": [1.6000000000000014, -2.0, -0.8000000000000007, 0.40000000000000036, 5.0, 11.0, 28.0, 5.0],
    "PF_SeatingM_2D": [6.951940660835992, -3.188175000000001, -2.320575999999999, 0.7278697060230377, 13.0, 12.0, 40.0, 6.0],
    "PF_SeatingMDeep_2D": [2.0300000000000034, -2.0, -1.4000000000000021, 0.7000000000000011, 7.0, 11.0, 36.0, 5.0],
    "PF_SeatingMDeepest_2D": [7.849526399999996, -2.9205760000000005, -2.8499999999999943, 0.9758349037997963, 13.0, 14.0, 40.0, 6.0],
    "PF_SeatingL_2D": [10.448996070686862, -3.5131605579733716, -3.206090688358856, 0.9125944104895524, 13.0, 9.0, 45.0, 5.0],
    "PF_SeatingLWithoutTV_2D": [10.448996070686862, -3.5131605579733716, -3.206090688358856, 0.9125944104895524, 13.0, 7.0, 37.0, 3.0],
    "PF_MiniDoor_2D": [0.029999999999993268, -0.5995670606906742, -0.15342929425075624, 0.25590013913374865, 5.0, 5.0, 17.0, 3.0],
    "PF_SlidingDoor_2D": [0.03499999999999744, -0.6999999999999886, -0.04999999999999716, 0.07142857142856852, 5.0, 1.0, 4.0, 1.0],
    "PF_DoubleDoor_2D": [0.039999999999997586, -0.7999999999999972, -0.04999999999999716, 0.06249999999999667, 5.0, 8.0, 48.0, 4.0],
    "PF_SmallDoor_2D": [0.029999999999998906, -0.6000000000000121, -0.04999999999999716, 0.08333333333332692, 5.0, 5.0, 28.0, 3.0],
    "PF_DiningEight_2D": [2.399999999999996, -2.499999999999943, -1.3000000000000398, 0.5200000000000278, 37.0, 5.0, 40.0, 1.0],
    "PF_Laundry_2D": [0.35999999999999743, -0.6000000000000014, -0.5999999999999943, 0.9999999999999881, 5.0, 1.0, 4.0, 1.0],
    "PF_Piano_2D": [2.18105709626231, -1.9189827835974462, -1.5, 0.7816641258177446, 31.0, 4.0, 33.0, 1.0],
    "PF_SeatingXSWide_2D": [1.2799999999999967, -1.5999999999999943, -0.8000000000000007, 0.5000000000000022, 5.0, 10.0, 27.0, 5.0],
    "PF_SeatingXL_2D": [11.546169540074603, -3.613160557973373, -3.4060906883588586, 0.9426901001790354, 17.0, 11.0, 56.0, 6.0],
    "PF_DiningSixB_2D": [1.8637499999999885, -1.9749999999999446, -1.3000000000000114, 0.6582278481012901, 29.0, 5.0, 32.0, 1.0]
}

# --- LOGICA PRINCIPALE ---
results = []
anchor_names = list(CATALOG.keys())
anchor_features = list(CATALOG.values())

# Verifica base
if Areas is None:
    risultato_match = ["Errore: Input vuoti"]
else:
    num_features = 8
    
    # Calcolo min/max per normalizzazione
    min_vals = [float('inf')] * num_features
    max_vals = [float('-inf')] * num_features
    
    for f_vector in anchor_features:
        for idx in range(num_features):
            if f_vector[idx] < min_vals[idx]: min_vals[idx] = f_vector[idx]
            if f_vector[idx] > max_vals[idx]: max_vals[idx] = f_vector[idx]
            
    def normalize_vector(v):
        norm_v = []
        for idx in range(num_features):
            denominator = max_vals[idx] - min_vals[idx]
            if denominator == 0:
                norm_v.append(0.0)
            else:
                norm_v.append((v[idx] - min_vals[idx]) / denominator)
        return norm_v

    normalized_anchors = [normalize_vector(anchor) for anchor in anchor_features]

    # Elaborazione
    min_length = len(Areas)
    for i in range(min_length):
        live_vector = [float(Areas[i]), float(BB_short_dim[i]), float(BB_long_dim[i]), float(Props[i]),
                       float(Verts[i]), float(Geoms[i]), float(Exp_edge_count[i]), float(Closed_curves[i])]
        
        norm_live = normalize_vector(live_vector)
        shortest_distance = float('inf')
        winning_name = "Unknown"
        
        for index, norm_anchor in enumerate(normalized_anchors):
            sq_diff = sum((l - a) ** 2 for l, a in zip(norm_live, norm_anchor))
            dist = math.sqrt(sq_diff)
            if dist < shortest_distance:
                shortest_distance = dist
                winning_name = anchor_names[index]
        
        results.append(winning_name)

    # Assegna al nuovo nome di output
    risultato_match = results
# ---------- end py3_2 ----------
py3_3 = Python3Script()  # -> out, a; disabled
# ---------- py3_3: Python ----------
import math

# =====================================================================
# THE CATALOG (BUCKET B + BUCKET A)
# This is a Python Dictionary. 
# The Key is the Name (Bucket A). The Value is the list of features (Bucket B).
# You will populate this with the exact numbers you extract from your 47 blocks.
# Format: "Block_Name": [Area, BB_long, BB_short, Vertices, Geometries]
# =====================================================================
CATALOG = {
    "PF_Chair_2D": [
        0.6000000000000006,
        -0.8000000000000012,
        -0.7499999999999998,
        0.9374999999999983,
        5.0,
        2.0,
        7.0,
        1.0
    ],
    "PF_SofaSmall_2D": [
        1.2800000000000002,
        -1.6000000000000005,
        -0.7999999999999998,
        0.4999999999999997,
        5.0,
        5.0,
        8.0,
        1.0
    ],
    "PF_SofaLarge_2D": [
        1.5999999999999996,
        -2.0,
        -0.7999999999999998,
        0.3999999999999999,
        5.0,
        6.0,
        9.0,
        1.0
    ],
    "PF_CoffeeSmall_2D": [
        0.5,
        -1.0,
        -0.5,
        0.5,
        5.0,
        1.0,
        4.0,
        1.0
    ],
    "PF_CoffeeLarge_2D": [
        1.3999999999999986,
        -1.3999999999999986,
        -1.0,
        0.714285714285715,
        5.0,
        1.0,
        4.0,
        1.0
    ],
    "PF_TV_2D": [
        0.34999999999999964,
        -1.3999999999999986,
        -0.25,
        0.17857142857142874,
        5.0,
        2.0,
        8.0,
        2.0
    ],
    "PF_DiningTwo_2D": [
        0.8649999999999975,
        -1.2999999999999972,
        -0.7999999999999998,
        0.6153846153846166,
        13.0,
        3.0,
        14.0,
        1.0
    ],
    "PF_DiningFour_2D": [
        1.6499999999999961,
        -1.5,
        -1.2999999999999972,
        0.8666666666666648,
        21.0,
        3.0,
        22.0,
        1.0
    ],
    "PF_DiningSix_2D": [
        2.199999999999994,
        -1.9999999999999996,
        -1.3000000000000256,
        0.6500000000000129,
        29.0,
        3.0,
        30.0,
        1.0
    ],
    "PF_Study_2D": [
        0.779999999999998,
        -1.2999999999999972,
        -0.5999999999999999,
        0.46153846153846245,
        5.0,
        5.0,
        14.0,
        3.0
    ],
    "PF_Bed_2D": [
        3.9200000000000017,
        -2.6000000000000014,
        -2.0,
        0.7692307692307688,
        11.0,
        9.0,
        23.0,
        1.0
    ],
    "PF_BedSingle_2D": [
        1.8000000000000007,
        -2.0,
        -0.9000000000000004,
        0.4500000000000002,
        5.0,
        5.0,
        12.0,
        1.0
    ],
    "PF_KitchenSink_2D": [
        0.2759999999999979,
        -0.5999999999999943,
        -0.46000000000000085,
        0.7666666666666754,
        5.0,
        3.0,
        13.0,
        3.0
    ],
    "PF_KitchenStove_2D": [
        0.3599999999999974,
        -0.6000000000000014,
        -0.5999999999999943,
        0.9999999999999881,
        5.0,
        5.0,
        84.0,
        5.0
    ],
    "PF_KitchenFridge_2D": [
        0.3599999999999964,
        -0.5999999999999996,
        -0.5999999999999943,
        0.9999999999999911,
        5.0,
        3.0,
        6.0,
        1.0
    ],
    "PF_Shower_2D": [
        0.810000000000001,
        -0.9000000000000083,
        -0.8999999999999986,
        0.9999999999999891,
        5.0,
        3.0,
        13.0,
        3.0
    ],
    "PF_Sink_2D": [
        0.23999999999999794,
        -0.5999999999999943,
        -0.40000000000000036,
        0.6666666666666736,
        5.0,
        3.0,
        13.0,
        3.0
    ],
    "PF_DoubleSink_2D": [
        0.6999999999999993,
        -1.3999999999999986,
        -0.5,
        0.3571428571428575,
        5.0,
        5.0,
        22.0,
        5.0
    ],
    "PF_Toilet_2D": [
        0.1888849102760865,
        -0.5737907492703158,
        -0.3524439598913425,
        0.6142377867533453,
        19.0,
        2.0,
        19.0,
        1.0
    ],
    "PF_Bath_2D": [
        1.3599999999999977,
        -1.6999999999999957,
        -0.8000000000000007,
        0.47058823529411925,
        5.0,
        4.0,
        19.0,
        3.0
    ],
    "PF_Door_2D": [
        0.039999999999997586,
        -0.7999999999999972,
        -0.04999999999999716,
        0.06249999999999667,
        5.0,
        5.0,
        28.0,
        3.0
    ],
    "PF_DoorEntrance_2D": [
        0.040493827160495294,
        -0.8888888888888857,
        -0.04555555555555735,
        0.0512500000000022,
        5.0,
        5.0,
        28.0,
        3.0
    ],
    "PF_DiningThree_2D": [
        0.9775,
        -1.2999999999999972,
        -1.0500000000000043,
        0.8076923076923127,
        17.0,
        4.0,
        19.0,
        1.0
    ],
    "PF_SofaCorner_2D": [
        2.0300000000000034,
        -2.000000000000001,
        -1.4000000000000021,
        0.7000000000000007,
        7.0,
        4.0,
        12.0,
        1.0
    ],
    "PF_SofaBed_2D": [
        1.2800000000000025,
        -1.6000000000000014,
        -0.8000000000000007,
        0.5,
        5.0,
        32.0,
        39.0,
        1.0
    ],
    "PF_SquareCoffeeTable_2D": [
        0.48999999999999905,
        -0.6999999999999993,
        -0.6999999999999993,
        1.0,
        5.0,
        1.0,
        4.0,
        1.0
    ],
    "PF_DiningRound_2D": [
        1.1180982748428927,
        -1.2000000000000028,
        -1.1999999999999957,
        0.9999999999999941,
        25.0,
        5.0,
        48.0,
        1.0
    ],
    "PF_BedWithoutSides_2D": [
        3.5999999999999943,
        -2.0,
        -1.7999999999999972,
        0.8999999999999986,
        5.0,
        9.0,
        17.0,
        1.0
    ],
    "PF_SinkToilet_2D": [
        0.17499999999999893,
        -0.5,
        -0.34999999999999787,
        0.6999999999999957,
        5.0,
        3.0,
        13.0,
        3.0
    ],
    "PF_SeatingXS_2D": [
        1.2799999999999967,
        -1.5999999999999943,
        -0.8000000000000007,
        0.5000000000000022,
        5.0,
        8.0,
        20.0,
        4.0
    ],
    "PF_SeatingS_2D": [
        1.6000000000000014,
        -2.0,
        -0.8000000000000007,
        0.40000000000000036,
        5.0,
        9.0,
        21.0,
        4.0
    ],
    "PF_SeatingSWide_2D": [
        1.6000000000000014,
        -2.0,
        -0.8000000000000007,
        0.40000000000000036,
        5.0,
        11.0,
        28.0,
        5.0
    ],
    "PF_SeatingM_2D": [
        6.951940660835992,
        -3.188175000000001,
        -2.320575999999999,
        0.7278697060230377,
        13.0,
        12.0,
        40.0,
        6.0
    ],
    "PF_SeatingMDeep_2D": [
        2.0300000000000034,
        -2.0,
        -1.4000000000000021,
        0.7000000000000011,
        7.0,
        11.0,
        36.0,
        5.0
    ],
    "PF_SeatingMDeepest_2D": [
        7.849526399999996,
        -2.9205760000000005,
        -2.8499999999999943,
        0.9758349037997963,
        13.0,
        14.0,
        40.0,
        6.0
    ],
    "PF_SeatingL_2D": [
        10.448996070686862,
        -3.5131605579733716,
        -3.206090688358856,
        0.9125944104895524,
        13.0,
        9.0,
        45.0,
        5.0
    ],
    "PF_SeatingLWithoutTV_2D": [
        10.448996070686862,
        -3.5131605579733716,
        -3.206090688358856,
        0.9125944104895524,
        13.0,
        7.0,
        37.0,
        3.0
    ],
    "PF_MiniDoor_2D": [
        0.029999999999993268,
        -0.5995670606906742,
        -0.15342929425075624,
        0.25590013913374865,
        5.0,
        5.0,
        17.0,
        3.0
    ],
    "PF_SlidingDoor_2D": [
        0.03499999999999744,
        -0.6999999999999886,
        -0.04999999999999716,
        0.07142857142856852,
        5.0,
        1.0,
        4.0,
        1.0
    ],
    "PF_DoubleDoor_2D": [
        0.039999999999997586,
        -0.7999999999999972,
        -0.04999999999999716,
        0.06249999999999667,
        5.0,
        8.0,
        48.0,
        4.0
    ],
    "PF_SmallDoor_2D": [
        0.029999999999998906,
        -0.6000000000000121,
        -0.04999999999999716,
        0.08333333333332692,
        5.0,
        5.0,
        28.0,
        3.0
    ],
    "PF_DiningEight_2D": [
        2.399999999999996,
        -2.499999999999943,
        -1.3000000000000398,
        0.5200000000000278,
        37.0,
        5.0,
        40.0,
        1.0
    ],
    "PF_Laundry_2D": [
        0.35999999999999743,
        -0.6000000000000014,
        -0.5999999999999943,
        0.9999999999999881,
        5.0,
        1.0,
        4.0,
        1.0
    ],
    "PF_Piano_2D": [
        2.18105709626231,
        -1.9189827835974462,
        -1.5,
        0.7816641258177446,
        31.0,
        4.0,
        33.0,
        1.0
    ],
    "PF_SeatingXSWide_2D": [
        1.2799999999999967,
        -1.5999999999999943,
        -0.8000000000000007,
        0.5000000000000022,
        5.0,
        10.0,
        27.0,
        5.0
    ],
    "PF_SeatingXL_2D": [
        11.546169540074603,
        -3.613160557973373,
        -3.4060906883588586,
        0.9426901001790354,
        17.0,
        11.0,
        56.0,
        6.0
    ],
    "PF_DiningSixB_2D": [
        1.8637499999999885,
        -1.9749999999999446,
        -1.3000000000000114,
        0.6582278481012901,
        29.0,
        5.0,
        32.0,
        1.0
    ]
}


# 1. SETUP LISTS
Semantic_Labels = []
anchor_names = list(CATALOG.keys())
anchor_features = list(CATALOG.values())

# Check if Grasshopper actually provided live data
if Live_Areas and Live_LongDims and Live_ShortDims and Live_Verts and Live_Geoms:
    
    # 2. GROUP THE LIVE DATA (BUCKET C)
    # We combine the separate Grasshopper lists into unified vectors
    # e.g., Live item 0 becomes [Area0, LongDim0, ShortDim0, Verts0, Geoms0]
    live_items = []
    for i in range(len(Live_Areas)):
        live_items.append([
            Live_Areas[i],
            Live_LongDims[i],
            Live_ShortDims[i],
            Live_Verts[i],
            Live_Geoms[i]
        ])
        
    # 3. THE NEAREST NEIGHBOR LOOP
    for live_vector in live_items:
        # Start by assuming the distance is infinitely large
        shortest_distance = float('inf')
        winning_name = "Unknown_Asset"
        
        # Compare the live item against every single anchor item in the catalog
        for index, anchor_vector in enumerate(anchor_features):
            
            # Calculate Euclidean Distance across all 5 features
            # zip() pairs them up: (live Area with anchor Area), (live Verts with anchor Verts), etc.
            squared_differences = []
            for l_val, a_val in zip(live_vector, anchor_vector):
                squared_differences.append((l_val - a_val) ** 2)
                
            distance = math.sqrt(sum(squared_differences))
            
            # If this anchor is closer than the previous closest, update the winner!
            if distance < shortest_distance:
                shortest_distance = distance
                winning_name = anchor_names[index]
                
        # After checking all 47 anchors, append the winner to our output list
        Semantic_Labels.append(winning_name)
# ---------- end py3_3 ----------
relay = Relay()
panel_8 = Panel(py3_2.risultato_match)  # disabled
number_slider_5 = Slider(1, range=0..16)  # disabled
group = Group(Geometry=relay)  # -> flatten(Group); disabled
item = ListItem(List=flatten(group), Index=number_slider_5, Wrap=True)  # disabled

# ---- group: RECORD FURNITURE DATASET
dataset_medium_features = Data(Tree({0}: [3.0642, 2.342, 3.365, 1.436806149, 7, 12, 109, 10], {1}: [3.92, 2, 2.6, 1.3, 11, 9, 23, 1], {2}: [1.65, 1.3, 1.5, 1.153846154, 21, 3, 22, 1], {3}: [1.6, 0.8, 2, 2.5, 5, 6, 9, 1], {4}: [1.419, 0.6, 2.365, 3.941666667, 5, 1, 4, 1], {5}: [1.4, 1, 1.4, 1.4, 5, 1, 4, 1]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))
dataset_medium = Data(Tree({0;0}: [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], {0;1}: [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], {0;2}: [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], {0;3}: [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], {0;4}: [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], {0;5}: [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]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))

# ----
# dataset generation - don't trigger unless to change layouts
# WARNING: CLICK WRITE TO GENERATE JSONS
seed = Slider(3, range=0..999)
# PLANFINDER
sample_count = Slider(800, range=1..1000)
random_parameter_generator = Python3Script(seed=seed, sample_count=sample_count)  # -> a, b, c, d, e, f, g; inputs seed: Int32, sample_count: Int32
# ---------- random_parameter_generator: Python ----------
import random

lengths        = [4.5, 6.0, 7.5, 9.0, 10.5, 12.0, 13.5, 15.0, 16.5, 18.0]
widths         = [4.5, 6.0, 7.5, 9.0, 10.5, 12.0, 13.5, 15.0, 16.5, 18.0]
door_edges     = [0, 1, 2, 3]
door_positions = [0.2, 0.3, 0.4, 0.5, 0.6, 0.7, 0.8, 0.85, 0.9]
window_pats    = [0, 1, 2, 3, 4, 5]

counts = [len(lengths), len(widths), len(door_edges), len(door_positions), len(window_pats)]
total  = counts[0] * counts[1] * counts[2] * counts[3] * counts[4]

# Pre-filter: keep only non-square combinations
valid_indices = []
for idx in range(total):
    tmp = idx
    tmp //= counts[4]
    tmp //= counts[3]
    tmp //= counts[2]
    wi = tmp % counts[1]
    li = tmp // counts[1]
    if lengths[li] != widths[wi]:
        valid_indices.append(idx)

random.seed(int(seed))
n = min(int(sample_count), len(valid_indices))
chosen = sorted(random.sample(valid_indices, n))

out_L, out_W, out_de, out_dp, out_wp = [], [], [], [], []
for idx in chosen:
    tmp = idx
    wp  = tmp % counts[4]; tmp //= counts[4]
    dp  = tmp % counts[3]; tmp //= counts[3]
    de  = tmp % counts[2]; tmp //= counts[2]
    wi  = tmp % counts[1]; li   = tmp // counts[1]
    out_L.append(lengths[li])
    out_W.append(widths[wi])
    out_de.append(door_edges[de])
    out_dp.append(door_positions[dp])
    out_wp.append(window_pats[wp])

a = out_L
b = out_W
c = out_de
d = out_dp
e = out_wp
f = n
# ---------- end random_parameter_generator ----------
counter = Python3Script(reset=False, step=True, max_count=random_parameter_generator.f)  # -> a; inputs reset: Boolean, step: Boolean, max_count: String
# ---------- counter: Python ----------
import scriptcontext as sc

if reset or "pf_idx" not in sc.sticky:
    sc.sticky["pf_idx"] = 0
else:
    if sc.sticky["pf_idx"] < int(max_count) - 1:
        sc.sticky["pf_idx"] += 1

a = sc.sticky["pf_idx"]
# ---------- end counter ----------
panel_9 = Panel(counter)
list_item_2 = ListItem(List=random_parameter_generator.a, Index=counter, Wrap=True)
list_item_3 = ListItem(List=random_parameter_generator.b, Index=counter, Wrap=True)
list_item_4 = ListItem(List=random_parameter_generator.c, Index=counter, Wrap=True)
list_item_5 = ListItem(List=random_parameter_generator.d, Index=counter, Wrap=True)
list_item_6 = ListItem(List=random_parameter_generator.e, Index=counter, Wrap=True)
fit_settings = FitSettings(WidthInterior=100, WidthExterior=200, DownScaling=0.8, UpScaling=1.05, ThresholdScore=0, AmountOptions=5, UnitSystem=4)
layout_option = Slider(0, range=0..2)
panel_10 = Panel("C:\Users\mosmo\OneDrive\Desktop\AIA Studio\AIA26_Studio\team_06\layout_inputs\Planfinder_Dataset")

boundary_length = Data(list_item_2)
boundary_width = Data(list_item_3)
window_pattern = Data(list_item_6)
door_edge_idx = Data(list_item_4)
door_position = Data(list_item_5)

# ----
# RPLAN JSON Dataset
number_slider_6 = Slider(1364, range=0..2200)  # disabled
number_slider_7 = Slider(1240, range=0..2200)  # disabled
trigger_2 = Trigger(Interval=10, TimerInterval=10, Target=py3_5)  # disabled
json_dataset_path = Panel("C:\Users\giofo\Desktop\ARCHIVIO\MASTERS\MACAD\2_MACAD\0_MACAD DRIVE\AIA\STUDIO\AIA26_Studio\team_06\layout_inputs\RPLAN_Dataset_R-NB")  # disabled
button_2 = Button()  # disabled
panel_11 = Panel(".json")  # disabled
py3_4 = Python3Script(path=json_dataset_path, extension=panel_11)  # -> out, a; inputs path: String, extension: String; disabled
# ---------- py3_4: Python ----------
import os

# Check if the path is valid
if os.path.isdir(path):
    # Get all files in the directory
    all_files = os.listdir(path)
    full_paths = []
    
    for f in all_files:
        if f.endswith(extension):
            # Construct the full file path (e.g., C:\Folder\file.json)
            full_paths.append(os.path.join(path, f))
            
    # Sort the files alphabetically
    full_paths.sort()
    
    # Send the ordered list to output 'a'
    a = full_paths
else:
    a = []
# ---------- end py3_4 ----------
number_slider_8 = Slider(138, range=0..150)  # disabled

# ----
# connect (a) into list item layout indices to go through dataset
# Go through dataset
py3_5 = Python3Script(reset=button_2)  # -> out, a, banned_indices; disabled
# ---------- py3_5: Python ----------
import scriptcontext as sc

# 1. ADD THE INDICES YOU WANT TO EXCLUDE HERE
banned_indices = []  # Just separate them with commas

# 2. Initialize or Reset
if reset or "count" not in sc.sticky:
    sc.sticky["count"] = 0
    # If 0 happens to be banned, skip to the first safe index
    while sc.sticky["count"] in banned_indices and sc.sticky["count"] < 100:
        sc.sticky["count"] += 1
else:
    # 3. Increment the counter
    if sc.sticky["count"] < 100:
        sc.sticky["count"] += 1
        
        # WHILE the current number is in the ban list, keep skipping forward
        while sc.sticky["count"] in banned_indices and sc.sticky["count"] < 100:
            sc.sticky["count"] += 1

# 4. Output the safe index
a = sc.sticky["count"]
b = banned_indices
# ---------- end py3_5 ----------

panel_12 = Panel(py3_4.a)  # disabled

# ----
# layout indices
item_2 = ListItem(List=py3_4.a, Index=py3_5.a, Wrap=invert(True))  # disabled
file = ReadFile(File=item_2, PerLineParse=False)  # disabled

banned_indices = Panel(py3_5.banned_indices)  # disabled
panel_13 = Panel(py3_5.a)  # disabled
item_3 = ListItem(List=py3_4.a, Index=banned_indices, Wrap=True)  # -> graft(Item); disabled
panel_14 = Panel(item_3)  # disabled
panel_15 = Panel(file)  # disabled
fragment = TextFragment(Text=panel_14, Start=number_slider_8)  # -> flatten(Fragment); disabled
banned_layouts = Panel(fragment)  # disabled

# ----
# RPLAN
# COMMON EROOR
# 1. Index was out of range. Must be non-negative and less than the size of the collection. (Parameter 'index') (line: 0)
item_4 = ListItem(List=py3_4.a, Index=py3_5.a, Wrap=True)  # -> graft(Item); disabled
number_slider_9 = Slider(140, range=0..150)  # disabled
panel_16 = Panel(item_4)  # disabled
fragment_2 = TextFragment(Text=panel_16, Start=number_slider_9)  # -> flatten(Fragment); disabled
layouts = Panel(fragment_2)  # disabled
panel_17 = Panel(".")  # disabled
split = TextSplit(Text=layouts, Separators=panel_17)  # disabled
item_5 = ListItem(List=split, Index=0, Wrap=True)  # disabled
layouts_2 = Panel(item_5)  # disabled

# ----
# PLANFINDER JSON Dataset
trigger_3 = Trigger(Interval=10, TimerInterval=10, Target=py3_7)  # disabled
json_dataset_path_2 = Panel("C:\Users\mosmo\OneDrive\Desktop\AIA Studio\AIA26_Studio\team_06\layout_inputs\Planfinder_Dataset")
button_3 = Button()  # disabled
panel_18 = Panel(".json")  # disabled
py3_6 = Python3Script(path=json_dataset_path_2, extension=panel_18)  # -> out, a; inputs path: String, extension: String; disabled; same code as py3_4
number_slider_10 = Slider(138, range=0..150)  # disabled

# ----
# connect (a) into list item layout indices to go through dataset
# Go through dataset
py3_7 = Python3Script(reset=button_3)  # -> out, a, banned_indices; disabled
# ---------- py3_7: Python ----------
import scriptcontext as sc

# 1. ADD THE INDICES YOU WANT TO EXCLUDE HERE
banned_indices = []  # Just separate them with commas

# 2. Initialize or Reset
if reset or "count" not in sc.sticky:
    sc.sticky["count"] = 0
    # If 0 happens to be banned, skip to the first safe index
    while sc.sticky["count"] in banned_indices and sc.sticky["count"] < 100:
        sc.sticky["count"] += 1
else:
    # 3. Increment the counter
    if sc.sticky["count"] < 71:
        sc.sticky["count"] += 1
        
        # WHILE the current number is in the ban list, keep skipping forward
        while sc.sticky["count"] in banned_indices and sc.sticky["count"] < 100:
            sc.sticky["count"] += 1

# 4. Output the safe index
a = sc.sticky["count"]
b = banned_indices
# ---------- end py3_7 ----------

panel_19 = Panel(py3_6.a)  # disabled

# ----
# layout indices
item_6 = ListItem(List=py3_6.a, Index=py3_7.a, Wrap=invert(True))  # disabled
file_2 = ReadFile(File=item_6, PerLineParse=False)  # disabled

banned_indices_2 = Panel(py3_7.banned_indices)  # disabled
panel_20 = Panel(py3_7.a)  # disabled
item_7 = ListItem(List=py3_6.a, Index=banned_indices_2, Wrap=True)  # -> graft(Item); disabled
panel_21 = Panel(file_2)  # disabled
panel_22 = Panel(item_7)  # disabled
fragment_3 = TextFragment(Text=panel_22, Start=number_slider_10)  # -> flatten(Fragment); disabled
banned_layouts_2 = Panel(fragment_3)  # disabled

panel_23 = Panel(boundary_width)
panel_24 = Panel(boundary_length)
multiplication = Multiplication(A=boundary_length, B=boundary_width)
area_sqm = Panel(multiplication)
rectangle = Rectangle(Plane=PlaneXY(0, 0, 0), XSize=boundary_length, YSize=boundary_width, Radius=0)  # -> Rectangle, Length
explode_3 = Explode(Curve=rectangle.Rectangle, Recursive=True)  # -> Segments, Vertices
cull_index = CullIndex(List=explode_3.Vertices, Indices=-1, Wrap=True)
custom_preview = CustomPreview(
    Geometry=rectangle.Rectangle,
    Material={diffuse=RGB(32, 0, 221), emission=RGB(10, 0, 66), shine=0.5, specular=RGB(255, 255, 255), transparency=0})
window_edges_selection = Python3Script(edges=explode_3.Segments, door_edge_idx=door_edge_idx, window_pattern=window_pattern)  # -> window_edge_idxs; inputs edges: list of Curve, door_edge_idx: Int32, window_pattern: Int32
# ---------- window_edges_selection: Python ----------
candidates = [i for i in range(4) if i != door_edge_idx]
patterns = [[0], [1], [2], [0, 1], [0, 2], [1, 2]]
selected = patterns[window_pattern]
window_edge_idxs = [candidates[i] for i in selected]
# ---------- end window_edges_selection ----------
panel_25 = Panel(window_edges_selection)
list_item_7 = ListItem(List=explode_3.Segments, Index=window_edges_selection, Wrap=True)
list_item_8 = ListItem(List=explode_3.Segments, Index=door_edge_idx, Wrap=False)
door_edge = Data(list_item_8)
evaluate_curve = EvaluateCurve(Curve=reparameterize(door_edge), Parameter=door_position)  # -> Point, Tangent, Angle
window_facades = Data(list_item_7)
boundary = Data(rectangle.Rectangle)
entrance = Data(evaluate_curve.Point)
panel_26 = Panel(boundary)
plan_fit = PlanFit(
    Boundary=boundary,
    EntranceS=entrance,
    FacadeS=window_facades,
    Beds=-1,
    Baths=-1,
    Country=26,
    FitSettings=fit_settings,
    InHousePlans=False)
plans = Data(plan_fit)
choose_plan = ListItem(List=plans, Index=layout_option, Wrap=True)
deconstruct_plan = DeconstructPlan(Plan=choose_plan)  # -> InteriorWalls, ExteriorWalls, DoorCurves, Glass, WindowFrames, Furniture, Score, Rooms, DoorBlockInstances, FurnitureBlockInstances
deconstruct_room = DeconstructRoom(Room=deconstruct_plan.Rooms)  # -> Boundary, InteriorBoundary, Function
panel_27 = Panel(deconstruct_room.Function)
join_curves = JoinCurves(Curves=deconstruct_room.Boundary, Preserve=False)
filter_circulation_rooms = Python3Script(boundaries=deconstruct_room.Boundary, functions=deconstruct_room.Function)  # -> a; inputs boundaries: list, functions: list
# ---------- filter_circulation_rooms: Python ----------
a = [b for b, f in zip(boundaries, functions) if str(f).lower() == "circulation"]
# ---------- end filter_circulation_rooms ----------
region_union = RegionUnion(Curves=join_curves)  # -> simplify(Result)

json_serialiser = Python3Script(
    vertices=cull_index,
    area_sqm=area_sqm,
    length=boundary_length,
    width=boundary_width,
    door_edge_idx=door_edge_idx,
    door_point=entrance,
    door_position=door_position,
    window_edge_idxs=window_edges_selection,
    window_pattern=window_pattern,
    room_boundaries=deconstruct_room.Boundary,
    room_functions=deconstruct_room.Function,
    door_curves=deconstruct_plan.DoorCurves,
    facade_curves=deconstruct_plan.ExteriorWalls,
    circulation_crv=filter_circulation_rooms,
    window_frames=deconstruct_plan.WindowFrames,
    write=False)  # -> out, a, b; inputs vertices: list of Point3d, area_sqm: Double, length: Double, width: Double, door_edge_idx: Int32, door_point: Point3d, door_position: Double, window_edge_idxs: list of Int32, window_pattern: Int32, room_boundaries: list of Curve, room_functions: list of String, door_curves: list of Curve, facade_curves: list of Curve, circulation_crv: Curve, window_frames: list of Curve, output_folder: String, write: Boolean; disabled
# ---------- json_serialiser: Python ----------
import os, json, math
import Rhino.Geometry as rg
import scriptcontext as sc

PROGRAMS = {
    0: (["kitchen", "bath", "living", "circulation"], "any"),
    1: (["kitchen", "bath", "living", "circulation", "storage"], "any"),
    2: (["bed", "bath", "kitchen", "living", "circulation"], "connected"),
    3: (["bed", "bath", "kitchen", "living", "circulation", "storage"], "connected"),
    4: (["bed", "bed", "bath", "wc", "kitchen", "living", "circulation"], "connected"),
}
programs, conn_type = PROGRAMS[2]

layout_id = sc.sticky.get("pf_idx", 0)

def curve_to_pts(crv):
    if crv is None:
        return []
    nc = crv.ToNurbsCurve()
    if nc is None:
        return []
    return [(round(nc.Points[i].Location.X, 4), round(nc.Points[i].Location.Y, 4))
            for i in range(nc.Points.Count)]

def curve_area(crv):
    if crv is None:
        return 0
    amp = rg.AreaMassProperties.Compute(crv)
    return amp.Area if amp else 0

def pt_to_seg_dist(px, py, x1, y1, x2, y2):
    dx, dy = x2 - x1, y2 - y1
    if dx == 0 and dy == 0:
        return math.sqrt((px - x1)**2 + (py - y1)**2)
    t = max(0.0, min(1.0, ((px - x1)*dx + (py - y1)*dy) / (dx*dx + dy*dy)))
    return math.sqrt((px - (x1 + t*dx))**2 + (py - (y1 + t*dy))**2)

def dist_to_boundary(pt, boundary_coords):
    n = len(boundary_coords)
    best = float('inf')
    for i in range(n):
        x1, y1 = boundary_coords[i]
        x2, y2 = boundary_coords[(i+1) % n]
        d = pt_to_seg_dist(pt[0], pt[1], x1, y1, x2, y2)
        if d < best:
            best = d
    return best

def min_seg_dist(geom, px, py):
    n = len(geom)
    if n == 0:
        return float('inf')
    return min(pt_to_seg_dist(px, py, geom[k][0], geom[k][1], geom[(k+1)%n][0], geom[(k+1)%n][1]) for k in range(n))

def get_full_side_for_point(outline_coords, px, py, tol=0.5):
    n = len(outline_coords)
    best_dist = float('inf')
    best_seg = None
    for i in range(n):
        x1, y1 = outline_coords[i]
        x2, y2 = outline_coords[(i+1) % n]
        d = pt_to_seg_dist(px, py, x1, y1, x2, y2)
        if d < best_dist:
            best_dist = d
            best_seg = (x1, y1, x2, y2)
    if best_seg is None:
        return None
    x1, y1, x2, y2 = best_seg
    is_horiz = abs(y2 - y1) < abs(x2 - x1)
    coord_val = ((y1 + y2) / 2.0) if is_horiz else ((x1 + x2) / 2.0)
    if is_horiz:
        side_pts = sorted([p for p in outline_coords if abs(p[1] - coord_val) < tol], key=lambda p: p[0])
    else:
        side_pts = sorted([p for p in outline_coords if abs(p[0] - coord_val) < tol], key=lambda p: p[1])
    if len(side_pts) < 2:
        return None
    return (round(coord_val, 4), is_horiz, side_pts[0], side_pts[-1])

# Boundary from vertices
boundary_coords = [[round(p.X, 4), round(p.Y, 4)] for p in vertices]

# Build rooms
rooms = []
for rb, rf in zip(room_boundaries, room_functions):
    pts = curve_to_pts(rb)
    if not pts:
        continue
    rooms.append({
        "id": len(rooms),
        "type": rf.lower().strip(),
        "geometry": [list(p) for p in pts],
        "area": round(curve_area(rb), 4)
    })

# Actual outline from room union
outline_coords = boundary_coords
try:
    union_result = rg.Curve.CreateBooleanUnion([rb for rb in room_boundaries if rb is not None])
    if union_result and len(union_result) > 0:
        union_pts = curve_to_pts(union_result[0])
        if len(union_pts) >= 3:
            outline_coords = [list(p) for p in union_pts]
except:
    pass

# Door detection
DOOR_TOL = 0.15
BOUNDARY_TOL = 0.2

door_candidates = {}
for dc in door_curves:
    if dc is None:
        continue
    pts = curve_to_pts(dc)
    if not pts:
        continue
    mx = sum(p[0] for p in pts) / len(pts)
    my = sum(p[1] for p in pts) / len(pts)
    if dist_to_boundary((mx, my), boundary_coords) < BOUNDARY_TOL:
        continue
    connected = []
    for r in rooms:
        geom = r["geometry"]
        nr = len(geom)
        for j in range(nr):
            if pt_to_seg_dist(mx, my, geom[j][0], geom[j][1], geom[(j+1)%nr][0], geom[(j+1)%nr][1]) < DOOR_TOL:
                connected.append(r["id"])
                break
    if len(connected) >= 2:
        pair_key = frozenset(connected[:2])
        pair_list = list(pair_key)
        ra_geom = next((r["geometry"] for r in rooms if r["id"] == pair_list[0]), None)
        rb_geom = next((r["geometry"] for r in rooms if r["id"] == pair_list[1]), None)
        if ra_geom is None or rb_geom is None:
            continue
        combined = min_seg_dist(ra_geom, mx, my) + min_seg_dist(rb_geom, mx, my)
        if pair_key not in door_candidates or combined < door_candidates[pair_key][1]:
            door_candidates[pair_key] = ([round(mx,4), round(my,4)], combined)

doors = []
for i, (pair, (point, _)) in enumerate(door_candidates.items()):
    pair_list = list(pair)
    doors.append({
        "id": "door-{}".format(i + 1),
        "name": "Door {}".format(i + 1),
        "geometry": [point],
        "attributes": {"connectsRooms": [pair_list[0], pair_list[1]]}
    })
door_points = [data[0] for data in door_candidates.values()]


# Entrance door: midpoint of door curve closest to boundary
door_xy = boundary_coords[0] if boundary_coords else [0, 0]
best_d = float('inf')
for dc in door_curves:
    if dc is None:
        continue
    pts = curve_to_pts(dc)
    if not pts:
        continue
    mx = sum(p[0] for p in pts) / len(pts)
    my = sum(p[1] for p in pts) / len(pts)
    d = dist_to_boundary((mx, my), boundary_coords)
    if d < best_d:
        best_d = d
        door_xy = [round(mx,4), round(my,4)]

# Circulation: full outline side where entrance door is
circulation = []
if door_xy and outline_coords:
    side = get_full_side_for_point(outline_coords, door_xy[0], door_xy[1])
    if side:
        _, _, p_start, p_end = side
        circulation.append({"geometry": [list(p_start), list(p_end)]})

# Facades: use window_frames midpoints to find only window-bearing outline sides
facades = []
seen_sides = set()
wf_list = window_frames if hasattr(window_frames, '__iter__') else [window_frames]
for wf in wf_list:
    pts = curve_to_pts(wf)
    if not pts:
        continue
    mx = sum(p[0] for p in pts) / len(pts)
    my = sum(p[1] for p in pts) / len(pts)
    side = get_full_side_for_point(outline_coords, mx, my)
    if side is None:
        continue
    coord_val, is_horiz, p_start, p_end = side
    key = (round(coord_val, 3), is_horiz)
    if key not in seen_sides:
        seen_sides.add(key)
        facades.append({"geometry": [list(p_start), list(p_end)]})

record = {
    "layoutId": layout_id,
    "programType": programs,
    "connectivityType": conn_type,
    "outline": outline_coords,
    "boundary": boundary_coords,
    "door_point": door_xy,
    "door_points": door_points,
    "facades": facades,
    "circulation": circulation,
    "rooms": rooms,
    "doors": doors
}

a = json.dumps(record)
b = "no output_folder set"

if output_folder:
    try:
        fname = "L_L{}_W{}_de{}_dp{}_wp{}.json".format(
            round(float(length), 1),
            round(float(width), 1),
            int(door_edge_idx),
            round(float(door_position), 2),
            int(window_pattern)
        )
        filepath = os.path.join(str(output_folder), fname)
        with open(filepath, "w") as f:
            json.dump(record, f, indent=2)
        b = "saved: " + filepath
    except Exception as e:
        b = "error: " + str(e)
# ---------- end json_serialiser ----------

# ---- group: FURNITURE
furniture = Data(deconstruct_plan.Furniture)

# ---- group: DOORS
crv = Curve(deconstruct_plan.DoorCurves)
data_3 = Data(deconstruct_plan.DoorBlockInstances)
partition = PartitionList(List=crv, Size="5")  # -> simplify(Chunks)
number_slider_11 = Slider(5, range=0..5)
pln = Plane(data_3)
group_2 = Group(Geometry=partition)
item_8 = ListItem(List=flatten(group_2), Index=number_slider_11, Wrap=True)
item_9 = ListItem(List=pln, Index=number_slider_11, Wrap=True)
panel_28 = Panel(partition)

# ---- group: FURNITURE
panel_29 = Panel("""0
1""")
crv_2 = Curve(furniture)
eval = EvaluateCurve(Curve=reparameterize(crv_2), Parameter=graft(panel_29))  # -> Point, Tangent, Angle
flip_2 = FlipMatrix(Data=eval.Point)
item_10 = ListItem(List=flip_2, Index=0, Wrap=True)  # -> Item, Item1
dist = Distance(PointA=item_10.Item, PointB=item_10.Item1)
larger = LargerThan(FirstNumber=dist, SecondNumber=Slider(0, range=0..100))  # -> flatten(LargerThan), OrEqualTo
dispatch = Dispatch(List=crv_2, DispatchPattern=flatten(larger.LargerThan))  # -> ListA, ListB
eval_2 = EvaluateCurve(Curve=reparameterize(crv_2), Parameter=graft("0.27"))  # -> Point, Tangent, Angle
crv_3 = Curve(dispatch.ListB)
incurve = PointInCurve(Point=eval_2.Point, Curve=graft(crv_3))  # -> Relationship, Point
dispatch_2 = Dispatch(List=crv_2, DispatchPattern=incurve.Relationship)  # -> ListA, ListB
crv_4 = Curve(simplify(dispatch_2.ListA))

# ----
item_11 = ListItem(List=crv_2, Index=Slider(19, range=0..100), Wrap=True)
panel_30 = Panel(larger.LargerThan)
cls = Closed(Curve=crv_2)  # -> Closed, Periodic
panel_31 = Panel(cls.Periodic)
data_4 = Data(deconstruct_plan.DoorCurves)
data_5 = Data(deconstruct_plan.Glass)
panel_32 = Panel(deconstruct_plan.DoorCurves)
crv_rooms = Data(deconstruct_room.Boundary)
crv_bounds_3 = Data(region_union)
discontinuity = Discontinuity(Curve=crv_bounds_3, Level=1)  # -> Points, Parameters
crv_core_accessible = Data(filter_circulation_rooms)
vertices = Data(discontinuity.Points)

json_serialiser_2 = Python3Script(
    vertices=vertices,
    area_sqm=area_sqm,
    length=boundary_length,
    width=boundary_width,
    door_edge_idx=door_edge_idx,
    door_point=entrance,
    door_position=door_position,
    window_edge_idxs=window_edges_selection,
    window_pattern=window_pattern,
    room_boundaries=deconstruct_room.Boundary,
    room_functions=deconstruct_room.Function,
    door_curves=deconstruct_plan.DoorCurves,
    facade_curves=deconstruct_plan.ExteriorWalls,
    circulation_crv=filter_circulation_rooms,
    window_frames=deconstruct_plan.WindowFrames,
    output_folder=panel_10,
    write=False)  # -> out, a, b; inputs vertices: list of Point3d, area_sqm: Double, length: Double, width: Double, door_edge_idx: Int32, door_point: Point3d, door_position: Double, window_edge_idxs: list of Int32, window_pattern: Int32, room_boundaries: list of Curve, room_functions: list of String, door_curves: list of Curve, facade_curves: list of Curve, circulation_crv: Curve, window_frames: list of Curve, output_folder: String, write: Boolean
# ---------- json_serialiser_2: Python ----------
import os, json, math
import Rhino.Geometry as rg
import scriptcontext as sc

PROGRAMS = {
    0: (["kitchen", "bath", "living", "circulation"], "any"),
    1: (["kitchen", "bath", "living", "circulation", "storage"], "any"),
    2: (["bed", "bath", "kitchen", "living", "circulation"], "connected"),
    3: (["bed", "bath", "kitchen", "living", "circulation", "storage"], "connected"),
    4: (["bed", "bed", "bath", "wc", "kitchen", "living", "circulation"], "connected"),
}
programs, conn_type = PROGRAMS[2]

layout_id = sc.sticky.get("pf_idx", 0)

def curve_to_pts(crv):
    if crv is None: return []
    nc = crv.ToNurbsCurve()
    if nc is None: return []
    return [(round(nc.Points[i].Location.X, 4), round(nc.Points[i].Location.Y, 4))
            for i in range(nc.Points.Count)]

def curve_area(crv):
    if crv is None: return 0
    amp = rg.AreaMassProperties.Compute(crv)
    return amp.Area if amp else 0

def pt_to_seg_dist(px, py, x1, y1, x2, y2):
    dx, dy = x2 - x1, y2 - y1
    if dx == 0 and dy == 0:
        return math.sqrt((px - x1)**2 + (py - y1)**2)
    t = max(0.0, min(1.0, ((px - x1)*dx + (py - y1)*dy) / (dx*dx + dy*dy)))
    return math.sqrt((px - (x1 + t*dx))**2 + (py - (y1 + t*dy))**2)

def dist_to_boundary(pt, coords):
    n = len(coords)
    best = float('inf')
    for i in range(n):
        x1, y1 = coords[i]; x2, y2 = coords[(i+1) % n]
        d = pt_to_seg_dist(pt[0], pt[1], x1, y1, x2, y2)
        if d < best: best = d
    return best

def min_seg_dist(geom, px, py):
    n = len(geom)
    if n == 0: return float('inf')
    return min(pt_to_seg_dist(px, py, geom[k][0], geom[k][1],
                               geom[(k+1)%n][0], geom[(k+1)%n][1]) for k in range(n))

def get_full_side_for_point(coords, px, py, tol=0.5):
    n = len(coords)
    best_dist, best_seg = float('inf'), None
    for i in range(n):
        x1, y1 = coords[i]; x2, y2 = coords[(i+1) % n]
        d = pt_to_seg_dist(px, py, x1, y1, x2, y2)
        if d < best_dist:
            best_dist = d; best_seg = (x1, y1, x2, y2)
    if best_seg is None: return None
    x1, y1, x2, y2 = best_seg
    is_horiz = abs(y2 - y1) < abs(x2 - x1)
    coord_val = ((y1 + y2) / 2.0) if is_horiz else ((x1 + x2) / 2.0)
    if is_horiz:
        side_pts = sorted([p for p in coords if abs(p[1] - coord_val) < tol], key=lambda p: p[0])
    else:
        side_pts = sorted([p for p in coords if abs(p[0] - coord_val) < tol], key=lambda p: p[1])
    if len(side_pts) < 2: return None
    return (round(coord_val, 4), is_horiz, side_pts[0], side_pts[-1])

def seg_length(p1, p2):
    return round(math.sqrt((p2[0]-p1[0])**2 + (p2[1]-p1[1])**2), 4)

# ── Outline from room union (used for ALL boundary checks) ────
outline_coords = None
valid_rbs = [rb for rb in room_boundaries if rb is not None]
try:
    flat = []
    for rb in valid_rbs:
        c = rb.DuplicateCurve()
        c.Transform(rg.Transform.PlanarProjection(rg.Plane.WorldXY))
        flat.append(c)
    union_result = rg.Curve.CreateBooleanUnion(flat)
    if union_result and len(union_result) > 0:
        union_pts = curve_to_pts(union_result[0])
        if len(union_pts) >= 3:
            outline_coords = [list(p) for p in union_pts]
except:
    pass

if not outline_coords:
    outline_coords = [[round(p.X, 4), round(p.Y, 4)] for p in vertices]

# ── Build rooms ───────────────────────────────────────────
rooms = []
for rb, rf in zip(room_boundaries, room_functions):
    pts = curve_to_pts(rb)
    if not pts: continue
    rooms.append({
        "id": len(rooms),
        "type": rf.lower().strip(),
        "geometry": [list(p) for p in pts],
        "area": round(curve_area(rb), 4)
    })

# ── Internal door detection (outline_coords for boundary check) ──
DOOR_TOL = 0.15
BOUNDARY_TOL = 0.2

door_candidates = {}
for dc in door_curves:
    if dc is None: continue
    pts = curve_to_pts(dc)
    if not pts: continue
    mx = sum(p[0] for p in pts) / len(pts)
    my = sum(p[1] for p in pts) / len(pts)
    if dist_to_boundary((mx, my), outline_coords) < BOUNDARY_TOL:
        continue
    connected = []
    for r in rooms:
        geom = r["geometry"]; nr = len(geom)
        for j in range(nr):
            if pt_to_seg_dist(mx, my, geom[j][0], geom[j][1],
                               geom[(j+1)%nr][0], geom[(j+1)%nr][1]) < DOOR_TOL:
                connected.append(r["id"]); break
    if len(connected) >= 2:
        pair_key = frozenset(connected[:2])
        pair_list = list(pair_key)
        ra_geom = next((r["geometry"] for r in rooms if r["id"] == pair_list[0]), None)
        rb_geom = next((r["geometry"] for r in rooms if r["id"] == pair_list[1]), None)
        if ra_geom is None or rb_geom is None: continue
        combined = min_seg_dist(ra_geom, mx, my) + min_seg_dist(rb_geom, mx, my)
        if pair_key not in door_candidates or combined < door_candidates[pair_key][1]:
            door_candidates[pair_key] = ([round(mx,4), round(my,4)], combined)

doors_raw = []
for i, (pair, (point, _)) in enumerate(door_candidates.items()):
    pair_list = list(pair)
    doors_raw.append({
        "id": "door-{}".format(i + 1),
        "name": "Door {}".format(i + 1),
        "geometry": [point],
        "attributes": {"connectsRooms": [pair_list[0], pair_list[1]]}
    })
door_points = [data[0] for data in door_candidates.values()]

# ── Entry door: curve with both endpoints on boundary (straight leaf only) ──
ENDPOINT_TOL = 0.2
entry_door_xy = None
for dc in door_curves:
    if dc is None: continue
    try:
        sp = dc.PointAtStart
        ep = dc.PointAtEnd
        if (dist_to_boundary((sp.X, sp.Y), outline_coords) < ENDPOINT_TOL and
                dist_to_boundary((ep.X, ep.Y), outline_coords) < ENDPOINT_TOL):
            chord = math.sqrt((ep.X-sp.X)**2 + (ep.Y-sp.Y)**2)
            try:
                arc_len = dc.GetLength()
            except:
                arc_len = chord
            if chord < 0.05 or arc_len <= 0 or chord / arc_len < 0.95:
                continue
            entry_door_xy = [round((sp.X + ep.X) / 2.0, 4),
                             round((sp.Y + ep.Y) / 2.0, 4)]
            break
    except:
        pass

# Fallback: de/dp on outline_coords
if not entry_door_xy:
    oc_xs = [p[0] for p in outline_coords]; oc_ys = [p[1] for p in outline_coords]
    min_x, max_x = min(oc_xs), max(oc_xs)
    min_y, max_y = min(oc_ys), max(oc_ys)
    de = int(door_edge_idx); dp = float(door_position)
    if   de == 0: entry_door_xy = [round(min_x + dp*(max_x-min_x), 4), min_y]
    elif de == 1: entry_door_xy = [max_x, round(min_y + dp*(max_y-min_y), 4)]
    elif de == 2: entry_door_xy = [round(max_x - dp*(max_x-min_x), 4), max_y]
    else:         entry_door_xy = [min_x, round(max_y - dp*(max_y-min_y), 4)]

# ── Circulation from entry door position ──────────────────
circulation_raw = []
circ_side = get_full_side_for_point(outline_coords, entry_door_xy[0], entry_door_xy[1])
if circ_side:
    _, _, p_start, p_end = circ_side
    circulation_raw.append([list(p_start), list(p_end)])

# ── Facades from window frame midpoints ───────────────────
facades_raw = []
seen_sides = set()
wf_list = window_frames if hasattr(window_frames, '__iter__') else [window_frames]
for wf in wf_list:
    pts = curve_to_pts(wf)
    if not pts: continue
    mx = sum(p[0] for p in pts) / len(pts)
    my = sum(p[1] for p in pts) / len(pts)
    side = get_full_side_for_point(outline_coords, mx, my)
    if side is None: continue
    coord_val, is_horiz, p_start, p_end = side
    key = (round(coord_val, 3), is_horiz)
    if key not in seen_sides:
        seen_sides.add(key)
        facades_raw.append([list(p_start), list(p_end)])

# ── Build RPLAN-compatible record ─────────────────────────
SKIP_TYPES = {"fusebox", "shaft"}
PROG_REMAP = {"wc": "bath", "storage": "extra", "circulation": "extra"}

skipped_ids = set()
rplan_rooms = []
room_id_map = {}
for i, r in enumerate(rooms):
    prog = r["type"].lower()
    if prog in SKIP_TYPES:
        skipped_ids.add(r["id"]); continue
    new_id = "room-{}".format(len(rplan_rooms) + 1)
    room_id_map[r["id"]] = new_id
    prog = PROG_REMAP.get(prog, prog)
    rplan_rooms.append({
        "id": new_id,
        "name": prog.capitalize(),
        "geometry": r["geometry"],
        "attributes": {"area": r["area"], "program": prog}
    })

extra_ids = {r["id"] for r in rplan_rooms if r["attributes"]["program"] == "extra"}

rplan_doors = []
for d in doors_raw:
    connects = d["attributes"]["connectsRooms"]
    if any(rid in skipped_ids for rid in connects): continue
    mapped = [room_id_map.get(rid, "room-{}".format(rid + 1)) for rid in connects]
    if all(m in extra_ids for m in mapped): continue  # skip extra-to-extra false positives
    rplan_doors.append({
        "id": d["id"], "name": d["name"], "geometry": d["geometry"],
        "attributes": {"connectsRooms": mapped}
    })

rplan_facades = [
    {
        "id": "facade-{}".format(i + 1),
        "name": "Facade {}".format(i + 1),
        "geometry": geom,
        "attributes": {"type": "exterior",
                       "length": seg_length(geom[0], geom[-1]) if len(geom) >= 2 else 0}
    }
    for i, geom in enumerate(facades_raw)
]

rplan_circulation = [
    {
        "id": "circulation-{}".format(i + 1),
        "name": "Front Door Axis",
        "geometry": geom,
        "attributes": {"type": "circulation",
                       "length": seg_length(geom[0], geom[-1]) if len(geom) >= 2 else 0}
    }
    for i, geom in enumerate(circulation_raw)
]

total_area = round(sum(r["area"] for r in rooms), 4)
apt_desc = ", ".join(
    "{} {}.".format(programs.count(p), p)
    for p in dict.fromkeys(programs) if p != "circulation"
)

layoutId_str = "L_L{}_W{}_de{}_dp{}_wp{}".format(
    round(float(length), 1), round(float(width), 1),
    int(door_edge_idx), round(float(door_position), 2), int(window_pattern)
)

record = {
    "layoutId": layoutId_str,
    "apartment": {
        "id": "apartment-1", "name": "Apartment",
        "geometry": outline_coords,
        "attributes": {"area": total_area, "description": apt_desc}
    },
    "outline": outline_coords,
    "door_point": entry_door_xy,
    "door_points": door_points,
    "rooms": rplan_rooms,
    "doors": rplan_doors,
    "facades": rplan_facades,
    "circulation": rplan_circulation,
    "windows": [], "furniture": [], "mep": [], "structure": []
}

a = json.dumps(record)
b = "no output_folder set"

if output_folder:
    real_rooms = [r for r in rplan_rooms if r["attributes"]["program"] != "extra"]
    if not real_rooms:
        b = "skipped: no rooms"
    else:
        try:
            fname = "L_L{}_W{}_de{}_dp{}_wp{}.json".format(
                round(float(length), 1), round(float(width), 1),
                int(door_edge_idx), round(float(door_position), 2), int(window_pattern)
            )
            json_dir = os.path.join(str(output_folder), "pf_jsons")
            if not os.path.exists(json_dir):
                os.makedirs(json_dir)
            filepath = os.path.join(json_dir, fname)
            with open(filepath, "w") as f:
                json.dump(record, f, indent=2)
            b = "saved: " + filepath

            import System.Drawing as sd
            view = sc.doc.Views.ActiveView
            if view:
                bmp = view.CaptureToBitmap(sd.Size(1280, 960))
                if bmp:
                    screenshots_dir = os.path.join(str(output_folder), "pf_screenshots")
                    if not os.path.exists(screenshots_dir):
                        os.makedirs(screenshots_dir)
                    img_path = os.path.join(screenshots_dir, fname.replace('.json', '.png'))
                    bmp.Save(img_path)

        except Exception as e:
            b = "error: " + str(e)
# ---------- end json_serialiser_2 ----------
panel_33 = Panel(json_serialiser_2.a)
panel_34 = Panel(json_serialiser_2.b)

python_3_script_3 = Python3Script(
    room_boundaries=deconstruct_room.Boundary,
    door_curves=deconstruct_plan.DoorCurves,
    door_edge_idx=door_edge_idx,
    door_position=door_position,
    json_str=json_serialiser_2.a)  # -> circ_edge, door_points, entry_pt, window_edges, debug; inputs room_boundaries: list of Curve, door_curves: list of Curve, door_edge_idx: Int32, door_position: String, json_str: String
# ---------- python_3_script_3: Python ----------
import math, json
import Rhino.Geometry as rg

def curve_to_pts(crv):
    if crv is None: return []
    nc = crv.ToNurbsCurve()
    if nc is None: return []
    return [(round(nc.Points[i].Location.X, 4), round(nc.Points[i].Location.Y, 4))
            for i in range(nc.Points.Count)]

def pt_to_seg_dist(px, py, x1, y1, x2, y2):
    dx, dy = x2-x1, y2-y1
    if dx == 0 and dy == 0:
        return math.sqrt((px-x1)**2 + (py-y1)**2)
    t = max(0.0, min(1.0, ((px-x1)*dx + (py-y1)*dy) / (dx*dx + dy*dy)))
    return math.sqrt((px-(x1+t*dx))**2 + (py-(y1+t*dy))**2)

def dist_to_boundary(pt, coords):
    n = len(coords)
    if n == 0: return float('inf')
    return min(pt_to_seg_dist(pt[0], pt[1], coords[i][0], coords[i][1],
                               coords[(i+1)%n][0], coords[(i+1)%n][1])
               for i in range(n))

def pt2d_dist(a, b):
    return math.sqrt((a[0]-b[0])**2 + (a[1]-b[1])**2)

def get_wall_side(coords, px, py, tol=0.5):
    n = len(coords)
    best_dist, best_seg = float('inf'), None
    for i in range(n):
        x1, y1 = coords[i]; x2, y2 = coords[(i+1)%n]
        d = pt_to_seg_dist(px, py, x1, y1, x2, y2)
        if d < best_dist:
            best_dist = d; best_seg = (x1, y1, x2, y2)
    if best_seg is None: return None
    x1, y1, x2, y2 = best_seg
    is_horiz = abs(y2-y1) < abs(x2-x1)
    coord_val = ((y1+y2)/2.0) if is_horiz else ((x1+x2)/2.0)
    if is_horiz:
        side_pts = sorted([p for p in coords if abs(p[1]-coord_val) < tol], key=lambda p: p[0])
    else:
        side_pts = sorted([p for p in coords if abs(p[0]-coord_val) < tol], key=lambda p: p[1])
    if len(side_pts) < 2: return None
    return (round(coord_val,4), is_horiz, side_pts[0], side_pts[-1])

def side_to_line(side):
    coord_val, is_horiz, p_start, p_end = side
    if is_horiz:
        p1 = rg.Point3d(p_start[0], coord_val, 0)
        p2 = rg.Point3d(p_end[0],   coord_val, 0)
    else:
        p1 = rg.Point3d(coord_val, p_start[1], 0)
        p2 = rg.Point3d(coord_val, p_end[1],   0)
    return rg.LineCurve(rg.Line(p1, p2))

def pt_from_geom(geometry):
    if not geometry: return None
    pt = geometry[0]
    if isinstance(pt, list) and len(pt) >= 2:
        return rg.Point3d(pt[0], pt[1], 0)
    return None

def line_from_geom(geometry):
    if not geometry or len(geometry) < 2: return None
    p1 = rg.Point3d(geometry[0][0],  geometry[0][1],  0)
    p2 = rg.Point3d(geometry[-1][0], geometry[-1][1], 0)
    return rg.LineCurve(rg.Line(p1, p2))

# ── Boundary from room union ──────────────────────────────
valid_boundaries = [rb for rb in room_boundaries if rb is not None]
debug = ["rooms: {}".format(len(valid_boundaries))]

flat_curves = []
for rb in valid_boundaries:
    try:
        c = rb.DuplicateCurve()
        c.Transform(rg.Transform.PlanarProjection(rg.Plane.WorldXY))
        flat_curves.append(c)
    except:
        flat_curves.append(rb)

boundary = None
try:
    union_result = rg.Curve.CreateBooleanUnion(flat_curves)
    if union_result and len(union_result) > 0:
        pts = curve_to_pts(union_result[0])
        if len(pts) >= 3:
            boundary = [[p[0], p[1]] for p in pts]
            debug.append("union ok, {} pts".format(len(pts)))
except Exception as ex:
    debug.append("union err: {}".format(str(ex)[:60]))

if not boundary and flat_curves:
    bbox = rg.BoundingBox.Empty
    for c in flat_curves:
        bbox.Union(c.GetBoundingBox(False))
    if bbox.IsValid:
        mn, mx_ = bbox.Min, bbox.Max
        boundary = [[round(mn.X,4), round(mn.Y,4)], [round(mx_.X,4), round(mn.Y,4)],
                    [round(mx_.X,4), round(mx_.Y,4)], [round(mn.X,4), round(mx_.Y,4)]]
        debug.append("bbox fallback")

# ── Entry door: find curve with BOTH endpoints on boundary ─
# Planfinder always places exactly one door leaf on the exterior wall = entry door.
# Its midpoint is the exact center of the door opening.
ENDPOINT_TOL = 0.2
candidates = []
door_curves_list = [dc for dc in door_curves if dc is not None] if door_curves else []

for dc in door_curves_list:
    try:
        sp = dc.PointAtStart
        ep = dc.PointAtEnd
        if (dist_to_boundary((sp.X, sp.Y), boundary) < ENDPOINT_TOL and
                dist_to_boundary((ep.X, ep.Y), boundary) < ENDPOINT_TOL):
            chord = math.sqrt((ep.X-sp.X)**2 + (ep.Y-sp.Y)**2)
            try:
                arc_len = dc.GetLength()
            except:
                arc_len = chord
            if chord < 0.05 or arc_len <= 0 or chord / arc_len < 0.95:
                continue
            mx = (sp.X + ep.X) / 2.0
            my = (sp.Y + ep.Y) / 2.0
            candidates.append((mx, my))
    except:
        pass

debug.append("{} boundary door candidates".format(len(candidates)))

# Fallback door_xy from de/dp (used when 0 or multiple candidates)
b_xs = [p[0] for p in boundary]; b_ys = [p[1] for p in boundary]
bmin_x, bmax_x = min(b_xs), max(b_xs)
bmin_y, bmax_y = min(b_ys), max(b_ys)
de = int(door_edge_idx); dp = float(door_position)
if   de == 0: door_xy = [round(bmin_x + dp*(bmax_x-bmin_x), 4), bmin_y]
elif de == 1: door_xy = [bmax_x, round(bmin_y + dp*(bmax_y-bmin_y), 4)]
elif de == 2: door_xy = [round(bmax_x - dp*(bmax_x-bmin_x), 4), bmax_y]
else:         door_xy = [bmin_x, round(bmax_y - dp*(bmax_y-bmin_y), 4)]

entry_pt = None
circ_side = None
circ_edge = None

if candidates:
    # If multiple, pick the one closest to de/dp reference
    best = min(candidates, key=lambda p: pt2d_dist(p, door_xy))
    mx, my = best
    entry_pt = rg.Point3d(round(mx,4), round(my,4), 0)
    circ_side = get_wall_side(boundary, mx, my)
    debug.append("entry from door curve: [{},{}]".format(round(mx,3), round(my,3)))
else:
    entry_pt = rg.Point3d(door_xy[0], door_xy[1], 0)
    circ_side = get_wall_side(boundary, door_xy[0], door_xy[1])
    debug.append("entry fallback de/dp: {}".format(door_xy))

if circ_side:
    circ_edge = side_to_line(circ_side)
    debug.append("circ: coord={}, horiz={}".format(round(circ_side[0],3), circ_side[1]))
else:
    debug.append("circ_side: not found")

# ── Door points from JSON ─────────────────────────────────
layout = {}
try:
    layout = json.loads(json_str) if json_str else {}
except:
    debug.append("json parse failed")

seen_pairs = set()
door_points = []
for door in layout.get("doors", []):
    connected = door.get("attributes", {}).get("connectsRooms", [])
    if len(connected) >= 2:
        pair = tuple(sorted([str(connected[0]), str(connected[1])]))
        if pair not in seen_pairs:
            seen_pairs.add(pair)
            pt = pt_from_geom(door.get("geometry", []))
            if pt:
                door_points.append(pt)

debug.append("{} internal doors".format(len(door_points)))

# ── Window edges from JSON facades ───────────────────────
window_edges = []
for fac in layout.get("facades", []):
    ln = line_from_geom(fac.get("geometry", []))
    if ln:
        window_edges.append(ln)

debug.append("{} window edges".format(len(window_edges)))

a = circ_edge
b = door_points
c = entry_pt
d = window_edges
e = "\n".join(debug)
# ---------- end python_3_script_3 ----------
panel_35 = Panel(python_3_script_3.debug)
data_6 = Data(python_3_script_3.window_edges)
data_7 = Data(python_3_script_3.entry_pt)
data_8 = Data(python_3_script_3.door_points)
data_9 = Data(python_3_script_3.circ_edge)
custom_preview_lineweights_3 = CustomPreviewLineweights(
    Geometry=vertices,
    Shader={diffuse=RGB(255, 0, 148), emission=RGB(76, 0, 44), shine=0.5, specular=RGB(255, 255, 255), transparency=0},
    Absolute=False)
custom_preview_lineweights_4 = CustomPreviewLineweights(
    Geometry=data_8,
    Shader={diffuse=RGB(63, 194, 96), emission=RGB(19, 58, 29), shine=0.5, specular=RGB(255, 255, 255), transparency=0},
    Absolute=False)
custom_preview_lineweights_5 = CustomPreviewLineweights(
    Geometry=data_7,
    Shader={diffuse=RGB(57, 36, 148), emission=RGB(17, 11, 44), shine=0.5, specular=RGB(255, 255, 255), transparency=0},
    Absolute=False)
custom_preview_lineweights_6 = CustomPreviewLineweights(
    Geometry=data_6,
    Shader={diffuse=RGB(88, 207, 249), emission=RGB(26, 62, 75), shine=0.5, specular=RGB(255, 255, 255), transparency=0},
    Thickness=Slider(3, range=0..100),
    Absolute=False)
custom_preview_lineweights_7 = CustomPreviewLineweights(
    Geometry=data_9,
    Shader={diffuse=RGB(255, 0, 207), emission=RGB(76, 0, 62), shine=0.5, specular=RGB(255, 255, 255), transparency=0},
    Thickness=Slider(3.48, range=0..100),
    Absolute=False)

# ----
# LAYOUT FILTERING
# COMMON EROOR
# 1. Index was out of range. Must be non-negative and less than the size of the collection. (Parameter 'index') (line: 0)
number_slider_12 = Slider(97, range=0..150)  # disabled
item_12 = ListItem(List=item_6, Index=py3_7.a, Wrap=True)  # -> graft(Item); disabled
panel_36 = Panel(item_12)  # disabled
fragment_4 = TextFragment(Text=panel_36, Start=number_slider_12)  # -> flatten(Fragment); disabled
panel_37 = Panel(".json")  # disabled
layouts_3 = Panel(fragment_4)  # disabled
split_2 = TextSplit(Text=layouts_3, Separators=panel_37)  # disabled
item_13 = ListItem(List=split_2, Index=0, Wrap=True)  # disabled

python_3_script_4 = Python3Script(x=layouts_3, y=panel_2)  # -> out, a; inputs x: String, y: Int32; disabled
# ---------- python_3_script_4: Python ----------
a = str(x[:y])
# ---------- end python_3_script_4 ----------

layouts_name = Panel(python_3_script_4.a)  # disabled

# ----
# Apply Layout to Target
apartment_number = Slider(0, range=0..100)  # disabled
number_slider_13 = Slider(1, range=0..1)  # disabled
reference_layout_2 = Data(flatten(reference_layout))  # disabled
layout = Panel(layouts_name)  # disabled
target_facades_2 = Curve(simplify(flatten(target_facades)))  # disabled
target_circulation_2 = Curve(simplify(target_circulation))  # disabled

panel_38 = Panel(target_facades_2)  # disabled

# ----
# Reference Layout
# WITH TIMER 2
c_script_2 = CSharpScript(
    targetB=target_boundary_2,
    targetC=target_circulation_2,
    targetF=target_facades_2,
    bldg=layout,
    aptNum=apartment_number,
    areaFilter=number_slider_13,
    refAPT=reference_layout_2,
    Reference=["C:\USERS\GIOFO\DESKTOP\ARCHIVIO\MASTERS\MACAD\2_MACAD\0_MACAD DRIVE\AIA\STUDIO\HYPERGRAPH_G06-AIA-STUDIO\DLLS\LIB\MathNet.Numerics.dll", "C:\USERS\GIOFO\DESKTOP\ARCHIVIO\MASTERS\MACAD\2_MACAD\0_MACAD DRIVE\AIA\STUDIO\HYPERGRAPH_G06-AIA-STUDIO\DLLS\LIB\RGeoLib.dll", "C:\USERS\GIOFO\DESKTOP\ARCHIVIO\MASTERS\MACAD\2_MACAD\0_MACAD DRIVE\AIA\STUDIO\HYPERGRAPH_G06-AIA-STUDIO\DLLS\LIB\Dbscan.dll"])  # -> out, apts, aptsF, aptsRef, failedApt; inputs targetB: Polyline, targetC: list of Polyline, targetF: list of Polyline, bldg: String, aptNum: Int32, areaFilter: Double, refAPT: list; disabled
# ---------- c_script_2: C# usings ----------
using System.Linq;
using RGeoLib;
using RGeoLib.BuildingSolver;
# ---------- c_script_2: C# ----------
    // GLOBAL VALUES

    NFace boundsTarget = RhConvert.RhPolylineToNFace(targetB);

    NFace boundsTargetFlipped = RhConvert.RhPolylineToNFace(targetB);
    boundsTargetFlipped.flipRH();


    List<Apartment> referenceList = refAPT.Cast<Apartment>().ToList();


    List<NLine> circTarget = RhConvert.RhPolylineListToNLineList(targetC);
    List<NLine> facTarget = RhConvert.RhPolylineListToNLineList(targetF);

    List<NLine> circTargetF = RhConvert.RhPolylineListToNLineList(targetC);
    List<NLine> facTargetF = RhConvert.RhPolylineListToNLineList(targetF);

    for (int i = 0;i < circTargetF.Count; i++)
    {
      circTargetF[i].FlipLineWithhSwap();
    }
    for (int i = 0;i < circTargetF.Count; i++)
    {
      facTargetF[i].FlipLineWithhSwap();
    }

    Apartment targetApartment = new Apartment(boundsTarget, facTarget, circTarget);
    Apartment targetApartmentFlipped = new Apartment(boundsTargetFlipped, facTargetF, circTargetF);


    List<Apartment> outAptList = new List<Apartment>();

    // ⏱️ FILTER
    // Run the solver in the background so it doesn't freeze
    var task = System.Threading.Tasks.Task.Run(() =>
    {
      return Apartment.fitApartment(bldg, aptNum, referenceList, targetApartment, areaFilter, false, false);
    });

    // Wait for a maximum of 3000 milliseconds (3 seconds).
    if (task.Wait(3000))
    {
      // It solved it quickly! Save the good result.
      outAptList = task.Result;
    }
    else
    {
      // It got stuck in an infinite loop.
      // Throw an orange warning (not a red crash) and output an empty list so it moves on.
      Component.AddRuntimeMessage(GH_RuntimeMessageLevel.Warning, "Skipped a bad apartment! Took longer than 3 seconds.");

      //  THE BLACKLIST EXPORT
      failedApt = bldg + "_Apt_" + aptNum.ToString();
    }
    //List<Apartment> outAptList = Apartment.forceFitApartments(bldg, aptNum, referenceList, targetApartment);

    //List<Apartment> outAptListF = fitApartment(bldg, aptNum, referenceList, targetApartmentFlipped, areaFilter, false, false);

    apts = outAptList;
    //aptsF = outAptListF;

    List<Apartment> refList = new List<Apartment>();

    for (int i = 0;i < outAptList.Count; i++)
    {
      refList.Add(outAptList[i].referenceApartment);
    }

    aptsRef = refList;
# ---------- c_script_2: C# additional code ----------
  public static List<Apartment> fitApartment(string buildingName, int aptNum, List<Apartment> referenceList, Apartment targetApartment, double areaFilter = 0.15, bool cullAccess=true, bool sortByShape=true)
  {
    List<Apartment> chosenAreaRef = Apartment.preFilterByArea(referenceList, targetApartment, areaFilter);
    List<Apartment> apartmentOut = Apartment.createApartmentsFromReference(chosenAreaRef, targetApartment);

    if (cullAccess)
      apartmentOut = Apartment.preFilterByAccessAndProgram(apartmentOut);

    if (sortByShape)
      apartmentOut = Apartment.sortAptsByRoomShape(apartmentOut);

    // Add global properties
    for (int i = 0; i < apartmentOut.Count; i++)
    {
      apartmentOut[i].eval.building = buildingName;
      apartmentOut[i].eval.apartmentNum = aptNum;
    }
    return apartmentOut;
  }
# ---------- end c_script_2 ----------

panel_39 = Panel(c_script_2.out)  # disabled

# ---- group: WRITE BLACKLIST
rec = DataRecorder(c_script_2.failedApt, DataLimit=-10, RecordData=True)  # disabled
clean = CleanTree(RemoveNulls=True, RemoveInvalid=True, RemoveEmpty=invert(False), Tree=rec)  # disabled
panel_40 = Panel(clean)  # disabled
toggle = BooleanToggle(False)  # disabled
py3_8 = Python3Script(textData=flatten(panel_40), filePath=path, writeToggle=toggle)  # -> out, a; inputs textData: list of String; disabled
# ---------- py3_8: Python ----------
"""
Inputs:
    textData: The list of failed apartments (Set to 'List Access' + 'Flatten')
    filePath: The full path to your .txt file 
    writeToggle: A Boolean Toggle (True = Overwrite file)
"""
import os

if writeToggle:
    if not filePath:
        print("Error: Please provide a valid file path.")
    else:
        try:
            with open(filePath, 'w') as f:
                # 1. If Grasshopper gives us a List
                if isinstance(textData, list) or type(textData) is tuple:
                    for item in textData:
                        if item is not None:
                            # Force split any hidden multiline strings inside the list
                            lines = str(item).splitlines()
                            for line in lines:
                                if line.strip(): # Ignore completely empty blank lines
                                    f.write(line.strip() + '\n')
                
                # 2. If Grasshopper gives us one giant Multiline String
                else:
                    if textData is not None:
                        lines = str(textData).splitlines()
                        for line in lines:
                            if line.strip():
                                f.write(line.strip() + '\n')
            
            print("Boom. Multiline data split and overwritten successfully!")
            
        except Exception as e:
            print("Failed to write file. Error: " + str(e))
else:
    print("Waiting... Switch 'writeToggle' to True to overwrite the file.")
# ---------- end py3_8 ----------

# ----
panel_41 = Panel(py3_8.out)  # disabled

# ----
# Extract Geometry
number_slider_14 = Slider(0.25, range=0..1)  # disabled
number_slider_15 = Slider(0.075, range=0..0.1)  # disabled
number_slider_16 = Slider(0.12, range=0..1)  # disabled
c_script_3 = CSharpScript(
    testApt1=c_script_2.apts,
    mergeDelta=number_slider_14,
    wall_inside=number_slider_15,
    wall_outside=number_slider_16,
    Reference=["C:\USERS\GIOFO\DESKTOP\ARCHIVIO\MASTERS\MACAD\2_MACAD\0_MACAD DRIVE\AIA\STUDIO\HYPERGRAPH_G06-AIA-STUDIO\DLLS\LIB\MathNet.Numerics.dll", "C:\USERS\GIOFO\DESKTOP\ARCHIVIO\MASTERS\MACAD\2_MACAD\0_MACAD DRIVE\AIA\STUDIO\HYPERGRAPH_G06-AIA-STUDIO\DLLS\LIB\RGeoLib.dll", "C:\USERS\GIOFO\DESKTOP\ARCHIVIO\MASTERS\MACAD\2_MACAD\0_MACAD DRIVE\AIA\STUDIO\HYPERGRAPH_G06-AIA-STUDIO\DLLS\LIB\Dbscan.dll", "C:\USERS\GIOFO\DESKTOP\ARCHIVIO\MASTERS\MACAD\2_MACAD\0_MACAD DRIVE\AIA\STUDIO\HYPERGRAPH_G06-AIA-STUDIO\DLLS\LIB\System.Text.Json.dll", "C:\USERS\GIOFO\DESKTOP\ARCHIVIO\MASTERS\MACAD\2_MACAD\0_MACAD DRIVE\AIA\STUDIO\HYPERGRAPH_G06-AIA-STUDIO\DLLS\LIB\Clipper2Lib.dll"])  # -> out, boundsOut, facOut, circOut, rooms, roomsNames, roomsMerged, roomsMergedNames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; inputs mergeDelta: Double, wall_inside: Double, wall_outside: Double; disabled
# ---------- c_script_3: C# ----------
    Apartment aptIn = (Apartment) testApt1;

    aptIn.rooms = NMesh.cleanInOut(aptIn.rooms, -mergeDelta);
    aptIn.rooms = NMesh.cleanInOut(aptIn.rooms, mergeDelta);

    rooms = RhConvert.NMeshToRhLinePolylineList(aptIn.rooms);

    aptIn.updateMerged();



    roomsNames = aptIn.getRoomNames();
    roomsMergedNames = aptIn.getRoomMergedNames();

    // Extraction STEP 1: Facade
    facOut = RhConvert.NLineListToRhLineCurveList(aptIn.facade);

    // Extraction STEP 2: Bounds
    NFace bounds = aptIn.bounds;
    bounds.makeCounterClockwise();
    boundsOut = RhConvert.NFaceToRhLineCurveList(bounds);

    // Extraction STEP 3: Circulation
    circOut = RhConvert.NLineListToRhLineCurveList(aptIn.circulation);

    // Extraction STEP 4: Doors
    doorsOut = RhConvert.NLineListToRhLineCurveList(aptIn.doors);

    // Extraction STEP 5: Rooms Merged
    roomsMerged = RhConvert.NMeshToRhLinePolylineList(aptIn.roomsMerged);


    doors_all = RhConvert.NLineListToRhLineCurveList(aptIn.doorsAll);

    ///////////////////////////////////////////////////////////////////////
    ///Visualize Bounds

    NMesh internalMesh = aptIn.roomsMerged;

    List<NFace> outFaces = new List<NFace>();

    for (int i = 0;i < internalMesh.faceList.Count; i++)
    {
      NMesh tempMesh = RClipper.clipperInflatePathsMitterPolygon(internalMesh.faceList[i], -wall_inside);
      outFaces.AddRange(tempMesh.faceList);
    }

    NMesh outMesh = new NMesh(outFaces);

    draw_rooms = RhConvert.NMeshToRhLinePolylineList(outMesh);
    NMesh mergedRoomsNMesh = outMesh;

    NMesh outsideMesh = RClipper.clipperInflatePathsMitterPolygon(bounds, wall_outside);

    draw_bounds = RhConvert.NMeshToRhLinePolylineList(outsideMesh);




    List<NFace> intersectionRoomsList = new List<NFace>();

    for (int i = 0; i < aptIn.rooms.faceList.Count; i++)
    {

      for (int j = 0; j < mergedRoomsNMesh.faceList.Count; j++)
      {
        NMesh intersectionRooms = RClipper.clipperIntersection(aptIn.rooms.faceList[i], mergedRoomsNMesh.faceList[j]);
        intersectionRoomsList.AddRange(intersectionRooms.faceList);
      }
    }

    NMesh outMesh2 = new NMesh(intersectionRoomsList);
    draw_cut_rooms = RhConvert.NMeshToRhLinePolylineList(outMesh2);



    // Populate with furniture:

    ///////////////////////////////////////////
    // Rooms

    // offset inside line

    ///////////////////////////////////////////
    // DOORS


    // Blocked entrance

    // get longest line from entrance lines
    // offset on side and return line

    // Blocked doors
    // get doors

    // add blocking squares

    ///////////////////////////////////////////

    // Room Graph
    // check if in the room graph, the bedroom has an extra room attached:
    // if yes, no storage, if no, storage

    // dining room table only in one?

    ///////////////////////////////////////////////
    // Create Scoring metric


    double doorWidth = 0.8;
    double doorOffset = 0.2;
    double doorClearance = 1.5;
    double wallThickness = -0.15;

    bool leftOrient = true;
    List<NLine> doorActual = new List<NLine>();
    List<NFace> doorDrawing = new List<NFace>();

    for (int i = 0;i < aptIn.doors.Count;i++)
    {

      NLine selectedLine = aptIn.doors[i];

      Vec3d dirVecBlocked = Vec3d.ScaleToLen(selectedLine.Direction, doorOffset + doorWidth + doorOffset);
      Vec3d dirVecOffset = Vec3d.ScaleToLen(selectedLine.Direction, doorOffset);
      Vec3d dirVecDoor = Vec3d.ScaleToLen(selectedLine.Direction, doorWidth);

      //List<NLine> doorBlockedLine = new List<NLine>();
      //List<NLine> doorActual = new List<NLine>();


      /////////////////////////////////////////////////////////////////////////////
      // Check orientation and do left one or right one

      if (leftOrient)
      {
        NLine tempDoor = new NLine(selectedLine.start, selectedLine.start + dirVecBlocked);

        if (tempDoor.Length < selectedLine.Length)
        {
          // DOOR valid if smaller length than right door
          //doorBlockedLine.Add(tempDoor);
          NLine tempActual = new NLine(selectedLine.start + dirVecOffset, selectedLine.start + dirVecOffset + dirVecDoor);
          doorActual.Add(tempActual);

          List<NLine> tempList = new List<NLine>();
          tempList.Add(tempActual);
          NPolyLine tempActualPoly = new NPolyLine(tempList);
          NMesh tempFace = RClipper.clipperInflatePolylineMiterButtMesh(tempActualPoly, wallThickness);
          doorDrawing.AddRange(tempFace.faceList);
        }
      }
      else
      {
        NLine tempDoor = new NLine(selectedLine.end - dirVecBlocked, selectedLine.end);

        if (tempDoor.Length < selectedLine.Length)
        {
          // DOOR valid if smaller length than right door
          //doorBlockedLine.Add(tempDoor);
          NLine tempActual = new NLine(selectedLine.end - dirVecOffset - dirVecDoor, selectedLine.end - dirVecOffset);
          doorActual.Add(tempActual);

          List<NLine> tempList = new List<NLine>();
          tempList.Add(tempActual);
          NPolyLine tempActualPoly = new NPolyLine(tempList);
          NMesh tempFace = RClipper.clipperInflatePolylineMiterButtMesh(tempActualPoly, wallThickness);
          doorDrawing.AddRange(tempFace.faceList);

        }
      }
    }

    doors_center = RhConvert.NLineListToRhLineCurveList(doorActual);



    NMesh doorDrawMesh = new NMesh(doorDrawing);
    doors_rect = RhConvert.NMeshToRhLinePolylineList(doorDrawMesh);
# ---------- c_script_3: C# additional code ----------
  //-----------------------------------------------------------------
# ---------- end c_script_3 ----------

panel_42 = Panel(c_script_3.out)  # disabled

# ----
# Geo to Schema
join_3 = JoinCurves(Curves=c_script_3.boundsOut, Preserve=False)  # disabled
join_4 = JoinCurves(Curves=c_script_3.facOut, Preserve=False)  # disabled
join_5 = JoinCurves(Curves=c_script_3.circOut, Preserve=False)  # disabled
doors = CurveMiddle(Curve=c_script_3.doors_center)  # disabled
programs = Text(c_script_3.roomsNames)  # disabled
circulation = Geometry(join_5)  # disabled
outline = Geometry(join_3)  # disabled
facades = Geometry(join_4)  # disabled
rooms = Geometry(c_script_3.rooms)  # disabled
doors_2 = Point(doors)  # disabled
py3_9 = Python3Script(outline=outline, facades=facades, circulation=circulation, programs=programs, rooms=rooms, doors=doors_2)  # -> out, json; inputs outline: Curve, facades: Curve, circulation: Curve, programs: list of String, rooms: list of Curve, doors: list of Point3d; disabled
# ---------- py3_9: Python ----------
import json
from typing import List, Tuple, Dict, Any
from pathlib import Path


def polyline_to_coords(polyline) -> List[Tuple[float, float]]:
    """Convert Rhino Polyline to list of [x, y] coordinates"""
    coords = []
    for i in range(polyline.PointCount):
        pt = polyline.Point(i)
        coords.append([pt.X, pt.Y])
    return coords


def point3d_to_coords(point) -> Tuple[float, float]:
    """Convert Rhino Point3d to [x, y]"""
    return [point.X, point.Y]


def point3d_to_coords(point) -> Tuple[float, float]:
    """Convert Rhino Point3d to [x, y]"""
    return [point.X, point.Y]


def calculate_polygon_area(coords: List[List[float]]) -> float:
    """Calculate polygon area using shoelace formula"""
    if len(coords) < 3:
        return 0.0
    area = 0.0
    for i in range(len(coords) - 1):
        area += coords[i][0] * coords[i + 1][1]
        area -= coords[i + 1][0] * coords[i][1]
    return abs(area) / 2.0


def calculate_polyline_length(coords: List[List[float]]) -> float:
    """Calculate total length of a polyline"""
    if len(coords) < 2:
        return 0.0
    length = 0.0
    for i in range(len(coords) - 1):
        dx = coords[i + 1][0] - coords[i][0]
        dy = coords[i + 1][1] - coords[i][1]
        length += (dx**2 + dy**2) ** 0.5
    return round(length, 2)


def find_adjacent_rooms(door_coords: List[List[float]], rooms_coords: Dict[str, List[List[float]]]) -> List[str]:
    """Find which rooms a door connects to (simple proximity check)"""
    door_pt = door_coords[0]  # Use first point
    adjacent = []
    
    for room_id, coords in rooms_coords.items():
        # Check if door is near room boundary
        for i in range(len(coords) - 1):
            p1 = coords[i]
            p2 = coords[i + 1]
            dist = point_to_line_distance(door_pt, p1, p2)
            if dist < 0.5:  # Threshold: door within 0.5 units of boundary
                if room_id not in adjacent:
                    adjacent.append(room_id)
                break
    
    return adjacent


def point_to_line_distance(pt: List[float], p1: List[float], p2: List[float]) -> float:
    """Calculate distance from point to line segment"""
    x, y = pt
    x1, y1 = p1
    x2, y2 = p2
    
    denom = (x2 - x1) ** 2 + (y2 - y1) ** 2
    if denom == 0:
        return ((x - x1) ** 2 + (y - y1) ** 2) ** 0.5
    
    t = max(0, min(1, ((x - x1) * (x2 - x1) + (y - y1) * (y2 - y1)) / denom))
    closest_x = x1 + t * (x2 - x1)
    closest_y = y1 + t * (y2 - y1)
    
    return ((x - closest_x) ** 2 + (y - closest_y) ** 2) ** 0.5

def schema_to_desc(schema):
    """
    Convert a layout schema dict (or JSON string) to a simple description string.
    
    Args:
        schema: dict or JSON string representation of layout schema
    
    Returns format:
        "Name (ID). 1 bedroom, 1 bathroom, 1 living room. Area: 600 sqft."
    """
    try:
        # If schema is a string, parse it as JSON first
        if isinstance(schema, str):
            schema = json.loads(schema)
        
        apt = schema.get("apartment", {})
        name = apt.get("name", "?")
        apt_id = apt.get("id", "?")
        area = apt.get("attributes", {}).get("area", 0)
        
        # Count rooms by program
        rooms = schema.get("rooms", [])
        room_counts = {}
        for room in rooms:
            prog = room.get("attributes", {}).get("program", "?")
            room_counts[prog] = room_counts.get(prog, 0) + 1
        
        # Format room counts: "1 bedroom, 2 bathrooms, 1 living room"
        room_str = ", ".join([f"{count} {prog}" for prog, count in sorted(room_counts.items())])
        
        # Simple format
        desc = f"{name} (ID: {apt_id}). {room_str}. Area: {area:.0f} m2."
        return desc
    
    except:
        return "Error parsing schema"
    
def geometry_to_layout_schema(
    crvBounds,
    crv: List,
    u: List[str],
    crvFacade: List = None,
    crvCirc: List = None,
    ptCirc: List = None,
    layout_id: str = "Layout-001",
    apartment_id: str = "apartment-1",
    apartment_name: str = "Sample Apartment"
) -> Dict[str, Any]:
    # Convert bounds
    outline_coords = polyline_to_coords(crvBounds)
    outline_area = calculate_polygon_area(outline_coords)
    
    # Create apartment object
    apartment = {
        "id": apartment_id,
        "name": apartment_name,
        "geometry": outline_coords,
        "attributes": {
            "area": round(outline_area, 2)
        }
    }
    
    # Process rooms
    rooms = []
    rooms_coords = {}
    
    for i, room_polyline in enumerate(crv):
        room_coords = polyline_to_coords(room_polyline)
        room_id = f"room-{i + 1}"
        rooms_coords[room_id] = room_coords
        
        room_program = u[i] if i < len(u) else "unknown"
        room_area = calculate_polygon_area(room_coords)
        
        room = {
            "id": room_id,
            "name": f"{room_program.capitalize()}",

            "geometry": room_coords,
            "attributes": {
                "area": round(room_area, 2),
                "program": room_program
            }
        }
        rooms.append(room)
    
    # Process doors
    doors = []
    if ptCirc:
        for i, door_pt in enumerate(ptCirc):
            door_coords = [point3d_to_coords(door_pt)]
            adjacent_rooms = find_adjacent_rooms(door_coords, rooms_coords)
            
            door = {
                "id": f"door-{i + 1}",
                "name": f"Door {i + 1}",
                "geometry": door_coords,
                "attributes": {
                    "connectsRooms": adjacent_rooms
                }
            }
            doors.append(door)
    
    # Process facades
    facades = []
    if crvFacade:
        for i, facade_polyline in enumerate(crvFacade):
            facade_coords = polyline_to_coords(facade_polyline)
            facade_length = calculate_polyline_length(facade_coords)
            facade = {
                "id": f"facade-{i + 1}",
                "name": f"Facade {i + 1}",
                "geometry": facade_coords,
                "attributes": {
                    "type": "exterior",
                    "length": facade_length
                }
            }
            facades.append(facade)
    
    # Process circulation
    circulation = []
    if crvCirc:
        for i, circ_polyline in enumerate(crvCirc):
            circ_coords = polyline_to_coords(circ_polyline)
            circ_length = calculate_polyline_length(circ_coords)
            circ = {
                "id": f"circulation-{i + 1}",
                "name": f"Circulation {i + 1}",
                "geometry": circ_coords,
                "attributes": {
                    "type": "circulation",
                    "length": circ_length
                }
            }
            circulation.append(circ)
    
    # Build schema
    schema = {
        "layoutId": layout_id,
        "apartment": apartment,
        "outline": outline_coords,
        "rooms": rooms,
        "doors": doors,
        "facades": facades,
        "circulation": circulation,
        "windows": [],
        "furniture": [],
        "mep": [],
        "structure": []
    }
    description = schema_to_desc(schema)
    schema["description"] = description
    return schema

layout = geometry_to_layout_schema(outline, rooms, programs, [facades], [circulation], doors)
json = json.dumps(layout, indent=2)
# ---------- end py3_9 ----------

# ----
# Visualise Target Layout Results
panel_43 = Panel("""kitchen
bath
foyer
living
bed
extra""")  # disabled
area = Area(Geometry=c_script_3.rooms, UseTasks=False)  # -> Area, Centroid; disabled
foyer = ColourSwatch(SwatchColor=RGB(252, 114, 96))  # disabled
bed = ColourSwatch(SwatchColor=RGB(58, 38, 102))  # disabled
kitchen = ColourSwatch(SwatchColor=RGB(100, 48, 105))  # disabled
bath = ColourSwatch(SwatchColor=RGB(255, 187, 51))  # disabled
living = ColourSwatch(SwatchColor=RGB(191, 75, 98))  # disabled
extra = ColourSwatch(SwatchColor=RGB(242, 119, 145))  # disabled
crv_5 = Curve(c_script_3.draw_cut_rooms)  # disabled
flip_3 = FlipCurve(Curve=crv_5)  # -> Curve, Flag; disabled
merge = Merge(Data1=kitchen, Data2=bath, Data3=foyer, Data4=living, Data5=bed, Data6=extra)  # disabled
rooms_names = Text(c_script_3.roomsNames)  # disabled
pt = Point(area.Centroid)  # disabled
number_slider_17 = Slider(2, range=0..10)  # disabled
number_slider_18 = Slider(2.7, range=0..10)  # disabled
boundary_2 = BoundarySurfaces(Edges=graft(flip_3.Curve), UseTasks=False)  # -> flatten(Surfaces); disabled
replace = ReplaceMembers(Set=rooms_names, Find=panel_43, Replace=merge)  # disabled
swatch = ColourSwatch(SwatchColor=RGB(255, 0, 0))  # disabled
swatch_2 = ColourSwatch(SwatchColor=RGB(0, 0, 0))  # disabled
rooms_2 = Curve(c_script_3.draw_rooms)  # disabled
outline_2 = Curve(c_script_3.draw_bounds)  # disabled
colour_swatch = ColourSwatch(SwatchColor=RGB(0, 0, 139))  # disabled
preview = CustomPreview(Geometry=flatten(boundary_2), Material=flatten(replace))  # disabled
previewlw = CustomPreviewLineweights(Geometry=rooms_2, Shader=swatch, Thickness=number_slider_17, Absolute=False)  # disabled
previewlw_2 = CustomPreviewLineweights(Geometry=outline_2, Shader=swatch_2, Thickness=number_slider_18, Absolute=False)  # disabled
tag = TextTag(Location=pt, Text=rooms_names, Colour=colour_swatch)  # disabled

panel_44 = Panel(py3_9.json)  # disabled

# ---- group: FURNITURE
crv_6 = Curve(simplify(crv_4))
explode_4 = Explode(Curve=crv_6, Recursive=True)  # -> Segments, Vertices
eval_3 = EvaluateCurve(Curve=reparameterize(explode_4.Segments), Parameter=Slider(0.27, range=0..1))  # -> Point, Tangent, Angle
flatten = FlattenTree(Tree=eval_3.Point, Path="{0}")
lng = ListLength(List=flatten)
fsim = FindSimilarMember(Data=flatten, Set=flatten)  # -> Hit, Index
series = Series(Start=0, Step=1, Count=lng)
equals = Equality(FirstNumber=series, SecondNumber=fsim.Index)  # -> Equality, Inequality
unflatten = UnflattenTree(Tree=equals.Equality, Guide=explode_4.Segments)
furniture_2 = Data(furniture)
eval_4 = EvaluateCurve(Curve=reparameterize(furniture_2), Parameter=Slider(0.27, range=0..1))  # -> Point, Tangent, Angle

# ----
cullpt = CullDuplicates(Points=flatten, Tolerance=Slider(0.001, range=0..0.001), CullMode=1)  # -> Points, Indices, Valence
replace_2 = ReplaceItems(List=flatten, Indices=cullpt.Indices, Wrap=False)
unflatten_2 = UnflattenTree(Tree=replace_2, Guide=explode_4.Segments)
null = NullItem(Item=unflatten_2)  # -> NullFlags, InvalidFlags, Description
panel_45 = Panel(null.NullFlags)
eval_5 = EvaluateCurve(Curve=reparameterize(furniture_2), Parameter=Slider(0, range=0..1))  # -> Point, Tangent, Angle
eval_6 = EvaluateCurve(Curve=reparameterize(furniture_2), Parameter=Slider(1, range=0..1))  # -> Point, Tangent, Angle

# ---- group: FURNITURE (continued)
dispatch_3 = Dispatch(List=explode_4.Segments, DispatchPattern=null.NullFlags)  # -> ListA, ListB
geo = Geometry(dispatch_3.ListA)
trim = TrimTree(Tree=geo, Depth=1)
clean_2 = CleanTree(RemoveNulls=True, RemoveInvalid=True, RemoveEmpty=invert(False), Tree=trim)
group_3 = Group(Geometry=clean_2)
bbox = BoundingBox(Content=group_3, Plane=PlaneXY(0, 0, 0), UnionBox=True)  # -> flatten(Box), Box_2

# ---- group: FURNITURE / BOUNDING RECTANGLES
srf = Surface(bbox.Box)
crv_7 = Curve(srf)
area_2 = Area(Geometry=crv_7)  # -> Area, Centroid
sort = SortList(Keys=area_2.Area, ValuesA=crv_7, ValuesB=crv_7)  # -> Keys, reverse(ValuesA), reverse(ValuesB)
area_3 = Area(Geometry=sort.ValuesA)  # -> Area, Centroid
cullpt_2 = CullDuplicates(Points=area_3.Centroid, Tolerance=Slider(0.001, range=0..0.001), CullMode=1)  # -> Points, Indices, Valence
crv_8 = Curve(sort.ValuesB)
item_14 = ListItem(List=crv_8, Index=cullpt_2.Indices, Wrap=True)

# ----
srf_2 = Surface(item_14)
crv_9 = Curve(srf_2)
offset = OffsetCurve(Curve=crv_9, Distance=Slider(0.008, range=0.001..0.1), Corners=1)  # -> flatten(Curve)

# ---- group: FURNITURE (continued)
lng_2 = ListLength(List=flatten(item_14))
crv_10 = Curve(offset)
dup = DuplicateData(Data=graft(furniture_2), Number=lng_2, Order=True)
flip_4 = FlipMatrix(Data=dup)  # -> simplify(Data)
incurve_2 = PointInCurve(Point=eval_4.Point, Curve=graft(crv_10))  # -> Relationship, Point

# ----
incurve_3 = PointInCurve(Point=eval_6.Point, Curve=graft(crv_10))  # -> Relationship, Point
incurve_4 = PointInCurve(Point=eval_5.Point, Curve=graft(crv_10))  # -> Relationship, Point
and = GateAnd(A=incurve_4.Relationship, B=incurve_3.Relationship, C=incurve_2.Point)

# ---- group: FURNITURE (continued)
dispatch_4 = Dispatch(List=simplify(flip_4), DispatchPattern=simplify(and))  # -> ListA, ListB
crv_11 = Curve(dispatch_4.ListA)
panel_46 = Panel(crv_11)
group_4 = Group(Geometry=crv_11)  # -> flatten(Group)
item_15 = ListItem(List=flatten(group_4), Index=Slider(0, range=0..16), Wrap=True)

# ---- group: RECORD FURNITURE DATASET
crv_12 = Curve(crv_11)
seed_2 = Data(seed)
py3_10 = Python3Script(Data=crv_12, Seed=seed_2, Record=Toggle(True), Reset=Button())  # -> out, OutputTree; inputs Data: tree, Seed: Int32, Record: Boolean, Reset: Boolean
# ---------- py3_10: Python ----------
import Grasshopper as gh
import System

# Inizializza la memoria persistente del componente
# Se 'Reset' è True, svuota la memoria
if "recorded_data" not in globals() or Reset:
    recorded_data = {}

# Se premiamo il bottone Record e ci sono dati nell'albero
if Record and Data.DataCount > 0:
    
    # Creiamo un albero temporaneo per il seed corrente
    temp_tree = gh.DataTree[System.Object]()
    
    # Cicliamo attraverso tutti i branch dell'albero in entrata
    for i in range(Data.BranchCount):
        original_path = Data.Path(i)
        branch_data = Data.Branch(i)
        
        # 1. Estraiamo gli indici del branch originale (es. [0, 0])
        old_indices = list(original_path.Indices)
        
        # 2. Creiamo una nuova lista inserendo il Seed come primo elemento (es. [42, 0, 0])
        new_indices = [Seed] + old_indices
        
        # 3. Generiamo il vero GH_Path convertendo la lista Python in un Array .NET
        new_path = gh.Kernel.Data.GH_Path(System.Array[int](new_indices))
        
        # Aggiungiamo i dati mantenendo intatta la lista del branch originale
        temp_tree.AddRange(branch_data, new_path)
    
    # Salva l'albero strutturato nella memoria globale usando il Seed come chiave
    recorded_data[Seed] = temp_tree

# Ricostruiamo l'albero finale combinando tutti i seed registrati
OutputTree = gh.DataTree[System.Object]()
for key in sorted(recorded_data.keys()):
    tree = recorded_data[key]
    for i in range(tree.BranchCount):
        OutputTree.AddRange(tree.Branch(i), tree.Path(i))
# ---------- end py3_10 ----------
panel_47 = Panel(py3_10.OutputTree)
dataset_big = Data(Tree({0;0}: [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], {0;1}: [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], {0;2}: [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], {0;3}: [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], {0;4}: [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], {0;5}: [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]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))
py3_11 = Python3Script(Tree=dataset_big)  # -> out, CleanTree; inputs Tree: tree
# ---------- py3_11: Python ----------
import Grasshopper as gh
import System

# Creiamo un nuovo albero vuoto
CleanTree = gh.DataTree[System.Object]()

# Passiamo in rassegna ogni branch dell'albero originale
for i in range(Tree.BranchCount):
    # Estraiamo i dati del branch corrente
    branch_data = Tree.Branch(i)
    
    # Creiamo un nuovo percorso composto solo dall'indice sequenziale 'i'
    new_path = gh.Kernel.Data.GH_Path(i)
    
    # Inseriamo i dati nel nuovo albero con il percorso pulito
    CleanTree.AddRange(branch_data, new_path)
# ---------- end py3_11 ----------
dataset_big_features = Data(Tree({0}: [3.92, 2, 2.6, 1.3, 11, 9, 23, 1], {1}: [3.186, 0.6, 5.31, 8.85, 5, 12, 107, 10], {2}: [2.0302, 1.4, 2, 1.428571429, 7, 4, 12, 1], {3}: [2.2, 1.3, 2, 1.538461538, 29, 3, 30, 1], {4}: [2.1294, 0.6, 3.549, 5.915, 5, 1, 4, 1], {5}: [1.8, 0.9, 2, 2.222222222, 5, 5, 12, 1]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))
panel_48 = Panel("C:\Users\giofo\Desktop\ARCHIVIO\MASTERS\MACAD\2_MACAD\0_MACAD DRIVE\AIA\STUDIO\FURNITURE\furniture_geometry.json")
py3_12 = Python3Script(pieces=py3_11.CleanTree, feats=dataset_big_features, path=panel_48, run=Toggle(False))  # -> out, a; inputs pieces: tree of Curve, feats: tree
# ---------- py3_12: Python ----------
import json
import Rhino.Geometry as rg
import rhinoscriptsyntax as rs

def to_curve(o):
    # Works whether the branch item is a Curve, a GH curve wrapper, or a Guid.
    if isinstance(o, rg.Curve):
        return o
    return rs.coercecurve(o)

def poly_pts(o, samples=64):
    crv = to_curve(o)
    if crv is None:
        return []
    ok, pl = crv.TryGetPolyline()          # true polylines: exact vertices
    if ok:
        return [[round(p.X, 4), round(p.Y, 4)] for p in pl]
    ts = crv.DivideByCount(samples, True)  # arcs / nurbs: sample evenly
    pts = [crv.PointAt(t) for t in ts] if ts else []
    if crv.IsClosed and pts:
        pts.append(pts[0])                 # repeat first point to mark closure
    return [[round(p.X, 4), round(p.Y, 4)] for p in pts]

if run:
    out = {"units": "meters", "pieces": []}
    
    for b in range(pieces.BranchCount):
        crvs = pieces.Branch(b)
        
        # 1. Controllo: Il branch esiste in feats?
        if b >= feats.BranchCount:
            print("Saltato branch {}: Non esiste nell'albero 'feats'.".format(b))
            continue
            
        f = list(feats.Branch(b))
        
        # 2. Controllo: Ci sono tutti e gli 8 elementi previsti?
        if len(f) < 8:
            print("⚠️ Attenzione sul branch {}: trovati solo {} elementi invece di 8. Inserimento di dati 'None'.".format(b, len(f)))
            # Aggiungiamo dei 'None' fittizi per non far crashare lo script
            f.extend([None] * (8 - len(f)))

        # Genera le polilinee
        polylines = [p for p in (poly_pts(c) for c in crvs) if len(p) >= 2]
        
        out["pieces"].append({
            "id": "p%04d" % b,
            "features": {
                "Area": f[0], "BB_short_dim": f[1], "BB_long_dim": f[2], "Prop": f[3],
                "Verts": f[4], "Geoms": f[5], "Exp_edge_count": f[6], "Closed_curves": f[7],
            },
            "polylines": polylines,
        })
        
    out["count"] = len(out["pieces"])
    
    # Salva il file
    with open(path, "w") as fp:
        json.dump(out, fp)
        
    print("Export completato: scritti %d pezzi -> %s" % (out["count"], path))
# ---------- end py3_12 ----------
panel_49 = Panel(py3_12.a)

# ---- group: PF BLOCKS
toggle_2 = BooleanToggle(True)  # disabled
py3_13 = Python3Script(Run=toggle_2)  # -> out, Block_Names, Block_Geometries; disabled
# ---------- py3_13: Python ----------
import Rhino
import ghpythonlib.treehelpers as th

# Initialize lists to hold our data
names = []
geometries = [] # This will be a list of lists

# Execute only when the toggle is True
if Run:
    # Look directly into the active Rhino file
    doc = Rhino.RhinoDoc.ActiveDoc
    
    # Loop through every Block Definition (InstanceDefinition) in the file
    for idef in doc.InstanceDefinitions:
        
        # Filter: We only want active blocks that start with "PF_"
        if not idef.IsDeleted and idef.Name.startswith("PF_"):
            names.append(idef.Name)
            
            # Extract the actual geometry inside the block
            block_items = []
            for obj in idef.GetObjects():
                # Extract the underlying geometry (curves, surfaces, etc.)
                block_items.append(obj.Geometry)
                
            geometries.append(block_items)
            
    print(f"Successfully extracted {len(names)} PlanFinder Block Definitions.")

# Assign to outputs
Block_Names = names

# Convert the Python list-of-lists into a Grasshopper DataTree
# This ensures each block's geometry stays grouped in its own branch!
Block_Geometries = th.list_to_tree(geometries)
# ---------- end py3_13 ----------
number_slider_19 = Slider(39, range=0..50)  # disabled
number_slider_20 = Slider(22, range=0..50)  # disabled
geo_2 = Geometry(simplify(py3_13.Block_Geometries))  # disabled
pf_block_dataset = Data(Tree({0}: ["PF_Chair_2D", 0.6, -0.8, -0.75, 0.9375, 5, 2, 7, 1], {1}: ["PF_SofaSmall_2D", 1.28, -1.6, -0.8, 0.5, 5, 5, 8, 1], {2}: ["PF_SofaLarge_2D", 1.6, -2, -0.8, 0.4, 5, 6, 9, 1], {3}: ["PF_CoffeeSmall_2D", 0.5, -1, -0.5, 0.5, 5, 1, 4, 1], {4}: ["PF_CoffeeLarge_2D", 1.4, -1.4, -1, 0.7142857143, 5, 1, 4, 1], {5}: ["PF_TV_2D", 0.35, -1.4, -0.25, 0.1785714286, 5, 2, 8, 2]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))  # disabled
group_5 = Group(Geometry=geo_2)  # -> flatten(Group); disabled
item_16 = ListItem(List=group_5, Index=number_slider_19, Wrap=True)  # disabled
item_17 = ListItem(List=py3_13.Block_Names, Index=number_slider_19, Wrap=True)  # disabled
panel_50 = Panel(geo_2)  # disabled
panel_51 = Panel(item_17)  # disabled
catalog_code = Data("""CATALOG = {
    "PF_Chair_2D": [
        0.6000000000000006,
        -0.8000000000000012,
        -0.7499999999999998,
        0.9374999999999983,
        5.0,
        2.0,
        7.0,
        1.0
    ],
    "PF_SofaSmall_2D": [
        1.2800000000000002,
        -1.6000000000000005,
        -0.7999999999999998,
        0.4999999999999997,
        5.0,
        5.0,
        8.0,
        1.0
    ],
    "PF_SofaLarge_2D": [
        1.5999999999999996,
        -2.0,
        -0.7999999999999998,
        0.3999999999999999,
        5.0,
        6.0,
        9.0,
        1.0
    ],
    "PF_CoffeeSmall_2D": [
        0.5,
        -1.0,
        -0.5,
        0.5,
        5.0,
        1.0,
        4.0,
        1.0
    ],
    "PF_CoffeeLarge_2D": [
        1.3999999999999986,
        -1.3999999999999986,
        -1.0,
        0.714285714285715,
        5.0,
        1.0,
        4.0,
        1.0
    ],
    "PF_TV_2D": [
        0.34999999999999964,
        -1.3999999999999986,
        -0.25,
        0.17857142857142874,
        5.0,
        2.0,
        8.0,
        2.0
    ],
    "PF_DiningTwo_2D": [
        0.8649999999999975,
        -1.2999999999999972,
        -0.7999999999999998,
        0.6153846153846166,
        13.0,
        3.0,
        14.0,
        1.0
    ],
    "PF_DiningFour_2D": [
        1.6499999999999961,
        -1.5,
        -1.2999999999999972,
        0.8666666666666648,
        21.0,
        3.0,
        22.0,
        1.0
    ],
    "PF_DiningSix_2D": [
        2.199999999999994,
        -1.9999999999999996,
        -1.3000000000000256,
        0.6500000000000129,
        29.0,
        3.0,
        30.0,
        1.0
    ],
    "PF_Study_2D": [
        0.779999999999998,
        -1.2999999999999972,
        -0.5999999999999999,
        0.46153846153846245,
        5.0,
        5.0,
        14.0,
        3.0
    ],
    "PF_Bed_2D": [
        3.9200000000000017,
        -2.6000000000000014,
        -2.0,
        0.7692307692307688,
        11.0,
        9.0,
        23.0,
        1.0
    ],
    "PF_BedSingle_2D": [
        1.8000000000000007,
        -2.0,
        -0.9000000000000004,
        0.4500000000000002,
        5.0,
        5.0,
        12.0,
        1.0
    ],
    "PF_KitchenSink_2D": [
        0.2759999999999979,
        -0.5999999999999943,
        -0.46000000000000085,
        0.7666666666666754,
        5.0,
        3.0,
        13.0,
        3.0
    ],
    "PF_KitchenStove_2D": [
        0.3599999999999974,
        -0.6000000000000014,
        -0.5999999999999943,
        0.9999999999999881,
        5.0,
        5.0,
        84.0,
        5.0
    ],
    "PF_KitchenFridge_2D": [
        0.3599999999999964,
        -0.5999999999999996,
        -0.5999999999999943,
        0.9999999999999911,
        5.0,
        3.0,
        6.0,
        1.0
    ],
    "PF_Shower_2D": [
        0.810000000000001,
        -0.9000000000000083,
        -0.8999999999999986,
        0.9999999999999891,
        5.0,
        3.0,
        13.0,
        3.0
    ],
    "PF_Sink_2D": [
        0.23999999999999794,
        -0.5999999999999943,
        -0.40000000000000036,
        0.6666666666666736,
        5.0,
        3.0,
        13.0,
        3.0
    ],
    "PF_DoubleSink_2D": [
        0.6999999999999993,
        -1.3999999999999986,
        -0.5,
        0.3571428571428575,
        5.0,
        5.0,
        22.0,
        5.0
    ],
    "PF_Toilet_2D": [
        0.1888849102760865,
        -0.5737907492703158,
        -0.3524439598913425,
        0.6142377867533453,
        19.0,
        2.0,
        19.0,
        1.0
    ],
    "PF_Bath_2D": [
        1.3599999999999977,
        -1.6999999999999957,
        -0.8000000000000007,
        0.47058823529411925,
        5.0,
        4.0,
        19.0,
        3.0
    ],
    "PF_Door_2D": [
        0.039999999999997586,
        -0.7999999999999972,
        -0.04999999999999716,
        0.06249999999999667,
        5.0,
        5.0,
        28.0,
        3.0
    ],
    "PF_DoorEntrance_2D": [
        0.040493827160495294,
        -0.8888888888888857,
        -0.04555555555555735,
        0.0512500000000022,
        5.0,
        5.0,
        28.0,
        3.0
    ],
    "PF_DiningThree_2D": [
        0.9775,
        -1.2999999999999972,
        -1.0500000000000043,
        0.8076923076923127,
        17.0,
        4.0,
        19.0,
        1.0
    ],
    "PF_SofaCorner_2D": [
        2.0300000000000034,
        -2.000000000000001,
        -1.4000000000000021,
        0.7000000000000007,
        7.0,
        4.0,
        12.0,
        1.0
    ],
    "PF_SofaBed_2D": [
        1.2800000000000025,
        -1.6000000000000014,
        -0.8000000000000007,
        0.5,
        5.0,
        32.0,
        39.0,
        1.0
    ],
    "PF_SquareCoffeeTable_2D": [
        0.48999999999999905,
        -0.6999999999999993,
        -0.6999999999999993,
        1.0,
        5.0,
        1.0,
        4.0,
        1.0
    ],
    "PF_DiningRound_2D": [
        1.1180982748428927,
        -1.2000000000000028,
        -1.1999999999999957,
        0.9999999999999941,
        25.0,
        5.0,
        48.0,
        1.0
    ],
    "PF_BedWithoutSides_2D": [
        3.5999999999999943,
        -2.0,
        -1.7999999999999972,
        0.8999999999999986,
        5.0,
        9.0,
        17.0,
        1.0
    ],
    "PF_SinkToilet_2D": [
        0.17499999999999893,
        -0.5,
        -0.34999999999999787,
        0.6999999999999957,
        5.0,
        3.0,
        13.0,
        3.0
    ],
    "PF_SeatingXS_2D": [
        1.2799999999999967,
        -1.5999999999999943,
        -0.8000000000000007,
        0.5000000000000022,
        5.0,
        8.0,
        20.0,
        4.0
    ],
    "PF_SeatingS_2D": [
        1.6000000000000014,
        -2.0,
        -0.8000000000000007,
        0.40000000000000036,
        5.0,
        9.0,
        21.0,
        4.0
    ],
    "PF_SeatingSWide_2D": [
        1.6000000000000014,
        -2.0,
        -0.8000000000000007,
        0.40000000000000036,
        5.0,
        11.0,
        28.0,
        5.0
    ],
    "PF_SeatingM_2D": [
        6.951940660835992,
        -3.188175000000001,
        -2.320575999999999,
        0.7278697060230377,
        13.0,
        12.0,
        40.0,
        6.0
    ],
    "PF_SeatingMDeep_2D": [
        2.0300000000000034,
        -2.0,
        -1.4000000000000021,
        0.7000000000000011,
        7.0,
        11.0,
        36.0,
        5.0
    ],
    "PF_SeatingMDeepest_2D": [
        7.849526399999996,
        -2.9205760000000005,
        -2.8499999999999943,
        0.9758349037997963,
        13.0,
        14.0,
        40.0,
        6.0
    ],
    "PF_SeatingL_2D": [
        10.448996070686862,
        -3.5131605579733716,
        -3.206090688358856,
        0.9125944104895524,
        13.0,
        9.0,
        45.0,
        5.0
    ],
    "PF_SeatingLWithoutTV_2D": [
        10.448996070686862,
        -3.5131605579733716,
        -3.206090688358856,
        0.9125944104895524,
        13.0,
        7.0,
        37.0,
        3.0
    ],
    "PF_MiniDoor_2D": [
        0.029999999999993268,
        -0.5995670606906742,
        -0.15342929425075624,
        0.25590013913374865,
        5.0,
        5.0,
        17.0,
        3.0
    ],
    "PF_SlidingDoor_2D": [
        0.03499999999999744,
        -0.6999999999999886,
        -0.04999999999999716,
        0.07142857142856852,
        5.0,
        1.0,
        4.0,
        1.0
    ],
    "PF_DoubleDoor_2D": [
        0.039999999999997586,
        -0.7999999999999972,
        -0.04999999999999716,
        0.06249999999999667,
        5.0,
        8.0,
        48.0,
        4.0
    ],
    "PF_SmallDoor_2D": [
        0.029999999999998906,
        -0.6000000000000121,
        -0.04999999999999716,
        0.08333333333332692,
        5.0,
        5.0,
        28.0,
        3.0
    ],
    "PF_DiningEight_2D": [
        2.399999999999996,
        -2.499999999999943,
        -1.3000000000000398,
        0.5200000000000278,
        37.0,
        5.0,
        40.0,
        1.0
    ],
    "PF_Laundry_2D": [
        0.35999999999999743,
        -0.6000000000000014,
        -0.5999999999999943,
        0.9999999999999881,
        5.0,
        1.0,
        4.0,
        1.0
    ],
    "PF_Piano_2D": [
        2.18105709626231,
        -1.9189827835974462,
        -1.5,
        0.7816641258177446,
        31.0,
        4.0,
        33.0,
        1.0
    ],
    "PF_SeatingXSWide_2D": [
        1.2799999999999967,
        -1.5999999999999943,
        -0.8000000000000007,
        0.5000000000000022,
        5.0,
        10.0,
        27.0,
        5.0
    ],
    "PF_SeatingXL_2D": [
        11.546169540074603,
        -3.613160557973373,
        -3.4060906883588586,
        0.9426901001790354,
        17.0,
        11.0,
        56.0,
        6.0
    ],
    "PF_DiningSixB_2D": [
        1.8637499999999885,
        -1.9749999999999446,
        -1.3000000000000114,
        0.6582278481012901,
        29.0,
        5.0,
        32.0,
        1.0
    ]
}""")  # disabled
py3_14 = Python3Script(Data_Tree=pf_block_dataset)  # -> out, Catalog_Code; inputs Data_Tree: tree; disabled
# ---------- py3_14: Python ----------
import json

# Initialize the dictionary to store the catalog
catalog_dict = {}

if Data_Tree:
    # Use standard Grasshopper SDK properties to iterate over branches
    # BranchCount returns the total number of branches in the tree
    for i in range(Data_Tree.BranchCount):
        # Branch(i) extracts the list of items inside the branch at index i
        branch_data = Data_Tree.Branch(i)
        
        # Check if the branch has at least the name (index 0) and 1 feature
        if branch_data and len(branch_data) > 1:
            # First element is always the name of the block
            block_name = str(branch_data[0]).strip()
            
            # The rest of the elements are the physical features
            features = []
            # Use standard integer iteration to bypass .NET slicing limitations
            for j in range(1, len(branch_data)):
                try:
                    item = branch_data[j]
                    # Convert to float to clean up any GH wrapper types
                    features.append(float(item))
                except (ValueError, TypeError):
                    # Skip nulls or unconvertible values
                    pass
            
            # Assign features to our catalog dictionary
            catalog_dict[block_name] = features

# Serialize to a clean JSON string formatting
formatted_json = json.dumps(catalog_dict, indent=4)
Catalog_Code = "CATALOG = " + formatted_json

print("Catalog compiled successfully using native Grasshopper SDK!")
print("Identified {} unique furniture profiles.".format(len(catalog_dict)))
# ---------- end py3_14 ----------
len = Length(Curve=geo_2)  # disabled
sort_2 = SortList(Keys=len, ValuesA=geo_2)  # -> Keys, reverse(simplify(ValuesA)); disabled
brec = BoundingRectangle(Plane=PlaneXY(0, 0, 0), Axis=0, Slide=0, Union=True)  # -> Bounding, DimensionX, DimensionY; disabled
explode_5 = Explode(Curve=sort_2.ValuesA, Recursive=True)  # -> Segments, Vertices; disabled
lng_3 = ListLength(List=explode_5.Segments)  # disabled
trim_2 = TrimTree(Tree=lng_3, Depth=1)  # disabled
ma = MassAddition(Input=trim_2)  # -> Result, PartialResults; disabled
graft = GraftTree(Tree=py3_13.Block_Names, IncludeEmptyLists=True, IncludeNullItems=True)  # -> simplify(Tree); disabled

# ---- group: PF BLOCKS / outline area
item_18 = ListItem(List=sort_2.ValuesA, Index=0, Wrap=True)  # disabled
area_4 = Area(Geometry=item_18)  # -> Area, Centroid; disabled

# ---- group: PF BLOCKS / bb area proportion max/min
bbox_2 = BoundingBox(Content=item_18, Plane=PlaneXY(0, 0, 0), UnionBox=True)  # -> Box, Box_2; disabled
debox = DeconstructBox(Box=bbox_2.Box)  # -> Plane, X, Y, Z; disabled
dedomain = DeconstructDomain(Domain=debox.X)  # -> Start, End; disabled
dedomain_2 = DeconstructDomain(Domain=debox.Y)  # -> Start, End; disabled
subtraction = Subtraction(A=dedomain.Start, B=dedomain.End)  # disabled
subtraction_2 = Subtraction(A=dedomain_2.Start, B=dedomain_2.End)  # disabled
max = Maximum(A=subtraction, B=subtraction_2)  # disabled
min = Minimum(A=subtraction, B=subtraction_2)  # disabled
division = Division(A=max, B=min)  # disabled

# ---- group: PF BLOCKS / CLOSED CRUVES
cls_2 = Closed(Curve=sort_2.ValuesA)  # -> Closed, Periodic; disabled
dispatch_5 = Dispatch(List=sort_2.ValuesA, DispatchPattern=cls_2.Closed)  # -> ListA, ListB; disabled
crv_13 = Curve(dispatch_5.ListA)  # disabled
lng_4 = ListLength(List=crv_13)  # disabled

# ---- group: PF BLOCKS / outline vertices
explode_6 = Explode(Curve=item_18, Recursive=True)  # -> Segments, Vertices; disabled
lng_5 = ListLength(List=explode_6.Vertices)  # -> simplify(Length); disabled

# ---- group: PF BLOCKS / number of elements
lng_6 = ListLength(List=sort_2.ValuesA)  # disabled

# ---- group: PF BLOCKS (continued)
merge_2 = Merge(
    Data1=simplify(area_4.Area),
    Data2=simplify(min),
    Data3=simplify(max),
    Data4=simplify(division),
    Data5=simplify(lng_5),
    Data6=simplify(lng_6),
    Data7=simplify(ma.Result),
    Data8=simplify(lng_4))  # disabled
panel_52 = Panel(merge_2)  # disabled
merge_3 = Merge(Data1=graft, Data2=merge_2)  # disabled

# ---- group: furniture featuures
len_2 = Length(Curve=crv_11)
sort_3 = SortList(Keys=len_2, ValuesA=crv_11)  # -> Keys, reverse(simplify(ValuesA))
explode_7 = Explode(Curve=sort_3.ValuesA, Recursive=True)  # -> Segments, Vertices
lng_7 = ListLength(List=explode_7.Segments)
trim_3 = TrimTree(Tree=lng_7, Depth=1)
ma_2 = MassAddition(Input=trim_3)  # -> Result, PartialResults

# ---- group: furniture featuures / outline area
item_19 = ListItem(List=sort_3.ValuesA, Index=0, Wrap=True)
area_5 = Area(Geometry=item_19)  # -> Area, Centroid

# ---- group: furniture featuures / bb area proportion max/min
bbox_3 = BoundingBox(Content=item_19, Plane=PlaneXY(0, 0, 0), UnionBox=True)  # -> Box, Box_2
debox_2 = DeconstructBox(Box=bbox_3.Box)  # -> Plane, X, Y, Z
dedomain_3 = DeconstructDomain(Domain=debox_2.X)  # -> Start, End
dedomain_4 = DeconstructDomain(Domain=debox_2.Y)  # -> Start, End
subtraction_3 = Subtraction(A=dedomain_3.Start, B=dedomain_3.End)
subtraction_4 = Subtraction(A=dedomain_4.Start, B=dedomain_4.End)
abs = Absolute(Value=subtraction_3)
abs_2 = Absolute(Value=subtraction_4)
min_2 = Minimum(A=abs, B=abs_2)
max_2 = Maximum(A=abs, B=abs_2)
division_2 = Division(A=max_2, B=min_2)

# ---- group: furniture featuures / CLOSED CRUVES
cls_3 = Closed(Curve=sort_3.ValuesA)  # -> Closed, Periodic
dispatch_6 = Dispatch(List=sort_3.ValuesA, DispatchPattern=cls_3.Closed)  # -> ListA, ListB
crv_14 = Curve(dispatch_6.ListA)
lng_8 = ListLength(List=crv_14)

# ---- group: furniture featuures / outline vertices
explode_8 = Explode(Curve=item_19, Recursive=True)  # -> Segments, Vertices
lng_9 = ListLength(List=explode_8.Vertices)  # -> simplify(Length)

# ---- group: furniture featuures / number of elements
lng_10 = ListLength(List=sort_3.ValuesA)

# ---- group: furniture featuures (continued)
merge_4 = Merge(
    Data1=simplify(area_5.Area),
    Data2=simplify(min_2),
    Data3=simplify(max_2),
    Data4=simplify(division_2),
    Data5=simplify(lng_9),
    Data6=simplify(lng_10),
    Data7=simplify(ma_2.Result),
    Data8=simplify(lng_8))
flip_5 = FlipMatrix(Data=merge_4)
bang = ExplodeTree(Data=flip_5)  # -> Branch0, Branch1, Branch2, Branch3, Branch4, Branch5, Branch6, Branch7
bb_long_dim = Data(bang.Branch2)
exp_edge_count = Data(bang.Branch6)
closed_curves = Data(bang.Branch7)
areas = Data(bang.Branch0)
bb_short_dim = Data(bang.Branch1)
props = Data(bang.Branch3)
verts = Data(bang.Branch4)
geoms = Data(bang.Branch5)
panel_53 = Panel(closed_curves)
export_dataset_for_clsutering = Python3Script(
    Areas=areas,
    BB_short_dim=bb_short_dim,
    BB_long_dim=bb_long_dim,
    Props=props,
    Verts=verts,
    Geoms=geoms,
    Exp_edge_count=exp_edge_count,
    Closed_curves=closed_curves,
    Run=Toggle(True))  # -> out; inputs Areas: list of Double, BB_short_dim: list, BB_long_dim: list, Props: list of Double, Verts: list of Int32, Geoms: list of Int32, Exp_edge_count: list, Closed_curves: list, Run: Boolean
# ---------- export_dataset_for_clsutering: Python ----------
import os

# Ensure the script only runs when the toggle is True and data is present
if Run and Areas:
    # Target folder path using a raw string 'r' to prevent Windows backslash escape errors
    folder_path = r"C:\Users\giofo\Desktop\ARCHIVIO\MASTERS\MACAD\2_MACAD\0_MACAD DRIVE\AIA\STUDIO\FURNITURE"
    filepath = os.path.join(folder_path, "dataset_furniture_expanded.csv")
    
    # Safety check: automatically create the directory tree if it doesn't exist
    if not os.path.exists(folder_path):
        os.makedirs(folder_path)
        
    with open(filepath, "w") as f:
        # Write CSV Header matching your 8 new geometric features
        f.write("Area,BB_short_dim,BB_long_dim,Prop,Verts,Geoms,Exp_edge_count,Closed_curves\n")
        
        # Loop through all recorded furniture entries
        for i in range(len(Areas)):
            f.write(
                f"{Areas[i]},"
                f"{BB_short_dim[i]},"
                f"{BB_long_dim[i]},"
                f"{Props[i]},"
                f"{Verts[i]},"
                f"{Geoms[i]},"
                f"{Exp_edge_count[i]},"
                f"{Closed_curves[i]}\n"
            )
            
    print(f"Expanded dataset with {len(Areas)} rows successfully saved to:\n{filepath}")
# ---------- end export_dataset_for_clsutering ----------
panel_54 = Panel(export_dataset_for_clsutering)

# ----
bb_long_dim_2 = Data(bang.Branch2)
exp_edge_count_2 = Data(bang.Branch6)
closed_curves_2 = Data(bang.Branch7)
areas_2 = Data(bang.Branch0)
bb_short_dim_2 = Data(bang.Branch1)
props_2 = Data(bang.Branch3)
verts_2 = Data(bang.Branch4)
geoms_2 = Data(bang.Branch5)
nn_matcher = Python3Script(
    Areas=areas_2,
    BB_short_dim=bb_short_dim_2,
    BB_long_dim=bb_long_dim_2,
    Props=props_2,
    Verts=verts_2,
    Geoms=geoms_2,
    Exp_edge_count=exp_edge_count_2,
    Closed_curves=closed_curves_2,
    run=Toggle(True))  # -> out, flatten(match_result); inputs Areas: list, BB_short_dim: list, BB_long_dim: list, Props: list, Verts: list, Geoms: list, Exp_edge_count: list, Closed_curves: list
# ---------- nn_matcher: Python ----------
"""
Simplified Live Furniture Classifier (Nearest-Neighbor)
Takes 8 feature lists from Grasshopper, compares to catalog, outputs names.
"""

import json
import math

# 1. YOUR CUSTOM CATALOG PATH
CATALOG_JSON = r"C:\Users\giofo\Desktop\ARCHIVIO\MASTERS\MACAD\2_MACAD\0_MACAD DRIVE\AIA\STUDIO\AIA26_Studio\team_06\gh\furniture_catalog.json"
NUM_FEATURES = 8

# ---------------------------------------------------------------------------
# Catalog + Nearest-Neighbour Logic
# ---------------------------------------------------------------------------
def load_catalog(path=CATALOG_JSON):
    with open(path, "r", encoding="utf-8") as f:
        data = json.load(f)
        
    names = [t["name"] for t in data["types"]]
    anchors = [t["anchor"] for t in data["types"]]
    
    # Calculate min, max, and range for normalization
    mn = [min(a[i] for a in anchors) for i in range(NUM_FEATURES)]
    mx = [max(a[i] for a in anchors) for i in range(NUM_FEATURES)]
    rng = [mx[i] - mn[i] for i in range(NUM_FEATURES)]
    
    norm_anchors = [_normalize(a, mn, rng) for a in anchors]
    return {"names": names, "norm": norm_anchors, "mn": mn, "rng": rng}

def _normalize(v, mn, rng):
    return [((v[i] - mn[i]) / rng[i]) if rng[i] else 0.0 for i in range(NUM_FEATURES)]

def classify(feat, cat):
    """feat = [Area, BB_short, BB_long, Prop, Verts, Geoms, Exp_edge, Closed]."""
    q = _normalize([float(x) for x in feat], cat["mn"], cat["rng"])
    best_d, best = float("inf"), "Unknown"
    
    for name, a in zip(cat["names"], cat["norm"]):
        d = math.sqrt(sum((l - r) ** 2 for l, r in zip(q, a)))
        if d < best_d:
            best_d, best = d, name
            
    return best

# ---------------------------------------------------------------------------
# === GHPYTHON INPUTS ===
# ---------------------------------------------------------------------------
if run:
    try:
        cat = load_catalog()
        match_result = []
        
        # Loop through the parallel lists coming from Grasshopper
        for i in range(len(Areas)):
            # Build the feature vector for the current piece
            live_feat = [
                float(Areas[i]), float(BB_short_dim[i]), float(BB_long_dim[i]),
                float(Props[i]), float(Verts[i]), float(Geoms[i]),
                float(Exp_edge_count[i]), float(Closed_curves[i])
            ]
            
            # Classify and append the name to our output list
            best_name = classify(live_feat, cat)
            match_result.append(best_name)
            
    except Exception as e:
        match_result = ["Error: " + str(e)]
else:
    match_result = ["Waiting for 'run' boolean toggle..."]
# ---------- end nn_matcher ----------
panel_55 = Panel(nn_matcher.match_result)
panel_56 = Panel(sort_3.ValuesA)
number_slider_21 = Slider(0, range=0..16)
group_6 = Group(Geometry=sort_3.ValuesA)  # -> flatten(Group)
item_20 = ListItem(List=flatten(group_6), Index=number_slider_21, Wrap=True)
item_21 = ListItem(List=flatten(panel_55), Index=number_slider_21, Wrap=True)
furniture_json_builder = Python3Script(names=nn_matcher.match_result, furniture_curves=sort_3.ValuesA, run=Toggle(True))  # -> out, furniture_json; inputs names: list, furniture_curves: tree of Curve
# ---------- furniture_json_builder: Python ----------
"""
Script 1: Furniture JSON Builder (Multi-Curve Support)
Extracts the main outline and all interior detailing lines per furniture piece.
"""

import json

def curve_to_points(curve):
    """Helper function to extract X, Y coordinates from a Rhino line or polyline."""
    # Try to extract points if it is a polyline
    rc, polyline = curve.TryGetPolyline()
    if rc:
        return [[round(pt.X, 3), round(pt.Y, 3)] for pt in polyline]
    
    # Fallback for straight lines or other curve types (extracts control vertices)
    if hasattr(curve, "DuplicateControlPoints"):
        pts = curve.DuplicateControlPoints()
        return [[round(pt.X, 3), round(pt.Y, 3)] for pt in pts]
        
    # Ultimate fallback using start and end points
    return [
        [round(curve.PointAtStart.X, 3), round(curve.PointAtStart.Y, 3)],
        [round(curve.PointAtEnd.X, 3), round(curve.PointAtEnd.Y, 3)]
    ]

if run:
    furniture_list = []
    
    try:
        # Loop through each branch (where 1 branch = 1 furniture asset)
        for i in range(furniture_curves.BranchCount):
            name = names[i] if i < len(names) else "Unknown"
            branch_curves = furniture_curves.Branch(i)
            
            # Parse every single curve inside this branch into coordinate arrays
            parsed_curves = []
            for curve in branch_curves:
                pts = curve_to_points(curve)
                if pts:
                    parsed_curves.append(pts)
            
            # Since your branch is sorted by length, index 0 is always the main outline
            main_outline = parsed_curves[0] if parsed_curves else []
            
            # Build the complete furniture object
            furniture_piece = {
                "id": "furniture-{}".format(i + 1),
                "name": name,
                "geometry": main_outline,     # Used for boundary/room detection
                "all_curves": parsed_curves,   # Used by your UI to draw all lines
                "attributes": {
                    "type": "furniture"
                }
            }
            furniture_list.append(furniture_piece)
            
        # Output the structural data as a JSON string
        furniture_json = json.dumps(furniture_list, indent=2)
        
    except Exception as e:
        furniture_json = "Error processing curves: " + str(e)
else:
    furniture_json = "Waiting for 'run' toggle..."
# ---------- end furniture_json_builder ----------
panel_57 = Panel(item_21)
panel_58 = Panel(furniture_json_builder.furniture_json)
json_appender = Python3Script(apartment_json=panel_33, furniture_json=furniture_json_builder.furniture_json, run=Toggle(True))  # -> out, combined_json
# ---------- json_appender: Python ----------
"""
Script 2: JSON Appender
Injects the generated furniture array into the existing apartment JSON object.
"""

import json

if run:
    try:
        # 1. Parse both raw JSON string inputs into native Python objects
        apt_data = json.loads(apartment_json)
        furn_data = json.loads(furniture_json)
        
        # 2. Assign the furniture list to the "furniture" key inside the apartment object
        apt_data["furniture"] = furn_data
        
        # 3. Convert the unified object back into a clean, formatted string
        combined_json = json.dumps(apt_data, indent=2)
        
    except Exception as e:
        combined_json = "Error merging JSON objects: " + str(e)
else:
    combined_json = "Waiting for 'run' toggle..."
# ---------- end json_appender ----------
panel_59 = Panel(json_appender.combined_json)

# ---- group: furniture features
len_3 = Length(Curve=py3_11.CleanTree)
sort_4 = SortList(Keys=len_3, ValuesA=py3_11.CleanTree)  # -> Keys, reverse(simplify(ValuesA))
explode_9 = Explode(Curve=sort_4.ValuesA, Recursive=True)  # -> Segments, Vertices
lng_11 = ListLength(List=explode_9.Segments)
trim_4 = TrimTree(Tree=lng_11, Depth=1)
ma_3 = MassAddition(Input=trim_4)  # -> Result, PartialResults
py3_15 = Python3Script()  # -> out, a; unedited script template
number_slider_22 = Slider(40, range=0..100)  # disabled
toggle_3 = BooleanToggle(False)  # disabled
toggle_4 = BooleanToggle(False)  # disabled

# ---- group: furniture features / outline area
item_22 = ListItem(List=sort_4.ValuesA, Index=0, Wrap=True)
area_6 = Area(Geometry=item_22)  # -> Area, Centroid

# ---- group: furniture features / bb area proportion max/min
bbox_4 = BoundingBox(Content=item_22, Plane=PlaneXY(0, 0, 0), UnionBox=True)  # -> Box, Box_2
debox_3 = DeconstructBox(Box=bbox_4.Box)  # -> Plane, X, Y, Z
dedomain_5 = DeconstructDomain(Domain=debox_3.X)  # -> Start, End
dedomain_6 = DeconstructDomain(Domain=debox_3.Y)  # -> Start, End
subtraction_5 = Subtraction(A=dedomain_5.Start, B=dedomain_5.End)
subtraction_6 = Subtraction(A=dedomain_6.Start, B=dedomain_6.End)
abs_3 = Absolute(Value=subtraction_6)
abs_4 = Absolute(Value=subtraction_5)
max_3 = Maximum(A=abs_4, B=abs_3)
min_3 = Minimum(A=abs_4, B=abs_3)
division_3 = Division(A=max_3, B=min_3)

# ---- group: furniture features / CLOSED CRUVES
cls_4 = Closed(Curve=sort_4.ValuesA)  # -> Closed, Periodic
dispatch_7 = Dispatch(List=sort_4.ValuesA, DispatchPattern=cls_4.Closed)  # -> ListA, ListB
crv_15 = Curve(dispatch_7.ListA)
lng_12 = ListLength(List=crv_15)

# ---- group: furniture features / outline vertices
explode_10 = Explode(Curve=item_22, Recursive=True)  # -> Segments, Vertices
lng_13 = ListLength(List=explode_10.Vertices)  # -> simplify(Length)

# ---- group: furniture features / number of elements
lng_14 = ListLength(List=sort_4.ValuesA)

# ---- group: furniture features (continued)
merge_5 = Merge(
    Data1=simplify(area_6.Area),
    Data2=simplify(min_3),
    Data3=simplify(max_3),
    Data4=simplify(division_3),
    Data5=simplify(lng_13),
    Data6=simplify(lng_14),
    Data7=simplify(ma_3.Result),
    Data8=simplify(lng_12))
flip_6 = FlipMatrix(Data=merge_5)
viewer = ParamViewer(flip_6)
bang_2 = ExplodeTree(Data=flip_6)  # -> Branch0, Branch1, Branch2, Branch3, Branch4, Branch5, Branch6, Branch7
rec_2 = DataRecorder(flip_6, DataLimit=-10, RecordData=True)
viewer_2 = ParamViewer(rec_2)
areas_3 = Data(bang_2.Branch0)
bb_short_dim_3 = Data(bang_2.Branch1)
bb_long_dim_3 = Data(bang_2.Branch2)
props_3 = Data(bang_2.Branch3)
verts_3 = Data(bang_2.Branch4)
geoms_3 = Data(bang_2.Branch5)
exp_edge_count_3 = Data(bang_2.Branch6)
closed_curves_3 = Data(bang_2.Branch7)
panel_60 = Panel(closed_curves_3)
py3_16 = Python3Script(Areas=areas_3, Props=props_3, Verts=verts_3, Geoms=geoms_3, K=number_slider_22, Run=toggle_3)  # -> out, ClusterIDs, Centroids; inputs Areas: list of Double, Props: list of Double, Verts: list of Int32, Geoms: list of Int32, K: Int32, Run: Boolean; disabled
# ---------- py3_16: Python ----------
import math
import random

# Output predefiniti in caso di mancato avvio
ClusterIDs = []
Centroids = ["Imposta 'Run' su True e collega tutti gli input per calcolare i cluster."]

if Run and Areas and Props and Verts and Geoms and K:
    # 1. STRUTTURAZIONE DEL DATASET
    # Uniamo le 4 feature in un'unica matrice di dati
    raw_data = []
    for i in range(len(Areas)):
        raw_data.append([Areas[i], Props[i], Verts[i], Geoms[i]])
    
    num_features = 4
    num_samples = len(raw_data)
    
    # 2. NORMALIZZAZIONE (Min-Max Scaling)
    # Evita che il conteggio delle geometrie (es. 50) schiacci l'area (es. 3.5)
    min_vals = [min(f) for f in zip(*raw_data)]
    max_vals = [max(f) for f in zip(*raw_data)]
    
    norm_data = []
    for row in raw_data:
        norm_row = []
        for j in range(num_features):
            denom = max_vals[j] - min_vals[j]
            norm_row.append((row[j] - min_vals[j]) / denom if denom != 0 else 0.0)
        norm_data.append(norm_row)
        
    # 3. ALGORITMO K-MEANS
    random.seed(42)  # Seed fisso per rendere i risultati ripetibili
    
    # Inizializzazione dei centroidi prendendo K campioni casuali dal dataset
    centroids = random.sample(norm_data, min(K, num_samples))
    
    max_iters = 100
    cluster_assignments = [0] * num_samples
    
    for iteration in range(max_iters):
        changed = False
        
        # Fase di Assegnazione
        for i, point in enumerate(norm_data):
            min_dist = float('inf')
            best_cluster = 0
            
            for c_idx, centroid in enumerate(centroids):
                # Distanza Euclidea nello spazio a 4 dimensioni
                dist = math.sqrt(sum((p - c) ** 2 for p, c in zip(point, centroid)))
                if dist < min_dist:
                    min_dist = dist
                    best_cluster = c_idx
                    
            if cluster_assignments[i] != best_cluster:
                cluster_assignments[i] = best_cluster
                changed = True
                
        # Se nessun punto cambia cluster, l'algoritmo è convergente e si ferma
        if not changed:
            break
            
        # Fase di Aggiornamento dei Centroidi
        new_centroids = [[0.0] * num_features for _ in range(K)]
        counts = [0] * K
        
        for i, c_idx in enumerate(cluster_assignments):
            for j in range(num_features):
                new_centroids[c_idx][j] += norm_data[i][j]
            counts[c_idx] += 1
            
        for c_idx in range(K):
            if counts[c_idx] > 0:
                centroids[c_idx] = [new_centroids[c_idx][j] / counts[c_idx] for j in range(num_features)]
            else:
                # Se un cluster si svuota, lo riposizioniamo su un punto casuale
                centroids[c_idx] = random.choice(norm_data)
                
    # 4. DE-NORMALIZZAZIONE DEI CENTROIDI (Per lettura umana)
    denorm_centroids = []
    for c in centroids:
        denorm_row = []
        for j in range(num_features):
            real_val = c[j] * (max_vals[j] - min_vals[j]) + min_vals[j]
            denorm_row.append(round(real_val, 2))
        denorm_centroids.append(denorm_row)
        
    # Formattazione dell'output dei centroidi per il Pannello di Grasshopper
    centroids_info = []
    for idx, c in enumerate(denorm_centroids):
        info = f"Cluster {idx} -> Area: {c[0]} | Prop X/Y: {c[1]} | Vertici: {int(c[2])} | Geometrie: {round(c[3],1)}"
        centroids_info.append(info)
        
    # Assegnazione agli output di Grasshopper
    ClusterIDs = cluster_assignments
    Centroids = centroids_info
# ---------- end py3_16 ----------
py3_17 = Python3Script(
    Areas=areas_3,
    BB_short_dim=bb_short_dim_3,
    BB_long_dim=bb_long_dim_3,
    Props=props_3,
    Verts=verts_3,
    Geoms=geoms_3,
    Exp_edge_count=exp_edge_count_3,
    Closed_curves=closed_curves_3,
    Run=Toggle(True))  # -> out; inputs Areas: list of Double, BB_short_dim: list, BB_long_dim: list, Props: list of Double, Verts: list of Int32, Geoms: list of Int32, Exp_edge_count: list, Closed_curves: list, Run: Boolean; same code as export_dataset_for_clsutering
py3_18 = Python3Script(Areas=areas_3, Props=props_3, Verts=verts_3, Geoms=geoms_3, Run=toggle_4)  # -> out; inputs Areas: list of Double, Props: list of Double, Verts: list of Int32, Geoms: list of Int32, Run: Boolean; disabled
# ---------- py3_18: Python ----------
import os

if Run and Areas:
    # CRITICAL: Added 'r' prefix to make it a raw string. 
    # This prevents Windows backslash escape errors (like \U, \A, \M)
    folder_path = r"C:\Users\giofo\Desktop\ARCHIVIO\MASTERS\MACAD\2_MACAD\0_MACAD DRIVE\AIA\STUDIO\FURNITURE"
    filepath = os.path.join(folder_path, "dataset_furniture.csv")
    
    # Optional safety check: create directory if it doesn't exist
    if not os.path.exists(folder_path):
        os.makedirs(folder_path)
        
    with open(filepath, "w") as f:
        f.write("Area,Prop,Verts,Geoms\n") # CSV Header
        for i in range(len(Areas)):
            f.write(f"{Areas[i]},{Props[i]},{Verts[i]},{Geoms[i]}\n")
            
    print(f"Dataset successfully saved to: {filepath}")
# ---------- end py3_18 ----------
panel_61 = Panel(py3_18)  # disabled
panel_62 = Panel(py3_16.ClusterIDs)  # disabled
panel_63 = Panel(py3_17)
panel_64 = Panel(py3_16.Centroids)  # disabled
